# Grasshopper definition TestConnection.gh (Grasshopper 1.0.7)
# Copyright: 2021
# Copyright: 2022-28-21
# Copyright: 2022-06-43
# plug-ins: MantaRay, LadybugGrasshopper, Human, HDTTreeUtils

# ----
# Connect
toggle = BooleanToggle(True)
connect_ssh = ConnectSSH(User="mss", Ip="127.0.0.1", Password="_prompt", _port=22, Connect=toggle)  # -> Status, Run
panel = Panel(connect_ssh.Status)

# ----
# you can remove last characters of a value
# 
# Here adding render instead of image
panel_2 = Panel("echo <proj>/<target-8>_render.gif")
applyglobals = ApplyGlobals(Input=panel_2, AdditionalKeys="target", AdditionalValues="myFiles/myImage.hdr")  # -> Output, Pairs
panel_3 = Panel(applyglobals.Output)

# ----
# you can combine globals and locals
panel_4 = Panel("echo <proj>/<target-.>.gif")
applyglobals_2 = ApplyGlobals(Input=panel_4, AdditionalKeys="target", AdditionalValues="myFiles/myImage.hdr")  # -> Output, Pairs
panel_5 = Panel(applyglobals_2.Output)

# ----
# Applyglobals
# try <target-.>  to remove the file ending on <target>
# 
# Here we are changing from hdr to gif
panel_6 = Panel("echo <target-.>.gif")
applyglobals_3 = ApplyGlobals(Input=panel_6, AdditionalKeys="target", AdditionalValues="myFiles/myImage.hdr")  # -> Output, Pairs
panel_7 = Panel(applyglobals_3.Output)

# ----
# Setup globals
panel_8 = Panel("""proj
projname
projfolder""")
panel_9 = Panel("""~/simulation/test_project2
test_project2
/simulation/test_project2""")
global_overrides = GlobalOverrides(Keys=panel_8, Values=panel_9)
panel_10 = Panel(global_overrides)

od_outdated = ColourSwatch(SwatchColor=RGBA(97, 97, 97, 150))
u_updated = ColourSwatch(SwatchColor=RGBA(208, 115, 230, 112))
o_outputs = ColourSwatch(SwatchColor=RGBA(160, 218, 242, 203))
toggle_2 = BooleanToggle(True)
s_settings = ColourSwatch(SwatchColor=RGBA(224, 145, 81, 154))
g_general = ColourSwatch(SwatchColor=RGBA(245, 243, 237, 156))
cc_core2 = ColourSwatch(SwatchColor=RGBA(230, 216, 186, 208))
y_yellow = ColourSwatch(SwatchColor=RGBA(247, 244, 64, 188))
i_inputs = ColourSwatch(SwatchColor=RGBA(125, 217, 98, 150))
c_core = ColourSwatch(SwatchColor=RGBA(235, 227, 206, 203))
r_red = ColourSwatch(SwatchColor=RGBA(242, 63, 63, 203))

# ----
# Test connection
testconnection = TestConnection()  # -> Status, Errors
panel_11 = Panel(testconnection.Status)
panel_12 = Panel(testconnection.Errors)

# ----
# Vertex order (and normal)
# 
# source : https://www.radiance-online.org/learning/tutorials/Tutorial-ThreePhaseMethod.pdf
image = ImageSampler(
    FilePath="C:\Users\mm1013\Desktop\window normals.png",
    Filter="Colour",
    Interpolate=True,
    Umax=1,
    Umin=0,
    Vmax=1,
    Vmin=0,
    Wrap=1)  # disabled

# ----
# processes to kill
panel_13 = Panel("""dctimestep
rcontrib
rtrace
oconv
rvu
rmtxop""")
kill = LBFalseStartToggle(False)

# ----
# Kill processes running on linux
panel_14 = Panel("pkill -f <instance>")
overrides = ApplyOverrides(Input_=panel_14, Instance=graft(panel_13))  # -> flatten(Output), Pairs
join = TextJoin(Text=overrides.Output, Join=";")
execute_ssh_async = ExecuteSSHAsync(
    SSHCommands=join,
    Run=kill,
    addPrefix=False,
    addSuffix=False,
    description="pkill -f dctimestep;pkill -f rcontrib;pkill -f rtrace;pkill -f oconv;pkill -f rvu;pkill -f rmtxop",
    fireLogs=False,
    suppressWarnings=False)  # -> Stdout, Stderr_, Log, Pid, Ran
panel_15 = Panel(execute_ssh_async.Stderr_)

colorgroups = CSharpScript(
    Colors=[i_inputs, s_settings, g_general, c_core, o_outputs, r_red, y_yellow, u_updated, od_outdated, cc_core2],
    Enable=toggle_2,
    Rename=Toggle(False),
    RunOnce=Button(),
    Debug=Toggle(False))  # -> out; inputs Colors: list of Color, Enable: Boolean, Rename: Boolean, RunOnce: Boolean, Debug: Boolean
# ---------- colorgroups: C# usings ----------
using System.Linq;
using System.Text;
using System.Reflection;
# ---------- colorgroups: C# ----------
    msg.Clear();


    this.Component.Message = "id: " + id.ToString();

    _debug = Debug; //Set to true to have all events printed in rhino log
    _rename = Rename;

    if (Enable)
    {
      msg.AppendFormat("Set up events on ID {0}\n", id);
      SetupDict(); // Create a dictionary of the input swatches
      SetEventHandlers(); // This would do the job.


    }
    else
    {
      RemoveEventHandlers();
    }
    if (RunOnce)
    {
      foreach(Grasshopper.Kernel.Special.GH_Group grp in Grasshopper.Instances.ActiveCanvas.Document.Objects.OfType<Grasshopper.Kernel.Special.GH_Group>())
      {
        ColorGroup(grp, null); // You decide if it should run once on all existing groups

      }
    }

    Print(msg.ToString());


    // Component setup
    Component.Description = "Set up event handlers to color groups based on prefixes such as 'in_' and 'out_'.\n"
      + "Please insert only swatcheds directly into the Colors input\n\n"
      + "MIT License. Copyright Mathias Sønderskov Schaltz 2022";
    Component.Params.Input[0].Description = "Please insert only swatcheds directly into the Colors input.\nRemember to rename them";
    Component.Params.Input[1].Description = "Toggle to run...";
    Component.Params.Input[2].Description = "Set to true if you want to automatically rename the groups and remove prefix. Default is false.";
    Component.Params.Input[3].Description = "Set to true to run it once and color all existing groups.";
    Component.Params.Input[Component.Params.Input.Count - 1].Description = "Set debug to true to get all the events printed in the rhino log";
# ---------- colorgroups: C# additional code ----------
  public static Random rnd = new Random();
  public int id = rnd.Next(0, 1000);
  StringBuilder msg = new StringBuilder();
  Dictionary<string, System.Drawing.Color> colorDict = new Dictionary<string, System.Drawing.Color>();

  bool _debug = false;
  bool _rename = false;

  public bool IdExists(int id)
  {
    IList<IGH_DocumentObject> objs = Grasshopper.Instances.ActiveCanvas.Document.Objects;
    return objs
      .OfType<IGH_Component>()
      .Where(ob => ob.NickName == this.Component.NickName)
      .Where(ob => ob.GetType().ToString() == "ScriptComponents.Component_CSNET_Script")
      .Where(ob => ob.Message == "id: " + id.ToString()).Any();

  }


  public void SetupDict()
  {
    colorDict.Clear();
    // Get all inputs to "Colors"
    IList<IGH_Param> colorSources = this.Component.Params.Input[0].Sources;
    if (colorSources.Count == 0)
    {
      throw new Exception("You forgot to setup the colors. Please input swatch components and rename them");
    }
    foreach(IGH_Param source in colorSources)
    {
      //if (source.Type.ToString() == "Grasshopper.Kernel.Types.GH_Colour")
      if (source is Grasshopper.Kernel.Special.GH_ColourSwatch)
      {
        string nickName = source.NickName.Split('_')[0].Trim() + "_";
        if(!colorDict.ContainsKey(nickName))
        {
          Grasshopper.Kernel.Special.GH_ColourSwatch swatch = (Grasshopper.Kernel.Special.GH_ColourSwatch) source;
          colorDict.Add(nickName, swatch.SwatchColour);
        }
        else
        {
          throw new Exception("Multiple swatches using the same name detected. Please rename");
        }
      }
      else
      {
        throw new Exception("Whacko! Why did you input a non-swatch into the Colors? " + source.Type.ToString());
      }

    }

    msg.AppendFormat("Set up the dictionaries with {0} colors\n", colorDict.Count);
    foreach(var pairs in colorDict)
    {
      msg.AppendFormat("{0} -> {1}\n", ("\"" + pairs.Key + "\"").PadRight(5 + colorDict.Keys.Select(k => k.Length).Max()), pairs.Value);
    }
  }

  public void SetEventHandlers()
  {

    // Always remove events first to avoid duplicates
    GrasshopperDocument.ObjectsAdded -= OnObjectsAdded;
    GrasshopperDocument.ObjectsDeleted -= OnObjectsRemoved;
    GrasshopperDocument.ObjectsDeleted -= OnDeleteThisComponent;

    // Attach events
    GrasshopperDocument.ObjectsAdded += OnObjectsAdded;
    GrasshopperDocument.ObjectsDeleted += OnObjectsRemoved;
    GrasshopperDocument.ObjectsDeleted += OnDeleteThisComponent;


    foreach(Grasshopper.Kernel.Special.GH_Group grp in GrasshopperDocument.Objects.OfType<Grasshopper.Kernel.Special.GH_Group>())
    {
      grp.ObjectChanged -= ColorGroup;
      grp.ObjectChanged += ColorGroup;

      //ColorGroup(grp, null); // Make sure to run it once
    }
    msg.AppendFormat("Added the eventhandlers on {0} existing groups and on future created groups\n", GrasshopperDocument.Objects.OfType<Grasshopper.Kernel.Special.GH_Group>().Count());
  }

  public void OnObjectsAdded(object sender, GH_DocObjectEventArgs e)
  {
    bool any = false;
    foreach (Grasshopper.Kernel.Special.GH_Group grp in e.Objects.OfType<Grasshopper.Kernel.Special.GH_Group>())
    {
      grp.ObjectChanged -= ColorGroup;
      grp.ObjectChanged += ColorGroup;
      any = true;
    }

    DebugWrite(any ? "Group Objects Added: Attaching Events to ObjectChanged" : "Objects Added - but no groups");
  }

  //Same but reversed
  public void OnObjectsRemoved(object sender, GH_DocObjectEventArgs e)
  {
    bool any = false;
    foreach (Grasshopper.Kernel.Special.GH_Group grp in e.Objects.OfType<Grasshopper.Kernel.Special.GH_Group>())
    {
      grp.ObjectChanged -= ColorGroup;
      any = true;
    }

    DebugWrite(any ? "Group Objects Removed, removing event" : "Objects Removed - although not a group");

  }



  public void RemoveEventHandlers()
  {
    GrasshopperDocument.ObjectsAdded -= OnObjectsAdded;
    GrasshopperDocument.ObjectsDeleted -= OnObjectsRemoved;


    foreach(Grasshopper.Kernel.Special.GH_Group grp in GrasshopperDocument.Objects.OfType<Grasshopper.Kernel.Special.GH_Group>())
    {
      grp.ObjectChanged -= ColorGroup;

    }
    msg.AppendFormat("Removed event handlers on document and on {0} groups\n", GrasshopperDocument.Objects.OfType<Grasshopper.Kernel.Special.GH_Group>().Count());

  }

  public void ColorGroup(object sender, EventArgs e)
  {
    if (!IdExists(id))
    {
      DebugWrite("Component not relevant. Disabling old id + " + id.ToString());
      RemoveEventHandlers();
      return;
    }

    Grasshopper.Kernel.Special.GH_Group grp = sender as Grasshopper.Kernel.Special.GH_Group;
    if (grp == null) return; //not type GH_Group
    //if (!grp.NickName.EndsWith("_")) return;

    string[] nameParts = grp.NickName.Split('_');
    if (nameParts.Length <= 1)
      return;
    string prefix = grp.NickName.Split('_')[0].Trim() + '_';

    string prefixes = String.Join(", ", colorDict.Keys.Select(k => "\"" + k + "\""));

    msg.Append("prefix " + prefix + "\n");
    if (colorDict.ContainsKey(prefix))
    {
      //if (grp.NickName.EndsWith("_"))
      grp.Colour = colorDict[prefix];
      if (_rename)
      {
        grp.NickName = grp.NickName.Replace(prefix, "");
      }

      DebugWrite("Colored " + grp.NickName);

    }
    else
    {
      DebugWrite("Group changed but not relevant: prefix " + prefix + " is not among " + prefixes);
    }

  }
  public void DebugWrite(string msg)
  {
    if (_debug)
    {
      Rhino.RhinoApp.WriteLine(String.Format("[ColGrps {0}]: {1}", id, msg));
    }
  }

  public void OnDeleteThisComponent(object sender, GH_DocObjectEventArgs e)
  {

    if (e.Objects.OfType<Grasshopper.Kernel.GH_Component>().Where(o => o.NickName == this.Component.NickName).Any())
    {
      DebugWrite("Removed template component. Removing all the eventhandlers");
      RemoveEventHandlers();
    }

  }
# ---------- end colorgroups ----------

fixparams = CSharpScript(FixOnce=Button(), Enable=toggle_2, Debug=Toggle(False))  # -> out; inputs FixOnce: Boolean, Enable: Boolean, Debug: Boolean
# ---------- fixparams: C# usings ----------
using System.Text;
using System.Linq;
using Grasshopper.Kernel.Special;
# ---------- fixparams: C# ----------
    _debug = Debug;
    _enable = Enable;
    msg.Clear();
    this.Component.Message = "id: " + id.ToString();




    if (Enable)
    {
      SetEventHandlers();
    }
    else
    {
      RemoveEventHandlers();
    }


    if (FixOnce)
    {
      FixAll();
    }

    Print(msg.ToString());

    // Component setup
    Component.Description = "Set up event handlers to change params to show nickname and not icon"
      + "\n\n"
      + "MIT License. Copyright Mathias Sønderskov Schaltz 2022";
    Component.Params.Input[0].Description = "Run me once on the document";
    Component.Params.Input[1].Description = "Toggle to enable event listener";
    Component.Params.Input[Component.Params.Input.Count - 1].Description = "Set debug to true to get all the events printed in the rhino log";
# ---------- fixparams: C# additional code ----------
  public static Random rnd = new Random();
  public int id = rnd.Next(0, 1000);
  StringBuilder msg = new StringBuilder();
  bool _debug = false;
  bool _enable = false;

  public Dictionary<IGH_ActiveObject, HashSet<GH_Group>> groupsPerObject = new Dictionary<IGH_ActiveObject, HashSet<GH_Group>>();


  public void OnObjectsAdded(object sender, GH_DocObjectEventArgs e)
  {
    if (!IdExists(id))
    {
      DebugWrite("[FixParam] Component not relevant. Disabling old id " + id.ToString());
      RemoveEventHandlers();
      return;
    }


    if(_enable)
    {
      foreach(IGH_Param par in e.Objects.OfType<IGH_Param>())
      {
        FixInputs(par);
      }
    }


  }

  public void FixAll()
  {
    //DebugWrite("Fixing all?");
    foreach(IGH_Param par in GrasshopperDocument.Objects.OfType<IGH_Param>())
    {

      FixInputs(par);
    }
  }




  public void FixInputs(IGH_ActiveObject obj)
  {



    IGH_Param par = obj as IGH_Param;
    if (par != null)
    {

      par.IconDisplayMode = GH_IconDisplayMode.name;


    }

  }


  public void SetEventHandlers()
  {

    GrasshopperDocument.ObjectsAdded -= OnObjectsAdded;
    GrasshopperDocument.ObjectsAdded += OnObjectsAdded;
    GrasshopperDocument.ObjectsDeleted -= OnDeleteThisComponent;
    GrasshopperDocument.ObjectsDeleted += OnDeleteThisComponent;
    msg.AppendFormat("Added the eventhandlers to OnObjectsAdded\n", GrasshopperDocument.Objects.OfType<Grasshopper.Kernel.Special.GH_Group>().Count());
  }

  public void RemoveEventHandlers()
  {
    GrasshopperDocument.ObjectsAdded -= OnObjectsAdded;
    GrasshopperDocument.ObjectsDeleted -= OnDeleteThisComponent;

    msg.AppendFormat("Removed wire event handlers on document\n", GrasshopperDocument.Objects.OfType<Grasshopper.Kernel.Special.GH_Group>().Count());

  }

  public void OnDeleteThisComponent(object sender, GH_DocObjectEventArgs e)
  {

    if (e.Objects.OfType<Grasshopper.Kernel.GH_Component>().Where(o => o.NickName == this.Component.NickName).Any())
    {
      DebugWrite("Removed template component. Removing all the eventhandlers");
      RemoveEventHandlers();
    }

  }

  public bool IdExists(int id)
  {
    IList<IGH_DocumentObject> objs = Grasshopper.Instances.ActiveCanvas.Document.Objects;
    return objs
      .OfType<IGH_Component>()
      .Where(ob => ob.NickName == this.Component.NickName)
      .Where(ob => ob.GetType().ToString() == "ScriptComponents.Component_CSNET_Script")
      .Where(ob => ob.Message == "id: " + id.ToString()).Any();

  }

  public void DebugWrite(string msg)
  {
    if (_debug)
    {
      Rhino.RhinoApp.WriteLine(String.Format("[FixParams {0}]: {1}", id, msg));
    }
  }
# ---------- end fixparams ----------

fixwires = CSharpScript(FixOnce=Button(), Enable=toggle_2, Debug=Toggle(False))  # -> out; inputs FixOnce: Boolean, Enable: Boolean, Debug: Boolean
# ---------- fixwires: C# ----------
    _debug = Debug;
    _enable = Enable;
    msg.Clear();
    this.Component.Message = "id: " + id.ToString();


    SetDictionary();

    if (Enable)
    {
      SetEventHandlers();
    }
    else
    {
      RemoveEventHandlers();
    }


    if (FixOnce)
    {
      FixAll();
    }

    Print(msg.ToString());
    
    // Component setup
    Component.Description = "Set up event handlers to change all wire types across groups to faint"
      + "\n\n"
      + "MIT License. Copyright Mathias Sønderskov Schaltz 2022";
    Component.Params.Input[0].Description = "Run me once on the document";
    Component.Params.Input[1].Description = "Toggle to enable event listener";
    Component.Params.Input[Component.Params.Input.Count - 1].Description = "Set debug to true to get all the events printed in the rhino log";
# ---------- fixwires: C# additional code ----------
  public static Random rnd = new Random();
  public int id = rnd.Next(0, 1000);
  StringBuilder msg = new StringBuilder();
  bool _debug = false;
  bool _enable = false;

  public Dictionary<IGH_ActiveObject, HashSet<GH_Group>> groupsPerObject = new Dictionary<IGH_ActiveObject, HashSet<GH_Group>>();


  public void OnSolutionExpired(object sender, GH_DocUndoEventArgs e)
  {
    if(_enable)
      FixAll();
  }

  public void FixAll()
  {
    //DebugWrite("Fixing all?");
    foreach(IGH_ActiveObject key in groupsPerObject.Keys.Where(k => groupsPerObject[k].Count() > 0))
    {

      FixInputs(key);
    }
  }



  public bool HasGroup(IGH_ActiveObject obj)
  {
    return groupsPerObject[obj].Count > 0;
  }


  public void FixInputs(IGH_ActiveObject obj)
  {

    if (!IdExists(id))
    {
      DebugWrite("Component not relevant. Disabling old id " + id.ToString());
      RemoveEventHandlers();
      return;
    }

    //List<List<IGH_ActiveObject>> parents = new List<List<IGH_ActiveObject>>();
    IGH_Param par = obj as IGH_Param;
    if (par != null && par.Sources != null)
    {


      IEnumerable<IGH_ActiveObject> p = par.Sources.Select(s => s.Attributes.GetTopLevel.DocObject as IGH_ActiveObject);
      //parents.Add(p);
      if(HasGroup(obj) && p.All(o => !HasGroupsInCommon(o, obj)) && par.WireDisplay != GH_ParamWireDisplay.faint)
      {
        DebugWrite("Fixing " + par.Attributes.GetTopLevel.DocObject.NickName);
        par.WireDisplay = GH_ParamWireDisplay.faint;
      }

    }

    IGH_Component comp = obj as IGH_Component;
    if (comp != null)
    {
      foreach(IGH_Param inp in comp.Params.Input)
      {

        IEnumerable<IGH_ActiveObject> p = inp.Sources.Select(i => i.Attributes.GetTopLevel.DocObject as IGH_ActiveObject);

        if(HasGroup(obj) && p.All(o => !HasGroupsInCommon(o, obj)) && inp.WireDisplay != GH_ParamWireDisplay.faint)
        {
          DebugWrite("Fixing " + inp.Attributes.GetTopLevel.DocObject.NickName);
          inp.WireDisplay = GH_ParamWireDisplay.faint;
        }
      }

    }



  }





  public void SetDictionary()
  {
    IList<IGH_DocumentObject> objects = Grasshopper.Instances.ActiveCanvas.Document.Objects.ToList();
    //Print(String.Join(", ", objects.Select(o => o.NickName)));

    groupsPerObject = objects
      .Where(o => o.GetType() != typeof(GH_Group))
      .OfType<IGH_ActiveObject>()
      .ToDictionary(o => o, o => new HashSet<GH_Group>());

    foreach(GH_Group grp in objects.OfType<GH_Group>())
    {

      foreach(IGH_ActiveObject obj in grp.ObjectsRecursive().OfType<IGH_ActiveObject>())
      {
        groupsPerObject[obj].Add(grp);

      }
    }



  }

  public bool HasGroupsInCommon(IGH_ActiveObject obj1, IGH_ActiveObject obj2)
  {
    HashSet<GH_Group> set1 = groupsPerObject[obj1];
    HashSet<GH_Group> set2 = groupsPerObject[obj2];

    set1.IntersectWith(set2);

    return set1.Any();
  }

  public void SetEventHandlers()
  {

    GrasshopperDocument.UndoStateChanged -= OnSolutionExpired;
    GrasshopperDocument.UndoStateChanged += OnSolutionExpired;
    GrasshopperDocument.ObjectsDeleted -= OnDeleteThisComponent;
    GrasshopperDocument.ObjectsDeleted += OnDeleteThisComponent;
    msg.AppendFormat("Added the eventhandlers to UndoStateChanged\n", GrasshopperDocument.Objects.OfType<Grasshopper.Kernel.Special.GH_Group>().Count());
  }

  public void RemoveEventHandlers()
  {
    GrasshopperDocument.UndoStateChanged -= OnSolutionExpired;
    GrasshopperDocument.ObjectsDeleted -= OnDeleteThisComponent;

    msg.AppendFormat("Removed wire event handlers on document\n", GrasshopperDocument.Objects.OfType<Grasshopper.Kernel.Special.GH_Group>().Count());

  }

  public void OnDeleteThisComponent(object sender, GH_DocObjectEventArgs e)
  {

    if (e.Objects.OfType<Grasshopper.Kernel.GH_Component>().Where(o => o.NickName == this.Component.NickName).Any())
    {
      DebugWrite("Removed template component. Removing all the eventhandlers");
      RemoveEventHandlers();
    }

  }

  public bool IdExists(int id)
  {
    IList<IGH_DocumentObject> objs = Grasshopper.Instances.ActiveCanvas.Document.Objects;
    return objs
      .OfType<IGH_Component>()
      .Where(ob => ob.NickName == this.Component.NickName)
      .Where(ob => ob.GetType().ToString() == "ScriptComponents.Component_CSNET_Script")
      .Where(ob => ob.Message == "id: " + id.ToString()).Any();

  }

  public void DebugWrite(string msg)
  {
    if (_debug)
    {
      Rhino.RhinoApp.WriteLine(String.Format("[FixWire {0}]: {1}", id, msg));
    }
  }
# ---------- end fixwires ----------

# ----
# FILE NAMES: *.vmx - view matrix (data)
# *.hdr - view matrix (renderings)
# *.dmx - daylight matrix
# *.skv - sky vector
# *.smx – sky matrix
# *.xml - transmission matrix (the file is xml format)
# 
# *.rad - radiance scene data
# *.oct - octree file
# *.vf - view file
# *.dat - data
# 
# source : https://www.radiance-online.org/learning/tutorials/Tutorial-ThreePhaseMethod.pdf
nickname = GH_TestComponentColor(Color=ColourSwatch(SwatchColor=RGB(97, 97, 97)), SelColor=ColourSwatch(SwatchColor=RGB(59, 59, 59)))

# ----
# Template methods
# By Mathias Sønderskov Schaltz 2022
# Check for updates here https://github.com/Sonderwoods/GrasshopperScribbles
panel_16 = Panel(fixwires)
panel_17 = Panel(fixparams)
# Read more
# 
# 
# Ambient cache
# https://discourse.radiance-online.org/t/what-data-does-ambfile-store/4785/2
panel_18 = Panel(colorgroups)

panel_19 = Panel("""export PATH=$PATH.:/usr/local/radiance/bin
export RAYPATH=.:/usr/local/radiance/lib
objview <glowmat> ~/simulation/<name>.rad | meta2tga -x 1048 -y 1048 | ra_t8 -r > ~/simulation/<name>.hdr
normtiff ~/simulation/<name>.hdr ~/simulation/<name>.tif
convert ~/simulation/<name>.tif ~/simulation/<name>.png
echo "C:\Users\mm1013\simulation\<name>.png"
""")

panel_20 = Panel("""Mesh
Polysurface
Surface
Extrusion""")

panel_21 = Panel("""echo $PATH
genbox""")  # disabled
falsestart = LBFalseStartToggle(False)  # disabled
execute_ssh_async_2 = ExecuteSSHAsync(SSHCommands=panel_21, Run=falsestart, addPrefix=True, addSuffix=True, fireLogs=False, suppressWarnings=False)  # -> Stdout, Stderr, Log, Pid, Ran; disabled
panel_22 = Panel(execute_ssh_async_2.Stderr)  # disabled
panel_23 = Panel(execute_ssh_async_2.Stdout)  # disabled

mesh = Mesh([<mesh referenced from the Rhino model> x2])

# ----
# importing from rhino layers
dpipeline = DynamicGeometryPipeline(
    LayerFilter="Daylight_Inputs::*",
    TypeFilter=panel_20,
    NameFilter="*",
    GroupByLayer=False,
    GroupByType=False,
    IncludeHidden=True,
    IncludeLocked=True,
    enableFullPath=True,
    listenToAttributes=True)
dam = DataDam(DataA=dpipeline, BufferDelay=10000000, BufferMode=0)
objatts = ObjectAttributes(ObjectOrAttributes=dam)  # -> Name, LayerName, LayerFullPath, Color, MaterialName, LinetypeName, GroupIndices, PlotWeight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
cset = CreateSet(List=objatts.LayerName)  # -> Set, Map
assign_paths = AssignPaths(InputData=flatten(dam), PathsToAssign=flatten(cset.Map))
python = GhPythonScript(layer_name=graft(cset.Set))  # -> is_opaque, is_transparent, is_grid, is_HB_Room, is_HB_Window
# ---------- python: Python ----------
__author__ = "mm1013"
__version__ = "2022.01.16"

import rhinoscriptsyntax as rs

is_grid = layer_name == "Grids"

if layer_name.startswith("HB_"):
    is_opaque = is_transparent = is_grid = False
    
    is_HB_Window = layer_name.endswith("%")
    is_HB_Room = layer_name == "HB_Rooms"
    
    
else:
    if is_grid:
        is_opaque = False
        is_transparent = False
    else:
        is_transparent = layer_name.endswith("%")
        if is_transparent:
            transmittance = layer_name.split("_")[-1].replace("%","")
        is_opaque = not is_transparent
# ---------- end python ----------
layer_name = Text(cset.Set)
geo = Geometry(assign_paths)

facen = FaceNormals(Mesh=mesh)  # -> Centers, Normals
demesh = DeconstructMesh(Mesh=mesh)  # -> Vertices, Faces, Colours, Normals
# Log of latest(10) SSH Commands
logviewer = LogViewer(Number=10)  # -> CurrentTasks, Logs
panel_24 = Panel("""up_clock3
up_ccw3""")
panel_25 = Panel("""glowmat
glowmat""")
points = PointList(Points=demesh.Vertices, Size="50")
vdis = VectorDisplay(Anchor=facen.Centers, Vector=expr("x*500", facen.Normals))
panel_26 = Panel("""echo "void glow glowmat
0
0
4 12 12 12 1000" > <target>;echo <target>""")
falsestart_2 = LBFalseStartToggle(False)
panel_27 = Panel(logviewer.CurrentTasks)
mesh2obj = MeshToObj(Mesh=graft(mesh), Name=graft(panel_24), ModifierName=graft(panel_25), Run=falsestart_2)  # -> ObjFiles, MapFile, Run
panel_28 = Panel("""echo <filename>
echo <filename-.>.png""")
overrides_2 = ApplyOverrides(Input=panel_26, AdditionalKeys="target", AdditionalValues="~/simulation/testglow.rad")  # -> Output, Pairs
execute_ssh_async_3 = ExecuteSSHAsync(
    _SSHCommands_=overrides_2.Output,
    Run=falsestart_2,
    addPrefix=True,
    addSuffix=True,
    fireLogs=False,
    suppressWarnings=False)  # -> Stdout, Stderr_, Log, Pid, Ran
overrides_3 = ApplyOverrides(Input=panel_19, AdditionalKeys="glowmat", AdditionalValues=execute_ssh_async_3.Stdout)  # -> Output, Pairs
overrides_4 = ApplyOverrides(Input=overrides_3.Output, AdditionalKeys="name", AdditionalValues=graft(panel_24))  # -> Output, Pairs
panel_29 = Panel("echo hi")
panel_30 = Panel(overrides_4.Output)

# ----
# 5 phase bash script from andy mcneil
panel_31 = Panel("""#!/bin/bash

procs=4

### First let me download and unpacking Axel\'s files for rtcontrib lesson

printf "\nDownloading Axels rtcontrib lesson files...\n"
curl -O http://www.jaloxa.eu/resources/radiance/documentation/docs/rtcontrib_lesson.tgz
tar -xf rtcontrib_lesson.tgz
mv rtcontrib_lesson 5p_tutorial_examples

cd 5p_tutorial_examples

mkdir bsdf hourlypics hourlypics_dir hourlypics_ds hourlyresult \
	matrices octs viewpics viewpics_dir viewpics_ds
	
### Let me download the weather data file for you
printf "\nDownloading weather data...\n"
curl -O http://apps1.eere.energy.gov/buildings/energyplus/weatherdata/4_north_and_central_america_wmo_region_4/1_usa/USA_CA_Oakland.Intl.AP.724930_TMY3.zip
tar -xf USA_CA_Oakland.Intl.AP.724930_TMY3.zip
rm USA_CA_Oakland.Intl.AP.724930_TMY3.ddy 
rm USA_CA_Oakland.Intl.AP.724930_TMY3.stat
rm USA_CA_Oakland.Intl.AP.724930_TMY3.zip 
mv USA_CA_Oakland.Intl.AP.724930_TMY3.epw skies/.

# grabbing reinsrc.cal from CVS
printf "\nDownloading reinsrc.cal...\n"
curl -O http://radiance-online.org/cgi-bin/viewcvs.cgi/ray/src/cal/cal/reinsrc.cal

### Section 6.1 - Model adjustments for five-phase simulation
printf "\nMaking model adjustments...\n"
cat <<EOF > objects/testroom_Swall.rad
!genbox wall_mat wall_s_bottom 4 .3 1 |xform -t 0 -.3 0
!genbox wall_mat wall_s_top 4 .3 .5 |xform -t 0 -.3 2
!genbox wall_mat wall_s_west .5 .3 1 |xform -t 0 -.3 1
!genbox wall_mat wall_s_west .5 .3 1 |xform -t 3.5 -.3 1
EOF

cat <<EOF > objects/testroom.rad
!genbox floor_mat floor 4.6 6.6 .3 |xform -t -.3 -.3 -.3
!genbox ceiling_mat ceiling 4.6 6.6 .3 |xform -t -.3 -.3 2.5

!genbox wall_mat wall_w .3 6.6 2.5 |xform -t -.3 -.3 0
!genbox wall_mat wall_e .3 6.6 2.5 |xform -t 4 -.3 0
!genbox wall_mat wall_n 4 .3 2.5 |xform -t 0 6 0
EOF

cat <<EOF > objects/glazing.rad
void glass glazing
0
0
3 0.73 0.73 0.73

glazing polygon glass
0
0
12    0.5  -0.25   1
        0.5  -0.25   2
        3.5  -0.25   2
        3.5  -0.25   1
EOF

cat <<EOF > objects/venetianblind.rad
void plastic blindslat
0
0
5 .65 .65 .65 .01 0 

!genblinds blindslat blinds .05 3 1 25 0 +r .15 | xform -rz -90 -t 0.5 -.15 1 
EOF

cat <<EOF > objects/viewmtxsurf.rad
void glow viewsurf
0
0
4 1 1 1 0

viewsurf polygon inside
0
0
12    0.5   0   1
        0.5   0   2
        3.5   0   2
        3.5   0   1
EOF

cat <<EOF > objects/daymtxsurf.rad
void plastic daymtxsurf
0
0
5 0 0 0 0 0

daymtxsurf polygon outside
0
0
12    0.5   -0.3   1
        0.5   -0.3   2
        3.5   -0.3   2
        3.5   -0.3  1
EOF

cat <<EOF > objects/glazing_bsdf.rad
void BSDF BSDFproxy
6 0.30 bsdf/fullwindow_t45.xml 0 0 1 .
0
0

BSDFproxy polygon inside
0
0
12    0.5   0   1
        0.5   0   2
        3.5   0   2
        3.5   0   1
EOF

cat <<EOF >> materials/testroom.mat
void plastic black
0
0
5 0 0 0 0 0
EOF


### Section 6.2 - Creating BSDFs
xform -rz 180 -rx -90 -t 4 0 0 objects/glazing.rad objects/venetianblind.rad materials/testroom.mat \
	objects/testroom_Swall.rad > bsdf/fullwindow.rad

### I am going to save you the trouble of generating the High-Res BSDF
#genBSDF -n $procs +f +b -geom meter -dim 0.5 3.5 1 2 -.3 0 -t4 5 \
#	bsdf/fullwindow.rad > bsdf/fullwindow_t45.xml
printf "\nDownloading tensor tree BSDF...\n"
curl -o bsdf/fullwindow_t45.xml http://www.radiance-online.org/learning/tutorials/fivephasetutorialfiles/fullwindow_t45.xml

### I will also save you the trouble with the low-res BSDF
#bsdf2klems bsdf/fullwindow_t45.xml > bsdf/fullwindow_klems.xml
#genBSDF -n $procs +f +b -geom meter -dim 0.5 3.5 1 2 -.3 0 \
#	bsdf/fullwindow.rad > bsdf/fullwindow_klems.xml
printf "\nDownloading klems BSDF...\n"
curl -o bsdf/fullwindow.xml http://www.radiance-online.org/learning/tutorials/fivephasetutorialfiles/fullwindow.xml


### Section 6.3 - View matrix (V)
printf "\nDoing 5-phase simulation for sensor points...\n"
oconv materials/testroom.mat objects/daymtxsurf.rad objects/ground.rad objects/testroom.rad \
	objects/testroom_Swall.rad objects/viewmtxsurf.rad skies/sky_white.rad \
	objects/viewmtxsurf.rad objects/daymtxsurf.rad > octs/model_3ph.oct
printf "\nView Matrix\n"
time rcontrib < data/photocells.pts -n $procs -f klems_int.cal -b kbinS -bn Nkbins -m viewsurf \
	-I+ -ab 10 -ad 65536 -lw 1.52e-5 octs/model_3ph.oct > matrices/viewmatrix.vmx


### Section 6.4 - Direct view matrix (Vd)
printf "\nDirect View Matrix\n"
time rcontrib < data/photocells.pts -n $procs -f klems_int.cal -b kbinS -bn Nkbins -m viewsurf \
	-I+ -ab 1 -ad 65536 -lw 1.52e-5 octs/model_3ph.oct > matrices/viewmatrix_direct.vmx

### Section 6.5 - Daylight matrix (D)
printf "\nDaylight Matrix\n"
time genklemsamp -c 1000 -vd 0 -1 0 objects/daymtxsurf.rad | \
	rcontrib -n $procs -c 1000 -ab 2 -ad 1024 -e MF:1 -f reinhart.cal -b rbin -bn Nrbins \
		-m sky_glow octs/model_3ph.oct > matrices/daylightmatrix.dmx

### Section 6.6 - Direct daylight matrix (Dd)
printf "\nDirect Daylight Matrix\n"
xform -m black objects/testroom_Swall.rad objects/testroom.rad objects/ground.rad \
	objects/venetianblind.rad | oconv materials/testroom.mat - objects/viewmtxsurf.rad \
	objects/daymtxsurf.rad skies/sky_white.rad > octs/model_allblack.oct

time genklemsamp -c 1000 -vd 0 -1 0 objects/daymtxsurf.rad | \
	rcontrib -n $procs -c 1000 -ab 0 -e MF:1 -f reinhart.cal -b rbin -bn Nrbins \
		-m sky_glow octs/model_allblack.oct > matrices/daylightmatrix_direct.dmx

### Section 6.7 - Direct sun coefficient matrix (Cds)
printf "\nDirect Sun Coefficient Matrix\n"
echo void light solar 0 0 3 1e6 1e6 1e6 > skies/suns.rad
cnt 5185  |  rcalc -e MF:6 -f reinsrc.cal -e Rbin=recno \
	-o 'solar source sun 0 0 4 ${ Dx } ${ Dy } ${ Dz } 0.533' >> skies/suns.rad

xform -m black objects/testroom_Swall.rad objects/testroom.rad objects/ground.rad \
	| oconv materials/testroom.mat - objects/glazing.rad objects/venetianblind.rad \
		objects/glazing_bsdf.rad skies/suns.rad > octs/model_suns.oct

time rcontrib < data/photocells.pts -n $procs -I -ab 1 -ad 65536 -lw 1.52e-5 -dc 1 -dt 0 -dj 0 -st 1 -ss 0 -faf  \
	-e MF:6 -f reinhart.cal -b rbin -bn Nrbins -m solar \
	octs/model_suns.oct > matrices/directsun.dsmx

### Section 6.8 - Putting it all together
printf "\nCombining it all\n"
epw2wea skies/USA_CA_Oakland.Intl.AP.724930_TMY3.epw skies/OakLand.wea
gendaymtx -of skies/OakLand.wea > matrices/OakLand.smx
gendaymtx -of -d skies/OakLand.wea > matrices/OakLand_direct.smx
gendaymtx -5 -d -m 6 -of skies/OakLand.wea > matrices/OakLand_direct_m6.smx

time dctimestep -n 8760 -if matrices/viewmatrix.vmx bsdf/fullwindow.xml  \
	matrices/daylightmatrix.dmx matrices/OakLand.smx | \
	rcollate -h -oc 1 > i_3ph.txt

time dctimestep -n 8760 -if  matrices/viewmatrix_direct.vmx bsdf/fullwindow.xml  \
	matrices/daylightmatrix_direct.dmx matrices/OakLand_direct.smx | \
	rcollate -h -oc 1 > i_ds3ph.txt

time dctimestep -n 8760 -if matrices/directsun.dsmx matrices/OakLand_direct_m6.smx | \
	rcollate -h -oc 1 > i_ds5ph.txt

rlam i_3ph.txt i_ds3ph.txt i_ds5ph.txt | \
	rcalc -e 'r=$1-$4+$7;g=$2-$5+$8;b=$3-$6+$9' \
	-e '$1=179*(.265*r+.670*g+.065*b)' | \
	rcollate -h -fa1 -ic 8760 -t > illum.txt

printf "\nAll done with example 1!  look at illum.txt for the result.\n"


printf "\n\n\nDoing 5-phase simulation for rendering...\n"
### 7.1	View matrix (V)
printf "\nView Matrix...\n"
time vwrays -vf views/back.vf  -ff -x 500 -y 500 \
	| rcontrib `vwrays -vf views/back.vf  -x 500 -y 500 -d` -n $procs -ffc -fo -o viewpics/back_%03d.hdr \
		-f klems_int.cal -b kbinS -bn Nkbins -m viewsurf \
		-ab 10 -ad 65536 -lw 1.52e-5 octs/model_3ph.oct

### 7.2	Direct view matrix (Vd)	
printf "\nDirect View Matrix...\n"	
time vwrays -vf views/back.vf  -ff -x 500 -y 500 \
	| rcontrib `vwrays -vf views/back.vf  -x 500 -y 500 -d` -n $procs -ffc -fo -o viewpics_dir/back_%03d.hdr \
		-f klems_int.cal -b kbinS -bn Nkbins -m viewsurf \
		-ab 1 -ad 65536 -lw 1.52e-5 octs/model_3ph.oct

### 7.5	Direct sun coefficient matrix (Cds)
printf "\nDirect Coefficient Matrix...\n"
ulimit -n 9999
xform -m black objects/testroom_Swall.rad objects/testroom.rad objects/ground.rad | \
	oconv materials/testroom.mat - objects/venetianblind.rad > octs/model_nosuns.oct
time vwrays -c 4 -pj 1 -fa -vf views/back.vf -x 500 -y 500 | \
	rtrace -h- -opn -faa -ab 0 octs/model_nosuns.oct | \
	rcontrib `vwrays -vf views/back.vf -x 500 -y 500 -d` -n $procs -fac -fo -o viewpics_ds/back_%04d.hdr \
	-e MF:6 -f reinhart.cal -b rbin -bn Nrbins -m solar -c 4 -I -ab 1 -ad 100 -dt 0 -dc 1 -lw 1e-2 octs/model_suns.oct

oconv materials/testroom.mat objects/testroom_Swall.rad objects/testroom.rad \
	objects/ground.rad objects/glazing.rad objects/venetianblind.rad \
	objects/daymtxsurf.rad > octs/model_material.oct
time rpict -x 1000 -y 1000 -vf views/back.vf -ps 1 -pj 1 -av 0.31831 0.31831 0.31831 -aa 0 \
	octs/model_material.oct | pfilt -x /2 -y /2 -1 -e 1 > materialmap.hdr  

### 7.6	Putting it all together
printf "\nPutting it together...\n"
time dctimestep -n 8760 -if -o hourlypics/back_%04d.hdr viewpics/back_%03d.hdr \
	bsdf/fullwindow.xml matrices/daylightmatrix.dmx matrices/OakLand.smx 

time dctimestep -n 8760 -if -o hourlypics_dir/back_%04d.hdr viewpics_dir/back_%03d.hdr \
	bsdf/fullwindow.xml matrices/daylightmatrix_direct.dmx matrices/OakLand_direct.smx 

time dctimestep -n 8760 -if -o hourlypics_ds/back_%04d.hdr viewpics_ds/back_%04d.hdr \
	matrices/OakLand_direct_m6.smx

time for t in {1..8760} 
do ts=`printf %04d $t `
pcomb -e 'lo=li(1)-li(2)+li(3)*li(4)' -o hourlypics/back_${ts}.hdr -o hourlypics_dir/back_${ts}.hdr \
	-o hourlypics_ds/back_${ts}.hdr -o materialmap.hdr > hourlyresult/back_${ts}.hdr 
done
printf "\nAll Done with 5-phase Rendering sim\n"
pcond hourlyresult/back_0015.hdr | ximage &""")  # disabled

cluster = Cluster(L=execute_ssh_async_3.Stdout)
overrides_5 = ApplyOverrides(Input_=panel_28, Filename=graft("/filepath/MyFile.hdr"))  # -> Output, Pairs
cluster_2 = Cluster(L=overrides_4.Output)
panel_32 = Panel(cluster)
execute_ssh_async_4 = ExecuteSSHAsync(SSHCommands=overrides_4.Output, addPrefix=True, addSuffix=True, fireLogs=False, suppressWarnings=False)  # -> Stdout, Stderr, Log, Pid, Ran
panel_33 = Panel(cluster_2)
panel_34 = Panel(overrides_5.Output)
execute_ssh_async_5 = ExecuteSSHAsync(
    _SSHCommands_="echo \"Hello World\"",
    Run=Toggle(True),
    addPrefix=True,
    addSuffix=True,
    description="echo \"Hello World\"",
    fireLogs=False,
    stdouts="Hello World",
    suppressWarnings=False)  # -> Stdout, Stderr_, Log, Pid, Ran
execute_ssh_async_6 = ExecuteSSHAsync(
    _SSHCommands_="ehho \"Hello World\"",
    Run=Toggle(True),
    addPrefix=True,
    addSuffix=True,
    description="ehho \"Hello World\"",
    fireLogs=False,
    suppressWarnings=False)  # -> Stdout, Stderr_, Log, Pid, Ran
cluster_3 = Cluster(L=execute_ssh_async_4.Stdout)
item = ListItem(List=flatten(execute_ssh_async_4.Stdout), Index=0, Wrap=True)  # -> Item, Item1
panel_35 = Panel(cluster_3)

vertical_offset = Panel("0.75m")
grid_size = Panel("0.5m")
docunits = ConvertToDocumentUnits(ValueString=vertical_offset)
docunits_2 = ConvertToDocumentUnits(ValueString=grid_size)

imageviewer = LBImageViewer(ImagePath_=item.Item1, _scale_=1, DisableClickable=False, SaveImgWithCoords=False, scale=1)  # -> ImagePath, Values, GIF
panel_36 = Panel(execute_ssh_async_5.Stdout)
panel_37 = Panel(execute_ssh_async_6.Stdout)
panel_38 = Panel(execute_ssh_async_5.Ran)
panel_39 = Panel(execute_ssh_async_6.Ran)
panel_40 = Panel(execute_ssh_async_4.Stderr)

# ----
# Grid
# Setting up grid points
cull = CullPattern(List=graft(layer_name), CullPattern=graft(python.is_grid))  # -> simplify(List)
cull_2 = CullPattern(List=geo, CullPattern=python.is_grid)
grid_size_2 = Number(docunits_2)
clean = CleanTree(RemoveNulls=True, RemoveInvalid=True, RemoveEmpty=True, Tree=cull, SynchronousTree1=simplify(cull_2))  # -> Tree, SynchronousTree1
custom_mesh_settings = SettingsCustom(
    StitchSeams=True,
    SimplePlanes=False,
    Refine=True,
    MinCount=16,
    MaxCount=400,
    AspectRatio=20,
    MaxDistance=0,
    MaxAngle=20,
    MinEdge=grid_size_2,
    MaxEdge=grid_size_2)
offset = Number(docunits)
rectangle = Rectangle(Plane=PlaneXY(0, 0, 0), XSize=Domain(-1, 1), YSize=Domain(-2, 2), Radius=0)  # -> Rectangle, Length
geo_2 = Geometry(graft(clean.SynchronousTree1))
flip = Flip(Surface=geo_2, Guide=rectangle.Rectangle)  # -> Surface, Result
mesh_2 = MeshBrep(Brep=flip.Surface, Settings=custom_mesh_settings)
normals = Normals(geo=flip.Surface, amplitude=offset)  # -> center_2, norm_2, P
move = Move(Geometry=mesh_2, Motion=normals.norm_2)  # -> Geometry, Transform
facen_2 = FaceNormals(Mesh=move.Geometry)  # -> Centers, Normals

# ----
# opaque geometries
cull_3 = CullPattern(List=graft(layer_name), CullPattern=graft(python.is_opaque))  # -> simplify(List)
cull_4 = CullPattern(List=geo, CullPattern=graft(python.is_opaque))  # -> simplify(List)
panel_41 = Panel(cull_3)
python_2 = GhPythonScript(layer_name=panel_41)  # -> out, reflectance
# ---------- python_2: Python ----------
__author__ = "mm1013"
__version__ = "2022.01.16"

import rhinoscriptsyntax as rs
try:
    reflectance = layer_name.split("_")[-1]
    
except:
    reflectance = None
# ---------- end python_2 ----------
clean_2 = CleanTree(
    RemoveNulls=True,
    RemoveInvalid=True,
    RemoveEmpty=True,
    Tree=cull_3,
    SynchronousTree1=cull_4,
    SynchronousTree2=python_2.reflectance)  # -> Tree, SynchronousTree1, SynchronousTree2
geo_3 = Geometry(clean_2.SynchronousTree1)
refl = Number(clean_2.SynchronousTree2)
panel_42 = Panel(refl)
name = Text(clean_2.Tree)
concat = Concatenate(FragmentA=name, FragmentB="_mat")
meshit2 = MeshIt2(mesh_brep=geo_3)

imageviewer_2 = LBImageViewer(ImagePath_=item.Item, _scale_=1, DisableClickable=False, SaveImgWithCoords=False, scale=1)  # -> ImagePath, Values, GIF
panel_43 = Panel(execute_ssh_async_5.Stderr_)
panel_44 = Panel(execute_ssh_async_6.Stderr_)

# ----
# Glass geometries
cull_5 = CullPattern(List=graft(layer_name), CullPattern=graft(python.is_transparent))  # -> simplify(List)
cull_6 = CullPattern(List=geo, CullPattern=python.is_transparent)
python_3 = GhPythonScript(layer_name=cull_5)  # -> out, transmittance, name
# ---------- python_3: Python ----------
__author__ = "mm1013"
__version__ = "2022.01.16"

import rhinoscriptsyntax as rs

try:
    transmittance = layer_name.split("_")[-1].replace("%","")
    name = layer_name.replace("%","")
except:
    transmittance = None
    name = None
# ---------- end python_3 ----------
clean_3 = CleanTree(
    RemoveNulls=True,
    RemoveInvalid=True,
    RemoveEmpty=True,
    Tree=simplify(cull_6),
    SynchronousTree1=simplify(python_3.name),
    SynchronousTree2=simplify(python_3.transmittance))  # -> Tree, SynchronousTree1, SynchronousTree2
meshit2_2 = MeshIt2(mesh_brep=graft(clean_3.Tree))
name_2 = Text(clean_3.SynchronousTree1)
unflatten = UnflattenTree(Tree=meshit2_2, Guide=clean_3.Tree)
geo_4 = Geometry(unflatten)
panel_45 = Panel(name_2)
transmittance = Number(expr("x/100", clean_3.SynchronousTree2))
concat_2 = Concatenate(FragmentA=panel_45, FragmentB="_mat")
mesh_3 = Mesh(geo_4)

# ----
# export PATH=$PATH.:/usr/local/radiance/bin
# export RAYPATH=.:/usr/local/radiance/lib
# obj2rad -m /home/mss/simulation/mapping.map -f /home/mss/simulation/twoMeshes4.obj 2>&1 1>/home/mss/simulation/x.rad
# head /home/mss/simulation/x.rad
panel_46 = Panel("""export PATH=$PATH.:/usr/local/radiance/bin
export RAYPATH=.:/usr/local/radiance/lib
objline ~/simulation/twoMeshes5.rad | meta2tga -x 1048 -y 1048 | ra_t8 -r > ~/simulation/test.hdr
normtiff ~/simulation/test.hdr ~/simulation/test.tif
convert ~/simulation/test.tif ~/simulation/test.png
echo "C:\Users\mm1013\simulation\test.png"
""")  # disabled
folder_exists = Panel("[ -d <proj> ] && echo \"1\" || echo \"0\"")
prepare_everything_for_2ph_dds = LBFalseStartToggle(False)

start_raytracing_2ph_dds = LBFalseStartToggle(False)
prep_octrees = LBFalseStartToggle(False)
raytrace_2ph = Boolean(start_raytracing_2ph_dds)

# ----
# Create working folder
panel_47 = Panel("mkdir -p <proj>;echo <proj>")
overrides_6 = ApplyOverrides(Input_=panel_47)  # -> Output, Pairs
executessh = ExecuteSSH(
    _SSHCommands_=overrides_6.Output,
    Run=prep_octrees,
    addPrefix=True,
    description="mkdir -p ~/simulation/test_project2;echo ~/simulation/test_project2",
    fireLogs=True,
    lastRunTime=8,
    name="Create workingdir",
    results="/home/mss/simulation/test_project2",
    stderr=">JOIN<>JOIN<>JOIN<>JOIN<>JOIN<>JOIN<>JOIN<>JOIN<>JOIN<",
    suppressWarnings=False)  # -> Stdout, Stderr_, Ran

# ----
# grid points
pt = Point(facen_2.Centers)
vec = Vector(facen_2.Normals)
overrides_7 = ApplyOverrides(Input="<projfolder>")  # -> Output, Pairs
lng = ListLength(List=flatten(pt))
points2pts = PointsToPts(Points=flatten(pt), Vectors=flatten(vec), Name="points", SubfolderOverride=overrides_7.Output, Run=executessh.Ran)  # -> PtsFile, Run
ptscount = Integer(lng)
points_2 = Text(points2pts.PtsFile)

execute_ssh_async_7 = ExecuteSSHAsync(
    _SSHCommands_=folder_exists,
    Run=Toggle(False),
    addPrefix=True,
    addSuffix=True,
    description="[ -d ~/simulation/test_project2 ] && echo \"1\" || echo \"0\"",
    fireLogs=False,
    name="Create folders",
    suppressWarnings=False)  # -> Stdout, Stderr_, Log, Pid, Ran
prep_2ph = Boolean(prepare_everything_for_2ph_dds)
falsestart_3 = LBFalseStartToggle(False)  # disabled
execute_ssh_async_8 = ExecuteSSHAsync(SSHCommands=panel_46, Run=falsestart_3, addPrefix=True, addSuffix=True, fireLogs=False, suppressWarnings=False)  # -> Stdout, Stderr, Log, Pid, Ran; disabled
file = Text("~/simulation/points.pts2")

overrides_8 = ApplyOverrides(Input="<projfolder>/radFiles")  # -> Output, Pairs
overrides_9 = ApplyOverrides(Input="<projfolder>")  # -> Output, Pairs

applyglobals_4 = ApplyGlobals(Input="[ -f <file> ] && echo \"1\" || echo \"0\"", AdditionalKeys="file", AdditionalValues=file)  # -> Output, Pairs
execute_ssh_async_9 = ExecuteSSHAsync(
    _SSHCommands_=applyglobals_4.Output,
    Run=Toggle(True),
    addPrefix=True,
    addSuffix=True,
    description="[ -f ~/simulation/points.pts2 ] && echo \"1\" || echo \"0\"",
    fireLogs=False,
    stdouts="0",
    suppressWarnings=False)  # -> Stdout, Stderr_, Log, Pid, Ran
imageviewer_3 = LBImageViewer(ImagePath_=execute_ssh_async_8.Stdout, _scale_=1, DisableClickable=False, SaveImgWithCoords=False, scale=1)  # -> ImagePath, Values, GIF; disabled

# ----
# Opaque geometry
panel_48 = Panel("mapping_opaque")
modnames = Text(concat)
mesh_4 = Mesh(meshit2)
names = Text(name)
mesh2obj_2 = MeshToObj(
    Mesh=mesh_4,
    Name=graft(names),
    MapFileName=panel_48,
    ModifierName=graft(modnames),
    SubfolderOverride=overrides_9.Output,
    Run=executessh.Ran)  # -> ObjFiles, MapFile, Run
obj2rad = ObjToRad(
    ObjFiles=mesh2obj_2.ObjFiles,
    MapFile=mesh2obj_2.MapFile,
    SubfolderOverride=overrides_8.Output,
    Run=mesh2obj_2.Run,
    stdouts="~/simulation/test_project2/radFiles/Terrain_0.2.rad>JOIN<~/simulation/test_project2/radFiles/Ceiling_0.7.rad>JOIN<~/simulation/test_project2/radFiles/Floor_0.2.rad>JOIN<~/simulation/test_project2/radFiles/Context_0.2.rad>JOIN<~/simulation/test_project2/radFiles/Wall_0.5.rad>JOIN<~/simulation/test_project2/radFiles/Frames_0.7.rad")  # -> Status, RadFiles, Run
opaque_rad = Text(obj2rad.RadFiles)
panel_49 = Panel(opaque_rad)

exists = Boolean(execute_ssh_async_9.Stdout)
panel_50 = Panel(exists)
panel_51 = Panel(execute_ssh_async_8.Stderr)  # disabled

# ----
# rad files
# Window geometry
panel_52 = Panel("mapping_windows")
mesh2obj_3 = MeshToObj(
    Mesh=mesh_3,
    Name=graft(panel_45),
    MapFileName=panel_52,
    ModifierName=graft(concat_2),
    SubfolderOverride=overrides_9.Output,
    Run=executessh.Ran)  # -> ObjFiles, MapFile, Run
obj2rad_2 = ObjToRad(
    ObjFiles=mesh2obj_3.ObjFiles,
    MapFile=mesh2obj_3.MapFile,
    SubfolderOverride=overrides_8.Output,
    Run=mesh2obj_3.Run,
    stdouts="~/simulation/test_project2/radFiles/GlassSouth_70.rad>JOIN<~/simulation/test_project2/radFiles/Glass_70.rad>JOIN<~/simulation/test_project2/radFiles/GlassWest_70.rad")  # -> Status, RadFiles, Run
window_rad = Text(obj2rad_2.RadFiles)

prep_2ph_2 = Boolean(prep_2ph)

# ----
# sun primitive
prep_2ph_3 = Boolean(prep_2ph)
panel_53 = Panel("""echo "void light solar 0 0 3 1e6 1e6 1e6" > <target>
echo "<target>"
""")
overrides_10 = ApplyOverrides(Input_=panel_53, Target=graft("<LinuxHome>/suns.rad"))  # -> Output, Pairs
execute_ssh_async_10 = ExecuteSSHAsync(
    _SSHCommands_=overrides_10.Output,
    Run=prep_2ph_3,
    addPrefix=True,
    addSuffix=True,
    description="echo \"void light solar 0 0 3 1e6 1e6 1e6\" > ~/simulation/suns.rad;echo \"~/simulation/suns.rad\"",
    fireLogs=False,
    name="Sun primitive",
    stdouts="~/simulation/suns.rad",
    suppressWarnings=False)  # -> Stdout, Stderr_, Log, Pid, Ran

# ----
# opaque materials
panel_54 = Panel("echo \"<mats>\" > <proj>/radFiles/<target>;echo \"<proj>/radFiles/<target>\"")
opaquegreymat = OpaqueGreyMat(Name=concat, Reflectance_0_1=refl, Specularity=0, Roughness=0)  # -> flatten(RadMaterials), RadMaterialList
join_2 = TextJoin(Text=opaquegreymat.RadMaterials)
overrides_11 = ApplyOverrides(Input_=panel_54, Mats=graft(join_2), Target=graft("opaque_materials.mat"))  # -> Output, Pairs
execute_ssh_async_11 = ExecuteSSHAsync(
    SSHCommands_=overrides_11.Output,
    Run=obj2rad.Run,
    addPrefix=False,
    addSuffix=True,
    description="""echo "void plastic Frames_0.7_mat
0
0
5 0.700 0.700 0.700 0.000 0.000
void plastic Wall_0.5_mat
0
0
5 0.500 0.500 0.500 0.000 0.000
void plastic Context_0.2_mat
0
0
5 0.200 0.200 0.200 0.000 0.000
void plastic Floor_0.2_mat
0
0
5 0.200 0.200 0.200 0.000 0.000
void plastic Ceiling_0.7_mat
0
0
5 0.700 0.700 0.700 0.000 0.000
void plastic Terrain_0.2_mat
0
0
5 0.200 0.200 0.200 0.000 0.000" > ~/simulation/test_project2/radFiles/opaque_materials.mat;echo "~/simulation/test_project2/radFiles/opaque_materials.mat"
""",
    fireLogs=True,
    name="Opaque Materials",
    stdouts="~/simulation/test_project2/radFiles/opaque_materials.mat",
    suppressWarnings=False)  # -> Stdout, Stderr_, Log, Pid, Ran
opaque_mat = Text(execute_ssh_async_11.Stdout)

# ----
# blackmaterials
panel_55 = Panel("blackMaterial")
panel_56 = Panel("echo \"<mats>\" > <proj>/radFiles/<target>;echo \"<proj>/radFiles/<target>\"")
blackmatname = Text(panel_55)
opaquegreymat_2 = OpaqueGreyMat(Name=flatten(blackmatname), Reflectance_0_1="0.0", Specularity=0, Roughness=0)  # -> RadMaterials, RadMaterialList
overrides_12 = ApplyOverrides(Input_=panel_56, Mats=graft(opaquegreymat_2.RadMaterials), Target=graft("black_material.mat"))  # -> Output, Pairs
execute_ssh_async_12 = ExecuteSSHAsync(
    _SSHCommands_=overrides_12.Output,
    Run=executessh.Ran,
    addPrefix=True,
    addSuffix=True,
    description="""echo "void plastic blackMaterial
0
0
5 0.000 0.000 0.000 0.000 0.000" > ~/simulation/test_project2/radFiles/black_material.mat;echo "~/simulation/test_project2/radFiles/black_material.mat"
""",
    fireLogs=False,
    name="Black Materials",
    staticDescription="""echo "void plastic blackMaterial
0
0
5 0.000 0.000 0.000 0.000 0.000" > ~/simulation/test_project2/radFiles/black_material.mat;echo "~/simulation/testfefe_project2/radFiles/black_material.mat"
""",
    stdouts="~/simulation/test_project2/radFiles/black_material.mat",
    suppressWarnings=False)  # -> Stdout, Stderr_, Log, Pid, Ran
black_mat = Text(execute_ssh_async_12.Stdout)

names_2 = Text(names)
prep_2ph_4 = Boolean(prep_2ph)
panel_57 = Panel("xform -m <blackmat> <proj>/radFiles/<name>.rad > <proj>/radFiles/<name>_black.rad;echo \"<proj>/radFiles/<name>_black.rad\"")
overrides_13 = ApplyOverrides(Input_=panel_57, Name=graft(names_2), Blackmat=graft(blackmatname))  # -> Output, Pairs
execute_ssh_async_13 = ExecuteSSHAsync(
    _SSHCommands_=overrides_13.Output,
    Run=prep_2ph_4,
    addPrefix=True,
    addSuffix=True,
    description="""xform -m blackMaterial ~/simulation/test_project2/radFiles/_Ceiling_70.rad > ~/simulation/test_project2/radFiles/_Ceiling_70_black.rad;echo "~/simulation/test_project2/radFiles/_Ceiling_70_black.rad"
xform -m blackMaterial ~/simulation/test_project2/radFiles/_Floor_20.rad > ~/simulation/test_project2/radFiles/_Floor_20_black.rad;echo "~/simulation/test_project2/radFiles/_Floor_20_black.rad"
xform -m blackMaterial ~/simulation/test_project2/radFiles/_Wall_50.rad > ~/simulation/test_project2/radFiles/_Wall_50_black.rad;echo "~/simulation/test_project2/radFiles/_Wall_50_black.rad"
xform -m blackMaterial ~/simulation/test_project2/radFiles/_Frames_70.rad > ~/simulation/test_project2/radFiles/_Frames_70_black.rad;echo "~/simulation/test_project2/radFiles/_Frames_70_black.rad"
xform -m blackMaterial ~/simulation/test_project2/radFiles/_Ground_25.rad > ~/simulation/test_project2/radFiles/_Ground_25_black.rad;echo "~/simulation/test_project2/radFiles/_Ground_25_black.rad"
xform -m blackMaterial ~/simulation/test_project2/radFiles/_Concrete_30.rad > ~/simulation/test_project2/radFiles/_Concrete_30_black.rad;echo "~/simulation/test_project2/radFiles/_Concrete_30_black.rad"
xform -m blackMaterial ~/simulation/test_project2/radFiles/_Concrete_40.rad > ~/simulation/test_project2/radFiles/_Concrete_40_black.rad;echo "~/simulation/test_project2/radFiles/_Concrete_40_black.rad"
""",
    fireLogs=False,
    name="Black Materials",
    staticDescription="""echo "void plastic blackMaterial
0
0
5 0.000 0.000 0.000 0.000 0.000" > ~/simulation/test_project2/radFiles/black_material.mat;echo "~/simulation/testfefe_project2/radFiles/black_material.mat"
""",
    stdouts="~/simulation/test_project2/radFiles/_Ceiling_70_black.rad>JOIN<~/simulation/test_project2/radFiles/_Floor_20_black.rad>JOIN<~/simulation/test_project2/radFiles/_Wall_50_black.rad>JOIN<~/simulation/test_project2/radFiles/_Frames_70_black.rad>JOIN<~/simulation/test_project2/radFiles/_Ground_25_black.rad>JOIN<~/simulation/test_project2/radFiles/_Concrete_30_black.rad>JOIN<~/simulation/test_project2/radFiles/_Concrete_40_black.rad",
    suppressWarnings=False)  # -> Stdout, Stderr_, Log, Pid, Ran
black_rad_files = Text(execute_ssh_async_13.Stdout)

# ----
# Setup glass materials
panel_58 = Panel("<mat>.mat")
python_4 = GhPythonScript(matname=concat_2)  # -> filename
# ---------- python_4: Python ----------
__author__ = "mm1013"
__version__ = "2022.07.06"

import rhinoscriptsyntax as rs

filename = matname.replace(" ","_").replace(".","_")
# ---------- end python_4 ----------
glassmat = GlassMat(Name=concat_2, Transmittance_0_1=transmittance)  # -> RadMaterials, RadMaterialList
# materials
panel_59 = Panel("echo \"<mats>\" > <proj>/radFiles/<target>;echo \"<proj>/radFiles/<target>\"")
overrides_14 = ApplyOverrides(Input_=panel_58, Mat=graft(python_4))  # -> Output, Pairs
overrides_15 = ApplyOverrides(Input_=panel_59, Mats=graft(glassmat.RadMaterials), Target=graft(overrides_14.Output))  # -> Output, Pairs
execute_ssh_async_14 = ExecuteSSHAsync(
    _SSHCommands_=overrides_15.Output,
    Run=obj2rad.Run,
    addPrefix=True,
    addSuffix=True,
    description="""echo "void glass GlassWest_70_mat
0
0
3 0.763 0.763 0.763" > ~/simulation/test_project2/radFiles/GlassWest_70_mat.mat;echo "~/simulation/test_project2/radFiles/GlassWest_70_mat.mat"
echo "void glass Glass_70_mat
0
0
3 0.763 0.763 0.763" > ~/simulation/test_project2/radFiles/Glass_70_mat.mat;echo "~/simulation/test_project2/radFiles/Glass_70_mat.mat"
echo "void glass GlassSouth_70_mat
0
0
3 0.763 0.763 0.763" > ~/simulation/test_project2/radFiles/GlassSouth_70_mat.mat;echo "~/simulation/test_project2/radFiles/GlassSouth_70_mat.mat"
""",
    fireLogs=False,
    name="Glass Materials",
    stdouts="~/simulation/test_project2/radFiles/GlassWest_70_mat.mat>JOIN<~/simulation/test_project2/radFiles/Glass_70_mat.mat>JOIN<~/simulation/test_project2/radFiles/GlassSouth_70_mat.mat",
    suppressWarnings=False)  # -> Stdout, Stderr_, Log, Pid, Ran
window_mat = Text(execute_ssh_async_14.Stdout)

# ----
# Sun
panel_60 = Panel("""cnt 5165 | rcalc -e MF:6 -f reinsrc.cal -e Rbin=recno -o 'solar source sun 0 0 4 ${Dx} ${Dy} ${Dz} 0.553' >> <target>
echo <target>""")

# ----
# solar discs and modifiers for 5165 suns (=MF:6)
overrides_16 = ApplyOverrides(Input_=panel_60, Target=graft(execute_ssh_async_10.Stdout))  # -> Output, Pairs
execute_ssh_async_15 = ExecuteSSHAsync(
    _SSHCommands_=overrides_16.Output,
    Run=execute_ssh_async_10.Ran,
    addPrefix=True,
    addSuffix=True,
    description="cnt 5165 | rcalc -e MF:6 -f reinsrc.cal -e Rbin=recno -o 'solar source sun 0 0 4 ${Dx} ${Dy} ${Dz} 0.553' >> ~/simulation/suns.rad;echo ~/simulation/suns.rad",
    fireLogs=False,
    name="Solar Dics",
    stdouts="/home/mss/simulation/suns.rad",
    suppressWarnings=False)  # -> Stdout, Stderr_, Log, Pid, Ran

# ----
# -f is frozen (all links embedded)
panel_61 = Panel("""mkdir -p <proj>/octrees
oconv -f <rads> > <proj>/octrees/<target>.oct;echo <proj>/octrees/<target>.oct""")

# ----
# Octrees
# STANDARD octree
window_mat_2 = Text(window_mat)
opaque_mat_2 = Text(opaque_mat)
opaque_rad_2 = Text(opaque_rad)
window_rad_2 = Text(window_rad)
and = GateAnd(A=execute_ssh_async_14.Ran, B=execute_ssh_async_11.Ran)
entwine = Entwine(Branch00=window_mat_2, Branch01=window_rad_2, Branch02=opaque_mat_2, Branch03=opaque_rad_2, FlattenInputs=True)  # -> flatten(Result)
join_3 = TextJoin(Text=flatten(entwine), Join=" ")
overrides_17 = ApplyOverrides(Input_=panel_61, Rads=graft(join_3), Target=graft("my_geometry"))  # -> Output, Pairs
execute_ssh_async_16 = ExecuteSSHAsync(
    _SSHCommands_=overrides_17.Output,
    Run=and,
    addPrefix=True,
    addSuffix=True,
    description="""mkdir -p ~/simulation/test_project2/octrees
oconv -f ~/simulation/test_project2/radFiles/GlassWest_70_mat.mat ~/simulation/test_project2/radFiles/Glass_70_mat.mat ~/simulation/test_project2/radFiles/GlassSouth_70_mat.mat ~/simulation/test_project2/radFiles/GlassSouth_70.rad ~/simulation/test_project2/radFiles/Glass_70.rad ~/simulation/test_project2/radFiles/GlassWest_70.rad ~/simulation/test_project2/radFiles/opaque_materials.mat ~/simulation/test_project2/radFiles/Terrain_0.2.rad ~/simulation/test_project2/radFiles/Ceiling_0.7.rad ~/simulation/test_project2/radFiles/Floor_0.2.rad ~/simulation/test_project2/radFiles/Context_0.2.rad ~/simulation/test_project2/radFiles/Wall_0.5.rad ~/simulation/test_project2/radFiles/Frames_0.7.rad > ~/simulation/test_project2/octrees/my_geometry.oct;echo ~/simulation/test_project2/octrees/my_geometry.oct""",
    fireLogs=True,
    name="Standard Octree",
    stdouts="/home/mss/simulation/test_project2/octrees/my_geometry.oct",
    suppressWarnings=True)  # -> Stdout, Stderr, Log, Pid, Ran
panel_62 = Panel(overrides_17.Output)
panel_63 = Panel(execute_ssh_async_16.Stdout)
octree = Text(execute_ssh_async_16.Stdout)

# ----
# octrees for opaques (3ph)
and_2 = GateAnd(A=execute_ssh_async_14.Ran, B=execute_ssh_async_11.Ran)
opaque_mat_3 = Text(opaque_mat)
panel_64 = Panel("""mkdir -p <proj>/octrees
oconv -f <rads> > <proj>/octrees/<target>.oct;echo <proj>/octrees/<target>.oct""")
opaque_rad_3 = Text(opaque_rad)
entwine_2 = Entwine(Branch00=opaque_mat_3, Branch01=opaque_rad_3, FlattenInputs=True)  # -> flatten(Result)
join_4 = TextJoin(Text=flatten(entwine_2), Join=" ")
overrides_18 = ApplyOverrides(Input_=panel_64, Rads=graft(join_4), Target=graft("opaque_scene"))  # -> Output, Pairs
execute_ssh_async_17 = ExecuteSSHAsync(
    _SSHCommands_=overrides_18.Output,
    Run=and_2,
    addPrefix=True,
    addSuffix=True,
    description="""mkdir -p ~/simulation/test_project2/octrees
oconv -f ~/simulation/test_project2/radFiles/opaque_materials.mat ~/simulation/test_project2/radFiles/Terrain_0.2.rad ~/simulation/test_project2/radFiles/Ceiling_0.7.rad ~/simulation/test_project2/radFiles/Floor_0.2.rad ~/simulation/test_project2/radFiles/Context_0.2.rad ~/simulation/test_project2/radFiles/Wall_0.5.rad ~/simulation/test_project2/radFiles/Frames_0.7.rad > ~/simulation/test_project2/octrees/opaque_scene.oct;echo ~/simulation/test_project2/octrees/opaque_scene.oct""",
    fireLogs=True,
    name="Standard Octree",
    stdouts="/home/mss/simulation/test_project2/octrees/opaque_scene.oct",
    suppressWarnings=True)  # -> Stdout, Stderr, Log, Pid, Ran
panel_65 = Panel(overrides_18.Output)
panel_66 = Panel(execute_ssh_async_17.Stdout)
octree_2 = Text(execute_ssh_async_17.Stdout)

# ----
# create black octree
black_rad_files_2 = Text(black_rad_files)
window_mat_3 = Text(window_mat)
window_rad_3 = Text(window_rad)
black_mat_2 = Text(black_mat)
and_3 = GateAnd(A=execute_ssh_async_14.Ran, B=execute_ssh_async_12.Ran)
panel_67 = Panel("""mkdir -p <proj>/octrees
oconv -f <rads> > <proj>/octrees/my_geometry_black.oct;echo <proj>/octrees/my_geometry_black.oct""")
entwine_3 = Entwine(Branch02=black_mat_2, Branch03=black_rad_files_2, FlattenInputs=True)  # -> flatten(Result)
join_5 = TextJoin(Text=flatten(entwine_3), Join=" ")
overrides_19 = ApplyOverrides(Input=panel_67, Rads=graft(join_5))  # -> Output, Pairs
execute_ssh_async_18 = ExecuteSSHAsync(
    _SSHCommands_=overrides_19.Output,
    Run=and_3,
    addPrefix=True,
    addSuffix=True,
    description="""mkdir -p ~/simulation/test_project2/octrees
oconv -f ~/simulation/test_project2/radFiles/black_material.mat ~/simulation/test_project2/radFiles/_Ceiling_70_black.rad ~/simulation/test_project2/radFiles/_Floor_20_black.rad ~/simulation/test_project2/radFiles/_Wall_50_black.rad ~/simulation/test_project2/radFiles/_Frames_70_black.rad ~/simulation/test_project2/radFiles/_Ground_25_black.rad ~/simulation/test_project2/radFiles/_Concrete_30_black.rad ~/simulation/test_project2/radFiles/_Concrete_40_black.rad > ~/simulation/test_project2/octrees/my_geometry_black.oct;echo ~/simulation/test_project2/octrees/my_geometry_black.oct""",
    fireLogs=False,
    name="Black Octree",
    stdouts="/home/mss/simulation/test_project2/octrees/my_geometry_black.oct",
    suppressWarnings=True)  # -> Stdout, Stderr, Log, Pid, Ran
panel_68 = Panel(execute_ssh_async_18.Stdout)
octree_black = Text(execute_ssh_async_18.Stdout)

# ----
# create black octreeDDS
suns_material = Text(execute_ssh_async_10.Stdout)
black_rad_files_3 = Text(black_rad_files)
window_mat_4 = Text(window_mat)
window_rad_4 = Text(window_rad)
black_mat_3 = Text(black_mat)
mf6_suns = Text(execute_ssh_async_15.Stdout)
# Skies and Skymatrices
and_4 = GateAnd(A=execute_ssh_async_13.Ran, B=execute_ssh_async_15.Ran)
entwine_4 = Entwine(
    Branch00=window_mat_4,
    Branch01=window_rad_4,
    Branch02=black_mat_3,
    Branch03=black_rad_files_3,
    Branch04=suns_material,
    Branch05=mf6_suns,
    FlattenInputs=True)  # -> flatten(Result)
panel_69 = Panel("""mkdir -p <proj>/octrees
oconv -f <rads> > <proj>/octrees/<target>;echo <proj>/octrees/<target>""")
join_6 = TextJoin(Text=flatten(entwine_4), Join=" ")
overrides_20 = ApplyOverrides(Input=panel_69, Rads=graft(join_6), Target=graft("my_geometry_black_sunCoeffecientsDDS.oct"))  # -> Output, Pairs
execute_ssh_async_19 = ExecuteSSHAsync(
    _SSHCommands_=overrides_20.Output,
    Run=and_4,
    addPrefix=True,
    addSuffix=True,
    description="""mkdir -p ~/simulation/test_project2/octrees
oconv -f ~/simulation/test_project2/radFiles/_GlazingWest_65_mat.mat ~/simulation/test_project2/radFiles/_GlazingNorth_65_mat.mat ~/simulation/test_project2/radFiles/_GlazingNorth_65.rad ~/simulation/test_project2/radFiles/_GlazingWest_65.rad ~/simulation/test_project2/radFiles/black_material.mat ~/simulation/test_project2/radFiles/_Ceiling_70_black.rad ~/simulation/test_project2/radFiles/_Floor_20_black.rad ~/simulation/test_project2/radFiles/_Wall_50_black.rad ~/simulation/test_project2/radFiles/_Frames_70_black.rad ~/simulation/test_project2/radFiles/_Ground_25_black.rad ~/simulation/test_project2/radFiles/_Concrete_30_black.rad ~/simulation/test_project2/radFiles/_Concrete_40_black.rad ~/simulation/suns.rad /home/mss/simulation/suns.rad > ~/simulation/test_project2/octrees/my_geometry_black_sunCoeffecientsDDS.oct;echo ~/simulation/test_project2/octrees/my_geometry_black_sunCoeffecientsDDS.oct""",
    fireLogs=False,
    name="Black Octree DDS",
    stdouts="/home/mss/simulation/test_project2/octrees/my_geometry_black_sunCoeffecientsDDS.oct",
    suppressWarnings=True)  # -> Stdout, Stderr, Log, Pid, Ran
panel_70 = Panel(execute_ssh_async_19.Stdout)
octree_blackdds = Text(panel_70)

# ----
# Create skyglow.rad
panel_71 = Panel("""#@rfluxmtx u=+Y h=u
void glow groundglow
0
0
4 1 1 1 0

groundglow source ground
0
0
4 0 0 -1 180

#@rfluxmtx u=+Y h=r1
void glow skyglow
0
0
4 1 1 1 0

skyglow source skydome
0
0
4 0 0 1 180""")
panel_72 = Panel("""mkdir -p <proj>/radFiles
echo "<skyglow>" > <proj>/radFiles/<target>; echo <proj>/radFiles/<target>""")
overrides_21 = ApplyOverrides(Input=panel_72, Skyglow=graft(panel_71), Target=graft("skyglow.rad"))  # -> Output, Pairs
execute_ssh_async_20 = ExecuteSSHAsync(
    _SSHCommands_=overrides_21.Output,
    Run=executessh.Ran,
    addPrefix=True,
    addSuffix=True,
    description="""mkdir -p ~/simulation/test_project2/radFiles
echo "#@rfluxmtx u=+Y h=u
void glow groundglow
0
0
4 1 1 1 0

groundglow source ground
0
0
4 0 0 -1 180

#@rfluxmtx u=+Y h=r1
void glow skyglow
0
0
4 1 1 1 0

skyglow source skydome
0
0
4 0 0 1 180" > ~/simulation/test_project2/radFiles/skyglow.rad; echo ~/simulation/test_project2/radFiles/skyglow.rad""",
    fireLogs=False,
    stdouts="/home/mss/simulation/test_project2/radFiles/skyglow.rad",
    suppressWarnings=False)  # -> Stdout, Stderr_, Log, Pid, Ran
overrides_22 = ApplyOverrides(Input="head <proj>/radFiles/<target>", Target=graft("skyglow.rad"))  # -> Output, Pairs
execute_ssh_async_21 = ExecuteSSHAsync(
    _SSHCommands_=overrides_22.Output,
    Run=execute_ssh_async_20.Ran,
    addPrefix=True,
    addSuffix=True,
    description="head ~/simulation/test_project2/radFiles/skyglow.rad",
    fireLogs=False,
    stdouts="""#@rfluxmtx u=+Y h=u
void glow groundglow
0
0
4 1 1 1 0

groundglow source ground
0
0
4 0 0 -1 180""",
    suppressWarnings=False)  # -> Stdout, Stderr_, Log, Pid, Ran
panel_73 = Panel(execute_ssh_async_20.Stdout)
panel_74 = Panel(execute_ssh_async_21.Stdout)
skyglow = Text(execute_ssh_async_20.Stdout)

# ----
# preview pts files
# opt1 - cat directly from linux
panel_75 = Panel("cat <pts>")
points_3 = Text(points_2)
overrides_23 = ApplyOverrides(Input_=panel_75, Pts=graft(points_3))  # -> Output, Pairs
execute_ssh_async_22 = ExecuteSSHAsync(
    _SSHCommands_=overrides_23.Output,
    Run=Toggle(True),
    addPrefix=True,
    addSuffix=True,
    description="cat /home/mss/simulation/test_project2/points.pts",
    fireLogs=False,
    stdouts="""-22274 -24269 788 0 0 1
-22667 -24574 783 0 0 1
-23059 -24880 779 0 0 1
-23452 -25185 774 0 0 1
-23844 -25490 770 0 0 1
-24236 -25795 766 0 0 1
-24629 -26101 761 0 0 1
-25021 -26406 757 0 0 1
-25414 -26711 752 0 0 1
-22571 -23870 788 0 0 1
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""",
    suppressWarnings=False)  # -> Stdout, Stderr_, Log, Pid, Ran
ptsview = PtsViewer(PtsString=execute_ssh_async_22.Stdout)  # disabled

# ----
# preview rad files
convertpaths = ConvertPaths(I=entwine)  # -> Linux, Windows
radviewer = RadViewer(
    RadFiles=flatten(convertpaths.Windows),
    IsTwoSided=False,
    Polychromatic=True,
    ShowEdges=True,
    Transparent=True,
    ColorNames=["Glass_30_mat", "Glass_50_mat", "Ceiling_70_mat", "Floor_20_mat", "Context_25_mat", "Frames_70_mat", "Terrain_20_mat", "Wall_50_mat", "Glass_70_mat", "Terrain_0.2_mat", "Ceiling_0.7_mat", "Floor_0.2_mat", "Context_0.2_mat", "Wall_0.5_mat", "Frames_0.7_mat", "GlassSouth_70_mat", "GlassWest_70_mat"],
    Colors=[RGB(221, 165, 248), RGB(218, 126, 134), RGB(233, 226, 179), RGB(253, 251, 240), RGB(243, 216, 134), RGB(154, 130, 218), RGB(126, 110, 111), RGB(115, 206, 125), RGB(157, 157, 202), RGB(179, 204, 130), RGB(155, 250, 182), RGB(227, 103, 205), RGB(201, 181, 196), RGB(204, 120, 211), RGB(248, 129, 125), RGB(139, 224, 221), RGB(204, 114, 197)])  # -> Geo, ModifierNames, Modifiers, FailedWireFrame

# ----
# opt2 - read local windows pts file
points_4 = Text(points_2)
convertpaths_2 = ConvertPaths(I=points_4)  # -> Linux, Windows
ptsview_2 = PtsViewer(PtsString=convertpaths_2.Windows)

# ----
# 2phase DDS simulation
# Raytracing (rfluxmtx)
# Generate daylight coefficients
# export PATH=$PATH.:/usr/local/radiance/bin
# export RAYPATH=.:/usr/local/radiance/lib
panel_76 = Panel("""mkdir -p <proj>/mtxs/
rfluxmtx -I+ -y <ptcount> -lw 0.0001 -ab 5 -ad 5000 -n <cpus> - <skyglow> -i <octree> < <points> > <proj>/mtxs/<target>;echo <proj>/mtxs/<target>""")
raytrace_2ph_2 = Boolean(raytrace_2ph)
ptscount_2 = Integer(ptscount)
and_5 = GateAnd(
    octree_ok=execute_ssh_async_16.Ran,
    skyglow_ok=execute_ssh_async_20.Ran,
    points_ok=points2pts.Run,
    raytrace=raytrace_2ph_2)
skyglow_2 = Text(skyglow)
octree_3 = Text(octree)
points_5 = Text(points_2)
overrides_24 = ApplyOverrides(
    Input_=panel_76,
    Ptcount=graft(ptscount_2),
    Skyglow=graft(skyglow_2),
    Octree=graft(octree_3),
    Points=graft(points_5),
    Target=graft("dc_illum.mtx"))  # -> Output, Pairs
execute_ssh_async_23 = ExecuteSSHAsync(
    _SSHCommands_=overrides_24.Output,
    Run=and_5,
    addPrefix=True,
    addSuffix=True,
    description="mkdir -p ~/simulation/test_project2/mtxs/;rfluxmtx -I+ -y 199 -lw 0.0001 -ab 5 -ad 5000 -n 11 - /home/mss/simulation/test_project2/radFiles/skyglow.rad -i /home/mss/simulation/test_project2/octrees/my_geometry.oct < /home/mss/simulation/test_project2/points.pts > ~/simulation/test_project2/mtxs/dc_illum.mtx;echo ~/simulation/test_project2/mtxs/dc_illum.mtx",
    fireLogs=False,
    stdouts="/home/mss/simulation/test_project2/mtxs/dc_illum.mtx",
    suppressWarnings=False)  # -> Stdout, Stderr_, Log, Pid, Ran
panel_77 = Panel(overrides_24.Output)
panel_78 = Panel(execute_ssh_async_23.Stdout)

# ----
# Raytracing (rfluxmtx)
# Generate daylight coefficients black (direct only)
panel_79 = Panel("dcd_illum.mtx")
panel_80 = Panel("""mkdir -p <proj>/mtxs/
rfluxmtx -I+ -y <ptcount> -lw 0.0002 -ab 1 -ad 5000 -n <cpus> - <skyglow> -i <octree> < <points> > <proj>/mtxs/<target>;echo <proj>/mtxs/<target>""")
octree_black_2 = Text(octree_black)
ptscount_3 = Integer(ptscount)
skyglow_3 = Text(skyglow)
points_6 = Text(points_2)
and_6 = GateAnd(
    octree_ok=execute_ssh_async_18.Ran,
    skyglow_ok=execute_ssh_async_18.Ran,
    points_ok=points2pts.Run,
    ran_above=execute_ssh_async_23.Ran)
overrides_25 = ApplyOverrides(
    Input=panel_80,
    Ptcount=graft(ptscount_3),
    Skyglow=graft(skyglow_3),
    Octree=graft(octree_black_2),
    Points=graft(points_6),
    Target=graft(panel_79))  # -> Output, Pairs
execute_ssh_async_24 = ExecuteSSHAsync(
    _SSHCommands_=overrides_25.Output,
    Run=and_6,
    addPrefix=True,
    addSuffix=True,
    description="mkdir -p ~/simulation/test_project2/mtxs/;rfluxmtx -I+ -y 199 -lw 0.0002 -ab 1 -ad 5000 -n 11 - /home/mss/simulation/test_project2/radFiles/skyglow.rad -i /home/mss/simulation/test_project2/octrees/my_geometry_black.oct < /home/mss/simulation/test_project2/points.pts > ~/simulation/test_project2/mtxs/dcd_illum.mtx;echo ~/simulation/test_project2/mtxs/dcd_illum.mtx",
    fireLogs=False,
    stdouts="/home/mss/simulation/test_project2/mtxs/dcd_illum.mtx",
    suppressWarnings=False)  # -> Stdout, Stderr_, Log, Pid, Ran
panel_81 = Panel(execute_ssh_async_24.Stdout)
panel_82 = Panel(overrides_25.Output)

# ----
# Raytracing suns (rcontrib)
# Calculate illuminance sun coefficients for illuminance calculations
panel_83 = Panel("cdsDDS_illum.mtx")
panel_84 = Panel("""mkdir -p <proj>/mtxs/
rcontrib -I+ -ab 1 -y <ptcount> -n <cpus> -ad 256 -lw 1.0e-3 -dc 1 -dt 0 -dj 0 -faf -e MF:6 -f reinhart.cal -b rbin -bn Nrbins -m solar <octree> < <points> > <proj>/mtxs/<target>
echo <proj>/mtxs/<target>""")
octree_blackdds_2 = Text(octree_blackdds)
ptscount_4 = Integer(ptscount)
points_7 = Text(points_2)
overrides_26 = ApplyOverrides(
    Input=panel_84,
    Ptcount=graft(ptscount_4),
    Octree=graft(octree_blackdds_2),
    Points=graft(points_7),
    Target=graft(panel_83))  # -> Output, Pairs
and_7 = GateAnd(octree_ok=execute_ssh_async_19.Ran, points_ok=points2pts.Run, ran_above=execute_ssh_async_24.Ran)
execute_ssh_async_25 = ExecuteSSHAsync(
    _SSHCommands_=overrides_26.Output,
    Run=and_7,
    addPrefix=True,
    addSuffix=True,
    description="mkdir -p ~/simulation/test_project2/mtxs/;rcontrib -I+ -ab 1 -y 199 -n 11 -ad 256 -lw 1.0e-3 -dc 1 -dt 0 -dj 0 -faf -e MF:6 -f reinhart.cal -b rbin -bn Nrbins -m solar /home/mss/simulation/test_project2/octrees/my_geometry_black_sunCoeffecientsDDS.oct < /home/mss/simulation/test_project2/points.pts > ~/simulation/test_project2/mtxs/cdsDDS_illum.mtx;echo ~/simulation/test_project2/mtxs/cdsDDS_illum.mtx",
    fireLogs=False,
    stdouts="/home/mss/simulation/test_project2/mtxs/cdsDDS_illum.mtx",
    suppressWarnings=True)  # -> Stdout, Stderr, Log, Pid, Ran
panel_85 = Panel(execute_ssh_async_25.Stderr)

# ----
# genblinds
panel_86 = Panel("genblinds blindmat blind 0.08 1 2 28 20 +r 0.12 | xform -rz -90 -rx -90 -t 0 0 -0.15 > <proj>/radFiles/<target>.rad;echo <proj>/radFiles/<target>.rad")
falsestart_4 = LBFalseStartToggle(False)
overrides_27 = ApplyOverrides(Input_=panel_86, Target=graft("blinds_001"))  # -> Output, Pairs
bool = Boolean(falsestart_4)
executessh_2 = ExecuteSSH(
    _SSHCommands_=overrides_27.Output,
    Run=bool,
    addPrefix=True,
    description="genblinds blindmat blind 0.08 1 2 28 20 +r 0.12 | xform -rz -90 -rx -90 -t 0 0 -0.15 > ~/simulation/test_project2/radFiles/blinds_001.rad;echo ~/simulation/test_project2/radFiles/blinds_001.rad",
    fireLogs=False,
    lastRunTime=10,
    results="/home/mss/simulation/test_project2/radFiles/blinds_001.rad",
    stderr=">JOIN<>JOIN<>JOIN<>JOIN<>JOIN<>JOIN<",
    suppressWarnings=False)  # -> Stdout, Stderr_, Ran

# ----
# Check the modifiers you want to make BSDF materials with.
# If LT values are the same you can just choose to use one of them
window_rad_5 = Text(window_rad)
list = ItemSelector(
    window_rad_5,
    {"~/simulation/test_project2/radFiles/GlassSouth_70.rad", "~/simulation/test_project2/radFiles/Glass_70.rad", "~/simulation/test_project2/radFiles/GlassWest_70.rad"}, selected="~/simulation/test_project2/radFiles/GlassSouth_70.rad")

# ----
# 3 phase simulation
# Check the glass you want for multiphase
# (window groups)
window_rad_6 = Text(window_rad)
list_2 = ItemSelector(
    window_rad_6,
    {"~/simulation/test_project2/radFiles/GlassSouth_70.rad", "~/simulation/test_project2/radFiles/Glass_70.rad", "~/simulation/test_project2/radFiles/GlassWest_70.rad"}, selected=["~/simulation/test_project2/radFiles/GlassSouth_70.rad", "~/simulation/test_project2/radFiles/GlassWest_70.rad"])

button = Button()
panel_87 = Panel("""Int1
Int2
Ext1
Ext2""")
view = CreateView(Viewport=panel_87, Update=button)  # -> ViewfileContent, ImageRatio
panel_88 = Panel(view.ViewfileContent)

window_rads = Text(list_2)

# ----
# ground
panel_89 = Panel("""mkdir -p <proj>/radFiles/
echo "<gnd>" > <proj>/radFiles/<target>
echo <proj>/radFiles/<target>""")
panel_90 = Panel("""void plastic Ground

0

0

5 0.2 0.2 0.2 0.0 0.0

Ground polygon f_1_0
0
0
12
-172.195109 117.478512 -0.060960
-172.195109 -192.438001 -0.060960
226.699191 -192.438001 -0.060960
226.699191 117.478512 -0.060960""")
falsestart_5 = LBFalseStartToggle(False)
overrides_28 = ApplyOverrides(Input_=panel_89, Gnd=graft(panel_90), Target=graft("Ground.rad"))  # -> Output, Pairs
execute_ssh_async_26 = ExecuteSSHAsync(
    _SSHCommands_=overrides_28.Output,
    Run=falsestart_5,
    addPrefix=True,
    addSuffix=True,
    description="""mkdir -p ~/simulation/test_project2/radFiles/
echo "void plastic Ground

0

0

5 0.2 0.2 0.2 0.0 0.0

Ground polygon f_1_0
0
0
12
-172.195109 117.478512 -0.060960
-172.195109 -192.438001 -0.060960
226.699191 -192.438001 -0.060960
226.699191 117.478512 -0.060960" > ~/simulation/test_project2/radFiles/Ground.rad
echo ~/simulation/test_project2/radFiles/Ground.rad""",
    fireLogs=False,
    stdouts="/home/mss/simulation/test_project2/radFiles/Ground.rad",
    suppressWarnings=False)  # -> Stdout, Stderr_, Log, Pid, Ran
panel_91 = Panel(execute_ssh_async_26.Stdout)

# ----
# skyUp
panel_92 = Panel("""mkdir -p <proj>/views/
echo "<view>" > <proj>/views/<target>
echo <proj>/views/<target>""")
panel_93 = Panel("rvu -x 800 -y 800 -vd 0 0 1 -vv 180 -vh 180 -vp 0 0 0 -vu 0 1 0 -vth -vo 0 -va 0 -vs 0 -vl 0")
overrides_29 = ApplyOverrides(Input_=panel_92, View=graft(panel_93), Target=graft("skyUp.vf"))  # -> Output, Pairs
execute_ssh_async_27 = ExecuteSSHAsync(
    _SSHCommands_=overrides_29.Output,
    Run=falsestart_5,
    addPrefix=True,
    addSuffix=True,
    description="""mkdir -p ~/simulation/test_project2/views/
echo "rvu -x 800 -y 800 -vd 0 0 1 -vv 180 -vh 180 -vp 0 0 0 -vu 0 1 0 -vth -vo 0 -va 0 -vs 0 -vl 0" > ~/simulation/test_project2/views/skyUp.vf
echo ~/simulation/test_project2/views/skyUp.vf""",
    fireLogs=False,
    stdouts="/home/mss/simulation/test_project2/views/skyUp.vf",
    suppressWarnings=False)  # -> Stdout, Stderr_, Log, Pid, Ran
panel_94 = Panel(execute_ssh_async_27.Stdout)

# ----
# Visualize Sky (Sarith thesis appendix B)
# skydome
# vwrays views/skyUp.vf -x 300 -y 300 -pj 0.7 -c 9 -ff | rfluxmtx -ffc -v -n 16 `vwrays -vf views/skyUp.vf -x 300 -y 300 -d` -c 9  -ab 1 -ad 1000 -lw 0.001 -o mtxs/skyRenders/skyTregenza%04d.hdr - radFiles/skyglow.rad -i octrees/sky_mathias.oct
panel_95 = Panel("""#@rfluxmtx u=+Y h=u
void glow groundglow
0
0
4 1 1 1 0

groundglow source ground
0
0
4 0 0 -1 180

#@rfluxmtx u=+Y h=r1
void glow skyglow
0
0
4 1 1 1 0

skyglow source skydome
0
0
4 0 0 1 180""")
panel_96 = Panel("""mkdir -p <proj>/radFiles/
echo "<sky>" > <proj>/radFiles/<target>
echo <proj>/radFiles/<target>""")
overrides_30 = ApplyOverrides(Input_=panel_96, Sky=graft(panel_95), Target=graft("skyglow.rad"))  # -> Output, Pairs
execute_ssh_async_28 = ExecuteSSHAsync(
    _SSHCommands_=overrides_30.Output,
    Run=execute_ssh_async_26.Ran,
    addPrefix=True,
    addSuffix=True,
    description="""mkdir -p ~/simulation/test_project2/radFiles/
echo "#@rfluxmtx u=+Y h=u
void glow groundglow
0
0
4 1 1 1 0

groundglow source ground
0
0
4 0 0 -1 180

#@rfluxmtx u=+Y h=r1
void glow skyglow
0
0
4 1 1 1 0

skyglow source skydome
0
0
4 0 0 1 180" > ~/simulation/test_project2/radFiles/skyglow.rad
echo ~/simulation/test_project2/radFiles/skyglow.rad""",
    fireLogs=False,
    stdouts="/home/mss/simulation/test_project2/radFiles/skyglow.rad",
    suppressWarnings=False)  # -> Stdout, Stderr_, Log, Pid, Ran
falsestart_6 = LBFalseStartToggle(False)
execute_ssh_async_29 = ExecuteSSHAsync(
    _SSHCommands_="echo <proj>/radFiles/materials.rad",
    Run=falsestart_6,
    addPrefix=True,
    addSuffix=True,
    description="echo ~/simulation/test_project2/radFiles/materials.rad",
    fireLogs=False,
    stdouts="/home/mss/simulation/test_project2/radFiles/materials.rad",
    suppressWarnings=False)  # -> Stdout, Stderr_, Log, Pid, Ran
panel_97 = Panel("""mkdir -p <proj>/octrees/
oconv -f <mat> <rad> > <proj>/octrees/sky_mathias.oct
echo "<proj>/octrees/sky_mathias.oct"
""")
overrides_31 = ApplyOverrides(Input_=panel_97, Rad=graft(execute_ssh_async_26.Stdout), Mat=graft(execute_ssh_async_29.Stdout))  # -> Output, Pairs
panel_98 = Panel(overrides_31.Output)
execute_ssh_async_30 = ExecuteSSHAsync(
    _SSHCommands_=overrides_31.Output,
    Run=execute_ssh_async_26.Ran,
    addPrefix=True,
    addSuffix=True,
    description="""mkdir -p ~/simulation/test_project2/octrees/
oconv -f /home/mss/simulation/test_project2/radFiles/materials.rad /home/mss/simulation/test_project2/radFiles/Ground.rad > ~/simulation/test_project2/octrees/sky_mathias.oct
echo "~/simulation/test_project2/octrees/sky_mathias.oct"
""",
    fireLogs=False,
    stdouts="~/simulation/test_project2/octrees/sky_mathias.oct",
    suppressWarnings=False)  # -> Stdout, Stderr_, Log, Pid, Ran
panel_99 = Panel("""mkdir -p <proj>/mtxs/skyRenders/
cd <proj>
vwrays -vf <vf> -x <x> -y <y> -pj 0.7 -c 9 -ff | rfluxmtx -ffc -v -n 16 `vwrays -vf <vf> -x <x> -y <y> -d` -c 9  -ab 1 -ad 1000 -lw 0.001 -o <proj>/mtxs/skyRenders/skyTregenza%04d.hdr - <sky> -i <oct>""")
overrides_32 = ApplyOverrides(
    Input_=panel_99,
    Vf=graft(execute_ssh_async_27.Stdout),
    X=graft("300"),
    Y=graft("300"),
    Oct=graft(execute_ssh_async_30.Stdout),
    Sky=graft(execute_ssh_async_28.Stdout))  # -> Output, Pairs
panel_100 = Panel("mogrify -format png -resize 1500x1500 <proj>/mtxs/skyRenders/all.hdr;echo <proj>/mtxs/skyRenders/all.png")
execute_ssh_async_31 = ExecuteSSHAsync(
    _SSHCommands_=overrides_32.Output,
    Run=execute_ssh_async_30.Ran,
    addPrefix=True,
    addSuffix=True,
    description="""mkdir -p ~/simulation/test_project2/mtxs/skyRenders/
cd ~/simulation/test_project2
vwrays -vf /home/mss/simulation/test_project2/views/skyUp.vf -x 300 -y 300 -pj 0.7 -c 9 -ff | rfluxmtx -ffc -v -n 16 `vwrays -vf /home/mss/simulation/test_project2/views/skyUp.vf -x 300 -y 300 -d` -c 9  -ab 1 -ad 1000 -lw 0.001 -o ~/simulation/test_project2/mtxs/skyRenders/skyTregenza%04d.hdr - /home/mss/simulation/test_project2/radFiles/skyglow.rad -i ~/simulation/test_project2/octrees/sky_mathias.oct""",
    fireLogs=True,
    name="rfluxmtx to visualize the sky",
    suppressWarnings=True)  # -> Stdout, Stderr, Log, Pid, Ran
panel_101 = Panel("pcompos -a 15 -b 1 1 1 -s 5 <proj>/mtxs/skyRenders/skyTregenza*.hdr > <proj>/mtxs/skyRenders/all.hdr")
falsestart_7 = LBFalseStartToggle(False)
panel_102 = Panel("convert '<proj>/mtxs/skyRenders/skyTregenza????.hdr' sky_converted_%04d.png;echo <proj>/mtxs/skyRenders/")
panel_103 = Panel(execute_ssh_async_31.Stderr)
execute_ssh_async_32 = ExecuteSSHAsync(
    _SSHCommands_=panel_102,
    Run=[execute_ssh_async_31.Ran, falsestart_7],
    addPrefix=True,
    addSuffix=True,
    description="convert '~/simulation/test_project2/mtxs/skyRenders/skyTregenza????.hdr' sky_converted_%04d.png;echo ~/simulation/test_project2/mtxs/skyRenders/",
    fireLogs=False,
    stdouts="/home/mss/simulation/test_project2/mtxs/skyRenders/",
    suppressWarnings=False)  # -> Stdout, Stderr_, Log, Pid, Ran
execute_ssh_async_33 = ExecuteSSHAsync(
    _SSHCommands_=panel_101,
    Run=execute_ssh_async_31.Ran,
    addPrefix=True,
    addSuffix=True,
    description="pcompos -a 15 -b 1 1 1 -s 5 ~/simulation/test_project2/mtxs/skyRenders/skyTregenza*.hdr > ~/simulation/test_project2/mtxs/skyRenders/all.hdr",
    fireLogs=True,
    name="pcompos combine the sky views to a collage",
    staticDescription="pcompos -a 15 -b 1 1 1 -s 5 ~/simulation/test_project2/mtxs/skyRenders/skyTregenza*.hdr > ~/simulation/test_project2/mtxs/skyRenders/all.hdr",
    suppressWarnings=False)  # -> Stdout, Stderr_, Log, Pid, Ran
execute_ssh_async_34 = ExecuteSSHAsync(
    _SSHCommands_=panel_100,
    Run=execute_ssh_async_33.Ran,
    addPrefix=True,
    addSuffix=True,
    description="mogrify -format png -resize 1500x1500 ~/simulation/test_project2/mtxs/skyRenders/all.hdr;echo ~/simulation/test_project2/mtxs/skyRenders/all.png",
    fireLogs=False,
    stdouts="/home/mss/simulation/test_project2/mtxs/skyRenders/all.png",
    suppressWarnings=False)  # -> Stdout, Stderr_, Log, Pid, Ran
convertpaths_3 = ConvertPaths(I=execute_ssh_async_34.Stdout)  # -> Linux, Windows
imageviewer_4 = LBImageViewer(ImagePath_=convertpaths_3.Windows, _scale_=2, DisableClickable=False, SaveImgWithCoords=False, scale=2)  # -> ImagePath, Values, GIF

cached_results_from_amb_pos_lev1 = Panel("""-20235.7207	-21236.8496	3000
-27713.6855	-19984.041	-600
-25227.498	-20426.375	3000
-24839.8379	-21823.7402	3000
-19835.0898	-35555.3203	-2190
-14724.1777	-66234.7266	-6000
-22647.6523	-23338.9082	3000
-21681.6699	-19211.7129	3000
-16749.207	-44659.9844	-2190
-21867.5391	-18586.3789	3000
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""")
split = TextSplit(Text=cached_results_from_amb_pos_lev1)
python_5 = GhPythonScript(x=split)  # -> out, a
# ---------- python_5: Python ----------
__author__ = "mm1013"
__version__ = "2022.07.06"

import rhinoscriptsyntax as rs
a = x.split("\t")
# ---------- end python_5 ----------
item_2 = ListItem(List=python_5.a, Index=0, Wrap=True)  # -> Item, Item1, Item2
num = Number(item_2.Item)
pt_2 = ConstructPoint(XCoordinate=num, YCoordinate=item_2.Item1, ZCoordinate=item_2.Item2)

button_2 = Button()
view_names = Panel("P1")
view_2 = CreateView(Viewport=view_names, Update=button_2)  # -> ViewfileContent, ImageRatio
panel_104 = Panel("""mkdir -p <proj>/views/
echo "<vf>" > <proj>/views/<target>.vf
echo <proj>/views/<target>.vf""")
vf = Text(view_2.ViewfileContent)
overrides_33 = ApplyOverrides(Input=panel_104, Vf=graft(vf), Target=graft(view_names))  # -> Output, Pairs
file_exists = Panel("[ -f <out> ] && echo \"1\" || echo \"0\"")
execute_ssh_async_35 = ExecuteSSHAsync(
    _SSHCommands_=overrides_33.Output,
    Run=button_2,
    addPrefix=True,
    addSuffix=True,
    description="""mkdir -p ~/simulation/test_project2/views/
echo "rvu -vtv -vp -22628.9361776861 -19649.1284922488 4599.01771764096 -vd 0.135656474653245 -0.99040997675779 -0.0261801226751789 -vu 0.00355272087214904 -0.025937945132412 0.999657241846781 -vh 88.272 -vv 50.000" > ~/simulation/test_project2/views/P1.vf
echo ~/simulation/test_project2/views/P1.vf""",
    fireLogs=False,
    stdouts="/home/mss/simulation/test_project2/views/P1.vf",
    suppressWarnings=False)  # -> Stdout, Stderr_, Log, Pid, Ran
item_3 = ListItem(List=flatten(execute_ssh_async_35.Stdout), Index=0, Wrap=True)
panel_105 = Panel(execute_ssh_async_35.Stdout)
overrides_34 = ApplyOverrides(Input=file_exists, Out=graft(item_3))  # -> Output, Pairs
execute_ssh_async_36 = ExecuteSSHAsync(
    _SSHCommands_=overrides_34.Output,
    Run=execute_ssh_async_35.Ran,
    addPrefix=True,
    addSuffix=True,
    description="[ -f /home/mss/simulation/test_project2/views/P1.vf ] && echo \"1\" || echo \"0\"",
    fireLogs=False,
    stdouts="1",
    suppressWarnings=False)  # -> Stdout, Stderr_, Log, Pid, Ran

panel_106 = Panel("""mkdir -p <proj>/mtxs/3ph_view_<viewname>;
cd <proj>;
vwrays -vf <vf> -x <x> -y <y> -pj 0.7 -c 9 -ff | rfluxmtx -v -ffc `vwrays -vf <vf> -x <x> -y <y> -d` -o <proj>/mtxs/3ph_view_<viewname>/<windowgroup>_%03d.hdr <param> -c 9 -n <cpus> - <windowRad> -i <opaqueOctree>;
echo "<proj>/mtxs/3ph_view_<viewname>/<windowgroup>_%03d.hdr"
""")
panel_107 = Panel("""#@rfluxmtx h=r1 u=+Y
void glow sky_glow
0
0
4 1 1 1 0
sky_glow source sky
0
0
4 0 0 1 180
#@rfluxmtx h=u u=+Y
void glow ground_glow
0
0
4 1 1 1 0
ground_glow source ground
0
0
4 0 0 -1 180""")
panel_108 = Panel("""echo "<rfluxmtx>" > <windowRad-.>_rflux.rad
cat <windowRad> >> <windowRad-.>_rflux.rad
echo <windowRad-.>_rflux.rad""")
window_rads_2 = Text(window_rads)
vertical_glazing_rfluxmtx = Panel("#@rfluxmtx h=kf u=Z")

# ----
# Skyvector, point in time (m:1)
panel_109 = Panel("DNK_DRY_OFFICIAL_2001-2010_epw-fil.epw")
python_6 = GhPythonScript(filename=panel_109)  # -> local_path
# ---------- python_6: Python ----------
__author__ = "mm1013"
__version__ = "2022.08.16"

import rhinoscriptsyntax as rs
if filename is not None:
    local_path = "\\".join(ghdoc.Path.split("\\")[:-1]) + "\\" + filename
else:
    local_path = "\\".join(ghdoc.Path.split("\\")[:-1]) + "\\"
# ---------- end python_6 ----------
importepw = LBImportEPW(epw_file=python_6)  # -> location, dry_bulb_temperature, dew_point_temperature, relative_humidity, wind_speed, wind_direction, direct_normal_rad, diffuse_horizontal_rad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; plug-in component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
panel_110 = Panel("""mkdir -p <proj>/skyvectors
gensky <m> <d> <h>:00<ts> +s -a <lat> -o -<lon> | genskyvec -m 1 > <proj>/skyvectors/<prefix>_CIEs_<m2><d2><h2>.vec
echo "<proj>/skyvectors/<prefix>_CIEs_<m2><d2><h2>.vec"
""")
decnstrloc = LBDeconstructLocation(location=importepw.location)  # -> name, latitude, longitude, time_zone, elevation; plug-in component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
panel_111 = Panel(decnstrloc.longitude)
panel_112 = Panel(decnstrloc.latitude)
m = GhPythonScript(i="6")  # -> i1, i2; inputs i: Int32
# ---------- m: Python ----------
__author__ = "mm1013"
__version__ = "2022.08.21"

import rhinoscriptsyntax as rs

i1 = i
i2 = "%02d" % i
# ---------- end m ----------
d = GhPythonScript(i="21")  # -> i1, i2; inputs i: Int32; same code as m
h = GhPythonScript(i="15")  # -> i1, i2; inputs i: Int32; same code as m
overrides_35 = ApplyOverrides(
    Input_=panel_110,
    Lat=graft(panel_112),
    Lon=graft(panel_111),
    Prefix=graft("DNK"),
    M=graft(m.i1),
    M2=graft(m.i2),
    D=graft(d.i1),
    D2=graft(d.i2),
    H=graft(h.i1),
    H2=graft(h.i2),
    Ts=graft("CEST"))  # -> Output, Pairs
falsestart_8 = LBFalseStartToggle(True)
executessh_3 = ExecuteSSH(
    _SSHCommands_=overrides_35.Output,
    Run=falsestart_8,
    addPrefix=True,
    commands=""">JOIN<mkdir -p ~/simulation/test_project2/skyvectors
gensky 6 21 15:00CEST +s -a 55.8764 -o -12.4121 | genskyvec -m 1 > ~/simulation/test_project2/skyvectors/DNK_CIEs_062115.vec
echo "~/simulation/test_project2/skyvectors/DNK_CIEs_062115.vec"
""",
    description="""mkdir -p ~/simulation/test_project2/skyvectors
gensky 6 21 15:00CEST +s -a 55.8764 -o -12.4121 | genskyvec -m 1 > ~/simulation/test_project2/skyvectors/DNK_CIEs_062115.vec
echo "~/simulation/test_project2/skyvectors/DNK_CIEs_062115.vec"
""",
    fireLogs=False,
    lastRunTime=5.7673,
    results="~/simulation/test_project2/skyvectors/DNK_CIEs_062115.vec",
    stderr=">JOIN<>JOIN<>JOIN<>JOIN<>JOIN<>JOIN<>JOIN<>JOIN<>JOIN<>JOIN<>JOIN<>JOIN<>JOIN<>JOIN<>JOIN<>JOIN<>JOIN<>JOIN<>JOIN<",
    suppressWarnings=False)  # -> Stdout, Stderr_, Ran
panel_113 = Panel(executessh_3.Stdout)

panel_114 = Panel("""echo "<skyrad>" > <proj>/radFiles/skyglow_3ph.rad
echo "<proj>/radFiles/skyglow_3ph.rad"
""")
python_7 = GhPythonScript(x=window_rads_2)  # -> a
# ---------- python_7: Python ----------
__author__ = "mm1013"
__version__ = "2022.08.20"

import rhinoscriptsyntax as rs
a = ".".join(x.split("/")[-1].split(".")[:-1])
# ---------- end python_7 ----------
panel_115 = Panel(python_7)
# VIEWMATRIX
viewnames = Data(view_names)
overrides_36 = ApplyOverrides(Input_=panel_114, Skyrad=panel_107)  # -> Output, Pairs
falsestart_9 = LBFalseStartToggle(False)
falsestart_10 = LBFalseStartToggle(True)
crossref = CrossReference(ListA=viewnames, ListB=panel_115, CrossMode=1)  # -> ListA, ListB
crossref_2 = CrossReference(ListA=panel_105, ListB=window_rads_2, CrossMode=1)  # -> ListA, ListB
# Daylight matrix (exterior)
panel_116 = Panel("""mkdir -p <proj>/mtxs/3ph_view_<viewname>;
rfluxmtx -v -ff <param> -c 1000 -n <cpus> <receiver> <skyglow> -i <octree> > <proj>/mtxs/3ph_view_<viewname>/<receiverName>.dmx;echo "<proj>/mtxs/3ph_view_<viewname>/<receiverName>.dmx"
""")
executessh_4 = ExecuteSSH(
    _SSHCommands_=overrides_36.Output,
    Run=falsestart_10,
    addPrefix=True,
    commands=""">JOIN<echo "#@rfluxmtx h=r1 u=+Y
void glow sky_glow
0
0
4 1 1 1 0
sky_glow source sky
0
0
4 0 0 1 180
#@rfluxmtx h=u u=+Y
void glow ground_glow
0
0
4 1 1 1 0
ground_glow source ground
0
0
4 0 0 -1 180" > ~/simulation/test_project2/radFiles/skyglow_3ph.rad
echo "~/simulation/test_project2/radFiles/skyglow_3ph.rad"
""",
    description="""echo "#@rfluxmtx h=r1 u=+Y
void glow sky_glow
0
0
4 1 1 1 0
sky_glow source sky
0
0
4 0 0 1 180
#@rfluxmtx h=u u=+Y
void glow ground_glow
0
0
4 1 1 1 0
ground_glow source ground
0
0
4 0 0 -1 180" > ~/simulation/test_project2/radFiles/skyglow_3ph.rad
echo "~/simulation/test_project2/radFiles/skyglow_3ph.rad"
""",
    fireLogs=False,
    lastRunTime=5.6367,
    results="~/simulation/test_project2/radFiles/skyglow_3ph.rad",
    stderr=">JOIN<",
    suppressWarnings=False)  # -> Stdout, Stderr_, Ran
panel_117 = Panel(python_7)
viewnames_2 = Data(view_names)
falsestart_11 = LBFalseStartToggle(False)
panel_118 = Panel(executessh_4.Stdout)

panel_119 = Panel("""0
0
0
0
0
0
0
0
1
1
1
1
1
1
1
1
1
1
0
0
0
0
0
0""")
int = Integer(panel_119)
dup = DuplicateData(Data=int, Number="365", Order=True)

crossref_3 = CrossReference(ListA=viewnames_2, ListB=panel_117, CrossMode=1)  # -> ListA, ListB
falsestart_12 = LBFalseStartToggle(True)
python_8 = GhPythonScript(x=executessh_3.Stdout)  # -> flatten(a)
# ---------- python_8: Python ----------
__author__ = "mm1013"
__version__ = "2022.08.21"

import rhinoscriptsyntax as rs

a = x.split("/")[-1].split(".")[0]
# ---------- end python_8 ----------
# mkdir -p "<proj>/mtxs/3ph_view_<view>"
# dctimestep -h <vmx> <bsdf> <dmx> <sv> > "~/simulation/hi_<aperture>_<skyname>.hdr"
# echo "~/simulation/hi_<aperture>_<skyname>.hdr"
# rmtxop <vmx> <bsdf> <dmx> <smx> | rmtxop -fa -c 47.4 119.9 11.6 - > "<proj>/results/3ph_view_<view>"/<aperture>.ill
# "<proj>/results/3ph_view_<view>"
panel_120 = Panel("""mkdir -p "<proj>/mtxs/3ph_view_<view>"
dctimestep -h <vmx> <bsdf> <dmx> <sv> > "<proj>/mtxs/3ph_view_<view>/<aperture>_<skyname>.hdr"
echo "<proj>/mtxs/3ph_view_<view>/<aperture>_<skyname>.hdr"
""")
aperturename = Text(python_7)
viewnames_3 = Data(view_names)
skyvector = Text(executessh_3.Stdout)
skyname = Text(python_8)
viewfile = Text(execute_ssh_async_35.Stdout)
crossref_4 = CrossReference(ListA=panel_105, ListB=window_rads_2, CrossMode=1)  # -> ListA, ListB
falsestart_13 = LBFalseStartToggle(True)
panel_121 = Panel("""C:\Users\mm1013\simulation\test_project2\mtxs\3ph_view_P1\GlassSouth_70_DNK_CIEs_062115.hdr
C:\Users\mm1013\simulation\test_project2\mtxs\3ph_view_P1\GlassWest_70_DNK_CIEs_062115.hdr""")

# ----
# Testing one of the HDR images from the viewmtx.
# Remember our glow was set to 1,
# so the scale ranges from 0 to 1.0
number_slider = Slider(77, range=0..100)
expression = Expression(x=number_slider, Expression="Format(\"{0:000}\", x)")
panel_122 = Panel("C:\Users\mm1013\simulation\test_project2\mtxs\3ph_view_P1\GlassWest_70")
concat_3 = Concatenate(FragmentA=panel_122, FragmentB=expression, FragmentC=".hdr")
falsecolor = HBFalseColor(hdr=concat_3, max="1")  # -> hdr; plug-in component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
imageviewer_5 = LBImageViewer(ImagePath_=falsecolor, _scale_=1, DisableClickable=True, SaveImgWithCoords=False, scale=1)  # -> ImagePath, Values, GIF

panel_123 = Panel("""normtiff <file> <file-.>.tif
convert <file-.>.tif <file-.>.png
echo <file-.>.png""")

# ----
# Overview of all running tasks in linux
panel_124 = Panel("ps aux | grep '<AllRadProgs>'")

default = DefaultMSS(data=flatten(panel_124))
execute_ssh_async_37 = ExecuteSSHAsync(
    SSHCommands=default,
    Run=Toggle(True),
    addPrefix=True,
    addSuffix=True,
    description="ps aux | grep 'arch2rad\|bgraph\|cnt\|compamb\|cv\|dayfact\|dctimestep\|dgraph\|ev\|falsecolor\|fieldcomb\|findglare\|gcomp\|genblinds\|genbox\|genBSDF\|genclock\|genklemsamp\|genprism\|genrev\|gensky\|genskyvec\|gensurf\|genworm\|getbbox\|getinfo\|glare\|glarendx\|glrad\|histo\|icalc\|ies2rad\|igraph\|lampcolor\|libmeta.a\|lookamb\|macbethcal\|meta\|meta2bmp\|meta2tga\|metafile\|mgf2meta\|mgf2rad\|mkillum\|mksource\|neaten\|normpat\|normtiff\|obj2mesh\|obj2rad\|objline\|objview\|oconv\|pcomb\|pcompos\|pcond\|pdfblur\|pexpand\|pextrem\|pfilt\|pflip\|phisto\|pinterp\|pkgBSDF\|plotin\|pmblur\|pmdblur\|protate\|psign\|psmeta\|psort\|pvalue\|ra_bmp\|ra_gif\|ra_pict\|ra_ppm\|ra_ps\|ra_rgbe\|ra_t16\|ra_t8\|ra_tiff\|ra_xyze\|rad\|rad2mgf\|raddepend\|ran2tiff\|ranimate\|ranimove\|rcalc\|replmarks\|rhcopy\|rhinfo\|rholo\|rhoptimize\|rhpict\|rlam\|rpict\|rpiece\| rsensor \|rtcontrib\|rtrace\|rvu\|tabfunc\|tmesh2rad\|total\|trad\|ttyimage\|vwrays\|vwright\|x11meta\|xform\|xglaresrc\|ximage\|xshowtrace'",
    fireLogs=False,
    stdouts="""mss       3446  0.0  0.0   8620  3280 ?        Ss   21:30   0:00 bash -c export PATH=$PATH:/usr/local/radiance/bin;export RAYPATH=.:/usr/local/radiance/lib;export DISPLAY=$(ip route list default | awk '{print $3}'):0;export LIBGL_ALWAYS_INDIRECT=1;mkdir -p ~/simulation/test_project2/mtxs/3ph_view_P1; cd ~/simulation/test_project2; vwrays -vf /home/mss/simulation/test_project2/views/P1.vf -x 800 -y 600 -pj 0.7 -c 9 -ff | rfluxmtx -v -ffc `vwrays -vf /home/mss/simulation/test_project2/views/P1.vf -x 800 -y 600 -d` -o ~/simulation/test_project2/mtxs/3ph_view_P1/GlassSouth_70_%03d.hdr -ab 1 -ad 512 -lw 2e-4 -c 9 -n 11 - /home/mss/simulation/test_project2/radFiles/GlassSouth_70_rflux.rad -i /home/mss/simulation/test_project2/octrees/opaque_scene.oct; echo "~/simulation/test_project2/mtxs/3ph_view_P1/GlassSouth_70_%03d.hdr";echo _JOIN_;mkdir -p ~/simulation/test_project2/mtxs/3ph_view_P1; cd ~/simulation/test_project2; vwrays -vf /home/mss/simulation/test_project2/views/P1.vf -x 800 -y 600 -pj 0.7 -c 9 -ff | rfluxmtx -v -ffc `vwrays -vf /home/mss/simulation/test_project2/views/P1.vf -x 800 -y 600 -d` -o ~/simulation/test_project2/mtxs/3ph_view_P1/GlassWest_70_%03d.hdr -ab 1 -ad 512 -lw 2e-4 -c 9 -n 11 - /home/mss/simulation/test_project2/radFiles/GlassWest_70_rflux.rad -i /home/mss/simulation/test_project2/octrees/opaque_scene.oct; echo "~/simulation/test_project2/mtxs/3ph_view_P1/GlassWest_70_%03d.hdr"
mss       3468  0.6  0.0   3872   860 ?        S    21:39   0:00 vwrays -vf /home/mss/simulation/test_project2/views/P1.vf -x 800 -y 600 -pj 0.7 -c 9 -ff
mss       3469 22.1  0.0  19268 17304 ?        S    21:39   0:35 rcontrib -fo+ -o /home/mss/simulation/test_project2/mtxs/3ph_view_P1/GlassWest_70_%03d.hdr -ab 1 -ad 512 -lw 2e-4 -n 11 -x 800 -y 384 -ld- -ffc -c 9 -f klems_full.cal -p RHS=+1 -bn Nkbins -b kbin(0.798635,0.601815,-1.90446e-08,0,0,1) -m GlassWest_70_mat !oconv -f -i /home/mss/simulation/test_project2/octrees/opaque_scene.oct /home/mss/simulation/test_project2/radFiles/GlassWest_70_rflux.rad
mss       3473 96.9  0.0  17684 15204 ?        R    21:39   2:32 rcontrib -fo+ -o /home/mss/simulation/test_project2/mtxs/3ph_view_P1/GlassWest_70_%03d.hdr -ab 1 -ad 512 -lw 2e-4 -n 11 -x 800 -y 384 -ld- -ffc -c 9 -f klems_full.cal -p RHS=+1 -bn Nkbins -b kbin(0.798635,0.601815,-1.90446e-08,0,0,1) -m GlassWest_70_mat !oconv -f -i /home/mss/simulation/test_project2/octrees/opaque_scene.oct /home/mss/simulation/test_project2/radFiles/GlassWest_70_rflux.rad
mss       3474 96.0  0.0  17684 15204 ?        R    21:39   2:30 rcontrib -fo+ -o /home/mss/simulation/test_project2/mtxs/3ph_view_P1/GlassWest_70_%03d.hdr -ab 1 -ad 512 -lw 2e-4 -n 11 -x 800 -y 384 -ld- -ffc -c 9 -f klems_full.cal -p RHS=+1 -bn Nkbins -b kbin(0.798635,0.601815,-1.90446e-08,0,0,1) -m GlassWest_70_mat !oconv -f -i /home/mss/simulation/test_project2/octrees/opaque_scene.oct /home/mss/simulation/test_project2/radFiles/GlassWest_70_rflux.rad
mss       3475 95.8  0.0  17684 15204 ?        R    21:39   2:30 rcontrib -fo+ -o /home/mss/simulation/test_project2/mtxs/3ph_view_P1/GlassWest_70_%03d.hdr -ab 1 -ad 512 -lw 2e-4 -n 11 -x 800 -y 384 -ld- -ffc -c 9 -f klems_full.cal -p RHS=+1 -bn Nkbins -b kbin(0.798635,0.601815,-1.90446e-08,0,0,1) -m GlassWest_70_mat !oconv -f -i /home/mss/simulation/test_project2/octrees/opaque_scene.oct /home/mss/simulation/test_project2/radFiles/GlassWest_70_rflux.rad
mss       3476 96.1  0.0  17684 15204 ?        R    21:39   2:30 rcontrib -fo+ -o /home/mss/simulation/test_project2/mtxs/3ph_view_P1/GlassWest_70_%03d.hdr -ab 1 -ad 512 -lw 2e-4 -n 11 -x 800 -y 384 -ld- -ffc -c 9 -f klems_full.cal -p RHS=+1 -bn Nkbins -b kbin(0.798635,0.601815,-1.90446e-08,0,0,1) -m GlassWest_70_mat !oconv -f -i /home/mss/simulation/test_project2/octrees/opaque_scene.oct /home/mss/simulation/test_project2/radFiles/GlassWest_70_rflux.rad
mss       3477 96.2  0.0  17684 15152 ?        R    21:39   2:31 rcontrib -fo+ -o /home/mss/simulation/test_project2/mtxs/3ph_view_P1/GlassWest_70_%03d.hdr -ab 1 -ad 512 -lw 2e-4 -n 11 -x 800 -y 384 -ld- -ffc -c 9 -f klems_full.cal -p RHS=+1 -bn Nkbins -b kbin(0.798635,0.601815,-1.90446e-08,0,0,1) -m GlassWest_70_mat !oconv -f -i /home/mss/simulation/test_project2/octrees/opaque_scene.oct /home/mss/simulation/test_project2/radFiles/GlassWest_70_rflux.rad
mss       3478 96.5  0.0  17684 15108 ?        R    21:39   2:31 rcontrib -fo+ -o /home/mss/simulation/test_project2/mtxs/3ph_view_P1/GlassWest_70_%03d.hdr -ab 1 -ad 512 -lw 2e-4 -n 11 -x 800 -y 384 -ld- -ffc -c 9 -f klems_full.cal -p RHS=+1 -bn Nkbins -b kbin(0.798635,0.601815,-1.90446e-08,0,0,1) -m GlassWest_70_mat !oconv -f -i /home/mss/simulation/test_project2/octrees/opaque_scene.oct /home/mss/simulation/test_project2/radFiles/GlassWest_70_rflux.rad
mss       3479 96.6  0.0  17684 15100 ?        R    21:39   2:31 rcontrib -fo+ -o /home/mss/simulation/test_project2/mtxs/3ph_view_P1/GlassWest_70_%03d.hdr -ab 1 -ad 512 -lw 2e-4 -n 11 -x 800 -y 384 -ld- -ffc -c 9 -f klems_full.cal -p RHS=+1 -bn Nkbins -b kbin(0.798635,0.601815,-1.90446e-08,0,0,1) -m GlassWest_70_mat !oconv -f -i /home/mss/simulation/test_project2/octrees/opaque_scene.oct /home/mss/simulation/test_project2/radFiles/GlassWest_70_rflux.rad
mss       3480 96.8  0.0  17684 15152 ?        R    21:39   2:32 rcontrib -fo+ -o /home/mss/simulation/test_project2/mtxs/3ph_view_P1/GlassWest_70_%03d.hdr -ab 1 -ad 512 -lw 2e-4 -n 11 -x 800 -y 384 -ld- -ffc -c 9 -f klems_full.cal -p RHS=+1 -bn Nkbins -b kbin(0.798635,0.601815,-1.90446e-08,0,0,1) -m GlassWest_70_mat !oconv -f -i /home/mss/simulation/test_project2/octrees/opaque_scene.oct /home/mss/simulation/test_project2/radFiles/GlassWest_70_rflux.rad
mss       3481 96.7  0.0  17684 15152 ?        R    21:39   2:31 rcontrib -fo+ -o /home/mss/simulation/test_project2/mtxs/3ph_view_P1/GlassWest_70_%03d.hdr -ab 1 -ad 512 -lw 2e-4 -n 11 -x 800 -y 384 -ld- -ffc -c 9 -f klems_full.cal -p RHS=+1 -bn Nkbins -b kbin(0.798635,0.601815,-1.90446e-08,0,0,1) -m GlassWest_70_mat !oconv -f -i /home/mss/simulation/test_project2/octrees/opaque_scene.oct /home/mss/simulation/test_project2/radFiles/GlassWest_70_rflux.rad
mss       3482 96.8  0.0  17684 15152 ?        R    21:39   2:31 rcontrib -fo+ -o /home/mss/simulation/test_project2/mtxs/3ph_view_P1/GlassWest_70_%03d.hdr -ab 1 -ad 512 -lw 2e-4 -n 11 -x 800 -y 384 -ld- -ffc -c 9 -f klems_full.cal -p RHS=+1 -bn Nkbins -b kbin(0.798635,0.601815,-1.90446e-08,0,0,1) -m GlassWest_70_mat !oconv -f -i /home/mss/simulation/test_project2/octrees/opaque_scene.oct /home/mss/simulation/test_project2/radFiles/GlassWest_70_rflux.rad
mss       3483 96.6  0.0  17684 15152 ?        R    21:39   2:31 rcontrib -fo+ -o /home/mss/simulation/test_project2/mtxs/3ph_view_P1/GlassWest_70_%03d.hdr -ab 1 -ad 512 -lw 2e-4 -n 11 -x 800 -y 384 -ld- -ffc -c 9 -f klems_full.cal -p RHS=+1 -bn Nkbins -b kbin(0.798635,0.601815,-1.90446e-08,0,0,1) -m GlassWest_70_mat !oconv -f -i /home/mss/simulation/test_project2/octrees/opaque_scene.oct /home/mss/simulation/test_project2/radFiles/GlassWest_70_rflux.rad
mss       3491  0.0  0.0   8556  2656 ?        R    21:41   0:00 grep arch2rad\|bgraph\|cnt\|compamb\|cv\|dayfact\|dctimestep\|dgraph\|ev\|falsecolor\|fieldcomb\|findglare\|gcomp\|genblinds\|genbox\|genBSDF\|genclock\|genklemsamp\|genprism\|genrev\|gensky\|genskyvec\|gensurf\|genworm\|getbbox\|getinfo\|glare\|glarendx\|glrad\|histo\|icalc\|ies2rad\|igraph\|lampcolor\|libmeta.a\|lookamb\|macbethcal\|meta\|meta2bmp\|meta2tga\|metafile\|mgf2meta\|mgf2rad\|mkillum\|mksource\|neaten\|normpat\|normtiff\|obj2mesh\|obj2rad\|objline\|objview\|oconv\|pcomb\|pcompos\|pcond\|pdfblur\|pexpand\|pextrem\|pfilt\|pflip\|phisto\|pinterp\|pkgBSDF\|plotin\|pmblur\|pmdblur\|protate\|psign\|psmeta\|psort\|pvalue\|ra_bmp\|ra_gif\|ra_pict\|ra_ppm\|ra_ps\|ra_rgbe\|ra_t16\|ra_t8\|ra_tiff\|ra_xyze\|rad\|rad2mgf\|raddepend\|ran2tiff\|ranimate\|ranimove\|rcalc\|replmarks\|rhcopy\|rhinfo\|rholo\|rhoptimize\|rhpict\|rlam\|rpict\|rpiece\| rsensor \|rtcontrib\|rtrace\|rvu\|tabfunc\|tmesh2rad\|total\|trad\|ttyimage\|vwrays\|vwright\|x11meta\|xform\|xglaresrc\|ximage\|xshowtrace""",
    suppressWarnings=False)  # -> Stdout, Stderr, Log, Pid, Ran
panel_125 = Panel(execute_ssh_async_37.Stdout)

panel_126 = Panel("cat ~/.bashrc")  # disabled
panel_127 = Panel("dwd | tee ~/simulation/log.txt")  # disabled
falsestart_14 = LBFalseStartToggle(False)  # disabled

execute_ssh_async_38 = ExecuteSSHAsync(
    SSHCommands=[panel_126, panel_127],
    Run=falsestart_14,
    addPrefix=True,
    addSuffix=True,
    fireLogs=False,
    suppressWarnings=False)  # -> Stdout, Stderr, Log, Pid, Ran; disabled

panel_128 = Panel(execute_ssh_async_38.Stdout)  # disabled
panel_129 = Panel(execute_ssh_async_38.Log)  # disabled
panel_130 = Panel(execute_ssh_async_38.Stderr)  # disabled

# ----
# Check if ximage and other x-commands work.
# Must have Xlaunch running on windows with disabled access control
# Otherwise it will crash!
panel_131 = Panel("""export "DISPLAY=$(ip route list default | awk '{print $3}'):0"
export "LIBGL_ALWAYS_INDIRECT=1"
xclock""")
falsestart_15 = LBFalseStartToggle(False)

execute_ssh_async_39 = ExecuteSSHAsync(_SSHCommands_=panel_131, Run=falsestart_15, addPrefix=True, addSuffix=True, fireLogs=False, suppressWarnings=False)  # -> Stdout, Stderr_, Log, Pid, Ran
panel_132 = Panel(execute_ssh_async_39.Log)

panel_133 = Panel(execute_ssh_async_39.Stderr_)

# ----
# WEA file
# create WEA file
panel_134 = Panel("<LinuxHome>/weatherData")
path = FilePath("C:\Users\mm1013\Documents\Rhino setup\DNK_DRY_OFFICIAL_2001-2010_epw-fil.epw")
overrides_37 = ApplyOverrides(Input_=panel_134)  # -> Output, Pairs

python_9 = GhPythonScript(x=overrides_37.Output)  # -> a
# ---------- python_9: Python ----------
__author__ = "mm1013"
__version__ = "2022.07.02"

import rhinoscriptsyntax as rs

a = x[1:]
# ---------- end python_9 ----------

upload = Upload(
    LocalFilePaths=path,
    SubfolderOverride=python_9,
    Run=executessh.Ran,
    stdouts="~/simulation/weatherData/DNK_DRY_OFFICIAL_2001-2010_epw-fil.epw")  # -> Status, FilePaths, Run
overrides_38 = ApplyOverrides(Input_="epw2wea <epw> <epw-.>.wea 1>&2;echo <epw-.>.wea", Epw=graft(upload.FilePaths))  # -> Output, Pairs
execute_ssh_async_40 = ExecuteSSHAsync(
    _SSHCommands_=overrides_38.Output,
    Run=upload.Run,
    addPrefix=True,
    addSuffix=True,
    description="epw2wea ~/simulation/weatherData/DNK_DRY_OFFICIAL_2001-2010_epw-fil.epw ~/simulation/weatherData/DNK_DRY_OFFICIAL_2001-2010_epw-fil.wea 1>&2;echo ~/simulation/weatherData/DNK_DRY_OFFICIAL_2001-2010_epw-fil.wea",
    fireLogs=False,
    stdouts="/home/mss/simulation/weatherData/DNK_DRY_OFFICIAL_2001-2010_epw-fil.wea",
    suppressWarnings=True)  # -> Stdout, Stderr, Log, Pid, Ran
panel_135 = Panel(execute_ssh_async_40.Stdout)
panel_136 = Panel(execute_ssh_async_40.Stderr)
wea_file = Text(execute_ssh_async_40.Stdout)

# ----
# Get diffuseHorizontal from EPW
panel_137 = Panel("rcalc -t, -e '$1=$16' <epw>")
overrides_39 = ApplyOverrides(Input_=panel_137, Epw=graft(upload.FilePaths))  # -> Output, Pairs
execute_ssh_async_41 = ExecuteSSHAsync(
    _SSHCommands_=overrides_39.Output,
    Run=execute_ssh_async_40.Ran,
    addPrefix=True,
    addSuffix=True,
    description="rcalc -t, -e '$1=$16' ~/simulation/weatherData/DNK_DRY_OFFICIAL_2001-2010_epw-fil.epw",
    fireLogs=False,
    stdouts="""0
0
0
12
0
0
0
0
0
0
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""",
    suppressWarnings=True)  # -> Stdout, Stderr, Log, Pid, Ran
python_10 = GhPythonScript(inp=execute_ssh_async_41.Stdout)  # -> illum
# ---------- python_10: Python ----------
__author__ = "mm1013"
__version__ = "2022.07.04"

import rhinoscriptsyntax as rs

illum = [float(i) for i in inp.split("\n")][8:] #skipping headers
# ---------- end python_10 ----------

file_exists_2 = Panel("[ -f <out> ] && echo \"1\" || echo \"0\"")
panel_138 = Panel("out")  # disabled
applyglobals_5 = ApplyGlobals(Input=file_exists_2, AdditionalKeys=panel_138, AdditionalValues=execute_ssh_async_40.Stdout)  # -> Output, Pairs; disabled
execute_ssh_async_42 = ExecuteSSHAsync(
    SSHCommands=applyglobals_5.Output,
    Run=upload.Run,
    addPrefix=True,
    addSuffix=True,
    fireLogs=False,
    stdouts="1",
    suppressWarnings=False)  # -> Stdout, Stderr, Log, Pid, Ran; disabled

# ----
# broken
panel_139 = Panel("50")
python_11 = GhPythonScript(inp=python_10, threshold=panel_139)  # -> on_off_sorted, port, illum, hoys_sorted, illum_sorted, hoys; inputs inp: list; disabled
# ---------- python_11: Python ----------
__author__ = "mm1013"
__version__ = "2022.07.04"

import rhinoscriptsyntax as rs
illum = inp
hoys = range(len(illum))
hoys_sorted = [hoy for _, hoy in sorted(zip(illum, hoys))]
illum_sorted = [il for il, _ in sorted(zip(illum, hoys))]

thres = int(len(illum) * float(threshold) / 100.0)

off = [0] * thres
on = [1] * (len(illum) - thres)
off.extend(on)

on_off_sorted = [o for _, o in sorted(zip(hoys_sorted, off))]



hoys_ = sorted(hoys_sorted[thres:])
# ---------- end python_11 ----------

# ----
# EN17037 Schedule
cluster_4 = Cluster_2(horizontaldiffrad=python_10)

_3dchart = Ladybug_3DChart(inputData=flatten(cluster_4), xScale="0.25", zScale="0")  # -> readMe, graphMesh, graphCurves, legend, legendBasePts, title, titleBasePts, dataPts, conditionalHOY; disabled; plug-in component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
ladybug = Ladybug_Ladybug()  # -> Vviiiiiiiiiizzz; disabled; plug-in component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

# ----
# Annual sky-matrix 145 patches
panel_140 = Panel("gendaymtx -m 1 \"<wea>\" > <wea-.>_m1.smx;echo \"<wea-.>_m1.smx\"")
wea_file_2 = Text(wea_file)
overrides_40 = ApplyOverrides(Input=panel_140, Wea=graft(wea_file_2))  # -> Output, Pairs
execute_ssh_async_43 = ExecuteSSHAsync(
    _SSHCommands_=overrides_40.Output,
    Run=execute_ssh_async_40.Ran,
    addPrefix=True,
    addSuffix=True,
    description="gendaymtx -m 1 \"/home/mss/simulation/weatherData/DNK_DRY_OFFICIAL_2001-2010_epw-fil.wea\" > /home/mss/simulation/weatherData/DNK_DRY_OFFICIAL_2001-2010_epw-fil_m1.smx;echo \"/home/mss/simulation/weatherData/DNK_DRY_OFFICIAL_2001-2010_epw-fil_m1.smx\"",
    fireLogs=False,
    name="Sky 145 patch",
    stdouts="/home/mss/simulation/weatherData/DNK_DRY_OFFICIAL_2001-2010_epw-fil_m1.smx",
    suppressWarnings=False)  # -> Stdout, Stderr_, Log, Pid, Ran
panel_141 = Panel(execute_ssh_async_43.Stdout)

# ----
# Annual direct only daylight matrix with 145 patches
panel_142 = Panel("gendaymtx -m 1 -d \"<wea>\" > <wea-.>_d_m1.smx;echo \"<wea-.>_d_m1.smx\"")
wea_file_3 = Text(wea_file)
overrides_41 = ApplyOverrides(Input=panel_142, Wea=graft(wea_file_3))  # -> Output, Pairs
execute_ssh_async_44 = ExecuteSSHAsync(
    _SSHCommands_=overrides_41.Output,
    Run=execute_ssh_async_40.Ran,
    addPrefix=True,
    addSuffix=True,
    description="gendaymtx -m 1 -d \"/home/mss/simulation/weatherData/DNK_DRY_OFFICIAL_2001-2010_epw-fil.wea\" > /home/mss/simulation/weatherData/DNK_DRY_OFFICIAL_2001-2010_epw-fil_d_m1.smx;echo \"/home/mss/simulation/weatherData/DNK_DRY_OFFICIAL_2001-2010_epw-fil_d_m1.smx\"",
    fireLogs=False,
    name="Sky 145 patch direct only",
    stdouts="/home/mss/simulation/weatherData/DNK_DRY_OFFICIAL_2001-2010_epw-fil_d_m1.smx",
    suppressWarnings=False)  # -> Stdout, Stderr_, Log, Pid, Ran
panel_143 = Panel(execute_ssh_async_44.Stdout)

# ----
# Sun matrix with 5165 suns
panel_144 = Panel("gendaymtx -5 0.533 -d -m 6 \"<wea>\" > <wea-.>_d_m6.smx;echo \"<wea-.>_d_m6.smx\"")
wea_file_4 = Text(wea_file)
overrides_42 = ApplyOverrides(Input=panel_144, Wea=graft(wea_file_4))  # -> Output, Pairs
execute_ssh_async_45 = ExecuteSSHAsync(
    _SSHCommands_=overrides_42.Output,
    Run=execute_ssh_async_40.Ran,
    addPrefix=True,
    addSuffix=True,
    description="gendaymtx -5 0.533 -d -m 6 \"/home/mss/simulation/weatherData/DNK_DRY_OFFICIAL_2001-2010_epw-fil.wea\" > /home/mss/simulation/weatherData/DNK_DRY_OFFICIAL_2001-2010_epw-fil_d_m6.smx;echo \"/home/mss/simulation/weatherData/DNK_DRY_OFFICIAL_2001-2010_epw-fil_d_m6.smx\"",
    fireLogs=False,
    stdouts="/home/mss/simulation/weatherData/DNK_DRY_OFFICIAL_2001-2010_epw-fil_d_m6.smx",
    suppressWarnings=False)  # -> Stdout, Stderr_, Log, Pid, Ran
panel_145 = Panel(execute_ssh_async_45.Stdout)

# ----
# Construct BSDF file
octree_no_glass = Text(octree_2)
skymtx = Text(execute_ssh_async_43.Stdout)
window_mat_5 = Text(window_mat)
convertpaths_4 = ConvertPaths(I=flatten([list, window_mat_5]))  # -> Linux, Windows
radviewer_2 = RadViewer(
    RadFiles=flatten(convertpaths_4.Windows),
    IsTwoSided=False,
    Polychromatic=True,
    ShowEdges=True,
    Transparent=True,
    ColorNames=["blindmat", "GlassSouth_70_mat", "GlassWest_70_mat"],
    Colors=[RGB(201, 214, 143), RGB(117, 124, 152), RGB(211, 158, 127)])  # -> Geo, ModifierNames, Modifiers, FailedWireFrame
panel_146 = Panel(radviewer_2.ModifierNames)
panel_147 = Panel(radviewer_2.Modifiers)
panel_148 = Panel("""getbbox <rad>
getbbox -h <rad>""")
convertpaths_5 = ConvertPaths(I=executessh_2.Stdout)  # -> Linux, Windows
panel_149 = Panel(executessh_2.Stdout)
radviewer_3 = RadViewer(
    RadFiles=flatten(convertpaths_5.Windows),
    IsTwoSided=False,
    Polychromatic=True,
    ShowEdges=True,
    Transparent=True,
    ColorNames="blindmat",
    Colors=RGB(201, 214, 143))  # -> Geo, ModifierNames, Modifiers, FailedWireFrame
overrides_43 = ApplyOverrides(Input_=panel_148, Rad=graft(executessh_2.Stdout))  # -> Output, Pairs
executessh_5 = ExecuteSSH(
    _SSHCommands_=overrides_43.Output,
    Run=bool,
    addPrefix=True,
    description="""getbbox /home/mss/simulation/test_project2/radFiles/blinds_001.rad
getbbox -h /home/mss/simulation/test_project2/radFiles/blinds_001.rad""",
    fireLogs=False,
    lastRunTime=5,
    results="""     xmin      xmax      ymin      ymax      zmin      zmax
        0         1 0.0357143   1.99165     -0.15 -0.0748246
_JOIN_
        0         1 0.0357143   1.99165     -0.15 -0.0748246""",
    stderr=">JOIN<>JOIN<>JOIN<>JOIN<>JOIN<>JOIN<>JOIN<>JOIN<>JOIN<>JOIN<",
    suppressWarnings=False)  # -> Stdout, Stderr_, Ran
python_12 = GhPythonScript(l=executessh_5.Stdout)  # -> out, xmax, ymax; inputs l: list
# ---------- python_12: Python ----------
__author__ = "mm1013"
__version__ = "2022.08.20"

import rhinoscriptsyntax as rs
li = [s for s in l[1].split(" ") if len(s) > 0]
#print(li)
xmin, xmax, ymin, ymax, zmin, zmax = [float(v) for v in li]


if zmax > 0:
    print("Err, Zmax should be < 0!")
else:
    print("Zmax is OK (< 0)")
# ---------- end python_12 ----------
python_13 = GhPythonScript(l=executessh_5.Stdout)  # -> xmin, xmax, ymin, ymax, zmin; inputs l: list; same code as python_12
panel_150 = Panel(python_12.out)
panel_151 = Panel("""0.23
0.77""")
dom = ConstructDomain(DomainStart=python_13.xmin, DomainEnd=python_13.xmax)
dom_2 = ConstructDomain(DomainStart=python_13.ymin, DomainEnd=python_13.ymax)
panel_152 = Panel("echo \"<window>\" > <proj>/radFiles/BSDF_Geo_<name>.rad;echo <proj>/radFiles/BSDF_Geo_<name>.rad")
panel_153 = Panel("""<mat> polygon window
0
0
12 0 0 0
0 <y> 0
<x> <y> 0
<x> 0 0""")
remap = RemapNumbers(Value=panel_151, Source=Domain(0, 1), Target=dom)  # -> Mapped, Clipped
remap_2 = RemapNumbers(Value=panel_151, Source=Domain(0, 1), Target=dom_2)  # -> Mapped, Clipped
blinds_material = Panel("void plastic blindmat 0 0 5 .8 .8 .8 0 .01")
item_4 = ListItem(List=remap.Mapped, Index=0, Wrap=True)  # -> Item, Item1
item_5 = ListItem(List=remap_2.Mapped, Index=0, Wrap=True)  # -> Item, Item1
overrides_44 = ApplyOverrides(Input_=panel_153, Mat=graft(panel_146), X=graft(python_12.xmax), Y=graft(python_12.ymax))  # -> Output, Pairs
xstart = Number(item_4.Item)
xend = Number(item_4.Item1)
ystart = Number(item_5.Item)
yend = Number(item_5.Item1)
overrides_45 = ApplyOverrides(Input_=panel_152, Window=graft(overrides_44.Output), Name=graft(panel_146))  # -> Output, Pairs
concat_4 = Concatenate(FragmentA=panel_147, FragmentC=blinds_material)
panel_154 = Panel("echo \"<modifiers>\" > <proj>/radFiles/BSDF_Mods_<name>.rad;echo <proj>/radFiles/BSDF_Mods_<name>.rad")
executessh_6 = ExecuteSSH(
    _SSHCommands_=overrides_45.Output,
    Run=executessh_5.Ran,
    addPrefix=True,
    description="""echo "GlassSouth_70_mat polygon window
0
0
12 0 0 0
0 1.99165 0
1 1.99165 0
1 0 0" > ~/simulation/test_project2/radFiles/BSDF_Geo_GlassSouth_70_mat.rad;echo ~/simulation/test_project2/radFiles/BSDF_Geo_GlassSouth_70_mat.rad""",
    fireLogs=False,
    lastRunTime=17,
    results="/home/mss/simulation/test_project2/radFiles/BSDF_Geo_GlassSouth_70_mat.rad",
    stderr=">JOIN<",
    suppressWarnings=False)  # -> Stdout, Stderr_, Ran
overrides_46 = ApplyOverrides(
    Input_="-dim <xstart> <xend> <ystart> <yend> <zmin> 0",
    Xstart=graft(xstart),
    Xend=graft(xend),
    Ystart=graft(ystart),
    Yend=graft(yend),
    Zmin=graft(python_13.zmin))  # -> Output, Pairs
overrides_47 = ApplyOverrides(Input_=panel_154, Modifiers=graft(concat_4), Name=graft(panel_146))  # -> Output, Pairs
concat_5 = Concatenate(FragmentA="blinds_001", FragmentC="_", FragmentB=panel_146)
executessh_7 = ExecuteSSH(
    _SSHCommands_=overrides_47.Output,
    Run=executessh_5.Ran,
    addPrefix=True,
    description="""echo "void glass GlassSouth_70_mat
0
0
3
0.763 0.763 0.763
void plastic blindmat 0 0 5 .8 .8 .8 0 .01" > ~/simulation/test_project2/radFiles/BSDF_Mods_GlassSouth_70_mat.rad;echo ~/simulation/test_project2/radFiles/BSDF_Mods_GlassSouth_70_mat.rad""",
    fireLogs=False,
    lastRunTime=5,
    results="/home/mss/simulation/test_project2/radFiles/BSDF_Mods_GlassSouth_70_mat.rad",
    stderr=">JOIN<>JOIN<>JOIN<",
    suppressWarnings=False)  # -> Stdout, Stderr_, Ran
panel_155 = Panel("mkdir -p <proj>/BSDF;genBSDF -n 8 <dim> <radFiles> > <proj>/BSDF/<target>.xml;echo \"<proj>/BSDF/<target>.xml\"")
blindsgeo = Text(executessh_2.Stdout)
modifiers = Text(executessh_7.Stdout)
glassgeo = Text(executessh_6.Stdout)
merge = Merge(Data1=flatten(modifiers), Data2=flatten(blindsgeo), Data3=flatten(glassgeo))
join_7 = TextJoin(Text=merge, Join=" ")
overrides_48 = ApplyOverrides(Input_=panel_155, RadFiles=graft(join_7), Dim=graft(overrides_46.Output), Target=graft(concat_5))  # -> Output, Pairs
executessh_8 = ExecuteSSH(
    _SSHCommands=overrides_48.Output,
    Run=executessh_7.Ran,
    addPrefix=True,
    description="mkdir -p ~/simulation/test_project2/BSDF;genBSDF -n 8 -dim 0.23 0.77 0.48558 1.541785 -0.15 0 /home/mss/simulation/test_project2/radFiles/BSDF_Mods_GlassSouth_70_mat.rad /home/mss/simulation/test_project2/radFiles/blinds_001.rad /home/mss/simulation/test_project2/radFiles/BSDF_Geo_GlassSouth_70_mat.rad > ~/simulation/test_project2/BSDF/blinds_001_GlassSouth_70_mat.xml;echo \"~/simulation/test_project2/BSDF/blinds_001_GlassSouth_70_mat.xml\"",
    fireLogs=False,
    lastRunTime=129163,
    results="~/simulation/test_project2/BSDF/blinds_001_GlassSouth_70_mat.xml",
    stderr="""Recover using: /usr/local/radiance/bin/genBSDF -recover /tmp/genBSDF.dH95Nn
>JOIN<>JOIN<>JOIN<>JOIN<>JOIN<>JOIN<""",
    suppressWarnings=True)  # -> Stdout, Stderr, Ran
panel_156 = Panel(executessh_8.Stdout)

# ----
# Getting results (dctimestep)
# Results of daylight coefficients
# mkdir -p <proj>/results/
# dctimestep <dcillum> <skymtx> > <proj>/results/dctimestep_dcillum_skymtx.txt
panel_157 = Panel("""mkdir -p <proj>/results/
dctimestep <dcillum> <skymtx> | rmtxop -fa -t -c 47.4 119.9 11.6 - > <proj>/results/<target>;echo <proj>/results/<target>""")
overrides_49 = ApplyOverrides(
    Input=panel_157,
    Dcillum=graft(execute_ssh_async_23.Stdout),
    Skymtx=graft(execute_ssh_async_43.Stdout),
    Target=graft("annualR_DC.ill"))  # -> Output, Pairs
and_8 = GateAnd(A=execute_ssh_async_23.Ran, B=execute_ssh_async_43.Ran)
execute_ssh_async_46 = ExecuteSSHAsync(
    _SSHCommands_=overrides_49.Output,
    Run=and_8,
    addPrefix=True,
    addSuffix=True,
    description="mkdir -p ~/simulation/test_project2/results/;dctimestep /home/mss/simulation/test_project2/mtxs/dc_illum.mtx /home/mss/simulation/weatherData/DNK_DRY_OFFICIAL_2001-2010_epw-fil.smx | rmtxop -fa -t -c 47.4 119.9 11.6 - > ~/simulation/test_project2/results/annualR_DC.ill;echo ~/simulation/test_project2/results/annualR_DC.ill",
    fireLogs=False,
    stdouts="/home/mss/simulation/test_project2/results/annualR_DC.ill",
    suppressWarnings=False)  # -> Stdout, Stderr_, Log, Pid, Ran
panel_158 = Panel(overrides_49.Output)
panel_159 = Panel(execute_ssh_async_46.Stdout)

# ----
# - Results of daylight coefficients (direct from 145 sample sky)
dcillum = Text(execute_ssh_async_24.Stdout)
skymtx_2 = Text(execute_ssh_async_44.Stdout)
panel_160 = Panel("""mkdir -p <proj>/results/
dctimestep <dcillum> <skymtx> | rmtxop -fa -t -c 47.4 119.9 11.6 - > <proj>/results/<target>;echo <proj>/results/<target>""")
overrides_50 = ApplyOverrides(Input=panel_160, Dcillum=graft(dcillum), Skymtx=graft(skymtx_2), Target=graft("annualR_DCD.ill"))  # -> Output, Pairs
and_9 = GateAnd(A=execute_ssh_async_44.Ran, B=execute_ssh_async_24.Ran)
panel_161 = Panel(overrides_50.Output)
execute_ssh_async_47 = ExecuteSSHAsync(
    _SSHCommands_=overrides_50.Output,
    Run=and_9,
    addPrefix=True,
    addSuffix=True,
    description="mkdir -p ~/simulation/test_project2/results/;dctimestep /home/mss/simulation/test_project2/mtxs/dcd_illum.mtx /home/mss/simulation/weatherData/DNK_DRY_OFFICIAL_2001-2010_epw-fil_d_m1.smx | rmtxop -fa -t -c 47.4 119.9 11.6 - > ~/simulation/test_project2/results/annualR_DCD.ill;echo ~/simulation/test_project2/results/annualR_DCD.ill",
    fireLogs=True,
    name="Run dctimestep",
    staticDescription="used for direct sun check",
    stdouts="/home/mss/simulation/test_project2/results/annualR_DCD.ill",
    suppressWarnings=True)  # -> Stdout, Stderr, Log, Pid, Ran
panel_162 = Panel(execute_ssh_async_47.Stdout)

# ----
# Make sure zmax is below 0!
# Also pay attention to X/Y dims.
# Here ymax = 2 and xmax = 1
panel_163 = Panel(executessh_5.Stdout)

# ----
# + Results of direct sun coefficients (5165 sample sky)
panel_164 = Panel("""mkdir -p <proj>/results/
dctimestep <dcillum> <skymtx> | rmtxop -fa -t -c 47.4 119.9 11.6 - > <proj>/results/<target>;echo <proj>/results/<target>""")
m6_sky_mtx = Text(panel_145)
and_10 = GateAnd(A=execute_ssh_async_25.Ran, B=execute_ssh_async_45.Ran)
overrides_51 = ApplyOverrides(Input=panel_164, Dcillum=graft(execute_ssh_async_25.Stdout), Skymtx=graft(m6_sky_mtx), Target=graft("annualR_CDS.ill"))  # -> Output, Pairs
panel_165 = Panel(overrides_51.Output)
execute_ssh_async_48 = ExecuteSSHAsync(
    _SSHCommands_=overrides_51.Output,
    Run=and_10,
    addPrefix=True,
    addSuffix=True,
    fireLogs=True,
    name="Run dctimestep",
    staticDescription="used for direct sun check",
    suppressWarnings=True)  # -> Stdout, Stderr, Log, Pid, Ran
panel_166 = Panel(execute_ssh_async_48.Stdout)

panel_167 = Panel("head <ill> -n 13;echo \" \";echo \"Number of lines\";wc -l <ill>")
applyglobals_6 = ApplyGlobals(Input=panel_167, AdditionalKeys="ill", AdditionalValues=execute_ssh_async_46.Stdout)  # -> Output, Pairs
execute_ssh_async_49 = ExecuteSSHAsync(
    _SSHCommands_=applyglobals_6.Output,
    Run=execute_ssh_async_46.Ran,
    addPrefix=True,
    addSuffix=True,
    description="head /home/mss/simulation/test_project2/results/annualR_DC.ill -n 13;echo \" \";echo \"Number of lines\";wc -l /home/mss/simulation/test_project2/results/annualR_DC.ill",
    fireLogs=False,
    stdouts="""#?RADIANCE
rmtxop -fa -t -c 47.4 119.9 11.6 -
dctimestep /home/mss/simulation/test_project2/mtxs/dc_illum.mtx /home/mss/simulation/weatherData/DNK_DRY_OFFICIAL_2001-2010_epw-fil.smx
CAPDATE= 2022:08:18 07:22:23
GMT= 2022:08:18 05:22:23
Applied 1x3 matrix transform
Transposed rows and columns
NROWS=8760
NCOLS=199
NCOMP=1
FORMAT=ascii

 0.000000000000000e+00	 0.000000000000000e+00	 0.000000000000000e+00	 0.000000000000000e+00	 0.000000000000000e+00	 0.000000000000000e+00	 0.000000000000000e+00	 0.000000000000000e+00	 0.000000000000000e+00	 0.000000000000000e+00	 0.000000000000000e+00	 0.000000000000000e+00	 0.000000000000000e+00	 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
 
Number of lines
8772 /home/mss/simulation/test_project2/results/annualR_DC.ill""",
    suppressWarnings=False)  # -> Stdout, Stderr_, Log, Pid, Ran
panel_168 = Panel(execute_ssh_async_49.Stdout)

panel_169 = Panel("head <ill> -n 13;echo \" \";echo \"Number of lines\";wc -l <ill>")
overrides_52 = ApplyOverrides(Input=panel_169, Ill=graft(execute_ssh_async_47.Stdout))  # -> Output, Pairs
execute_ssh_async_50 = ExecuteSSHAsync(
    _SSHCommands_=overrides_52.Output,
    Run=execute_ssh_async_47.Ran,
    addPrefix=True,
    addSuffix=True,
    description="head /home/mss/simulation/test_project2/results/annualR_DCD.ill -n 13;echo \" \";echo \"Number of lines\";wc -l /home/mss/simulation/test_project2/results/annualR_DCD.ill",
    fireLogs=False,
    stdouts="""#?RADIANCE
rmtxop -fa -t -c 47.4 119.9 11.6 -
dctimestep /home/mss/simulation/test_project2/mtxs/dcd_illum.mtx /home/mss/simulation/weatherData/DNK_DRY_OFFICIAL_2001-2010_epw-fil_d_m1.smx
CAPDATE= 2022:08:18 07:16:30
GMT= 2022:08:18 05:16:30
Applied 1x3 matrix transform
Transposed rows and columns
NROWS=8760
NCOLS=274
NCOMP=1
FORMAT=ascii

 0.000000000000000e+00	 0.000000000000000e+00	 0.000000000000000e+00	 0.000000000000000e+00	 0.000000000000000e+00	 0.000000000000000e+00	 0.000000000000000e+00	 0.000000000000000e+00	 0.000000000000000e+00	 0.000000000000000e+00	 0.000000000000000e+00	 0.000000000000000e+00	 0.000000000000000e+00	 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
 
Number of lines
8772 /home/mss/simulation/test_project2/results/annualR_DCD.ill""",
    suppressWarnings=False)  # -> Stdout, Stderr_, Log, Pid, Ran
panel_170 = Panel(execute_ssh_async_50.Stdout)

panel_171 = Panel("head <ill> -n 13;echo \" \";echo \"Number of lines\";wc -l <ill>")
overrides_53 = ApplyOverrides(Input=panel_171, Ill=graft(execute_ssh_async_48.Stdout))  # -> Output, Pairs
execute_ssh_async_51 = ExecuteSSHAsync(
    _SSHCommands_=overrides_53.Output,
    Run=execute_ssh_async_48.Ran,
    addPrefix=True,
    addSuffix=True,
    description="head /home/mss/simulation/test_project2/results/annualR_DCD.ill -n 13;echo \" \";echo \"Number of lines\";wc -l /home/mss/simulation/test_project2/results/annualR_DCD.ill",
    fireLogs=True,
    name="Run dctimestep",
    staticDescription="used for direct sun check",
    stdouts="""#?RADIANCE
rmtxop -fa -t -c 47.4 119.9 11.6 -
dctimestep /home/mss/simulation/test_project2/mtxs/dcd_illum.mtx /home/mss/simulation/weatherData/DNK_DRY_OFFICIAL_2001-2010_epw-fil_d_m1.smx
CAPDATE= 2022:08:18 07:19:57
GMT= 2022:08:18 05:19:57
Applied 1x3 matrix transform
Transposed rows and columns
NROWS=8760
NCOLS=274
NCOMP=1
FORMAT=ascii

 0.000000000000000e+00	 0.000000000000000e+00	 0.000000000000000e+00	 0.000000000000000e+00	 0.000000000000000e+00	 0.000000000000000e+00	 0.000000000000000e+00	 0.000000000000000e+00	 0.000000000000000e+00	 0.000000000000000e+00	 0.000000000000000e+00	 0.000000000000000e+00	 0.000000000000000e+00	 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
 
Number of lines
8772 /home/mss/simulation/test_project2/results/annualR_DCD.ill""",
    suppressWarnings=True)  # -> Stdout, Stderr, Log, Pid, Ran
panel_172 = Panel(execute_ssh_async_51.Stderr)

panel_173 = Panel(execute_ssh_async_48.Stderr)

# ----
# final step: Combine results
panel_174 = Panel("""export PATH=$PATH.:/usr/local/radiance/bin
export RAYPATH=.:/usr/local/radiance/lib
rmtxop <DCannualR> + -s -1 <DCDannualR> + <CDSannualR> > <proj>/results/<target>;echo <proj>/results/<target>""")
falsestart_16 = LBFalseStartToggle(False)
and_11 = GateAnd(A=execute_ssh_async_46.Ran, B=execute_ssh_async_47.Ran, C=execute_ssh_async_48.Ran)
overrides_54 = ApplyOverrides(
    Input_=panel_174,
    DCannualR=graft(execute_ssh_async_46.Stdout),
    DCDannualR=graft(execute_ssh_async_47.Stdout),
    CDSannualR=graft(execute_ssh_async_48.Stdout),
    Target=graft("DDS_Total.ill"))  # -> Output, Pairs
or = GateOr(A=and_11, B=falsestart_16)
execute_ssh_async_52 = ExecuteSSHAsync(
    _SSHCommands_=overrides_54.Output,
    Run=or,
    addPrefix=True,
    addSuffix=True,
    fireLogs=True,
    name="Combine mtxs (DC-DCD+CDS)",
    suppressWarnings=False)  # -> Stdout, Stderr_, Log, Pid, Ran
panel_175 = Panel(overrides_54.Output)
panel_176 = Panel(execute_ssh_async_52.Stdout)

txt = Text(panel_146)
overrides_55 = ApplyOverrides(Input_="void glow <windowMod> 0 0 4 1 1 1 0", WindowMod=graft(txt))  # -> Output, Pairs
concat_6 = Concatenate(FragmentA=overrides_55.Output, FragmentB=vertical_glazing_rfluxmtx)
overrides_56 = ApplyOverrides(Input_=panel_108, Rfluxmtx=graft(concat_6), WindowRad=graft(window_rads_2))  # -> flatten(Output), Pairs
octree_no_glass_2 = Text(octree_no_glass)
executessh_9 = ExecuteSSH(
    _SSHCommands_=overrides_56.Output,
    Run=falsestart_9,
    addPrefix=True,
    commands=""">JOIN<echo "void glow GlassSouth_70_mat 0 0 4 1 1 1 0
#@rfluxmtx h=kf u=Z" > ~/simulation/test_project2/radFiles/GlassSouth_70_rflux.rad
cat ~/simulation/test_project2/radFiles/GlassSouth_70.rad >> ~/simulation/test_project2/radFiles/GlassSouth_70_rflux.rad
echo ~/simulation/test_project2/radFiles/GlassSouth_70_rflux.rad>JOIN<echo "void glow GlassSouth_70_mat 0 0 4 1 1 1 0
#@rfluxmtx h=kf u=Z" > ~/simulation/test_project2/radFiles/GlassWest_70_rflux.rad
cat ~/simulation/test_project2/radFiles/GlassWest_70.rad >> ~/simulation/test_project2/radFiles/GlassWest_70_rflux.rad
echo ~/simulation/test_project2/radFiles/GlassWest_70_rflux.rad""",
    description="""echo "void glow GlassSouth_70_mat 0 0 4 1 1 1 0
#@rfluxmtx h=kf u=Z" > ~/simulation/test_project2/radFiles/GlassSouth_70_rflux.rad
cat ~/simulation/test_project2/radFiles/GlassSouth_70.rad >> ~/simulation/test_project2/radFiles/GlassSouth_70_rflux.rad
echo ~/simulation/test_project2/radFiles/GlassSouth_70_rflux.rad
echo "void glow GlassSouth_70_mat 0 0 4 1 1 1 0
#@rfluxmtx h=kf u=Z" > ~/simulation/test_project2/radFiles/GlassWest_70_rflux.rad
cat ~/simulation/test_project2/radFiles/GlassWest_70.rad >> ~/simulation/test_project2/radFiles/GlassWest_70_rflux.rad
echo ~/simulation/test_project2/radFiles/GlassWest_70_rflux.rad""",
    fireLogs=False,
    lastRunTime=8.7231,
    results="""/home/mss/simulation/test_project2/radFiles/GlassSouth_70_rflux.rad
_JOIN_
/home/mss/simulation/test_project2/radFiles/GlassWest_70_rflux.rad""",
    stderr=">JOIN<>JOIN<>JOIN<>JOIN<",
    suppressWarnings=False)  # -> Stdout, Stderr_, Ran
crossref_5 = CrossReference(ListA=viewnames, ListB=executessh_9.Stdout, CrossMode=1)  # -> ListA, ListB
# mkdir -p ~/simulation/test_project2/mtxs/3ph_view_P1
# cd ~/simulation/test_project2
# vwrays -vf views/P1.vf -x 1000 -y 800 -pj 0.7 -c 9 -ff | rfluxmtx -v -ffc `vwrays -vf views/P1.vf -x 1000 -y 800 -d` -o mtxs/3ph_view_P1/GlassWest_70%03d.hdr -ab 2 -ad 2000 -lw 0.5e-4 -c 9 -n 5 - radFiles/GlassWest_70_rflux.rad -i octrees/opaque_scene.oct
overrides_57 = ApplyOverrides(
    Input_=panel_106,
    Viewname=graft(crossref.ListA),
    Windowgroup=graft(crossref.ListB),
    Vf=graft(crossref_2.ListA),
    X=graft("600"),
    Y=graft("400"),
    WindowRad=graft(crossref_5.ListB),
    OpaqueOctree=graft(octree_no_glass_2),
    Param="-ab 1 -ad 512 -lw 2e-4")  # -> flatten(Output), Pairs
panel_177 = Panel(executessh_9.Stdout)
executessh_10 = ExecuteSSH(
    _SSHCommands_=overrides_57.Output,
    Run=falsestart_11,
    addPrefix=True,
    commands=""">JOIN<mkdir -p ~/simulation/test_project2/mtxs/3ph_view_P1;
cd ~/simulation/test_project2;
vwrays -vf /home/mss/simulation/test_project2/views/P1.vf -x 600 -y 400 -pj 0.7 -c 9 -ff | rfluxmtx -v -ffc `vwrays -vf /home/mss/simulation/test_project2/views/P1.vf -x 600 -y 400 -d` -o ~/simulation/test_project2/mtxs/3ph_view_P1/GlassSouth_70_%03d.hdr -ab 1 -ad 512 -lw 2e-4 -c 9 -n 11 - /home/mss/simulation/test_project2/radFiles/GlassSouth_70_rflux.rad -i /home/mss/simulation/test_project2/octrees/opaque_scene.oct;
echo "~/simulation/test_project2/mtxs/3ph_view_P1/GlassSouth_70_%03d.hdr">JOIN<mkdir -p ~/simulation/test_project2/mtxs/3ph_view_P1;
cd ~/simulation/test_project2;
vwrays -vf /home/mss/simulation/test_project2/views/P1.vf -x 600 -y 400 -pj 0.7 -c 9 -ff | rfluxmtx -v -ffc `vwrays -vf /home/mss/simulation/test_project2/views/P1.vf -x 600 -y 400 -d` -o ~/simulation/test_project2/mtxs/3ph_view_P1/GlassWest_70_%03d.hdr -ab 1 -ad 512 -lw 2e-4 -c 9 -n 11 - /home/mss/simulation/test_project2/radFiles/GlassWest_70_rflux.rad -i /home/mss/simulation/test_project2/octrees/opaque_scene.oct;
echo "~/simulation/test_project2/mtxs/3ph_view_P1/GlassWest_70_%03d.hdr"
""",
    description="""mkdir -p ~/simulation/test_project2/mtxs/3ph_view_P1;
cd ~/simulation/test_project2;
vwrays -vf /home/mss/simulation/test_project2/views/P1.vf -x 600 -y 400 -pj 0.7 -c 9 -ff | rfluxmtx -v -ffc `vwrays -vf /home/mss/simulation/test_project2/views/P1.vf -x 600 -y 400 -d` -o ~/simulation/test_project2/mtxs/3ph_view_P1/GlassSouth_70_%03d.hdr -ab 1 -ad 512 -lw 2e-4 -c 9 -n 11 - /home/mss/simulation/test_project2/radFiles/GlassSouth_70_rflux.rad -i /home/mss/simulation/test_project2/octrees/opaque_scene.oct;
echo "~/simulation/test_project2/mtxs/3ph_view_P1/GlassSouth_70_%03d.hdr"
mkdir -p ~/simulation/test_project2/mtxs/3ph_view_P1;
cd ~/simulation/test_project2;
vwrays -vf /home/mss/simulation/test_project2/views/P1.vf -x 600 -y 400 -pj 0.7 -c 9 -ff | rfluxmtx -v -ffc `vwrays -vf /home/mss/simulation/test_project2/views/P1.vf -x 600 -y 400 -d` -o ~/simulation/test_project2/mtxs/3ph_view_P1/GlassWest_70_%03d.hdr -ab 1 -ad 512 -lw 2e-4 -c 9 -n 11 - /home/mss/simulation/test_project2/radFiles/GlassWest_70_rflux.rad -i /home/mss/simulation/test_project2/octrees/opaque_scene.oct;
echo "~/simulation/test_project2/mtxs/3ph_view_P1/GlassWest_70_%03d.hdr"
""",
    fireLogs=False,
    lastRunTime=515215.031,
    results="""~/simulation/test_project2/mtxs/3ph_view_P1/GlassSouth_70_%03d.hdr
_JOIN_
~/simulation/test_project2/mtxs/3ph_view_P1/GlassWest_70_%03d.hdr""",
    stderr="""rfluxmtx: running: rcontrib -fo+ -o /home/mss/simulation/test_project2/mtxs/3ph_view_P1/GlassSouth_70_%03d.hdr -ab 1 -ad 512 -lw 2e-4 -n 11 -x 600 -y 288 -ld- -ffc -c 9 -f klems_full.cal -p RHS=+1 -bn Nkbins -b 'kbin(0.601817,-0.798634,0,0,0,1)' -m GlassSouth_70_mat '!oconv -f -i /home/mss/simulation/test_project2/octrees/opaque_scene.oct /home/mss/simulation/test_project2/radFiles/GlassSouth_70_rflux.rad'
rcontrib: warning - non-planar vertex for polygon "Ceiling_0.7_1.40"
rcontrib: warning - non-planar vertex for polygon "Ceiling_0.7_1.62"
rcontrib: warning - non-planar vertex for polygon "Floor_0.2_1.170"
rcontrib: warning - non-planar vertex for polygon "Floor_0.2_1.174"
rcontrib: warning - non-planar vertex for polygon "Floor_0.2_1.176"
rcontrib: warning - non-planar vertex for polygon "Floor_0.2_1.192"
rcontrib: warning - non-planar vertex for polygon "Floor_0.2_1.193"
rcontrib: warning - non-planar vertex for polygon "Floor_0.2_1.195"
rcontrib: warning - non-planar vertex for polygon "Wall_0.5_1.3720"
rcontrib: warning - non-planar vertex for polygon "Frames_0.7_1.580"
rcontrib: warning - non-planar vertex for polygon "Frames_0.7_1.6150"
rcontrib: warning - non-planar vertex for polygon "Frames_0.7_1.6158"
rcontrib: warning - non-planar vertex for polygon "Frames_0.7_1.6221"
rcontrib: warning - non-planar vertex for polygon "Frames_0.7_1.6228"
rcontrib: warning - non-planar vertex for polygon "Frames_0.7_1.6276"
rfluxmtx: running: rcontrib -fo+ -o /home/mss/simulation/test_project2/mtxs/3ph_view_P1/GlassWest_70_%03d.hdr -ab 1 -ad 512 -lw 2e-4 -n 11 -x 600 -y 288 -ld- -ffc -c 9 -f klems_full.cal -p RHS=+1 -bn Nkbins -b 'kbin(0.798635,0.601815,-1.90446e-08,0,0,1)' -m GlassWest_70_mat '!oconv -f -i /home/mss/simulation/test_project2/octrees/opaque_scene.oct /home/mss/simulation/test_project2/radFiles/GlassWest_70_rflux.rad'
rcontrib: warning - non-planar vertex for polygon "Ceiling_0.7_1.40"
rcontrib: warning - non-planar vertex for polygon "Ceiling_0.7_1.62"
rcontrib: warning - non-planar vertex for polygon "Floor_0.2_1.170"
rcontrib: warning - non-planar vertex for polygon "Floor_0.2_1.174"
rcontrib: warning - non-planar vertex for polygon "Floor_0.2_1.176"
rcontrib: warning - non-planar vertex for polygon "Floor_0.2_1.192"
rcontrib: warning - non-planar vertex for polygon "Floor_0.2_1.193"
rcontrib: warning - non-planar vertex for polygon "Floor_0.2_1.195"
rcontrib: warning - non-planar vertex for polygon "Wall_0.5_1.3720"
rcontrib: warning - non-planar vertex for polygon "Frames_0.7_1.580"
rcontrib: warning - non-planar vertex for polygon "Frames_0.7_1.6150"
rcontrib: warning - non-planar vertex for polygon "Frames_0.7_1.6158"
rcontrib: warning - non-planar vertex for polygon "Frames_0.7_1.6221"
rcontrib: warning - non-planar vertex for polygon "Frames_0.7_1.6228"
rcontrib: warning - non-planar vertex for polygon "Frames_0.7_1.6276"
>JOIN<>JOIN<>JOIN<>JOIN<>JOIN<>JOIN<>JOIN<>JOIN<>JOIN<>JOIN<>JOIN<>JOIN<>JOIN<>JOIN<>JOIN<>JOIN<>JOIN<>JOIN<>JOIN<>JOIN<>JOIN<>JOIN<>JOIN<>JOIN<>JOIN<>JOIN<>JOIN<>JOIN<>JOIN<>JOIN<>JOIN<>JOIN<>JOIN<>JOIN<>JOIN<>JOIN<>JOIN<>JOIN<>JOIN<""",
    suppressWarnings=False)  # -> Stdout, Stderr_, Ran
crossref_6 = CrossReference(ListA=viewnames_2, ListB=executessh_9.Stdout, CrossMode=1)  # -> ListA, ListB
octree_no_glass_3 = Text(octree_no_glass)
overrides_58 = ApplyOverrides(Input_="head <file> -n 6", File=graft(executessh_9.Stdout))  # -> flatten(Output), Pairs
executessh_11 = ExecuteSSH(
    _SSHCommands_=overrides_58.Output,
    Run=executessh_9.Ran,
    addPrefix=True,
    commands=">JOIN<head /home/mss/simulation/test_project2/radFiles/GlassSouth_70_rflux.rad -n 6>JOIN<head /home/mss/simulation/test_project2/radFiles/GlassWest_70_rflux.rad -n 6",
    description="""head /home/mss/simulation/test_project2/radFiles/GlassSouth_70_rflux.rad -n 6
head /home/mss/simulation/test_project2/radFiles/GlassWest_70_rflux.rad -n 6""",
    fireLogs=False,
    lastRunTime=5.8728,
    results="""void glow GlassSouth_70_mat 0 0 4 1 1 1 0
#@rfluxmtx h=kf u=Z
# obj2rad -m /home/mss/simulation/test_project2/radFiles/mapping_windows.map -f /home/mss/simulation/test_project2/radFiles/GlassSouth_70.obj
# Written with MantaRay plugin/GH_MeshToRad

GlassSouth_70_mat polygon GlassSouth_70_1.1
_JOIN_
void glow GlassWest_70_mat 0 0 4 1 1 1 0
#@rfluxmtx h=kf u=Z
# obj2rad -m /home/mss/simulation/test_project2/radFiles/mapping_windows.map -f /home/mss/simulation/test_project2/radFiles/GlassWest_70.obj
# Written with MantaRay plugin/GH_MeshToRad

GlassWest_70_mat polygon GlassWest_70_1.1""",
    stderr=">JOIN<>JOIN<>JOIN<>JOIN<>JOIN<>JOIN<",
    suppressWarnings=False)  # -> Stdout, Stderr_, Ran
hi_res_override = Panel(executessh_10.Stdout)
overrides_59 = ApplyOverrides(
    Input_=panel_116,
    Param=graft("-ab 2 -ad 512 -lw 2e-4"),
    Viewname=graft(crossref_3.ListA),
    Receiver=graft(crossref_6.ListB),
    ReceiverName=graft(crossref_3.ListB),
    Octree=graft(octree_no_glass_3),
    Skyglow=graft(panel_118))  # -> flatten(Output), Pairs
panel_178 = Panel(executessh_11.Stdout)
executessh_12 = ExecuteSSH(
    _SSHCommands_=overrides_59.Output,
    Run=falsestart_12,
    addPrefix=True,
    commands=""">JOIN<mkdir -p ~/simulation/test_project2/mtxs/3ph_view_P1;
rfluxmtx -v -ff -ab 2 -ad 512 -lw 2e-4 -c 1000 -n 11 /home/mss/simulation/test_project2/radFiles/GlassSouth_70_rflux.rad ~/simulation/test_project2/radFiles/skyglow_3ph.rad -i /home/mss/simulation/test_project2/octrees/opaque_scene.oct > ~/simulation/test_project2/mtxs/3ph_view_P1/GlassSouth_70.dmx;echo "~/simulation/test_project2/mtxs/3ph_view_P1/GlassSouth_70.dmx">JOIN<mkdir -p ~/simulation/test_project2/mtxs/3ph_view_P1;
rfluxmtx -v -ff -ab 2 -ad 512 -lw 2e-4 -c 1000 -n 11 /home/mss/simulation/test_project2/radFiles/GlassWest_70_rflux.rad ~/simulation/test_project2/radFiles/skyglow_3ph.rad -i /home/mss/simulation/test_project2/octrees/opaque_scene.oct > ~/simulation/test_project2/mtxs/3ph_view_P1/GlassWest_70.dmx;echo "~/simulation/test_project2/mtxs/3ph_view_P1/GlassWest_70.dmx"
""",
    description="""mkdir -p ~/simulation/test_project2/mtxs/3ph_view_P1;
rfluxmtx -v -ff -ab 2 -ad 512 -lw 2e-4 -c 1000 -n 11 /home/mss/simulation/test_project2/radFiles/GlassSouth_70_rflux.rad ~/simulation/test_project2/radFiles/skyglow_3ph.rad -i /home/mss/simulation/test_project2/octrees/opaque_scene.oct > ~/simulation/test_project2/mtxs/3ph_view_P1/GlassSouth_70.dmx;echo "~/simulation/test_project2/mtxs/3ph_view_P1/GlassSouth_70.dmx"
mkdir -p ~/simulation/test_project2/mtxs/3ph_view_P1;
rfluxmtx -v -ff -ab 2 -ad 512 -lw 2e-4 -c 1000 -n 11 /home/mss/simulation/test_project2/radFiles/GlassWest_70_rflux.rad ~/simulation/test_project2/radFiles/skyglow_3ph.rad -i /home/mss/simulation/test_project2/octrees/opaque_scene.oct > ~/simulation/test_project2/mtxs/3ph_view_P1/GlassWest_70.dmx;echo "~/simulation/test_project2/mtxs/3ph_view_P1/GlassWest_70.dmx"
""",
    fireLogs=False,
    lastRunTime=83503.4549,
    results="""~/simulation/test_project2/mtxs/3ph_view_P1/GlassSouth_70.dmx
_JOIN_
~/simulation/test_project2/mtxs/3ph_view_P1/GlassWest_70.dmx""",
    stderr="""rfluxmtx: opening pipe to: rcontrib -fo+ -ab 2 -ad 512 -lw 2e-4 -n 11 -fdf -c 1000 -f reinhartb.cal -p MF=1,rNx=0,rNy=0,rNz=-1,Ux=0,Uy=1,Uz=0,RHS=+1 -bn Nrbins -b rbin -m sky_glow -bn 1 -b 'if(-Dx*0-Dy*0-Dz*1,0,-1)' -m ground_glow -y 145 '!oconv -f -i /home/mss/simulation/test_project2/octrees/opaque_scene.oct /home/mss/simulation/test_project2/radFiles/skyglow_3ph.rad'
rfluxmtx: sampling 145 directions
rcontrib: warning - non-planar vertex for polygon "Ceiling_0.7_1.40"
rcontrib: warning - non-planar vertex for polygon "Ceiling_0.7_1.62"
rcontrib: warning - non-planar vertex for polygon "Floor_0.2_1.170"
rcontrib: warning - non-planar vertex for polygon "Floor_0.2_1.174"
rcontrib: warning - non-planar vertex for polygon "Floor_0.2_1.176"
rcontrib: warning - non-planar vertex for polygon "Floor_0.2_1.192"
rcontrib: warning - non-planar vertex for polygon "Floor_0.2_1.193"
rcontrib: warning - non-planar vertex for polygon "Floor_0.2_1.195"
rcontrib: warning - non-planar vertex for polygon "Wall_0.5_1.3720"
rcontrib: warning - non-planar vertex for polygon "Frames_0.7_1.580"
rcontrib: warning - non-planar vertex for polygon "Frames_0.7_1.6150"
rcontrib: warning - non-planar vertex for polygon "Frames_0.7_1.6158"
rcontrib: warning - non-planar vertex for polygon "Frames_0.7_1.6221"
rcontrib: warning - non-planar vertex for polygon "Frames_0.7_1.6228"
rcontrib: warning - non-planar vertex for polygon "Frames_0.7_1.6276"
rfluxmtx: opening pipe to: rcontrib -fo+ -ab 2 -ad 512 -lw 2e-4 -n 11 -fdf -c 1000 -f reinhartb.cal -p MF=1,rNx=0,rNy=0,rNz=-1,Ux=0,Uy=1,Uz=0,RHS=+1 -bn Nrbins -b rbin -m sky_glow -bn 1 -b 'if(-Dx*0-Dy*0-Dz*1,0,-1)' -m ground_glow -y 145 '!oconv -f -i /home/mss/simulation/test_project2/octrees/opaque_scene.oct /home/mss/simulation/test_project2/radFiles/skyglow_3ph.rad'
rfluxmtx: sampling 145 directions (19 elements)
rcontrib: warning - non-planar vertex for polygon "Ceiling_0.7_1.40"
rcontrib: warning - non-planar vertex for polygon "Ceiling_0.7_1.62"
rcontrib: warning - non-planar vertex for polygon "Floor_0.2_1.170"
rcontrib: warning - non-planar vertex for polygon "Floor_0.2_1.174"
rcontrib: warning - non-planar vertex for polygon "Floor_0.2_1.176"
rcontrib: warning - non-planar vertex for polygon "Floor_0.2_1.192"
rcontrib: warning - non-planar vertex for polygon "Floor_0.2_1.193"
rcontrib: warning - non-planar vertex for polygon "Floor_0.2_1.195"
rcontrib: warning - non-planar vertex for polygon "Wall_0.5_1.3720"
rcontrib: warning - non-planar vertex for polygon "Frames_0.7_1.580"
rcontrib: warning - non-planar vertex for polygon "Frames_0.7_1.6150"
rcontrib: warning - non-planar vertex for polygon "Frames_0.7_1.6158"
rcontrib: warning - non-planar vertex for polygon "Frames_0.7_1.6221"
rcontrib: warning - non-planar vertex for polygon "Frames_0.7_1.6228"
rcontrib: warning - non-planar vertex for polygon "Frames_0.7_1.6276"
""",
    suppressWarnings=False)  # -> Stdout, Stderr_, Ran
panel_179 = Panel(executessh_12.Stdout)
dmx = Text(executessh_12.Stdout)
vmx = Text(hi_res_override)
bsdf = Text(executessh_8.Stdout)
crossref_7 = CrossReference(ListA=vmx, ListB=bsdf, ListC=viewnames_3, ListD=skyname, CrossMode=1)  # -> ListA, ListB, ListC, ListD
crossref_8 = CrossReference(ListA=aperturename, ListB=bsdf, ListC=viewnames_3, ListD=skyvector, CrossMode=1)  # -> ListA, ListB, ListC, ListD
crossref_9 = CrossReference(ListA=dmx, ListB=bsdf, ListC=viewnames_3, ListD=skyname, CrossMode=1)  # -> ListA, ListB, ListC, ListD
overrides_60 = ApplyOverrides(
    Input_=panel_120,
    Vmx=graft(crossref_7.ListA),
    Aperture=graft(crossref_8.ListA),
    Dmx=graft(crossref_9.ListA),
    Bsdf=graft(crossref_9.ListB),
    View=graft(crossref_9.ListC),
    Sv=graft(crossref_8.ListD),
    Skyname=graft(crossref_9.ListD))  # -> flatten(Output), Pairs
panel_180 = Panel(overrides_60.Output)
executessh_13 = ExecuteSSH(
    _SSHCommands_=overrides_60.Output,
    Run=falsestart_13,
    addPrefix=True,
    commands=""">JOIN<mkdir -p "~/simulation/test_project2/mtxs/3ph_view_P1"
dctimestep -h ~/simulation/test_project2/mtxs/3ph_view_P1/GlassSouth_70_%03d.hdr ~/simulation/test_project2/BSDF/blinds_001_GlassSouth_70_mat.xml ~/simulation/test_project2/mtxs/3ph_view_P1/GlassSouth_70.dmx ~/simulation/test_project2/skyvectors/DNK_CIEs_062115.vec > "~/simulation/test_project2/mtxs/3ph_view_P1/GlassSouth_70_DNK_CIEs_062115.hdr"
echo "~/simulation/test_project2/mtxs/3ph_view_P1/GlassSouth_70_DNK_CIEs_062115.hdr">JOIN<mkdir -p "~/simulation/test_project2/mtxs/3ph_view_P1"
dctimestep -h ~/simulation/test_project2/mtxs/3ph_view_P1/GlassWest_70_%03d.hdr ~/simulation/test_project2/BSDF/blinds_001_GlassSouth_70_mat.xml ~/simulation/test_project2/mtxs/3ph_view_P1/GlassWest_70.dmx ~/simulation/test_project2/skyvectors/DNK_CIEs_062115.vec > "~/simulation/test_project2/mtxs/3ph_view_P1/GlassWest_70_DNK_CIEs_062115.hdr"
echo "~/simulation/test_project2/mtxs/3ph_view_P1/GlassWest_70_DNK_CIEs_062115.hdr"
""",
    description="""mkdir -p "~/simulation/test_project2/mtxs/3ph_view_P1"
dctimestep -h ~/simulation/test_project2/mtxs/3ph_view_P1/GlassSouth_70_%03d.hdr ~/simulation/test_project2/BSDF/blinds_001_GlassSouth_70_mat.xml ~/simulation/test_project2/mtxs/3ph_view_P1/GlassSouth_70.dmx ~/simulation/test_project2/skyvectors/DNK_CIEs_062115.vec > "~/simulation/test_project2/mtxs/3ph_view_P1/GlassSouth_70_DNK_CIEs_062115.hdr"
echo "~/simulation/test_project2/mtxs/3ph_view_P1/GlassSouth_70_DNK_CIEs_062115.hdr"
mkdir -p "~/simulation/test_project2/mtxs/3ph_view_P1"
dctimestep -h ~/simulation/test_project2/mtxs/3ph_view_P1/GlassWest_70_%03d.hdr ~/simulation/test_project2/BSDF/blinds_001_GlassSouth_70_mat.xml ~/simulation/test_project2/mtxs/3ph_view_P1/GlassWest_70.dmx ~/simulation/test_project2/skyvectors/DNK_CIEs_062115.vec > "~/simulation/test_project2/mtxs/3ph_view_P1/GlassWest_70_DNK_CIEs_062115.hdr"
echo "~/simulation/test_project2/mtxs/3ph_view_P1/GlassWest_70_DNK_CIEs_062115.hdr"
""",
    fireLogs=False,
    lastRunTime=7065.5094,
    results="""~/simulation/test_project2/mtxs/3ph_view_P1/GlassSouth_70_DNK_CIEs_062115.hdr
_JOIN_
~/simulation/test_project2/mtxs/3ph_view_P1/GlassWest_70_DNK_CIEs_062115.hdr""",
    stderr=">JOIN<>JOIN<>JOIN<>JOIN<>JOIN<>JOIN<>JOIN<>JOIN<>JOIN<>JOIN<>JOIN<>JOIN<>JOIN<",
    suppressWarnings=False)  # -> Stdout, Stderr_, Ran
overrides_61 = ApplyOverrides(Input_=panel_123, Text=graft(executessh_13.Stdout))  # -> Output, Pairs
executessh_14 = ExecuteSSH(
    _SSHCommands_=flatten(overrides_61.Output),
    Run=executessh_13.Ran,
    addPrefix=True,
    commands=""">JOIN<normtiff ~/simulation/test_project2/mtxs/3ph_view_P1/GlassSouth_70_DNK_CIEs_062115.hdr ~/simulation/test_project2/mtxs/3ph_view_P1/GlassSouth_70_DNK_CIEs_062115.tif
convert ~/simulation/test_project2/mtxs/3ph_view_P1/GlassSouth_70_DNK_CIEs_062115.tif ~/simulation/test_project2/mtxs/3ph_view_P1/GlassSouth_70_DNK_CIEs_062115.png
echo ~/simulation/test_project2/mtxs/3ph_view_P1/GlassSouth_70_DNK_CIEs_062115.png>JOIN<normtiff ~/simulation/test_project2/mtxs/3ph_view_P1/GlassWest_70_DNK_CIEs_062115.hdr ~/simulation/test_project2/mtxs/3ph_view_P1/GlassWest_70_DNK_CIEs_062115.tif
convert ~/simulation/test_project2/mtxs/3ph_view_P1/GlassWest_70_DNK_CIEs_062115.tif ~/simulation/test_project2/mtxs/3ph_view_P1/GlassWest_70_DNK_CIEs_062115.png
echo ~/simulation/test_project2/mtxs/3ph_view_P1/GlassWest_70_DNK_CIEs_062115.png""",
    description="""normtiff ~/simulation/test_project2/mtxs/3ph_view_P1/GlassSouth_70_DNK_CIEs_062115.hdr ~/simulation/test_project2/mtxs/3ph_view_P1/GlassSouth_70_DNK_CIEs_062115.tif
convert ~/simulation/test_project2/mtxs/3ph_view_P1/GlassSouth_70_DNK_CIEs_062115.tif ~/simulation/test_project2/mtxs/3ph_view_P1/GlassSouth_70_DNK_CIEs_062115.png
echo ~/simulation/test_project2/mtxs/3ph_view_P1/GlassSouth_70_DNK_CIEs_062115.png
normtiff ~/simulation/test_project2/mtxs/3ph_view_P1/GlassWest_70_DNK_CIEs_062115.hdr ~/simulation/test_project2/mtxs/3ph_view_P1/GlassWest_70_DNK_CIEs_062115.tif
convert ~/simulation/test_project2/mtxs/3ph_view_P1/GlassWest_70_DNK_CIEs_062115.tif ~/simulation/test_project2/mtxs/3ph_view_P1/GlassWest_70_DNK_CIEs_062115.png
echo ~/simulation/test_project2/mtxs/3ph_view_P1/GlassWest_70_DNK_CIEs_062115.png""",
    fireLogs=False,
    lastRunTime=5.8819,
    results="""/home/mss/simulation/test_project2/mtxs/3ph_view_P1/GlassSouth_70_DNK_CIEs_062115.png
_JOIN_
/home/mss/simulation/test_project2/mtxs/3ph_view_P1/GlassWest_70_DNK_CIEs_062115.png""",
    stderr="""TIFFOpen: /home/mss/simulation/test_project2/mtxs/3ph_view_P1/GlassSouth_70_DNK_CIEs_062115.hdr: No such file or directory.
normtiff: cannot open or interpret file "/home/mss/simulation/test_project2/mtxs/3ph_view_P1/GlassSouth_70_DNK_CIEs_062115.hdr"
convert-im6.q16: unable to open image `/home/mss/simulation/test_project2/mtxs/3ph_view_P1/GlassSouth_70_DNK_CIEs_062115.tif': No such file or directory @ error/blob.c/OpenBlob/2874.
convert-im6.q16: no images defined `/home/mss/simulation/test_project2/mtxs/3ph_view_P1/GlassSouth_70_DNK_CIEs_062115.png' @ error/convert.c/ConvertImageCommand/3258.
TIFFOpen: /home/mss/simulation/test_project2/mtxs/3ph_view_P1/GlassWest_70_DNK_CIEs_062115.hdr: No such file or directory.
normtiff: cannot open or interpret file "/home/mss/simulation/test_project2/mtxs/3ph_view_P1/GlassWest_70_DNK_CIEs_062115.hdr"
convert-im6.q16: unable to open image `/home/mss/simulation/test_project2/mtxs/3ph_view_P1/GlassWest_70_DNK_CIEs_062115.tif': No such file or directory @ error/blob.c/OpenBlob/2874.
convert-im6.q16: no images defined `/home/mss/simulation/test_project2/mtxs/3ph_view_P1/GlassWest_70_DNK_CIEs_062115.png' @ error/convert.c/ConvertImageCommand/3258.
>JOIN<>JOIN<>JOIN<>JOIN<>JOIN<>JOIN<>JOIN<>JOIN<""",
    suppressWarnings=False)  # -> Stdout, Stderr_, Ran
convertpaths_6 = ConvertPaths(I=executessh_13.Stdout)  # -> Linux, Windows
imageviewer_6 = LBImageViewer(ImagePath_=convertpaths_6.Windows, _scale_=1, DisableClickable=True, SaveImgWithCoords=False, scale=1)  # -> ImagePath, Values, GIF
panel_181 = Panel(convertpaths_6.Windows)

# ----
# RENDER TESTS
# # start of sky definition for daylighting studies
# # location name: COPENHAGEN_DNK LAT: 55.63
# !gensky 5 14 14.0 -c -a 55.63 -o -12.67 -m -15.0 | xform -rz 0.0
# skyfunc glow sky_mat
# 0
# 0
# 4
# 1 1 1 0
# sky_mat source sky
# 0
# 0
# 4
# 0 0 1 180
# skyfunc glow ground_glow
# 0
# 0
# 4
# 1 .8 .5 0
# ground_glow source ground
# 0
# 0
# 4
# 0 0 -1 180
# # end of sky definition for daylighting studies
panel_182 = Panel("""mkdir -p <proj>/radFiles/
gensky -ang 45 0 -c -B 55.866 > <proj>/radFiles/<target>; echo <proj>/radFiles/<target>""")
_10000lux_overcast = Panel("gensky -ang 45 0 -c -B 55.866")
and_append_the_ground = Panel("""##The 1 will be multiplie with brightfunc
skyfunc glow sky_glow
0
0
4 1 1 1 0

##Set to 1 as it will be multiplied with the gensky result
sky_glow source sky
0
0
4 0 0 1 180

##Set to 1 as it will be multiplied with the gensky result
skyfunc glow ground_glow
0
0
4 1 1 1 0

##The ground pane
ground_glow source ground
0
0
4 0 0 -1 180""")
ladybug_2 = Ladybug_Ladybug()  # -> Vviiiiiiiiiizzz; disabled; plug-in component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
geo_5 = Geometry(<brep referenced from the Rhino model>)  # disabled
path_2 = FilePath("C:\Users\mm1013\Documents\Rhino setup\DNK_Copenhagen.061800_IWEC.epw")  # disabled
panel_183 = Panel("5")  # disabled
panel_184 = Panel("14")  # disabled
panel_185 = Panel("14")  # disabled
debrep = DeconstructBrep(Brep=geo_5)  # -> Faces, Edges, Vertices; disabled
panel_186 = Panel("4")  # disabled
genstandardciesky = Honeybee_GenerateStandardCIESky(weatherFile=path_2, month=panel_183, day=panel_184, hour=panel_185, skyType=panel_186)  # -> skyFilePath; disabled; plug-in component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
createhbsrfs = Honeybee_createHBSrfs(geometry=debrep.Faces)  # -> readMe, simplify(HBSurface); disabled; plug-in component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
panel_187 = Panel("Perspective")  # disabled
panel_188 = Panel("700")  # disabled
panel_189 = Panel("152")  # disabled
imagebasedsimulation = Honeybee_ImageBasedSimulation(
    skyFile=genstandardciesky,
    rhinoViewsName=panel_187,
    simulationType=2,
    imageWidth=panel_189,
    imageHeight=panel_188,
    backupImages=0)  # -> analysisRecipe; disabled; plug-in component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
toggle_3 = BooleanToggle(True)  # disabled
rundaylightanalysis = Honeybee_RunDaylightSimulation(
    HBObjects=flatten(createhbsrfs.HBSurface),
    analysisRecipe=imagebasedsimulation,
    writeRad=toggle_3,
    runRad=toggle_3,
    overwriteResults=True)  # -> readMe, analysisType, resultsUnit, results, testPts, luminance_files, radGeoFile, studyFolder, done; disabled; plug-in component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
hdr_gif = Honeybee_ConvertHDRToGIF(HDRFilePath=rundaylightanalysis.luminance_files, adjustExposure=False)  # -> GIFFilePath; disabled; plug-in component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
imageviewer_7 = LBImageViewer(ImagePath_=hdr_gif, _scale_=1, DisableClickable=False, SaveImgWithCoords=False, scale=1)  # -> ImagePath, Values, GIF; disabled

# ----
# Create a dummy gensky for renders
# mkdir -p <proj>/radFiles/
# gensky 12 4 +12:00 -c -B 55.866 > <proj>/radFiles/<target>; echo <proj>/radFiles/<target>
panel_190 = Panel("sky_10klx.mat")
overrides_62 = ApplyOverrides(Input=panel_182, Target=graft(panel_190))  # -> Output, Pairs
execute_ssh_async_53 = ExecuteSSHAsync(
    _SSHCommands_=overrides_62.Output,
    Run=executessh.Ran,
    addPrefix=True,
    addSuffix=True,
    description="""mkdir -p ~/simulation/test_project2/radFiles/
gensky -ang 45 0 -c -B 55.866 > ~/simulation/test_project2/radFiles/sky_10klx.mat; echo ~/simulation/test_project2/radFiles/sky_10klx.mat""",
    fireLogs=False,
    stdouts="/home/mss/simulation/test_project2/radFiles/sky_10klx.mat",
    suppressWarnings=False)  # -> Stdout, Stderr_, Log, Pid, Ran
overrides_63 = ApplyOverrides(Input="head <proj>/radFiles/<target>", Target=graft(panel_190))  # -> Output, Pairs
execute_ssh_async_54 = ExecuteSSHAsync(
    _SSHCommands_=overrides_63.Output,
    Run=execute_ssh_async_53.Ran,
    addPrefix=True,
    addSuffix=True,
    description="head ~/simulation/test_project2/radFiles/sky_10klx.mat",
    fireLogs=False,
    stdouts="""# gensky -ang 45 0 -c -B 55.866
# Ground ambient level: 17.8

void brightfunc skyfunc
2 skybr skybright.cal
0
3 2 2.29e+01 3.56e+00""",
    suppressWarnings=False)  # -> Stdout, Stderr_, Log, Pid, Ran
panel_191 = Panel(execute_ssh_async_53.Stdout)
panel_192 = Panel(execute_ssh_async_54.Stdout)
sky10klx = Text(execute_ssh_async_53.Stdout)

# ----
# Preview a RAD file with objpict
# can also use ra_tiff/normtiff/pfilt
# gamma will vary
# 
# check axel jacobs radiance tutorial p26
panel_193 = Panel("""mkdir -p <proj>/images/
objpict <rad> > <proj>/images/<target-.>.hdr
normtiff <proj>/images/<target-.>.hdr <proj>/images/<target-.>.tif
convert <proj>/images/<target-.>.tif <proj>/images/<target>
echo <proj>/images/<target>""")  # disabled
radfile = Text(execute_ssh_async_53.Stdout)  # disabled
panel_194 = Panel("quickRender.png")  # disabled
panel_195 = Panel("""rad
target""")  # disabled
applyglobals_7 = ApplyGlobals(Input=panel_193, AdditionalKeys=panel_195, AdditionalValues=[radfile, panel_194])  # -> Output, Pairs; disabled
execute_ssh_async_55 = ExecuteSSHAsync(
    SSHCommands=applyglobals_7.Output,
    Run=execute_ssh_async_54.Ran,
    addPrefix=True,
    addSuffix=True,
    fireLogs=False,
    stdouts="/home/mss/simulation/test_project/images/quickRender.png",
    suppressWarnings=False)  # -> Stdout, Stderr, Log, Pid, Ran; disabled
convertpaths_7 = ConvertPaths(I=execute_ssh_async_55.Stdout)  # -> Linux, Windows; disabled
imageviewer_8 = LBImageViewer(ImagePath_=convertpaths_7.Windows, _scale_=1, DisableClickable=False, SaveImgWithCoords=False, scale=1)  # -> ImagePath, Values, GIF; disabled

txt_2 = Text(sky10klx)

# ----
# 10klx overcast sky (RwR p357)
bool_2 = Boolean(execute_ssh_async_54.Ran)
execute_ssh_async_56 = ExecuteSSHAsync(
    _SSHCommands_="gensky -ang 45 0 -c -B 55.866",
    Run=bool_2,
    addPrefix=True,
    addSuffix=True,
    description="gensky -ang 45 0 -c -B 55.866",
    fireLogs=False,
    stdouts="""# gensky -ang 45 0 -c -B 55.866
# Ground ambient level: 17.8

void brightfunc skyfunc
2 skybr skybright.cal
0
3 2 2.29e+01 3.56e+00""",
    suppressWarnings=False)  # -> Stdout, Stderr_, Log, Pid, Ran
panel_196 = Panel("""mkdir -p <proj>/skies/
echo "<sky>" > <proj>/skies/<target>
echo "<proj>/skies/<target>"
""")

concat_7 = Concatenate(
    FragmentC="##Will control the gradient of the sky",
    FragmentA=execute_ssh_async_56.Stdout,
    FragmentB=and_append_the_ground)

panel_197 = Panel(concat_7)
overrides_64 = ApplyOverrides(Input=panel_196, Sky=graft(panel_197), Target=graft("overcast_sky.rad"))  # -> Output, Pairs
execute_ssh_async_57 = ExecuteSSHAsync(
    _SSHCommands_=overrides_64.Output,
    Run=execute_ssh_async_56.Ran,
    addPrefix=True,
    addSuffix=True,
    description="""mkdir -p ~/simulation/test_project2/skies/;echo "##Will control the gradient of the sky
# gensky -ang 45 0 -c -B 55.866
# Ground ambient level: 17.8

void brightfunc skyfunc
2 skybr skybright.cal
0
3 2 2.29e+01 3.56e+00

##The 1 will be multiplie with brightfunc
skyfunc glow sky_glow
0
0
4 1 1 1 0

##Set to 1 as it will be multiplied with the gensky result
sky_glow source sky
0
0
4 0 0 1 180

##Set to 1 as it will be multiplied with the gensky result
skyfunc glow ground_glow
0
0
4 1 1 1 0

##The ground pane
ground_glow source ground
0
0
4 0 0 -1 180" > ~/simulation/test_project2/skies/overcast_sky.rad;echo "~/simulation/test_project2/skies/overcast_sky.rad"
""",
    fireLogs=False,
    stdouts="~/simulation/test_project2/skies/overcast_sky.rad",
    suppressWarnings=False)  # -> Stdout, Stderr_, Log, Pid, Ran
panel_198 = Panel(execute_ssh_async_57.Stdout)

overrides_65 = ApplyOverrides(Input="cat <target>", Target=graft(execute_ssh_async_57.Stdout))  # -> Output, Pairs
execute_ssh_async_58 = ExecuteSSHAsync(
    _SSHCommands_=overrides_65.Output,
    Run=execute_ssh_async_57.Ran,
    addPrefix=True,
    addSuffix=True,
    description="cat ~/simulation/test_project2/skies/overcast_sky.rad",
    fireLogs=False,
    stdouts="""##Will control the gradient of the sky
# gensky -ang 45 0 -c -B 55.866
# Ground ambient level: 17.8

void brightfunc skyfunc
2 skybr skybright.cal
0
3 2 2.29e+01 3.56e+00

##The 1 will be multiplie with brightfunc
skyfunc glow sky_glow
0
0
4 1 1 1 0

##Set to 1 as it will be multiplied with the gensky result
sky_glow source sky
0
0
4 0 0 1 180

##Set to 1 as it will be multiplied with the gensky result
skyfunc glow ground_glow
0
0
4 1 1 1 0

##The ground pane
ground_glow source ground
0
0
4 0 0 -1 180""",
    suppressWarnings=False)  # -> Stdout, Stderr_, Log, Pid, Ran
panel_199 = Panel(execute_ssh_async_58.Stdout)

# ----
# OCTREE
panel_200 = Panel("my_test_scene.oct")
scene_rads = Text(entwine)
sky_ovc = Text(execute_ssh_async_57.Stdout)
python_14 = GhPythonScript(x=flatten(scene_rads))  # -> a; inputs x: list
# ---------- python_14: Python ----------
__author__ = "mm1013"
__version__ = "2022.06.15"

import rhinoscriptsyntax as rs

a = None not in x
# ---------- end python_14 ----------
entwine_5 = Entwine(Branch01=sky_ovc, Branch02=scene_rads, FlattenInputs=True)  # -> flatten(Radfiles)
panel_201 = Panel("""mkdir -p <proj>/octrees/
oconv -r 2048 -f <rads> > <proj>/octrees/<target>
echo <proj>/octrees/<target>""")
and_12 = GateAnd(A=python_14, B=execute_ssh_async_57.Ran)
join_8 = TextJoin(Text=entwine_5, Join=" ")
overrides_66 = ApplyOverrides(Input=panel_201, Rads=graft(join_8), Target=graft(panel_200))  # -> Output, Pairs
execute_ssh_async_59 = ExecuteSSHAsync(
    _SSHCommands_=overrides_66.Output,
    Run=and_12,
    addPrefix=True,
    addSuffix=True,
    description="""mkdir -p ~/simulation/test_project2/octrees/
oconv -r 2048 -f ~/simulation/test_project2/skies/overcast_sky.rad ~/simulation/test_project2/radFiles/GlassWest_70_mat.mat ~/simulation/test_project2/radFiles/Glass_70_mat.mat ~/simulation/test_project2/radFiles/GlassSouth_70_mat.mat ~/simulation/test_project2/radFiles/GlassSouth_70.rad ~/simulation/test_project2/radFiles/Glass_70.rad ~/simulation/test_project2/radFiles/GlassWest_70.rad ~/simulation/test_project2/radFiles/opaque_materials.mat ~/simulation/test_project2/radFiles/Terrain_0.2.rad ~/simulation/test_project2/radFiles/Ceiling_0.7.rad ~/simulation/test_project2/radFiles/Floor_0.2.rad ~/simulation/test_project2/radFiles/Context_0.2.rad ~/simulation/test_project2/radFiles/Wall_0.5.rad ~/simulation/test_project2/radFiles/Frames_0.7.rad > ~/simulation/test_project2/octrees/my_test_scene.oct
echo ~/simulation/test_project2/octrees/my_test_scene.oct""",
    fireLogs=False,
    stdouts="/home/mss/simulation/test_project2/octrees/my_test_scene.oct",
    suppressWarnings=False)  # -> Stdout, Stderr_, Log, Pid, Ran
convertpaths_8 = ConvertPaths(I=execute_ssh_async_59.Stdout)  # -> Linux, Windows
panel_202 = Panel(execute_ssh_async_59.Stdout)
panel_203 = Panel(convertpaths_8.Windows)

# ----
# VIEW
panel_204 = Panel("""mkdir -p <proj>/views/
echo "<vf>" > <proj>/views/<target>.vf
echo <proj>/views/<target>.vf""")
panel_205 = Panel("""vf
target""")
vf_2 = Text(view.ViewfileContent)
overrides_67 = ApplyOverrides(Input=panel_204, Vf=graft(vf_2), Target=graft(panel_87))  # -> Output, Pairs
file_exists_3 = Panel("[ -f <out> ] && echo \"1\" || echo \"0\"")
execute_ssh_async_60 = ExecuteSSHAsync(
    _SSHCommands_=overrides_67.Output,
    Run=button,
    addPrefix=True,
    addSuffix=True,
    description="""mkdir -p ~/simulation/test_project2/views/
echo "rvu -vtv -vp -16129.6594378479 -13119.0887339954 1438.98379141628 -vd -0.309000050777079 -0.951004369262931 -0.0104717841162459 -vu -0.0032359592533459 -0.00995925852099161 0.999945169365512 -vh 83.719 -vv 50.000" > ~/simulation/test_project2/views/Int1.vf
echo ~/simulation/test_project2/views/Int1.vf
mkdir -p ~/simulation/test_project2/views/
echo "rvu -vtv -vp -22515.1031894701 -18917.6388779913 4325.25435296232 -vd 0.223222574198169 -0.974640940321721 -0.0157073173118207 -vu 0.0035066604120845 -0.0153108833804109 0.999876632481661 -vh 83.719 -vv 50.000" > ~/simulation/test_project2/views/Int2.vf
echo ~/simulation/test_project2/views/Int2.vf
mkdir -p ~/simulation/test_project2/views/
echo "rvu -vtv -vp -25409.5898832296 -51537.7113099733 -176.26047822389 -vd 0.296482456823451 0.946076670223119 0.130526192220052 -vu -0.0390326559316543 -0.124553356544041 0.99144486137381 -vh 49.513 -vv 26.991" > ~/simulation/test_project2/views/Ext1.vf
echo ~/simulation/test_project2/views/Ext1.vf
mkdir -p ~/simulation/test_project2/views/
echo "rvu -vtv -vp -21862.7849604518 -57227.1112993256 165765.363180022 -vd 0.0353111372197547 0.230759315075391 -0.972369920397677 -vu 0.147081471743077 0.961181722029749 0.233445363855906 -vh 19.085 -vv 10.000" > ~/simulation/test_project2/views/Ext2.vf
echo ~/simulation/test_project2/views/Ext2.vf""",
    fireLogs=False,
    stdouts="/home/mss/simulation/test_project2/views/Int1.vf>JOIN</home/mss/simulation/test_project2/views/Int2.vf>JOIN</home/mss/simulation/test_project2/views/Ext1.vf>JOIN</home/mss/simulation/test_project2/views/Ext2.vf",
    suppressWarnings=False)  # -> Stdout, Stderr_, Log, Pid, Ran
item_6 = ListItem(List=flatten(execute_ssh_async_60.Stdout), Index=0, Wrap=True)
panel_206 = Panel(execute_ssh_async_60.Stdout)
overrides_68 = ApplyOverrides(Input=file_exists_3, Out=graft(item_6))  # -> Output, Pairs
execute_ssh_async_61 = ExecuteSSHAsync(
    _SSHCommands_=overrides_68.Output,
    Run=execute_ssh_async_59.Ran,
    addPrefix=True,
    addSuffix=True,
    description="[ -f /home/mss/simulation/test_project2/views/Int1.vf ] && echo \"1\" || echo \"0\"",
    fireLogs=False,
    stdouts="1",
    suppressWarnings=False)  # -> Stdout, Stderr_, Log, Pid, Ran

# ----
# rpict RENDER
# single core render, using normtiff to set
# exposure and convert to png
# -ps 8 -pt 0.15 -pj 0.6 -dj 0 -ds 0.5 -dt 0.5 -dc 0.25 -dr 0 -dp 64 -st 0.85 -ab 2 -ad 512 -as 128 -ar 16 -aa 0.250 -lr 4 -lw 0.050 -av 0 0 0
panel_207 = Panel("""mkdir -p <proj>/images/
rpict -t 10 -vf <vf> -x <x> -y <y> <radPar> <octree> > <proj>/images/<target-.>_<vn>.hdr
normtiff <proj>/images/<target-.>_<vn>.hdr <proj>/images/<target-.>_<vn>.tif
convert <proj>/images/<target-.>_<vn>.tif <proj>/images/<target-.>_<vn>.png
echo <proj>/images/<target-.>_<vn>.png""")
octree_4 = Text(execute_ssh_async_59.Stdout)
viewfiles = Text(execute_ssh_async_60.Stdout)
python_15 = GhPythonScript(viewfile=viewfiles)  # -> viewname
# ---------- python_15: Python ----------
__author__ = "mm1013"
__version__ = "2022.07.09"

import rhinoscriptsyntax as rs

viewname = viewfile.split("/")[-1].split(".")[0]
# ---------- end python_15 ----------
overrides_69 = ApplyOverrides(
    Input=panel_207,
    Vf=graft(viewfiles),
    X=graft("600"),
    Y=graft("500"),
    RadPar=graft("-ab 1 -ad 2048 -ar 128 -as 512 -aa 0.12 -lw 5e-2"),
    Octree=graft(octree_4),
    Target=graft("rpict_render"),
    Vn=graft(python_15))  # -> Output, Pairs
and_13 = GateAnd(A=execute_ssh_async_59.Ran, B=execute_ssh_async_61.Stdout)
execute_ssh_async_62 = ExecuteSSHAsync(
    _SSHCommands_=overrides_69.Output,
    Run=and_13,
    addPrefix=True,
    addSuffix=True,
    description="""mkdir -p ~/simulation/test_project2/images/
rpict -t 10 -vf /home/mss/simulation/test_project2/views/Int1.vf -x 600 -y 500 -ab 1 -ad 2048 -ar 128 -as 512 -aa 0.12 -lw 5e-2 /home/mss/simulation/test_project2/octrees/my_test_scene.oct > ~/simulation/test_project2/images/_Int1.hdr
normtiff ~/simulation/test_project2/images/_Int1.hdr ~/simulation/test_project2/images/_Int1.tif
convert ~/simulation/test_project2/images/_Int1.tif ~/simulation/test_project2/images/_Int1.png
echo ~/simulation/test_project2/images/_Int1.png
mkdir -p ~/simulation/test_project2/images/
rpict -t 10 -vf /home/mss/simulation/test_project2/views/Int2.vf -x 600 -y 500 -ab 1 -ad 2048 -ar 128 -as 512 -aa 0.12 -lw 5e-2 /home/mss/simulation/test_project2/octrees/my_test_scene.oct > ~/simulation/test_project2/images/_Int2.hdr
normtiff ~/simulation/test_project2/images/_Int2.hdr ~/simulation/test_project2/images/_Int2.tif
convert ~/simulation/test_project2/images/_Int2.tif ~/simulation/test_project2/images/_Int2.png
echo ~/simulation/test_project2/images/_Int2.png
mkdir -p ~/simulation/test_project2/images/
rpict -t 10 -vf /home/mss/simulation/test_project2/views/Ext1.vf -x 600 -y 500 -ab 1 -ad 2048 -ar 128 -as 512 -aa 0.12 -lw 5e-2 /home/mss/simulation/test_project2/octrees/my_test_scene.oct > ~/simulation/test_project2/images/_Ext1.hdr
normtiff ~/simulation/test_project2/images/_Ext1.hdr ~/simulation/test_project2/images/_Ext1.tif
convert ~/simulation/test_project2/images/_Ext1.tif ~/simulation/test_project2/images/_Ext1.png
echo ~/simulation/test_project2/images/_Ext1.png
mkdir -p ~/simulation/test_project2/images/
rpict -t 10 -vf /home/mss/simulation/test_project2/views/Ext2.vf -x 600 -y 500 -ab 1 -ad 2048 -ar 128 -as 512 -aa 0.12 -lw 5e-2 /home/mss/simulation/test_project2/octrees/my_test_scene.oct > ~/simulation/test_project2/images/_Ext2.hdr
normtiff ~/simulation/test_project2/images/_Ext2.hdr ~/simulation/test_project2/images/_Ext2.tif
convert ~/simulation/test_project2/images/_Ext2.tif ~/simulation/test_project2/images/_Ext2.png
echo ~/simulation/test_project2/images/_Ext2.png""",
    fireLogs=False,
    stdouts="/home/mss/simulation/test_project2/images/_Int1.png>JOIN</home/mss/simulation/test_project2/images/_Int2.png>JOIN</home/mss/simulation/test_project2/images/_Ext1.png>JOIN</home/mss/simulation/test_project2/images/_Ext2.png",
    suppressWarnings=False)  # -> Stdout, Stderr_, Log, Pid, Ran
convertpaths_9 = ConvertPaths(I=execute_ssh_async_62.Stdout)  # -> Linux, Windows
imageviewer_9 = LBImageViewer(ImagePath_=convertpaths_9.Windows, _scale_=1, DisableClickable=False, SaveImgWithCoords=False, scale=1)  # -> ImagePath, Values, GIF

# ----
# show ambient positions
# genambpos can for some reason not find the
# files through grasshopper.
# 
# Try however to execute genambpos
# without any parameters inside
# same folder as your amb file and
# follow the instructions.
# single core render, using normtiff to set
# exposure and convert to png
panel_208 = Panel("""mkdir -p <proj>/images/
rpict -t 10 -vf <vf> -x <x> -y <y> <radPar> -af <proj>/<target-.>.amb <octree> > <proj>/images/<target-.>.hdr
normtiff <proj>/images/<target-.>.hdr <proj>/images/<target-.>.tif
convert <proj>/images/<target-.>.tif <proj>/images/<target>
echo <proj>/images/<target>""")
really_bad_ad = Panel("-ab 3 -ar 256 -as 256 -ad 256")
panel_209 = Panel("rpict_render_ambpos4.png")
octree_5 = Text(execute_ssh_async_59.Stdout)
falsestart_17 = LBFalseStartToggle(False)
overrides_70 = ApplyOverrides(
    Input=panel_208,
    Vf=graft(execute_ssh_async_60.Stdout),
    X=graft("600"),
    Y=graft("500"),
    RadPar=graft(really_bad_ad),
    Octree=graft(octree_5),
    Target=graft(panel_209))  # -> Output, Pairs
execute_ssh_async_63 = ExecuteSSHAsync(
    _SSHCommands_=overrides_70.Output,
    Run=falsestart_17,
    addPrefix=True,
    addSuffix=True,
    description="""mkdir -p ~/simulation/test_project2/images/
rpict -t 10 -vf /home/mss/simulation/test_project2/views/view.vf -x 600 -y 500 -ab 3 -ar 256 -as 256 -ad 256 -af ~/simulation/test_project2/rpict_render_ambpos4.amb /home/mss/simulation/test_project2/octrees/my_test_scene.oct > ~/simulation/test_project2/images/rpict_render_ambpos4.hdr
normtiff ~/simulation/test_project2/images/rpict_render_ambpos4.hdr ~/simulation/test_project2/images/rpict_render_ambpos4.tif
convert ~/simulation/test_project2/images/rpict_render_ambpos4.tif ~/simulation/test_project2/images/rpict_render_ambpos4.png
echo ~/simulation/test_project2/images/rpict_render_ambpos4.png""",
    fireLogs=False,
    stdouts="/home/mss/simulation/test_project2/images/rpict_render_ambpos4.png",
    suppressWarnings=False)  # -> Stdout, Stderr_, Log, Pid, Ran
convertpaths_10 = ConvertPaths(I=execute_ssh_async_63.Stdout)  # -> Linux, Windows
imageviewer_10 = LBImageViewer(ImagePath_=convertpaths_10.Windows, _scale_=1, DisableClickable=False, SaveImgWithCoords=False, scale=1)  # -> ImagePath, Values, GIF
panel_210 = Panel("""cd <proj>
rcalc -e 'x1=$1;y1=$2;z1=$3' -o sph_lev1.fmt amb_pos_lev1 > <proj>/<target>;head <target>""")
overrides_71 = ApplyOverrides(Input_=panel_210, Target=graft("spheres.rad"))  # -> Output, Pairs
overrides_72 = ApplyOverrides(Input_="cd <proj>;genambpos <amb-.>.amb > <proj>/<target>", Target=graft("amb_target.rad"), Amb=graft(panel_209))  # -> Output, Pairs
execute_ssh_async_64 = ExecuteSSHAsync(
    _SSHCommands_=overrides_71.Output,
    Run=execute_ssh_async_63.Ran,
    addPrefix=True,
    addSuffix=True,
    description="""cd ~/simulation/test_project2
rcalc -e 'x1=$1;y1=$2;z1=$3' -o sph_lev1.fmt amb_pos_lev1 > ~/simulation/test_project2/spheres.rad;head spheres.rad""",
    fireLogs=False,
    suppressWarnings=False)  # -> Stdout, Stderr_, Log, Pid, Ran
execute_ssh_async_65 = ExecuteSSHAsync(
    _SSHCommands_=overrides_72.Output,
    Run=execute_ssh_async_63.Ran,
    addPrefix=True,
    addSuffix=True,
    description="cd ~/simulation/test_project2;genambpos rpict_render_ambpos4.amb > ~/simulation/test_project2/amb_target.rad",
    fireLogs=False,
    suppressWarnings=False)  # -> Stdout, Stderr_, Log, Pid, Ran
panel_211 = Panel(overrides_72.Output)

# ----
# Parallel RTRACE render (illuminance)
# this hdr is over exposed,
# I wonder what we can do with that..
panel_212 = Panel("""mkdir -p <proj>/images/
vwrays -ff -x <x> -y <y> -vf <vf> -pa 1 | rtrace <radOptions> -n <cpus> `vwrays -d -ff -x <x> -y <y> -vf <vf> -pa 1` -ffc <oct> > <proj>/images/<target-.>.hdr
echo <proj>/images/<target-.>.hdr""")
octree_6 = Text(execute_ssh_async_59.Stdout)
run = LBFalseStartToggle(False)
viewfile_2 = Text(execute_ssh_async_60.Stdout)
panel_213 = Panel("echo \"rvu -vtv -vp 0.5 4.5 1.6 -vd 0.830824 -1.13002 -0.181063 -vu 0 0 1 -vh 98.2132 -vv 79.2785 -vo 0 -va 0 -vs 0 -vl 0\" > <proj>/views/myview.vf;echo <proj>/views/myview.vf")
overrides_73 = ApplyOverrides(
    Input=panel_212,
    RadOptions=graft("-i -ab 1 -ad 512"),
    X=graft("600"),
    Y=graft("500"),
    Vf=graft(viewfile_2),
    Oct=graft(octree_6),
    Target=graft("rtrace_rendering_illum.png"))  # -> Output, Pairs
execute_ssh_async_66 = ExecuteSSHAsync(
    SSHCommands=panel_213,
    Run=run,
    addPrefix=True,
    addSuffix=True,
    fireLogs=False,
    stdouts="/home/mss/simulation/test_project2/views/myview.vf",
    suppressWarnings=False)  # -> Stdout, Stderr, Log, Pid, Ran; disabled
execute_ssh_async_67 = ExecuteSSHAsync(
    _SSHCommands=overrides_73.Output,
    Run=run,
    addPrefix=True,
    addSuffix=False,
    fireLogs=False,
    stdouts="/home/mss/simulation/test_project2/images/rtrace_rendering_illum.hdr",
    suppressWarnings=False)  # -> Stdout, Stderr_, Log, Pid, Ran
panel_214 = Panel(execute_ssh_async_67.Stdout)
convertpaths_11 = ConvertPaths(I=execute_ssh_async_67.Stdout)  # -> Linux, Windows
imageviewer_11 = LBImageViewer(ImagePath_=convertpaths_11.Windows, _scale_=1, DisableClickable=False, SaveImgWithCoords=False, scale=1)  # -> ImagePath, Values, GIF

# ----
# Parallel RTRACE render
# this hdr is over exposed,
# I wonder what we can do with that..
octree_7 = Text(execute_ssh_async_59.Stdout)
run_2 = LBFalseStartToggle(False)
viewfile_3 = Text(execute_ssh_async_60.Stdout)
panel_215 = Panel("""mkdir -p <proj>/images/
vwrays -ff -x <x> -y <y> -vf <vf> -pa 1 | rtrace <radOptions> -n <cpus> `vwrays -d -ff -x <x> -y <y> -vf <vf> -pa 1` -ffc <oct> > <proj>/images/<target-.>.hdr
echo <proj>/images/<target-.>.hdr""")
panel_216 = Panel("echo \"rvu -vtv -vp 0.5 4.5 1.6 -vd 0.830824 -1.13002 -0.181063 -vu 0 0 1 -vh 98.2132 -vv 79.2785 -vo 0 -va 0 -vs 0 -vl 0\" > <proj>/views/myview.vf;echo <proj>/views/myview.vf")
overrides_74 = ApplyOverrides(
    Input=panel_215,
    RadOptions=graft("-ab 1 -ad 512"),
    X=graft("600"),
    Y=graft("500"),
    Vf=graft(viewfile_3),
    Oct=graft(octree_7),
    Target=graft("rtrace_rendering.png"))  # -> Output, Pairs
execute_ssh_async_68 = ExecuteSSHAsync(
    SSHCommands=panel_216,
    Run=run_2,
    addPrefix=True,
    addSuffix=True,
    fireLogs=False,
    stdouts="/home/mss/simulation/test_project2/views/myview.vf",
    suppressWarnings=False)  # -> Stdout, Stderr, Log, Pid, Ran; disabled
execute_ssh_async_69 = ExecuteSSHAsync(
    _SSHCommands=overrides_74.Output,
    Run=run_2,
    addPrefix=True,
    addSuffix=False,
    description="Hi",
    fireLogs=False,
    name="Test",
    stdouts="/home/mss/simulation/test_project2/images/rtrace_rendering.hdr",
    suppressWarnings=False)  # -> Stdout, Stderr_, Log, Pid, Ran
panel_217 = Panel(execute_ssh_async_69.Stdout)
convertpaths_12 = ConvertPaths(I=execute_ssh_async_69.Stdout)  # -> Linux, Windows
imageviewer_12 = LBImageViewer(ImagePath_=convertpaths_12.Windows, _scale_=1, DisableClickable=False, SaveImgWithCoords=False, scale=1)  # -> ImagePath, Values, GIF

# ----
# RENDER PARALLEL (RPIECE)
# rpiece render multithreaded
# 
# https://discourse.radiance-online.org/t/another-rpiece-question/308/5
opt1 = Panel("""NCPU=<cpus>
COLS=<cpus>
ROWS=8
echo "-vf views/view.vf" > viewpoint
echo "-w -i -bv -ab 4 -ar 128 -ad 1024 -as 512 -aa 0.15 -av 0.0 0.0 0.0 -aw 0 -lr -10 -lw 0.004 -x 2048 -y 2048 -af ambfile -ps 1 -ds .1 -dj .6 -t 120" > options
echo "-o <proj>/<unf> <proj>/<octree>" > arguments
echo $COLS $ROWS > syncfile
rm -f pp
while [ "$NCPU" -gt 0 ]
do
	echo "running proc $NCPU"
	rpiece -v -PP pp -F syncfile @viewpoint @options @arguments &
	NCPU=`expr $NCPU - 1`
	sleep 2
done
wait""")
panel_218 = Panel("""echo "" > <proj>/run2.sh

tee -a <proj>/run2.sh > /dev/null <<EOF
<shell>
EOF""")
ex = Ex(T=opt1)
overrides_75 = ApplyOverrides(Input=panel_218, Shell=graft(ex))  # -> Output, Pairs
octree_8 = Text(execute_ssh_async_59.Stdout)
falsestart_18 = LBFalseStartToggle(False)
overrides_76 = ApplyOverrides(Input=overrides_75.Output, Unf=graft("collectedRender.unf"), Octree=graft(octree_8))  # -> Output, Pairs
panel_219 = Panel("pcompos -a <cpus> <unf> > <targethdr>")
execute_ssh_async_70 = ExecuteSSHAsync(
    SSHCommands_=overrides_76.Output,
    Run=falsestart_18,
    addPrefix=False,
    addSuffix=True,
    description="""echo "" > ~/simulation/test_project2/run2.sh

tee -a ~/simulation/test_project2/run2.sh > /dev/null <<EOF
NCPU=11
COLS=11
ROWS=8
echo "-vf views/view.vf" > viewpoint
echo "-w -i -bv -ab 4 -ar 128 -ad 1024 -as 512 -aa 0.15 -av 0.0 0.0 0.0 -aw 0 -lr -10 -lw 0.004 -x 2048 -y 2048 -af ambfile -ps 1 -ds .1 -dj .6 -t 120" > options
echo "-o ~/simulation/test_project2/collectedRender.unf ~/simulation/test_project2//home/mss/simulation/test_project2/octrees/my_test_scene.oct" > arguments
echo \$COLS \$ROWS > syncfile
rm -f pp
while [ "\$NCPU" -gt 0 ]
do
	echo "running proc \$NCPU"
	rpiece -v -PP pp -F syncfile @viewpoint @options @arguments &
	NCPU=\`expr \$NCPU - 1\`
	sleep 2
done
wait
EOF""",
    fireLogs=False,
    suppressWarnings=False)  # -> Stdout, Stderr_, Log, Pid, Ran
panel_220 = Panel(overrides_76.Output)
panel_221 = Panel(execute_ssh_async_70.Stderr_)

# ----
# Using PCOND to set automatic exposure
# and convert to PNG
panel_222 = Panel("""pcond -h <hdr> <hdr-.>_exposed.hdr
ra_tiff <hdr-.>_exposed.hdr <hdr-.>_exposed.tif
convert <hdr-.>_exposed.tif <hdr-.>_exposed.png
echo <hdr-.>_exposed.png""")
overrides_77 = ApplyOverrides(Input_=panel_222, Hdr=graft(execute_ssh_async_67.Stdout))  # -> Output, Pairs
execute_ssh_async_71 = ExecuteSSHAsync(
    _SSHCommands_=overrides_77.Output,
    Run=execute_ssh_async_67.Ran,
    addPrefix=True,
    addSuffix=True,
    fireLogs=False,
    stdouts="/home/mss/simulation/test_project2/images/rtrace_rendering_illum_exposed.png",
    suppressWarnings=False)  # -> Stdout, Stderr_, Log, Pid, Ran
convertpaths_13 = ConvertPaths(I=execute_ssh_async_71.Stdout)  # -> Linux, Windows
imageviewer_13 = LBImageViewer(ImagePath_=convertpaths_13.Windows, _scale_="1.5", DisableClickable=False, SaveImgWithCoords=False, scale=1.5)  # -> ImagePath, Values, GIF

# ----
# Using PCOND to set automatic exposure
# and convert to PNG
panel_223 = Panel("""pcond -h <hdr> <hdr-.>_exposed.hdr
ra_tiff <hdr-.>_exposed.hdr <hdr-.>_exposed.tif
convert <hdr-.>_exposed.tif <hdr-.>_exposed.png
echo <hdr-.>_exposed.png""")
overrides_78 = ApplyOverrides(Input_=panel_223, Hdr=graft(execute_ssh_async_69.Stdout))  # -> Output, Pairs
execute_ssh_async_72 = ExecuteSSHAsync(
    _SSHCommands_=overrides_78.Output,
    Run=execute_ssh_async_69.Ran,
    addPrefix=True,
    addSuffix=True,
    fireLogs=False,
    stdouts="/home/mss/simulation/test_project2/images/rtrace_rendering_exposed.png",
    suppressWarnings=False)  # -> Stdout, Stderr_, Log, Pid, Ran
convertpaths_14 = ConvertPaths(I=execute_ssh_async_72.Stdout)  # -> Linux, Windows
imageviewer_14 = LBImageViewer(ImagePath_=convertpaths_14.Windows, _scale_="1.5", DisableClickable=False, SaveImgWithCoords=False, scale=1.5)  # -> ImagePath, Values, GIF

# ----
# False color with illuminance curves
# on top of luminance picture
panel_224 = Panel("falsecolor -s 9000 -l lux -p <rad-.>_exposed.hdr -i <irrad> -cl -log 2 > <rad-.>_fc.hdr;echo <rad-.>_fc.hdr")
and_14 = GateAnd(A=execute_ssh_async_72.Ran, B=execute_ssh_async_67.Ran)
overrides_79 = ApplyOverrides(Input_=panel_224, Rad=graft(execute_ssh_async_69.Stdout), Irrad=graft(execute_ssh_async_67.Stdout))  # -> Output, Pairs
execute_ssh_async_73 = ExecuteSSHAsync(
    _SSHCommands_=overrides_79.Output,
    Run=and_14,
    addPrefix=True,
    addSuffix=True,
    fireLogs=False,
    stdouts="/home/mss/simulation/test_project2/images/rtrace_rendering_fc.hdr",
    suppressWarnings=False)  # -> Stdout, Stderr_, Log, Pid, Ran
convertpaths_15 = ConvertPaths(I=execute_ssh_async_73.Stdout)  # -> Linux, Windows
imageviewer_15 = LBImageViewer(ImagePath_=convertpaths_15.Windows, _scale_="1.5", DisableClickable=False, SaveImgWithCoords=False, scale=1.5)  # -> ImagePath, Values, GIF

# ----
# preview grid results
entwine_6 = Entwine(
    Branch00=execute_ssh_async_52.Stdout,
    Branch01=execute_ssh_async_47.Stdout,
    Branch02=execute_ssh_async_48.Stdout,
    FlattenInputs=True)  # -> flatten(Result)
falsestart_19 = LBFalseStartToggle(False)
or_2 = GateOr(A=execute_ssh_async_52.Ran, B=falsestart_19)
_17037_schedule = Integer(cluster_4)
download = Download(
    LinuxFilePaths=entwine_6,
    Run=or_2,
    stdouts="C:\Users\mm1013\simulation\DDS_Total.ill>JOIN<C:\Users\mm1013\simulation\annualR_DCD.ill>JOIN<C:\Users\mm1013\simulation\annualR_DCD.ill")  # -> Status, FilePaths, Run
list_3 = ItemSelector(
    download.FilePaths,
    {"C:\Users\mm1013\simulation\DDS_Total.ill", "C:\Users\mm1013\simulation\annualR_DCD.ill", "C:\Users\mm1013\simulation\annualR_DCD.ill"}, selected="C:\Users\mm1013\simulation\DDS_Total.ill")
annualresults = AnnualResults(
    IllFile=list_3,
    Schedule=_17037_schedule,
    Min=300,
    Max=0,
    Run=invert(download.Run),
    stdouts="#?RADIANCE>JOIN<rmtxop /home/mss/simulation/test_project2/results/annualR_DC.ill + -s -1 /home/mss/simulation/test_project2/results/annualR_DCD.ill + /home/mss/simulation/test_project2/results/annualR_DCD.ill>JOIN<rmtxop -fa -t -c 47.4 119.9 11.6 ->JOIN<dctimestep /home/mss/simulation/test_project2/mtxs/dc_illum.mtx /home/mss/simulation/weatherData/DNK_DRY_OFFICIAL_2001-2010_epw-fil.smx>JOIN<CAPDATE= 2022:08:18 07:16:19>JOIN<GMT= 2022:08:18 05:16:19>JOIN<Applied 1x3 matrix transform>JOIN<Transposed rows and columns>JOIN<NROWS=8760>JOIN<NCOLS=274>JOIN<NCOMP=1>JOIN<FORMAT=ascii",
    numbers=[0.8358447489, 0.8388127854, 0.8388127854, 0.84543379, 0.847260274, 0.852283105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])  # -> Headers, Results, Ran
bnd = Bounds(Numbers=annualresults.Results)
pt_3 = Point(flatten(pt))
pt_4 = Point(pt_3)

# ----
# round to .2 (visual)
panel_225 = Panel(".2")
division = Division(A=annualresults.Results, B=panel_225)
int_2 = Integer(division)
multiplication = Multiplication(A=int_2, B=panel_225)

gradient = Gradient(
    LowerLimit="1",
    UpperLimit="0",
    Parameter=multiplication,
    stops=[0: RGB(234, 38, 0), 0.25: RGB(234, 126, 0), 0.5: RGB(254, 244, 84), 0.75: RGB(173, 203, 249), 1: RGB(75, 107, 169)])
preview = CustomPreview(Geometry=pt_4, Material=gradient)

# ==== cluster Cluster
L = ClusterInput()
item = ListItem(List=flatten(L), Index=0, Wrap=True)
rec = DataRecorder(item, DataLimit=-10, RecordData=True)
lng = ListLength(List=rec)
L_2 = ClusterOutput(lng)

# ==== cluster Normals
amplitude = ClusterInput()
amplitude_2 = Data(amplitude)
geo = ClusterInput()
merge = Merge(Data1=flatten(amplitude_2), Data2=flatten("1m"))
geo_2 = Geometry(geo)
item = ListItem(List=merge, Index=0, Wrap=True)
facen = FaceNormals(Mesh=geo_2)  # -> Centers, Normals
U = Units(ValueString=item)
avr = Average(Input=facen.Centers)
avr_2 = Average(Input=facen.Normals)
unflatten = UnflattenTree(Tree=avr, Guide=geo_2)
unflatten_2 = UnflattenTree(Tree=avr_2, Guide=geo_2)
amp = Amplitude(Vector=unflatten_2, Amplitude=U)
pl = PlaneNormal(Origin=unflatten, ZAxis=unflatten_2)
norm = Vector(amp)
center = Point(unflatten)
P = ClusterOutput(pl)
norm_2 = ClusterOutput(norm)
center_2 = ClusterOutput(center)

# ==== cluster Ex
T = ClusterInput()
rep = ReplaceText(Text=T, Find="\", Replace="\\", RecursiveReplace=False)
rep_2 = ReplaceText(Text=rep, Find="$", Replace="\$", RecursiveReplace=False)
rep_3 = ReplaceText(Text=rep_2, Find="`", Replace="\`", RecursiveReplace=False)
R = ClusterOutput(rep_3)

# ==== cluster Cluster_2
horizontaldiffrad = ClusterInput()
horizontaldiffrad_2 = Number(horizontaldiffrad)
lng = ListLength(List=horizontaldiffrad_2)
lng_2 = ListLength(List=horizontaldiffrad_2)
series = Series(Start=0, Step=0, Count=lng)
division = Division(A=lng, B=2)
series_2 = Series(Start=0, Step=1, Count=lng_2)
subtraction = Subtraction(A=division, B=1)
sort = SortList(Keys=horizontaldiffrad_2, ValuesA=series_2)  # -> reverse(Keys), reverse(ValuesA)
dom = ConstructDomain(DomainStart="0", DomainEnd=subtraction)
subset = SubList(List=sort.ValuesA, Domain=dom, Wrap=True)  # -> List, Index
replace = ReplaceItems(List=series, Item="1", Indices=subset.List, Wrap=False)
schedule_01 = ClusterOutput(replace)

# ==== cluster DefaultMSS
default_value_flattened = ClusterInput()
data = ClusterInput()
data_2 = Data(data)
merge = Merge(Data1=flatten(data_2), Data2="0")  # -> flatten(Result)
default_value_flattened_2 = Data(flatten(default_value_flattened))
lng = ListLength(List=merge)
equals = Equality(FirstNumber=lng, SecondNumber="1")  # -> Equality, Inequality
cull = CullPattern(List=data_2, CullPattern=invert(equals.Equality))
panel = Panel(equals.Equality)
cull_2 = CullPattern(List=default_value_flattened_2, CullPattern=equals.Equality)
data_3 = Data([cull, cull_2])
data_4 = ClusterOutput(data_3)

# ==== cluster MeshIt2: Meshes everything in the input. Graft the input if you want to make several meshes, otherwise returns a joined mesh.
mesh_brep = ClusterInput()
mesh_brep_2 = Geometry(simplify(mesh_brep))
tmatch = MatchText(Text=mesh_brep_2, RegEx="(mesh)", Case=False)
tmatch_2 = MatchText(Text=mesh_brep_2, RegEx="(brep)|(polysurface)|(surface)|(extrusion)", Case=False)
group = Group(Objects=mesh_brep_2)
cull = CullPattern(List=mesh_brep_2, CullPattern=tmatch_2)
mesh = MeshBrep(
    Brep=cull,
    Settings={GridMaxCount=0, GridMinCount=16, JaggedSeams=False, MaxEdgeLength=0, MinEdgeLength=0.0001, MinTolerance=0, Refine=True, RefineAngle=0, RelativeTolerance=0.65, SimplePlanes=True, Tolerance=0})  # -> simplify(Mesh)
cull_2 = CullPattern(List=mesh_brep_2, CullPattern=tmatch)  # -> simplify(List)

# ----
# Fix invalid mesh
panel = Panel("Invalid Mesh")  # disabled
mesh_2 = Mesh(mesh)  # disabled
tmatch_3 = MatchText(Text=mesh_2, RegEx=panel, Case=False)  # disabled
unweave = Unweave(List=mesh_2, UnweavePattern=tmatch_3)  # -> Data0, Data1; disabled
explode = MeshExplode(Mesh=unweave.Data1, Interpolate=False)  # -> simplify(Faces); disabled
abc_a = ABC(data=explode)  # disabled
panel_2 = Panel("0")  # disabled
num = Number(panel_2)  # disabled
area = MeshArea(Mesh=abc_a)  # -> Area, Centroid; disabled
equals = Equality(FirstNumber=area.Area, SecondNumber=num)  # -> Equality, Inequality; disabled
cull_3 = CullPattern(List=abc_a, CullPattern=equals.Inequality)  # disabled
mjoin = MeshJoin(Meshes=[cull_3, unweave.Data0])  # disabled

# ----
# Fix invalid mesh
panel_3 = Panel("Invalid Mesh")  # disabled
mesh_3 = Mesh(cull_2)  # disabled
tmatch_4 = MatchText(Text=mesh_3, RegEx=panel_3, Case=False)  # disabled
unweave_2 = Unweave(List=mesh_3, UnweavePattern=tmatch_4)  # -> Data0, Data1; disabled
explode_2 = MeshExplode(Mesh=unweave_2.Data1, Interpolate=False)  # -> simplify(Faces); disabled
abc_a_2 = ABC(data=explode_2)  # disabled
panel_4 = Panel("0")  # disabled
num_2 = Number(panel_4)  # disabled
area_2 = MeshArea(Mesh=abc_a_2)  # -> Area, Centroid; disabled
equals_2 = Equality(FirstNumber=area_2.Area, SecondNumber=num_2)  # -> Equality, Inequality; disabled
cull_4 = CullPattern(List=abc_a_2, CullPattern=equals_2.Inequality)  # disabled
mjoin_2 = MeshJoin(Meshes=[cull_4, unweave_2.Data0])  # disabled

mjoin_3 = MeshJoin(Meshes=[mesh, cull_2])
c_script = CSharpScript(mesh=mjoin_3)  # -> A; inputs mesh: Mesh
# ---------- c_script: C# ----------
    mesh.Faces.CullDegenerateFaces();
    A = mesh;
# ---------- end c_script ----------
abc_a_3 = ABC(data=mjoin)  # disabled
abc_a_4 = ABC(data=mjoin_2)  # disabled
clean = CleanTree(RemoveNulls=True, RemoveInvalid=True, RemoveEmpty=False, Tree=[abc_a_3, abc_a_4])  # disabled
mjoin_4 = MeshJoin(Meshes=clean)  # disabled
unflatten = UnflattenTree(Tree=c_script, Guide=group)
mesh_explode = MeshExplode(m=mjoin_4)  # -> out, simplify(A); disabled
# ---------- mesh_explode: VB ----------
    Component.Params.Input(0).Name = "Mesh"
    Component.Params.Input(0).Description = "Open or closed mesh"

    Component.Params.Output(1).Name = "Mesh"
    Component.Params.Output(1).Description = "If successful, a valid mesh"

    If m IsNot Nothing Then
      Dim pts As Rhino.Geometry.Collections.MeshVertexList
      Dim faces As Rhino.Geometry.Collections.MeshFaceList
      Dim clrs As Rhino.Geometry.Collections.MeshVertexColorList
      Dim i As Integer
      Dim mshs As New list(Of mesh)

      faces = m.Faces
      pts = m.Vertices
      If m.VertexColors.count() = 0 Then m.VertexColors.CreateMonotoneMesh(color.FromArgb(100, 100, 100))
      clrs = m.VertexColors

      For i = 0 To faces.count() - 1 Step 1
        Dim fc As New meshFace
        Dim face As New MeshFace
        Dim ptList As New list(Of point3d)
        Dim clrList As New list(Of color)
        Dim msh As New mesh

        face = faces(i)

        ptList.add(New point3d(pts(face.A)))
        ptList.add(New point3d(pts(face.B)))
        ptList.add(New point3d(pts(face.C)))
        If face.IsQuad Then ptList.add(New point3d(pts(face.D)))

        clrList.add(clrs(face.A))
        clrList.add(clrs(face.B))
        clrList.add(clrs(face.C))
        If face.IsQuad Then clrList.add(clrs(face.D))

        If face.IsQuad Then fc = New meshFace(0, 1, 2, 3) Else fc = New meshface(0, 1, 2)

        msh.Vertices.AddVertices(ptList.toarray())
        msh.Faces.AddFace(fc)
        msh.VertexColors.SetColors(clrList.toarray())
        mshs.add(msh)
      Next

      A = mshs
    End If
# ---------- end mesh_explode ----------
c_script_2 = CSharpScript(mesh=mjoin_4)  # -> A; inputs mesh: Mesh; disabled; same code as c_script
c_script_3 = CSharpScript(mesh=mesh_explode.A)  # -> out, A; inputs mesh: list of Mesh; disabled
# ---------- c_script_3: C# ----------
    List<bool> isValid = new List<bool>();
    for (int i = 0; i < mesh.Count; i++)
    {
      isValid.Add(mesh[i].IsValid);
    }
    
    A = isValid;
# ---------- end c_script_3 ----------
mesh_joined = Mesh(unflatten)
cullf = CullFaces(Mesh=mjoin_4, Pattern=invert(c_script_3.A))  # disabled
mesh_joined_2 = ClusterOutput(mesh_joined)

# ==== cluster ABC
data = ClusterInput()
data_2 = Data(data)
path_mapper = PathMapper(
    data_2,
    source=["{A;B;C;D;E;F;G}", "{A;B;C;D;E;F}", "{A;B;C;D;E}", "{A;B;C;D}", "{A;B;C}", "{A;B}", "{A}"],
    target=["{A}", "{A}", "{A}", "{A}", "{A}", "{A}", "{A}"])
data_3 = Data(path_mapper)
data_4 = ClusterOutput(data_3)
