# Grasshopper definition TestPaths.gh (Grasshopper 1.0.7)
# Copyright: 2021
# plug-ins: MantaRay, LadybugGrasshopper

panel = Panel("""echo hi2_1
echo hi2_2""")

# ----
# Connect
panel_2 = Panel("mm1013")
connect_ssh = ConnectSSH(User=panel_2, Ip="10.71.5.181", Password="_prompt", _port=22, Connect=Toggle(True), Prefixes=". /etc/profile")  # -> Status, Run, Run_2
panel_3 = Panel(connect_ssh.Status)

panel_4 = Panel("localhost")
panel_5 = Panel("mss")
falsestart = LBFalseStartToggle(True)
panel_6 = Panel("fef")
entwine = Entwine(Branch00="echo hi", Branch01=panel, FlattenInputs=True)
logviewer = LogViewer(Number=10)  # -> CurrentTasks, Logs
executessh_wip = ExecuteSSHWIP(
    _SSHCommands_=entwine,
    Run=falsestart,
    addPrefix=True,
    description="""echo hi

- - -

echo hi2_1
echo hi2_2""",
    fireLogs=True,
    lastRunTime=21.5518,
    name="XX",
    staticDescription="""---

echo ll1
echo llll""",
    suppressWarnings=False,
    results=["hi", """hi2_1
_JOIN_
hi2_2"""],
    commands=["echo hi", """echo hi2_1
_JOIN_
echo hi2_2"""])  # -> Stdout, Stderr_, Ran
overrides = ApplyOverrides(Input_="<cpus-2>", Cpus=graft("776"))  # -> Output, Pairs
panel_7 = Panel(overrides.Output)
panel_8 = Panel(executessh_wip.Stdout)
panel_9 = Panel(logviewer.CurrentTasks)
panel_10 = Panel(logviewer.Logs)
