# Grasshopper definition TestRenders_with_results.gh (Grasshopper 1.0.7)
# Copyright: 2021
# Copyright: 2022-29-14
# Copyright: 2022-22-28
# plug-ins: MantaRay, LadybugGrasshopper, Human, Bombyx 2

falsestart = LBFalseStartToggle(False)

# ----
# Setup globals
panel = Panel("""<LinuxHome>
simulation""")
panel_2 = Panel("""proj
projname""")
global_overrides = GlobalOverrides(Keys=panel_2, Values=panel)
panel_3 = Panel(global_overrides)

panel_4 = Panel("C:\MantaRayLinux")

# ----
# Local Connect
python = GhPythonScript()  # -> username; disabled
# ---------- python: Python ----------
__author__ = "mm1013"
__version__ = "2022.09.25"

import rhinoscriptsyntax as rs

import System

username = System.Environment.UserName

if username == "mm1013":
    username = "mss"
# ---------- end python ----------
toggle = BooleanToggle(True)  # disabled
panel_5 = Panel("127.0.0.1")  # disabled
panel_6 = Panel(python)  # disabled
connect = ConnectSSHFTP(User=panel_6, Ip="127.0.0.1", Password="_prompt", _port=22, Connect=toggle)  # -> Status, Prefixes, Run; disabled
panel_7 = Panel(connect.Status)  # disabled

od_outdated = ColourSwatch(SwatchColor=RGBA(97, 97, 97, 150))
u_updated = ColourSwatch(SwatchColor=RGBA(208, 115, 230, 112))
toggle_2 = BooleanToggle(False)
g_general = ColourSwatch(SwatchColor=RGBA(245, 243, 237, 156))
o_outputs = ColourSwatch(SwatchColor=RGBA(160, 218, 242, 203))
s_settings = ColourSwatch(SwatchColor=RGBA(224, 145, 81, 154))
cc_core2 = ColourSwatch(SwatchColor=RGBA(230, 216, 186, 208))
y_yellow = ColourSwatch(SwatchColor=RGBA(247, 244, 64, 188))
i_inputs = ColourSwatch(SwatchColor=RGBA(125, 217, 98, 150))
c_core = ColourSwatch(SwatchColor=RGBA(235, 227, 206, 203))
r_red = ColourSwatch(SwatchColor=RGBA(242, 63, 63, 203))

# ----
# Test connection
testconnection = TestConnection()  # -> Status, Errors
panel_8 = Panel(testconnection.Status)
panel_9 = Panel(testconnection.Errors)

# ----
# 10klx overcast sky (RwR p357)
# # start of sky definition for daylighting studies
# # location name: COPENHAGEN_DNK LAT: 55.63
# !gensky 5 14 14.0 -c -a 55.63 -o -12.67 -m -15.0 | xform -rz 0.0
# skyfunc glow sky_mat
# 0
# 0
# 4
# 1 1 1 0
# sky_mat source sky
# 0
# 0
# 4
# 0 0 1 180
# skyfunc glow ground_glow
# 0
# 0
# 4
# 1 .8 .5 0
# ground_glow source ground
# 0
# 0
# 4
# 0 0 -1 180
# # end of sky definition for daylighting studies
falsestart_2 = LBFalseStartToggle(True)
bool = Boolean(falsestart_2)
and_append_the_ground = Panel("""##The 1 will be multiplie with brightfunc
skyfunc glow sky_glow
0
0
4 1 1 1 0

##Set to 1 as it will be multiplied with the gensky result
sky_glow source sky
0
0
4 0 0 1 180

##Set to 1 as it will be multiplied with the gensky result
skyfunc glow ground_glow
0
0
4 1 1 1 0

##The ground pane
ground_glow source ground
0
0
4 0 0 -1 180""")
executessh = ExecuteSSH(
    _SSHCommands_="gensky -ang 45 0 -c -B 55.866",
    Run=bool,
    addPrefix=True,
    fireLogs=False,
    lastRunTime=54.0842,
    suppressWarnings=False,
    results="""# gensky -ang 45 0 -c -B 55.866
# Ground ambient level: 17.8

void brightfunc skyfunc
2 skybr skybright.cal
0
3 2 2.29e+01 3.56e+00""",
    commands="gensky -ang 45 0 -c -B 55.866")  # -> Stdout, Stderr_, Ran
concat = Concatenate(FragmentC="##Will control the gradient of the sky", FragmentA=executessh.Stdout, FragmentB=and_append_the_ground)
panel_10 = Panel("""mkdir -p <proj>/skies/
echo "<sky>" > <proj>/skies/<target>
echo "<proj>/skies/<target>"
""")
panel_11 = Panel(concat)
overrides = ApplyOverrides(Input=panel_10, Sky=graft(panel_11), Target=graft("overcast_sky.rad"))  # -> Output, DynamicOutput
executessh_2 = ExecuteSSH(
    _SSHCommands_=overrides.DynamicOutput,
    Run=executessh.Ran,
    addPrefix=True,
    description="""mkdir -p ~/MantaRay/Andrei/skies/
echo "##Will control the gradient of the sky
# gensky -ang 45 0 -c -B 55.866
# Ground ambient level: 17.8

void brightfunc skyfunc
2 skybr skybright.cal
0
3 2 2.29e+01 3.56e+00

##The 1 will be multiplie with brightfunc
skyfunc glow sky_glow
0
0
4 1 1 1 0

##Set to 1 as it will be multiplied with the gensky result
sky_glow source sky
0
0
4 0 0 1 180

##Set to 1 as it will be multiplied with the gensky result
skyfunc glow ground_glow
0
0
4 1 1 1 0

##The ground pane
ground_glow source ground
0
0
4 0 0 -1 180" > ~/MantaRay/Andrei/skies/overcast_sky.rad
echo "~/MantaRay/Andrei/skies/overcast_sky.rad"
""",
    fireLogs=False,
    lastRunTime=61.9741,
    suppressWarnings=False,
    results="""_JOIN_
_JOIN_
~/MantaRay/Andrei/skies/overcast_sky.rad""",
    commands="""mkdir -p ~/MantaRay/Andrei/skies/
_JOIN_
echo "##Will control the gradient of the sky
# gensky -ang 45 0 -c -B 55.866
# Ground ambient level: 17.8

void brightfunc skyfunc
2 skybr skybright.cal
0
3 2 2.29e+01 3.56e+00

##The 1 will be multiplie with brightfunc
skyfunc glow sky_glow
0
0
4 1 1 1 0

##Set to 1 as it will be multiplied with the gensky result
sky_glow source sky
0
0
4 0 0 1 180

##Set to 1 as it will be multiplied with the gensky result
skyfunc glow ground_glow
0
0
4 1 1 1 0

##The ground pane
ground_glow source ground
0
0
4 0 0 -1 180" > ~/MantaRay/Andrei/skies/overcast_sky.rad
_JOIN_
echo "~/MantaRay/Andrei/skies/overcast_sky.rad"
""")  # -> Stdout, Stderr_, Ran
panel_12 = Panel(overrides.DynamicOutput)
panel_13 = Panel(executessh_2.Stderr_)
sky_ovc = Text(executessh_2.Stdout)

executessh_3 = ExecuteSSH(
    _SSHCommands_="genbox",
    Run=falsestart,
    addPrefix=True,
    fireLogs=False,
    lastRunTime=8,
    suppressWarnings=False,
    stderr="Usage: genbox material name xsize ysize zsize [-i] [-b bevel | -r rounde]",
    commands="genbox")  # -> Stdout, Stderr_, Ran

# ----
# Read rhino file and prepare simple geometry
parserhinofile = ParseRhinoFile(LayerPrefix="Daylight_Inputs::_", Grids="_Grids")  # -> GlassGeometries, GlassModifiers, port, OpaqueGeometries, OpaqueModifiers, port_2, CustomGeometries, ModifierNames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
falsestart_3 = LBFalseStartToggle(True)
panel_14 = Panel(parserhinofile.SkippedLayers)

# ----
# Create working folder
panel_15 = Panel("""mkdir -p <LinuxHome>
mkdir -p <LinuxHome>/radFiles
mkdir -p <LinuxHome>/objFiles
echo <LinuxHome>""")
prep_octrees = LBFalseStartToggle(False)
overrides_2 = ApplyOverrides(Input=panel_15)  # -> Output, DynamicOutput
executessh_4 = ExecuteSSH(
    _SSHCommands_=overrides_2.DynamicOutput,
    Run=prep_octrees,
    addPrefix=True,
    description="""mkdir -p ~/MantaRay/Andrei
mkdir -p ~/MantaRay/Andrei/radFiles
mkdir -p ~/MantaRay/Andrei/objFiles
echo ~/MantaRay/Andrei""",
    fireLogs=False,
    lastRunTime=21,
    name="Create working dir",
    suppressWarnings=False,
    results="/home/lio/MantaRay/Andrei",
    commands="""mkdir -p ~/MantaRay/Andrei
mkdir -p ~/MantaRay/Andrei/radFiles
mkdir -p ~/MantaRay/Andrei/objFiles
echo ~/MantaRay/Andrei""")  # -> Stdout, Stderr_, Ran

colorgroups = CSharpScript(
    Colors=[i_inputs, s_settings, g_general, c_core, o_outputs, r_red, y_yellow, u_updated, od_outdated, cc_core2],
    Enable=toggle_2,
    Rename=Toggle(False),
    RunOnce=Button(),
    Debug=Toggle(False))  # -> out; inputs Colors: list of Color, Enable: Boolean, Rename: Boolean, RunOnce: Boolean, Debug: Boolean
# ---------- colorgroups: C# usings ----------
using System.Linq;
using System.Text;
using System.Reflection;
# ---------- colorgroups: C# ----------
    msg.Clear();


    this.Component.Message = "id: " + id.ToString();

    _debug = Debug; //Set to true to have all events printed in rhino log
    _rename = Rename;

    if (Enable)
    {
      msg.AppendFormat("Set up events on ID {0}\n", id);
      SetupDict(); // Create a dictionary of the input swatches
      SetEventHandlers(); // This would do the job.


    }
    else
    {
      RemoveEventHandlers();
    }
    if (RunOnce)
    {
      foreach(Grasshopper.Kernel.Special.GH_Group grp in Grasshopper.Instances.ActiveCanvas.Document.Objects.OfType<Grasshopper.Kernel.Special.GH_Group>())
      {
        ColorGroup(grp, null); // You decide if it should run once on all existing groups

      }
    }

    Print(msg.ToString());


    // Component setup
    Component.Description = "Set up event handlers to color groups based on prefixes such as 'in_' and 'out_'.\n"
      + "Please insert only swatcheds directly into the Colors input\n\n"
      + "MIT License. Copyright Mathias Sønderskov Schaltz 2022";
    Component.Params.Input[0].Description = "Please insert only swatcheds directly into the Colors input.\nRemember to rename them";
    Component.Params.Input[1].Description = "Toggle to run...";
    Component.Params.Input[2].Description = "Set to true if you want to automatically rename the groups and remove prefix. Default is false.";
    Component.Params.Input[3].Description = "Set to true to run it once and color all existing groups.";
    Component.Params.Input[Component.Params.Input.Count - 1].Description = "Set debug to true to get all the events printed in the rhino log";
# ---------- colorgroups: C# additional code ----------
  public static Random rnd = new Random();
  public int id = rnd.Next(0, 1000);
  StringBuilder msg = new StringBuilder();
  Dictionary<string, System.Drawing.Color> colorDict = new Dictionary<string, System.Drawing.Color>();

  bool _debug = false;
  bool _rename = false;

  public bool IdExists(int id)
  {
    IList<IGH_DocumentObject> objs = Grasshopper.Instances.ActiveCanvas.Document.Objects;
    return objs
      .OfType<IGH_Component>()
      .Where(ob => ob.NickName == this.Component.NickName)
      .Where(ob => ob.GetType().ToString() == "ScriptComponents.Component_CSNET_Script")
      .Where(ob => ob.Message == "id: " + id.ToString()).Any();

  }


  public void SetupDict()
  {
    colorDict.Clear();
    // Get all inputs to "Colors"
    IList<IGH_Param> colorSources = this.Component.Params.Input[0].Sources;
    if (colorSources.Count == 0)
    {
      throw new Exception("You forgot to setup the colors. Please input swatch components and rename them");
    }
    foreach(IGH_Param source in colorSources)
    {
      //if (source.Type.ToString() == "Grasshopper.Kernel.Types.GH_Colour")
      if (source is Grasshopper.Kernel.Special.GH_ColourSwatch)
      {
        string nickName = source.NickName.Split('_')[0].Trim() + "_";
        if(!colorDict.ContainsKey(nickName))
        {
          Grasshopper.Kernel.Special.GH_ColourSwatch swatch = (Grasshopper.Kernel.Special.GH_ColourSwatch) source;
          colorDict.Add(nickName, swatch.SwatchColour);
        }
        else
        {
          throw new Exception("Multiple swatches using the same name detected. Please rename");
        }
      }
      else
      {
        throw new Exception("Whacko! Why did you input a non-swatch into the Colors? " + source.Type.ToString());
      }

    }

    msg.AppendFormat("Set up the dictionaries with {0} colors\n", colorDict.Count);
    foreach(var pairs in colorDict)
    {
      msg.AppendFormat("{0} -> {1}\n", ("\"" + pairs.Key + "\"").PadRight(5 + colorDict.Keys.Select(k => k.Length).Max()), pairs.Value);
    }
  }

  public void SetEventHandlers()
  {

    // Always remove events first to avoid duplicates
    GrasshopperDocument.ObjectsAdded -= OnObjectsAdded;
    GrasshopperDocument.ObjectsDeleted -= OnObjectsRemoved;
    GrasshopperDocument.ObjectsDeleted -= OnDeleteThisComponent;

    // Attach events
    GrasshopperDocument.ObjectsAdded += OnObjectsAdded;
    GrasshopperDocument.ObjectsDeleted += OnObjectsRemoved;
    GrasshopperDocument.ObjectsDeleted += OnDeleteThisComponent;


    foreach(Grasshopper.Kernel.Special.GH_Group grp in GrasshopperDocument.Objects.OfType<Grasshopper.Kernel.Special.GH_Group>())
    {
      grp.ObjectChanged -= ColorGroup;
      grp.ObjectChanged += ColorGroup;

      //ColorGroup(grp, null); // Make sure to run it once
    }
    msg.AppendFormat("Added the eventhandlers on {0} existing groups and on future created groups\n", GrasshopperDocument.Objects.OfType<Grasshopper.Kernel.Special.GH_Group>().Count());
  }

  public void OnObjectsAdded(object sender, GH_DocObjectEventArgs e)
  {
    bool any = false;
    foreach (Grasshopper.Kernel.Special.GH_Group grp in e.Objects.OfType<Grasshopper.Kernel.Special.GH_Group>())
    {
      grp.ObjectChanged -= ColorGroup;
      grp.ObjectChanged += ColorGroup;
      any = true;
    }

    DebugWrite(any ? "Group Objects Added: Attaching Events to ObjectChanged" : "Objects Added - but no groups");
  }

  //Same but reversed
  public void OnObjectsRemoved(object sender, GH_DocObjectEventArgs e)
  {
    bool any = false;
    foreach (Grasshopper.Kernel.Special.GH_Group grp in e.Objects.OfType<Grasshopper.Kernel.Special.GH_Group>())
    {
      grp.ObjectChanged -= ColorGroup;
      any = true;
    }

    DebugWrite(any ? "Group Objects Removed, removing event" : "Objects Removed - although not a group");

  }



  public void RemoveEventHandlers()
  {
    GrasshopperDocument.ObjectsAdded -= OnObjectsAdded;
    GrasshopperDocument.ObjectsDeleted -= OnObjectsRemoved;


    foreach(Grasshopper.Kernel.Special.GH_Group grp in GrasshopperDocument.Objects.OfType<Grasshopper.Kernel.Special.GH_Group>())
    {
      grp.ObjectChanged -= ColorGroup;

    }
    msg.AppendFormat("Removed event handlers on document and on {0} groups\n", GrasshopperDocument.Objects.OfType<Grasshopper.Kernel.Special.GH_Group>().Count());

  }

  public void ColorGroup(object sender, EventArgs e)
  {
    if (!IdExists(id))
    {
      DebugWrite("Component not relevant. Disabling old id + " + id.ToString());
      RemoveEventHandlers();
      return;
    }

    Grasshopper.Kernel.Special.GH_Group grp = sender as Grasshopper.Kernel.Special.GH_Group;
    if (grp == null) return; //not type GH_Group
    //if (!grp.NickName.EndsWith("_")) return;

    string[] nameParts = grp.NickName.Split('_');
    if (nameParts.Length <= 1)
      return;
    string prefix = grp.NickName.Split('_')[0].Trim() + '_';

    string prefixes = String.Join(", ", colorDict.Keys.Select(k => "\"" + k + "\""));

    msg.Append("prefix " + prefix + "\n");
    if (colorDict.ContainsKey(prefix))
    {
      //if (grp.NickName.EndsWith("_"))
      grp.Colour = colorDict[prefix];
      if (_rename)
      {
        grp.NickName = grp.NickName.Replace(prefix, "");
      }

      DebugWrite("Colored " + grp.NickName);

    }
    else
    {
      DebugWrite("Group changed but not relevant: prefix " + prefix + " is not among " + prefixes);
    }

  }
  public void DebugWrite(string msg)
  {
    if (_debug)
    {
      Rhino.RhinoApp.WriteLine(String.Format("[ColGrps {0}]: {1}", id, msg));
    }
  }

  public void OnDeleteThisComponent(object sender, GH_DocObjectEventArgs e)
  {

    if (e.Objects.OfType<Grasshopper.Kernel.GH_Component>().Where(o => o.NickName == this.Component.NickName).Any())
    {
      DebugWrite("Removed template component. Removing all the eventhandlers");
      RemoveEventHandlers();
    }

  }
# ---------- end colorgroups ----------

fixparams = CSharpScript(FixOnce=Button(), Enable=toggle_2, Debug=Toggle(False))  # -> out; inputs FixOnce: Boolean, Enable: Boolean, Debug: Boolean
# ---------- fixparams: C# usings ----------
using System.Text;
using System.Linq;
using Grasshopper.Kernel.Special;
# ---------- fixparams: C# ----------
    _debug = Debug;
    _enable = Enable;
    msg.Clear();
    this.Component.Message = "id: " + id.ToString();




    if (Enable)
    {
      SetEventHandlers();
    }
    else
    {
      RemoveEventHandlers();
    }


    if (FixOnce)
    {
      FixAll();
    }

    Print(msg.ToString());

    // Component setup
    Component.Description = "Set up event handlers to change params to show nickname and not icon"
      + "\n\n"
      + "MIT License. Copyright Mathias Sønderskov Schaltz 2022";
    Component.Params.Input[0].Description = "Run me once on the document";
    Component.Params.Input[1].Description = "Toggle to enable event listener";
    Component.Params.Input[Component.Params.Input.Count - 1].Description = "Set debug to true to get all the events printed in the rhino log";
# ---------- fixparams: C# additional code ----------
  public static Random rnd = new Random();
  public int id = rnd.Next(0, 1000);
  StringBuilder msg = new StringBuilder();
  bool _debug = false;
  bool _enable = false;

  public Dictionary<IGH_ActiveObject, HashSet<GH_Group>> groupsPerObject = new Dictionary<IGH_ActiveObject, HashSet<GH_Group>>();


  public void OnObjectsAdded(object sender, GH_DocObjectEventArgs e)
  {
    if (!IdExists(id))
    {
      DebugWrite("[FixParam] Component not relevant. Disabling old id " + id.ToString());
      RemoveEventHandlers();
      return;
    }


    if(_enable)
    {
      foreach(IGH_Param par in e.Objects.OfType<IGH_Param>())
      {
        FixInputs(par);
      }
    }


  }

  public void FixAll()
  {
    //DebugWrite("Fixing all?");
    foreach(IGH_Param par in GrasshopperDocument.Objects.OfType<IGH_Param>())
    {

      FixInputs(par);
    }
  }




  public void FixInputs(IGH_ActiveObject obj)
  {



    IGH_Param par = obj as IGH_Param;
    if (par != null)
    {

      par.IconDisplayMode = GH_IconDisplayMode.name;


    }

  }


  public void SetEventHandlers()
  {

    GrasshopperDocument.ObjectsAdded -= OnObjectsAdded;
    GrasshopperDocument.ObjectsAdded += OnObjectsAdded;
    GrasshopperDocument.ObjectsDeleted -= OnDeleteThisComponent;
    GrasshopperDocument.ObjectsDeleted += OnDeleteThisComponent;
    msg.AppendFormat("Added the eventhandlers to OnObjectsAdded\n", GrasshopperDocument.Objects.OfType<Grasshopper.Kernel.Special.GH_Group>().Count());
  }

  public void RemoveEventHandlers()
  {
    GrasshopperDocument.ObjectsAdded -= OnObjectsAdded;
    GrasshopperDocument.ObjectsDeleted -= OnDeleteThisComponent;

    msg.AppendFormat("Removed wire event handlers on document\n", GrasshopperDocument.Objects.OfType<Grasshopper.Kernel.Special.GH_Group>().Count());

  }

  public void OnDeleteThisComponent(object sender, GH_DocObjectEventArgs e)
  {

    if (e.Objects.OfType<Grasshopper.Kernel.GH_Component>().Where(o => o.NickName == this.Component.NickName).Any())
    {
      DebugWrite("Removed template component. Removing all the eventhandlers");
      RemoveEventHandlers();
    }

  }

  public bool IdExists(int id)
  {
    IList<IGH_DocumentObject> objs = Grasshopper.Instances.ActiveCanvas.Document.Objects;
    return objs
      .OfType<IGH_Component>()
      .Where(ob => ob.NickName == this.Component.NickName)
      .Where(ob => ob.GetType().ToString() == "ScriptComponents.Component_CSNET_Script")
      .Where(ob => ob.Message == "id: " + id.ToString()).Any();

  }

  public void DebugWrite(string msg)
  {
    if (_debug)
    {
      Rhino.RhinoApp.WriteLine(String.Format("[FixParams {0}]: {1}", id, msg));
    }
  }
# ---------- end fixparams ----------

fixwires = CSharpScript(FixOnce=Button(), Enable=toggle_2, Debug=Toggle(False))  # -> out; inputs FixOnce: Boolean, Enable: Boolean, Debug: Boolean
# ---------- fixwires: C# ----------
    _debug = Debug;
    _enable = Enable;
    msg.Clear();
    this.Component.Message = "id: " + id.ToString();


    SetDictionary();

    if (Enable)
    {
      SetEventHandlers();
    }
    else
    {
      RemoveEventHandlers();
    }


    if (FixOnce)
    {
      FixAll();
    }

    Print(msg.ToString());
    
    // Component setup
    Component.Description = "Set up event handlers to change all wire types across groups to faint"
      + "\n\n"
      + "MIT License. Copyright Mathias Sønderskov Schaltz 2022";
    Component.Params.Input[0].Description = "Run me once on the document";
    Component.Params.Input[1].Description = "Toggle to enable event listener";
    Component.Params.Input[Component.Params.Input.Count - 1].Description = "Set debug to true to get all the events printed in the rhino log";
# ---------- fixwires: C# additional code ----------
  public static Random rnd = new Random();
  public int id = rnd.Next(0, 1000);
  StringBuilder msg = new StringBuilder();
  bool _debug = false;
  bool _enable = false;

  public Dictionary<IGH_ActiveObject, HashSet<GH_Group>> groupsPerObject = new Dictionary<IGH_ActiveObject, HashSet<GH_Group>>();


  public void OnSolutionExpired(object sender, GH_DocUndoEventArgs e)
  {
    if(_enable)
      FixAll();
  }

  public void FixAll()
  {
    //DebugWrite("Fixing all?");
    foreach(IGH_ActiveObject key in groupsPerObject.Keys.Where(k => groupsPerObject[k].Count() > 0))
    {

      FixInputs(key);
    }
  }



  public bool HasGroup(IGH_ActiveObject obj)
  {
    return groupsPerObject[obj].Count > 0;
  }


  public void FixInputs(IGH_ActiveObject obj)
  {

    if (!IdExists(id))
    {
      DebugWrite("Component not relevant. Disabling old id " + id.ToString());
      RemoveEventHandlers();
      return;
    }

    //List<List<IGH_ActiveObject>> parents = new List<List<IGH_ActiveObject>>();
    IGH_Param par = obj as IGH_Param;
    if (par != null && par.Sources != null)
    {


      IEnumerable<IGH_ActiveObject> p = par.Sources.Select(s => s.Attributes.GetTopLevel.DocObject as IGH_ActiveObject);
      //parents.Add(p);
      if(HasGroup(obj) && p.All(o => !HasGroupsInCommon(o, obj)) && par.WireDisplay != GH_ParamWireDisplay.faint)
      {
        DebugWrite("Fixing " + par.Attributes.GetTopLevel.DocObject.NickName);
        par.WireDisplay = GH_ParamWireDisplay.faint;
      }

    }

    IGH_Component comp = obj as IGH_Component;
    if (comp != null)
    {
      foreach(IGH_Param inp in comp.Params.Input)
      {

        IEnumerable<IGH_ActiveObject> p = inp.Sources.Select(i => i.Attributes.GetTopLevel.DocObject as IGH_ActiveObject);

        if(HasGroup(obj) && p.All(o => !HasGroupsInCommon(o, obj)) && inp.WireDisplay != GH_ParamWireDisplay.faint)
        {
          DebugWrite("Fixing " + inp.Attributes.GetTopLevel.DocObject.NickName);
          inp.WireDisplay = GH_ParamWireDisplay.faint;
        }
      }

    }



  }





  public void SetDictionary()
  {
    IList<IGH_DocumentObject> objects = Grasshopper.Instances.ActiveCanvas.Document.Objects.ToList();
    //Print(String.Join(", ", objects.Select(o => o.NickName)));

    groupsPerObject = objects
      .Where(o => o.GetType() != typeof(GH_Group))
      .OfType<IGH_ActiveObject>()
      .ToDictionary(o => o, o => new HashSet<GH_Group>());

    foreach(GH_Group grp in objects.OfType<GH_Group>())
    {

      foreach(IGH_ActiveObject obj in grp.ObjectsRecursive().OfType<IGH_ActiveObject>())
      {
        groupsPerObject[obj].Add(grp);

      }
    }



  }

  public bool HasGroupsInCommon(IGH_ActiveObject obj1, IGH_ActiveObject obj2)
  {
    HashSet<GH_Group> set1 = groupsPerObject[obj1];
    HashSet<GH_Group> set2 = groupsPerObject[obj2];

    set1.IntersectWith(set2);

    return set1.Any();
  }

  public void SetEventHandlers()
  {

    GrasshopperDocument.UndoStateChanged -= OnSolutionExpired;
    GrasshopperDocument.UndoStateChanged += OnSolutionExpired;
    GrasshopperDocument.ObjectsDeleted -= OnDeleteThisComponent;
    GrasshopperDocument.ObjectsDeleted += OnDeleteThisComponent;
    msg.AppendFormat("Added the eventhandlers to UndoStateChanged\n", GrasshopperDocument.Objects.OfType<Grasshopper.Kernel.Special.GH_Group>().Count());
  }

  public void RemoveEventHandlers()
  {
    GrasshopperDocument.UndoStateChanged -= OnSolutionExpired;
    GrasshopperDocument.ObjectsDeleted -= OnDeleteThisComponent;

    msg.AppendFormat("Removed wire event handlers on document\n", GrasshopperDocument.Objects.OfType<Grasshopper.Kernel.Special.GH_Group>().Count());

  }

  public void OnDeleteThisComponent(object sender, GH_DocObjectEventArgs e)
  {

    if (e.Objects.OfType<Grasshopper.Kernel.GH_Component>().Where(o => o.NickName == this.Component.NickName).Any())
    {
      DebugWrite("Removed template component. Removing all the eventhandlers");
      RemoveEventHandlers();
    }

  }

  public bool IdExists(int id)
  {
    IList<IGH_DocumentObject> objs = Grasshopper.Instances.ActiveCanvas.Document.Objects;
    return objs
      .OfType<IGH_Component>()
      .Where(ob => ob.NickName == this.Component.NickName)
      .Where(ob => ob.GetType().ToString() == "ScriptComponents.Component_CSNET_Script")
      .Where(ob => ob.Message == "id: " + id.ToString()).Any();

  }

  public void DebugWrite(string msg)
  {
    if (_debug)
    {
      Rhino.RhinoApp.WriteLine(String.Format("[FixWire {0}]: {1}", id, msg));
    }
  }
# ---------- end fixwires ----------

largest_brep = LargestBREP(window_breps=[<geometry referenced from the Rhino model> x224])

# ----
# processes to kill
panel_16 = Panel("""dctimestep
rcontrib
rtrace
oconv
rvu
rmtxop""")
kill = LBFalseStartToggle(False)

# ----
# Kill processes running on linux
panel_17 = Panel("pkill -f <instance>")
overrides_3 = ApplyOverrides(Input=panel_17, Instance=graft(panel_16))  # -> Output, DynamicOutput
join = TextJoin(Text=flatten(overrides_3.Output), Join=";")
executessh_5 = ExecuteSSH(_SSHCommands_=join, Run=kill, addPrefix=True, fireLogs=False, lastRunTime=0, suppressWarnings=False)  # -> Stdout, Stderr_, Ran
panel_18 = Panel(executessh_5.Stderr_)

nickname = GH_TestComponentColor(Color=ColourSwatch(SwatchColor=RGB(188, 118, 194)), SelColor=ColourSwatch(SwatchColor=RGB(191, 128, 128)))
panel_19 = Panel(executessh_3.Stdout)
panel_20 = Panel(executessh_3.Stderr_)

# ----
# Template methods
# By Mathias Sønderskov Schaltz 2022
# Check for updates here https://github.com/Sonderwoods/GrasshopperScribbles
panel_21 = Panel(colorgroups)
panel_22 = Panel(fixwires)
panel_23 = Panel(fixparams)

bool_2 = Boolean(falsestart_3)
cluster = Cluster(mod=parserhinofile.OpaqueModifiers)  # -> name_geo, name_mod
geo = Geometry(parserhinofile.OpaqueGeometries)
overrides_4 = ApplyOverrides(Input="<Project>\objFiles")  # -> Output, DynamicOutput
mesh2obj = MeshToObj(
    Mesh=graft(geo),
    Name=graft(cluster.name_geo),
    MapFileName="mapping_opaque",
    ModifierName=graft(cluster.name_mod),
    TargetFolder=overrides_4.Output,
    Run=bool_2)  # -> ObjFiles, MapFile, Run
entwine = Entwine(Branch00=mesh2obj.ObjFiles, Branch01=mesh2obj.MapFile, FlattenInputs=True)
overrides_5 = ApplyOverrides(Input="<SftpHome>/objFiles")
upload = Upload(
    LocalFilePaths=flatten(entwine),
    TargetFolder=overrides_5,
    Run=mesh2obj.Run,
    stdouts="/home/lio/MantaRay/Andrei/objFiles/FloorMat_0.7_geo.obj>JOIN</home/lio/MantaRay/Andrei/objFiles/Cladding_0.5_geo.obj>JOIN</home/lio/MantaRay/Andrei/objFiles/ConcreteWhite_0.8_geo.obj>JOIN</home/lio/MantaRay/Andrei/objFiles/ConcreteStructure_0.3_geo.obj>JOIN</home/lio/MantaRay/Andrei/objFiles/ConcreteGrey_0.5_geo.obj>JOIN</home/lio/MantaRay/Andrei/objFiles/IntWalls_0.9_geo.obj>JOIN</home/lio/MantaRay/Andrei/objFiles/Pipes_0.03_geo.obj>JOIN</home/lio/MantaRay/Andrei/objFiles/ConcreteDarker_0.1_geo.obj>JOIN</home/lio/MantaRay/Andrei/objFiles/Frames_0.6_geo.obj>JOIN</home/lio/MantaRay/Andrei/objFiles/Black_0.01_geo.obj>JOIN</home/lio/MantaRay/Andrei/objFiles/CurvedCeiling_0.8_geo.obj>JOIN</home/lio/MantaRay/Andrei/objFiles/IntWalls_0.8_geo.obj>JOIN</home/lio/MantaRay/Andrei/objFiles/FloorBox_0.75_geo.obj>JOIN</home/lio/MantaRay/Andrei/objFiles/mapping_opaque.map")  # -> Status, FilePaths, Ran
panel_24 = Panel("""obj2rad -m <mapfile> -f <objFile> > <LinuxHome>/radFiles/<name>.rad
echo <LinuxHome>/radFiles/<name>.rad""")
python_2 = GhPythonScript(f=upload.FilePaths)  # -> m, o; inputs f: list
# ---------- python_2: Python ----------
__author__ = "mm1013"
__version__ = "2023.03.11"

import rhinoscriptsyntax as rs

m = f[-1]
o = f[:-1]
# ---------- end python_2 ----------
overrides_6 = ApplyOverrides(Input=panel_24, Mapfile=graft(python_2.m), ObjFile=graft(python_2.o), Name=graft(cluster.name_geo))  # -> Output, flatten(DynamicOutput)
executessh_6 = ExecuteSSH(
    _SSHCommands_=graft(overrides_6.DynamicOutput),
    Run=upload.Ran,
    addPrefix=True,
    description="""obj2rad -m /home/lio/MantaRay/Andrei/objFiles/mapping_opaque.map -f /home/lio/MantaRay/Andrei/objFiles/FloorMat_0.7_geo.obj > ~/MantaRay/Andrei/radFiles/FloorMat_0.7_geo.rad
echo ~/MantaRay/Andrei/radFiles/FloorMat_0.7_geo.rad


- - -

obj2rad -m /home/lio/MantaRay/Andrei/objFiles/mapping_opaque.map -f /home/lio/MantaRay/Andrei/objFiles/Cladding_0.5_geo.obj > ~/MantaRay/Andrei/radFiles/Cladding_0.5_geo.rad
echo ~/MantaRay/Andrei/radFiles/Cladding_0.5_geo.rad


- - -

obj2rad -m /home/lio/MantaRay/Andrei/objFiles/mapping_opaque.map -f /home/lio/MantaRay/Andrei/objFiles/ConcreteWhite_0.8_geo.obj > ~/MantaRay/Andrei/radFiles/ConcreteWhite_0.8_geo.rad
echo ~/MantaRay/Andrei/radFiles/ConcreteWhite_0.8_geo.rad


- - -

obj2rad -m /home/lio/MantaRay/Andrei/objFiles/mapping_opaque.map -f /home/lio/MantaRay/Andrei/objFiles/ConcreteStructure_0.3_geo.obj > ~/MantaRay/Andrei/radFiles/ConcreteStructure_0.3_geo.rad
echo ~/MantaRay/Andrei/radFiles/ConcreteStructure_0.3_geo.rad


- - -

obj2rad -m /home/lio/MantaRay/Andrei/objFiles/mapping_opaque.map -f /home/lio/MantaRay/Andrei/objFiles/ConcreteGrey_0.5_geo.obj > ~/MantaRay/Andrei/radFiles/ConcreteGrey_0.5_geo.rad
echo ~/MantaRay/Andrei/radFiles/ConcreteGrey_0.5_geo.rad


- - -

obj2rad -m /home/lio/MantaRay/Andrei/objFiles/mapping_opaque.map -f /home/lio/MantaRay/Andrei/objFiles/IntWalls_0.9_geo.obj > ~/MantaRay/Andrei/radFiles/IntWalls_0.9_geo.rad
echo ~/MantaRay/Andrei/radFiles/IntWalls_0.9_geo.rad


- - -

obj2rad -m /home/lio/MantaRay/Andrei/objFiles/mapping_opaque.map -f /home/lio/MantaRay/Andrei/objFiles/Pipes_0.03_geo.obj > ~/MantaRay/Andrei/radFiles/Pipes_0.03_geo.rad
echo ~/MantaRay/Andrei/radFiles/Pipes_0.03_geo.rad


- - -

obj2rad -m /home/lio/MantaRay/Andrei/objFiles/mapping_opaque.map -f /home/lio/MantaRay/Andrei/objFiles/ConcreteDarker_0.1_geo.obj > ~/MantaRay/Andrei/radFiles/ConcreteDarker_0.1_geo.rad
echo ~/MantaRay/Andrei/radFiles/ConcreteDarker_0.1_geo.rad


- - -

obj2rad -m /home/lio/MantaRay/Andrei/objFiles/mapping_opaque.map -f /home/lio/MantaRay/Andrei/objFiles/Frames_0.6_geo.obj > ~/MantaRay/Andrei/radFiles/Frames_0.6_geo.rad
echo ~/MantaRay/Andrei/radFiles/Frames_0.6_geo.rad


- - -

obj2rad -m /home/lio/MantaRay/Andrei/objFiles/mapping_opaque.map -f /home/lio/MantaRay/Andrei/objFiles/Black_0.01_geo.obj > ~/MantaRay/Andrei/radFiles/Black_0.01_geo.rad
echo ~/MantaRay/Andrei/radFiles/Black_0.01_geo.rad


- - -

obj2rad -m /home/lio/MantaRay/Andrei/objFiles/mapping_opaque.map -f /home/lio/MantaRay/Andrei/objFiles/CurvedCeiling_0.8_geo.obj > ~/MantaRay/Andrei/radFiles/CurvedCeiling_0.8_geo.rad
echo ~/MantaRay/Andrei/radFiles/CurvedCeiling_0.8_geo.rad


- - -

obj2rad -m /home/lio/MantaRay/Andrei/objFiles/mapping_opaque.map -f /home/lio/MantaRay/Andrei/objFiles/IntWalls_0.8_geo.obj > ~/MantaRay/Andrei/radFiles/IntWalls_0.8_geo.rad
echo ~/MantaRay/Andrei/radFiles/IntWalls_0.8_geo.rad


- - -

obj2rad -m /home/lio/MantaRay/Andrei/objFiles/mapping_opaque.map -f /home/lio/MantaRay/Andrei/objFiles/FloorBox_0.75_geo.obj > ~/MantaRay/Andrei/radFiles/FloorBox_0.75_geo.rad
echo ~/MantaRay/Andrei/radFiles/FloorBox_0.75_geo.rad""",
    fireLogs=True,
    lastRunTime=245.8256,
    name="obj2map - opaque",
    suppressWarnings=False,
    results=["/home/lio/MantaRay/Andrei/radFiles/FloorMat_0.7_geo.rad", "/home/lio/MantaRay/Andrei/radFiles/Cladding_0.5_geo.rad", "/home/lio/MantaRay/Andrei/radFiles/ConcreteWhite_0.8_geo.rad", "/home/lio/MantaRay/Andrei/radFiles/ConcreteStructure_0.3_geo.rad", "/home/lio/MantaRay/Andrei/radFiles/ConcreteGrey_0.5_geo.rad", "/home/lio/MantaRay/Andrei/radFiles/IntWalls_0.9_geo.rad", "/home/lio/MantaRay/Andrei/radFiles/Pipes_0.03_geo.rad", "/home/lio/MantaRay/Andrei/radFiles/ConcreteDarker_0.1_geo.rad", "/home/lio/MantaRay/Andrei/radFiles/Frames_0.6_geo.rad", "/home/lio/MantaRay/Andrei/radFiles/Black_0.01_geo.rad", "/home/lio/MantaRay/Andrei/radFiles/CurvedCeiling_0.8_geo.rad", "/home/lio/MantaRay/Andrei/radFiles/IntWalls_0.8_geo.rad", "/home/lio/MantaRay/Andrei/radFiles/FloorBox_0.75_geo.rad"],
    commands=["""obj2rad -m /home/lio/MantaRay/Andrei/objFiles/mapping_opaque.map -f /home/lio/MantaRay/Andrei/objFiles/FloorMat_0.7_geo.obj > ~/MantaRay/Andrei/radFiles/FloorMat_0.7_geo.rad
echo ~/MantaRay/Andrei/radFiles/FloorMat_0.7_geo.rad""", """obj2rad -m /home/lio/MantaRay/Andrei/objFiles/mapping_opaque.map -f /home/lio/MantaRay/Andrei/objFiles/Cladding_0.5_geo.obj > ~/MantaRay/Andrei/radFiles/Cladding_0.5_geo.rad
echo ~/MantaRay/Andrei/radFiles/Cladding_0.5_geo.rad""", """obj2rad -m /home/lio/MantaRay/Andrei/objFiles/mapping_opaque.map -f /home/lio/MantaRay/Andrei/objFiles/Pipes_0.03_geo.obj > ~/MantaRay/Andrei/radFiles/Pipes_0.03_geo.rad
echo ~/MantaRay/Andrei/radFiles/Pipes_0.03_geo.rad""", """obj2rad -m /home/lio/MantaRay/Andrei/objFiles/mapping_opaque.map -f /home/lio/MantaRay/Andrei/objFiles/ConcreteGrey_0.5_geo.obj > ~/MantaRay/Andrei/radFiles/ConcreteGrey_0.5_geo.rad
echo ~/MantaRay/Andrei/radFiles/ConcreteGrey_0.5_geo.rad""", """obj2rad -m /home/lio/MantaRay/Andrei/objFiles/mapping_opaque.map -f /home/lio/MantaRay/Andrei/objFiles/ConcreteWhite_0.8_geo.obj > ~/MantaRay/Andrei/radFiles/ConcreteWhite_0.8_geo.rad
echo ~/MantaRay/Andrei/radFiles/ConcreteWhite_0.8_geo.rad""", """obj2rad -m /home/lio/MantaRay/Andrei/objFiles/mapping_opaque.map -f /home/lio/MantaRay/Andrei/objFiles/ConcreteStructure_0.3_geo.obj > ~/MantaRay/Andrei/radFiles/ConcreteStructure_0.3_geo.rad
echo ~/MantaRay/Andrei/radFiles/ConcreteStructure_0.3_geo.rad""", """obj2rad -m /home/lio/MantaRay/Andrei/objFiles/mapping_opaque.map -f /home/lio/MantaRay/Andrei/objFiles/Frames_0.6_geo.obj > ~/MantaRay/Andrei/radFiles/Frames_0.6_geo.rad
echo ~/MantaRay/Andrei/radFiles/Frames_0.6_geo.rad""", """obj2rad -m /home/lio/MantaRay/Andrei/objFiles/mapping_opaque.map -f /home/lio/MantaRay/Andrei/objFiles/ConcreteDarker_0.1_geo.obj > ~/MantaRay/Andrei/radFiles/ConcreteDarker_0.1_geo.rad
echo ~/MantaRay/Andrei/radFiles/ConcreteDarker_0.1_geo.rad""", """obj2rad -m /home/lio/MantaRay/Andrei/objFiles/mapping_opaque.map -f /home/lio/MantaRay/Andrei/objFiles/Black_0.01_geo.obj > ~/MantaRay/Andrei/radFiles/Black_0.01_geo.rad
echo ~/MantaRay/Andrei/radFiles/Black_0.01_geo.rad""", """obj2rad -m /home/lio/MantaRay/Andrei/objFiles/mapping_opaque.map -f /home/lio/MantaRay/Andrei/objFiles/IntWalls_0.8_geo.obj > ~/MantaRay/Andrei/radFiles/IntWalls_0.8_geo.rad
echo ~/MantaRay/Andrei/radFiles/IntWalls_0.8_geo.rad""", """obj2rad -m /home/lio/MantaRay/Andrei/objFiles/mapping_opaque.map -f /home/lio/MantaRay/Andrei/objFiles/FloorBox_0.75_geo.obj > ~/MantaRay/Andrei/radFiles/FloorBox_0.75_geo.rad
echo ~/MantaRay/Andrei/radFiles/FloorBox_0.75_geo.rad"""])  # -> flatten(Stdout), Stderr_, Ran
opaque_rad = Text(executessh_6.Stdout)

bool_3 = Boolean(falsestart_3)
cluster_2 = Cluster(mod=parserhinofile.GlassModifiers)  # -> name_geo, name_mod
geo_2 = Geometry(parserhinofile.GlassGeometries)
overrides_7 = ApplyOverrides(Input="<Project>\objFiles")  # -> Output, DynamicOutput
mesh2obj_2 = MeshToObj(
    Mesh=graft(geo_2),
    Name=graft(cluster_2.name_geo),
    MapFileName="mapping_glass",
    ModifierName=graft(cluster_2.name_mod),
    TargetFolder=overrides_7.Output,
    Run=bool_3)  # -> ObjFiles, MapFile, Run
entwine_2 = Entwine(Branch00=mesh2obj_2.ObjFiles, Branch01=mesh2obj_2.MapFile, FlattenInputs=True)
overrides_8 = ApplyOverrides(Input="<SftpHome>/objFiles")
upload_2 = Upload(
    LocalFilePaths=flatten(entwine_2),
    TargetFolder=overrides_8,
    Run=mesh2obj_2.Run,
    stdouts="/home/lio/MantaRay/Andrei/objFiles/Glass_70_geo.obj>JOIN</home/lio/MantaRay/Andrei/objFiles/mapping_glass.map")  # -> Status, FilePaths, Ran
panel_25 = Panel("""obj2rad -m <mapfile> -f <objFile> > <LinuxHome>/radFiles/<name>.rad
echo <LinuxHome>/radFiles/<name>.rad""")
python_3 = GhPythonScript(f=upload_2.FilePaths)  # -> m, o; inputs f: list; same code as python_2
overrides_9 = ApplyOverrides(Input=panel_25, Mapfile=graft(python_3.m), ObjFile=graft(python_3.o), Name=graft(cluster_2.name_geo))  # -> Output, flatten(DynamicOutput)
executessh_7 = ExecuteSSH(
    _SSHCommands_=graft(overrides_9.DynamicOutput),
    Run=upload_2.Ran,
    addPrefix=True,
    description="""obj2rad -m /home/lio/MantaRay/Andrei/objFiles/mapping_glass.map -f /home/lio/MantaRay/Andrei/objFiles/Glass_70_geo.obj > ~/MantaRay/Andrei/radFiles/Glass_70_geo.rad
echo ~/MantaRay/Andrei/radFiles/Glass_70_geo.rad""",
    fireLogs=True,
    lastRunTime=68.3068,
    name="obj2map - glass",
    suppressWarnings=False,
    results="/home/lio/MantaRay/Andrei/radFiles/Glass_70_geo.rad",
    commands="""obj2rad -m /home/lio/MantaRay/Andrei/objFiles/mapping_glass.map -f /home/lio/MantaRay/Andrei/objFiles/Glass_70_geo.obj > ~/MantaRay/Andrei/radFiles/Glass_70_geo.rad
echo ~/MantaRay/Andrei/radFiles/Glass_70_geo.rad""")  # -> flatten(Stdout), Stderr_, Ran
window_rad = Text(executessh_7.Stdout)

# ----
# Current Radiance version
panel_26 = Panel("head /usr/local/radiance/bin/rtpict -n 2")
executessh_8 = ExecuteSSH(
    _SSHCommands_=panel_26,
    Run=Toggle(True),
    addPrefix=True,
    fireLogs=False,
    lastRunTime=102.3676,
    suppressWarnings=False,
    results="""#!/usr/bin/perl -w
# RCSid $Id: rtpict.pl,v 2.25 2022/04/12 00:30:58 greg Exp $""",
    commands="head /usr/local/radiance/bin/rtpict -n 2")  # -> Stdout, Stderr_, Ran
panel_27 = Panel(executessh_8.Stdout)

# ----
# Read more
# 
# 
# Ambient cache
# https://discourse.radiance-online.org/t/what-data-does-ambfile-store/4785/2
# Vertex order (and normal)
# 
# source : https://www.radiance-online.org/learning/tutorials/Tutorial-ThreePhaseMethod.pdf
# FILE NAMES: *.vmx - view matrix (data)
# *.hdr - view matrix (renderings)
# *.dmx - daylight matrix
# *.skv - sky vector
# *.smx – sky matrix
# *.xml - transmission matrix (the file is xml format)
# 
# *.rad - radiance scene data
# *.oct - octree file
# *.vf - view file
# *.dat - data
# 
# source : https://www.radiance-online.org/learning/tutorials/Tutorial-ThreePhaseMethod.pdf
image = ImageSampler(Filter="Colour", Interpolate=True, Umax=1, Umin=0, Vmax=1, Vmin=0, Wrap=1)  # disabled
overrides_10 = ApplyOverrides(Input="cat <t>", Text=graft(upload_2.FilePaths))  # -> Output, DynamicOutput

overrides_11 = ApplyOverrides(Input="cat <target>", Target=graft(executessh_2.Stdout))  # -> Output, DynamicOutput
# Colored skies! Why not?
# from https://discourse.radiance-online.org/t/new-tool-for-generating-colored-sky/5891
executessh_9 = ExecuteSSH(
    _SSHCommands_=overrides_11.Output,
    Run=False,
    addPrefix=True,
    fireLogs=False,
    lastRunTime=0,
    suppressWarnings=False,
    results="""##Will control the gradient of the sky
# gensky -ang 45 0 -c -B 55.866
# Ground ambient level: 17.8

void brightfunc skyfunc
2 skybr skybright.cal
0
3 2 2.29e+01 3.56e+00

##The 1 will be multiplie with brightfunc
skyfunc glow sky_glow
0
0
4 1 1 1 0

##Set to 1 as it will be multiplied with the gensky result
sky_glow source sky
0
0
4 0 0 1 180

##Set to 1 as it will be multiplied with the gensky result
skyfunc glow ground_glow
0
0
4 1 1 1 0

##The ground pane
ground_glow source ground
0
0
4 0 0 -1 180""",
    commands="cat ~/MantaRay/UnnamedProject/skies/overcast_sky.rad")  # -> Stdout, Stderr_, Ran
panel_28 = Panel(executessh_9.Stdout)

logviewer = LogViewer(Number=10)  # -> CurrentTasks, Logs
executessh_10 = ExecuteSSH(
    _SSHCommands_=overrides_10.Output,
    Run=invert(False),
    addPrefix=True,
    description="- - -",
    fireLogs=False,
    lastRunTime=103.7738,
    suppressWarnings=False,
    results=["""# Written with MantaRay plugin/GH_MeshToRad
g Glass_70_geo
o Glass_70_geo_1
v 85.220 15.227 0.000
v 85.220 15.227 2.696
v 85.220 32.579 0.000
v 85.220 32.579 2.696
v 54.216 34.799 4.810
v 54.216 32.809 4.810
v 54.216 33.802 5.604
v 60.823 34.799 7.227
v 60.823 32.809 7.227
v 60.823 33.802 8.021
v 69.801 34.862 15.046
v 69.801 32.872 15.046
v 69.801 33.865 15.839
v 67.434 34.799 10.836
v 67.434 32.809 10.836
v 67.434 33.802 11.629
v 78.541 34.862 15.046
v 78.541 32.872 15.046
v 78.541 33.865 15.839
v 91.840 34.862 4.821
v 91.840 32.872 4.821
v 91.840 33.865 5.615
v 83.081 34.862 6.626
v 83.081 32.872 6.626
v 83.081 33.865 7.419
v 87.445 33.784 5.636
v 87.445 32.744 4.805
v 83.140 33.784 5.636
v 83.140 32.744 4.805
v 87.445 33.946 5.636
v 87.445 34.987 4.805
v 83.140 33.946 5.636
v 83.140 34.987 4.805
v 91.799 33.784 5.636
v 91.799 32.744 4.805
v 87.495 33.784 5.636
v 87.495 32.744 4.805
v 91.799 33.946 5.636
v 91.799 34.987 4.805
v 87.495 33.946 5.636
v 87.495 34.987 4.805
v 58.611 33.884 5.636
v 58.611 34.924 4.805
v 60.759 33.884 5.636
v 60.759 34.924 4.805
v 58.611 33.721 5.636
v 58.611 32.681 4.805
v 60.759 33.721 5.636
v 60.759 32.681 4.805
v 58.561 33.721 5.636
v 58.561 32.681 4.805
v 54.257 33.721 5.636
v 54.257 32.681 4.805
v 58.561 33.884 5.636
v 58.561 34.924 4.805
v 54.257 33.884 5.636
v 54.257 34.924 4.805
v 65.218 33.884 8.042
v 65.218 34.924 7.211
v 67.366 33.884 8.042
v 67.366 34.924 7.211
v 65.218 33.721 8.042
v 65.218 32.681 7.211
v 67.366 33.721 8.042
v 67.366 32.681 7.211
v 65.168 33.721 8.042
v 65.168 32.681 7.211
v 60.863 33.721 8.042
v 60.863 32.681 7.211
v 65.168 33.884 8.042
v 65.168 34.924 7.211
v 60.863 33.884 8.042
v 60.863 34.924 7.211
v 67.474 33.884 11.651
v 67.474 34.924 10.819
v 69.572 33.884 11.651
v 69.572 34.924 10.819
v 67.474 33.721 11.651
v 67.474 32.681 10.819
v 69.572 33.721 11.651
v 69.572 32.681 10.819
v 78.500 33.784 15.861
v 78.500 33.264 15.445
v 78.500 32.744 15.029
v 74.196 33.784 15.861
v 74.196 33.264 15.445
v 74.196 32.744 15.029
v 78.500 33.946 15.861
v 78.500 34.987 15.029
v 74.196 33.946 15.861
v 74.196 34.987 15.029
v 74.146 33.784 15.861
v 74.146 33.264 15.445
v 74.146 32.744 15.029
v 69.841 33.784 15.861
v 69.841 33.264 15.445
v 69.841 32.744 15.029
v 74.146 33.946 15.861
v 74.146 34.987 15.029
v 69.841 33.946 15.861
v 69.841 34.987 15.029
v 83.040 33.946 7.441
v 83.040 34.987 6.609
v 78.736 33.946 7.441
v 78.736 34.987 6.609
v 83.040 33.784 7.441
v 83.040 32.744 6.609
v 78.736 33.784 7.441
v 78.736 32.744 6.609
v 77.815 32.524 11.157
v 77.815 15.324 11.157
v 77.679 32.524 13.144
v 77.679 15.324 13.144
v 63.200 15.227 6.074
v 63.200 32.574 6.074
v 61.981 15.227 5.304
v 61.981 32.574 5.304
v 61.981 15.227 5.304
v 61.981 32.574 5.304
v 60.817 15.227 4.710
v 60.817 32.574 4.710
v 54.220 14.991 4.810
v 54.220 13.001 4.810
v 54.220 13.994 5.604
v 60.827 14.991 7.227
v 60.827 13.001 7.227
v 60.827 13.994 8.021
v 69.805 15.054 15.046
v 69.805 13.064 15.046
v 69.805 14.057 15.839
v 67.438 14.991 10.836
v 67.438 13.001 10.836
v 67.438 13.994 11.629
v 78.544 15.054 15.046
v 78.544 13.064 15.046
v 78.544 14.057 15.839
v 91.843 15.054 4.821
v 91.843 13.064 4.821
v 91.843 14.057 5.615
v 83.084 15.054 6.626
v 83.084 13.064 6.626
v 83.084 14.057 7.419
v 87.449 13.976 5.636
v 87.449 12.935 4.805
v 83.144 13.976 5.636
v 83.144 12.935 4.805
v 87.449 14.138 5.636
v 87.449 15.178 4.805
v 83.144 14.138 5.636
v 83.144 15.178 4.805
v 91.803 13.976 5.636
v 91.803 12.935 4.805
v 87.499 13.976 5.636
v 87.499 12.935 4.805
v 91.803 14.138 5.636
v 91.803 15.178 4.805
v 87.499 14.138 5.636
v 87.499 15.178 4.805
v 58.615 14.075 5.636
v 58.615 15.116 4.805
v 60.763 14.075 5.636
v 60.763 15.116 4.805
v 58.615 13.913 5.636
v 58.615 12.873 4.805
v 60.763 13.913 5.636
v 60.763 12.873 4.805
v 58.565 13.913 5.636
v 58.565 12.873 4.805
v 54.260 13.913 5.636
v 54.260 12.873 4.805
v 58.565 14.075 5.636
v 58.565 15.116 4.805
v 54.260 14.075 5.636
v 54.260 15.116 4.805
v 65.222 14.075 8.042
v 65.222 15.116 7.211
v 67.369 14.075 8.042
v 67.369 15.116 7.211
v 65.222 13.913 8.042
v 65.222 12.873 7.211
v 67.369 13.913 8.042
v 67.369 12.873 7.211
v 65.172 13.913 8.042
v 65.172 12.873 7.211
v 60.867 13.913 8.042
v 60.867 12.873 7.211
v 65.172 14.075 8.042
v 65.172 15.116 7.211
v 60.867 14.075 8.042
v 60.867 15.116 7.211
v 67.478 14.075 11.651
v 67.478 15.116 10.819
v 69.576 14.075 11.651
v 69.576 15.116 10.819
v 67.478 13.913 11.651
v 67.478 12.873 10.819
v 69.576 13.913 11.651
v 69.576 12.873 10.819
v 78.504 13.976 15.861
v 78.504 12.935 15.029
v 74.200 13.976 15.861
v 74.200 12.935 15.029
v 78.504 14.138 15.861
v 78.504 15.178 15.029
v 74.200 14.138 15.861
v 74.200 15.178 15.029
v 74.150 13.976 15.861
v 74.150 12.935 15.029
v 69.845 13.976 15.861
v 69.845 12.935 15.029
v 74.150 14.138 15.861
v 74.150 15.178 15.029
v 69.845 14.138 15.861
v 69.845 15.178 15.029
v 83.044 14.138 7.441
v 83.044 15.178 6.609
v 78.740 14.138 7.441
v 78.740 15.178 6.609
v 83.044 13.976 7.441
v 83.044 12.935 6.609
v 78.740 13.976 7.441
v 78.740 12.935 6.609
f 4 2 1 3
f 6 7 5
f 9 10 8
f 12 13 11
f 15 16 14
f 18 17 19
f 21 20 22
f 24 23 25
f 29 27 26 28
f 33 32 30 31
f 37 35 34 36
f 41 40 38 39
f 45 43 42 44
f 49 48 46 47
f 53 51 50 52
f 57 56 54 55
f 61 59 58 60
f 65 64 62 63
f 69 67 66 68
f 73 72 70 71
f 77 75 74 76
f 81 80 78 79
f 86 83 82 85
f 87 84 83 86
f 91 90 88 89
f 96 93 92 95
f 97 94 93 96
f 101 100 98 99
f 105 104 102 103
f 109 107 106 108
f 113 111 110 112
f 114 116 117 115
f 118 120 121 119
f 123 124 122
f 126 127 125
f 129 130 128
f 132 133 131
f 135 134 136
f 138 137 139
f 141 140 142
f 146 144 143 145
f 150 149 147 148
f 154 152 151 153
f 158 157 155 156
f 162 160 159 161
f 166 165 163 164
f 170 168 167 169
f 174 173 171 172
f 178 176 175 177
f 182 181 179 180
f 186 184 183 185
f 190 189 187 188
f 194 192 191 193
f 198 197 195 196
f 202 200 199 201
f 206 205 203 204
f 210 208 207 209
f 214 213 211 212
f 218 217 215 216
f 222 220 219 221""", """default;
Glass_70 (Group "Glass_70_geo");"""],
    commands=["cat /home/lio/MantaRay/Andrei/objFiles/Glass_70_geo.obj", "cat /home/lio/MantaRay/Andrei/objFiles/mapping_glass.map"])  # -> Stdout, Stderr_, Ran
# Log of latest(10) SSH Commands
panel_29 = Panel(logviewer.Logs)
panel_30 = Panel(executessh_10.Stdout)

# ----
# materials
run = Boolean(falsestart_3)

# ----
# Setup glass materials
glass_mat = Data(parserhinofile.GlassModifiers)
panel_31 = Panel("echo \"<mats>\" > <LinuxHome>/radFiles/<target>;echo \"<LinuxHome>/radFiles/<target>\"")
overrides_12 = ApplyOverrides(Input="<mat>.mat", Mat=graft(cluster_2.name_mod))
overrides_13 = ApplyOverrides(Input=panel_31, Mats=graft(glass_mat), Target=graft(overrides_12))  # -> Output, DynamicOutput
cluster_3 = Cluster_2(L=glass_mat)
executessh_11 = ExecuteSSH(
    _SSHCommands_=overrides_13.DynamicOutput,
    Run=run,
    addPrefix=True,
    description="""echo "void glass Glass_70
0
0
3 0.763 0.763 0.763" > ~/MantaRay/Andrei/radFiles/Glass_70.mat;echo "~/MantaRay/Andrei/radFiles/Glass_70.mat"
""",
    fireLogs=False,
    lastRunTime=99.0502,
    name="glassMats",
    suppressWarnings=False,
    results="~/MantaRay/Andrei/radFiles/Glass_70.mat",
    commands="""echo "void glass Glass_70
0
0
3 0.763 0.763 0.763" > ~/MantaRay/Andrei/radFiles/Glass_70.mat;echo "~/MantaRay/Andrei/radFiles/Glass_70.mat"
""")  # -> Stdout, Stderr_, Ran
cull = CullPattern(List=executessh_11.Stdout, CullPattern=cluster_3)
window_mat = Text(flatten(cull))

# ----
# opaque materials
opaque_mats = Data(parserhinofile.OpaqueModifiers)
panel_32 = Panel("echo \"<mats>\" > <LinuxHome>/radFiles/<target>;echo \"<LinuxHome>/radFiles/<target>\"")
join_2 = TextJoin(Text=opaque_mats)
overrides_14 = ApplyOverrides(Input=panel_32, Mats=graft(join_2), Target=graft("opaque_materials.mat"))  # -> Output, DynamicOutput
executessh_12 = ExecuteSSH(
    _SSHCommands_=overrides_14.DynamicOutput,
    Run=run,
    addPrefix=True,
    description="""echo "void plastic FloorMat_0.7
0
0
5 70.000 70.000 70.000 0.000 0.000
void plastic Cladding_0.5
0
0
5 50.000 50.000 50.000 0.000 0.000
void plastic ConcreteWhite_0.8
0
0
5 80.000 80.000 80.000 0.000 0.000
void plastic ConcreteStructure_0.3
0
0
5 30.000 30.000 30.000 0.000 0.000
void plastic ConcreteGrey_0.5
0
0
5 50.000 50.000 50.000 0.000 0.000
void plastic IntWalls_0.9
0
0
5 90.000 90.000 90.000 0.000 0.000
void plastic Pipes_0.03
0
0
5 3.000 3.000 3.000 0.000 0.000
void plastic ConcreteDarker_0.1
0
0
5 10.000 10.000 10.000 0.000 0.000
void plastic Frames_0.6
0
0
5 60.000 60.000 60.000 0.000 0.000
void plastic Black_0.01
0
0
5 1.000 1.000 1.000 0.000 0.000
void plastic CurvedCeiling_0.8
0
0
5 80.000 80.000 80.000 0.000 0.000
void plastic IntWalls_0.8
0
0
5 80.000 80.000 80.000 0.000 0.000
void plastic FloorBox_0.75
0
0
5 75.000 75.000 75.000 0.000 0.000" > ~/MantaRay/Andrei/radFiles/opaque_materials.mat;echo "~/MantaRay/Andrei/radFiles/opaque_materials.mat"
""",
    fireLogs=False,
    lastRunTime=106.8061,
    name="opaqueMats",
    suppressWarnings=False,
    results="~/MantaRay/Andrei/radFiles/opaque_materials.mat",
    commands="""echo "void plastic FloorMat_0.7
0
0
5 70.000 70.000 70.000 0.000 0.000
void plastic Cladding_0.5
0
0
5 50.000 50.000 50.000 0.000 0.000
void plastic ConcreteWhite_0.8
0
0
5 80.000 80.000 80.000 0.000 0.000
void plastic ConcreteStructure_0.3
0
0
5 30.000 30.000 30.000 0.000 0.000
void plastic ConcreteGrey_0.5
0
0
5 50.000 50.000 50.000 0.000 0.000
void plastic IntWalls_0.9
0
0
5 90.000 90.000 90.000 0.000 0.000
void plastic Pipes_0.03
0
0
5 3.000 3.000 3.000 0.000 0.000
void plastic ConcreteDarker_0.1
0
0
5 10.000 10.000 10.000 0.000 0.000
void plastic Frames_0.6
0
0
5 60.000 60.000 60.000 0.000 0.000
void plastic Black_0.01
0
0
5 1.000 1.000 1.000 0.000 0.000
void plastic CurvedCeiling_0.8
0
0
5 80.000 80.000 80.000 0.000 0.000
void plastic IntWalls_0.8
0
0
5 80.000 80.000 80.000 0.000 0.000
void plastic FloorBox_0.75
0
0
5 75.000 75.000 75.000 0.000 0.000" > ~/MantaRay/Andrei/radFiles/opaque_materials.mat;echo "~/MantaRay/Andrei/radFiles/opaque_materials.mat"
""")  # -> Stdout, Stderr_, Ran
opaque_mat = Text(executessh_12.Stdout)

executessh_13 = ExecuteSSH(
    _SSHCommands_="whoami",
    Run=Toggle(True),
    addPrefix=True,
    fireLogs=False,
    lastRunTime=76.2962,
    suppressWarnings=False,
    results="lio",
    commands="whoami")  # -> Stdout, Stderr_, Ran
panel_33 = Panel(executessh_13.Stdout)

# ----
# Octrees
# STANDARD octree
window_mat_2 = Text(window_mat)
opaque_mat_2 = Text(opaque_mat)
window_rad_2 = Text(window_rad)
opaque_rad_2 = Text(opaque_rad)
entwine_3 = Entwine(Branch00=window_mat_2, Branch01=window_rad_2, Branch02=opaque_mat_2, Branch03=opaque_rad_2, FlattenInputs=True)  # -> flatten(Result)

# ----
# Download and preview rad files
entwine_4 = Entwine(Branch00=window_mat_2, Branch01=window_rad_2, FlattenInputs=True)
entwine_5 = Entwine(Branch00=opaque_mat_2, Branch01=opaque_rad_2, FlattenInputs=True)
falsestart_4 = LBFalseStartToggle(False)
overrides_15 = ApplyOverrides(Input="<WinHome>\Downloads")
falsestart_5 = LBFalseStartToggle(False)
download = Download(
    LinuxFilePaths=flatten(entwine_4),
    TargetLocalFolder=overrides_15,
    Run=falsestart_5,
    stdouts="C:\Users\mm1013\MantaRay\TestingRemote\Downloads\Glass_70_mat.mat>JOIN<C:\Users\mm1013\MantaRay\TestingRemote\Downloads\Glass_70.rad")  # -> FilePaths, Status, Ran
download_2 = Download(LinuxFilePaths=entwine_5, TargetLocalFolder=overrides_15, Run=falsestart_4, stdouts="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")  # -> FilePaths, Status, Ran
cull_2 = CullPattern(List=download.FilePaths, CullPattern=falsestart_5)
cull_3 = CullPattern(List=download_2.FilePaths, CullPattern=falsestart_4)
radviewer = RadViewer(
    RadFiles=flatten(cull_2),
    IsTwoSided=False,
    Polychromatic=True,
    ShowEdges=True,
    Transparent=True,
    ColorNames=["GlassTak_70_mat", "GlassInt_74_mat", "GlassFacade_74_mat", "GlassBSDF_70_mat", "SkylightWall_70_mat", "SlabCeiling_80_mat", "SlabFloor_30_mat", "SlabWall_50_mat", "SlabJ_50_mat", "WallExterior_50_mat", "Roofs_50_mat", "Doors_50_mat", "FramesCW_50_mat", "FacadeBright_70_mat", "ContextBright_70_mat", "WallInterior_70_mat", "FacadeDark_30_mat", "Frames_50_mat", "Terrain_20_mat", "Buildings_50_mat", "Glass_70_mat"],
    Colors=[RGB(177, 203, 218), RGB(149, 243, 118), RGB(218, 247, 105), RGB(165, 199, 252), RGB(100, 251, 165), RGB(203, 230, 172), RGB(169, 243, 224), RGB(238, 176, 232), RGB(242, 222, 239), RGB(146, 222, 239), RGB(144, 119, 233), RGB(174, 245, 124), RGB(120, 214, 159), RGB(156, 153, 225), RGB(117, 221, 150), RGB(184, 150, 138), RGB(158, 205, 172), RGB(189, 132, 143), RGB(106, 135, 236), RGB(102, 168, 232), RGB(245, 194, 251)])  # -> Geo, ModifierNames, Modifiers, FailedWireFrame
radviewer_2 = RadViewer(
    RadFiles=flatten(cull_3),
    IsTwoSided=False,
    Polychromatic=True,
    ShowEdges=True,
    Transparent=True,
    ColorNames=["GlassTak_70_mat", "GlassInt_74_mat", "GlassFacade_74_mat", "GlassBSDF_70_mat", "SkylightWall_70_mat", "SlabCeiling_80_mat", "SlabFloor_30_mat", "SlabWall_50_mat", "SlabJ_50_mat", "WallExterior_50_mat"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],
    Colors=[RGB(177, 203, 218), RGB(149, 243, 118), RGB(218, 247, 105), RGB(165, 199, 252), RGB(100, 251, 165), RGB(203, 230, 172)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])  # -> Geo, ModifierNames, Modifiers, FailedWireFrame
panel_34 = Panel(entwine_5)

overrides_16 = ApplyOverrides(Input="head <f>", F=graft(window_mat_2))  # -> Output, DynamicOutput
executessh_14 = ExecuteSSH(
    _SSHCommands_=overrides_16.DynamicOutput,
    Run=Toggle(True),
    addPrefix=True,
    description="head ~/MantaRay/Andrei/radFiles/Glass_70.mat",
    fireLogs=False,
    lastRunTime=56.828,
    suppressWarnings=False,
    results="""void glass Glass_70
0
0
3 0.763 0.763 0.763""",
    commands="head ~/MantaRay/Andrei/radFiles/Glass_70.mat")  # -> Stdout, Stderr_, Ran
panel_35 = Panel(executessh_14.Stdout)

# ----
# Preview a RAD file with objpict
# can also use ra_tiff/normtiff/pfilt
# gamma will vary
# 
# check axel jacobs radiance tutorial p26
panel_36 = Panel("""mkdir -p <proj>/images/
objpict <rad> > <proj>/images/<target-.>.hdr
normtiff <proj>/images/<target-.>.hdr <proj>/images/<target-.>.tif
convert <proj>/images/<target-.>.tif <proj>/images/<target>
echo <proj>/images/<target>""")  # disabled
falsestart_6 = LBFalseStartToggle(False)
radfile = Text(flatten(entwine_3))  # disabled
panel_37 = Panel("quickRender.png")  # disabled
item = ListItem(List=radfile, Index=0, Wrap=True)
panel_38 = Panel("""rad
target""")  # disabled
applyglobals = ApplyGlobals(Input=panel_36, AdditionalKeys=panel_38, AdditionalValues=[item, panel_37])  # -> Output, Pairs; disabled
convertpaths = ConvertPaths()  # -> Linux, Windows; disabled
imageviewer = LBImageViewer(ImagePath_=convertpaths.Windows, _scale_=1, DisableClickable=False, SaveImgWithCoords=False, scale=1)  # -> ImagePath, Values, GIF; disabled

falsestart_7 = LBFalseStartToggle(True)

# ----
# OCTREE (overcast)
scene_rads = Text(entwine_3)
sky_ovc_2 = Text(sky_ovc)
python_4 = GhPythonScript(x=flatten(scene_rads))  # -> a; inputs x: list
# ---------- python_4: Python ----------
__author__ = "mm1013"
__version__ = "2022.06.15"

import rhinoscriptsyntax as rs

a = None not in x
# ---------- end python_4 ----------
entwine_6 = Entwine(Branch01=sky_ovc_2, Branch02=scene_rads, FlattenInputs=True)  # -> flatten(Radfiles)
panel_39 = Panel("""mkdir -p <proj>/octrees/
oconv -r 2048 -w -f <rads> > <proj>/octrees/<target>
echo <proj>/octrees/<target>""")
and = GateAnd(A=python_4, B=falsestart_7)
join_3 = TextJoin(Text=entwine_6, Join=" ")
overrides_17 = ApplyOverrides(Input=panel_39, Rads=graft(join_3), Target=graft("Scene_Overcast10klux.oct"))  # -> Output, DynamicOutput
executessh_15 = ExecuteSSH(
    _SSHCommands=overrides_17.DynamicOutput,
    Run=and,
    addPrefix=True,
    description="""mkdir -p ~/MantaRay/Andrei/octrees/
oconv -r 2048 -w -f ~/MantaRay/Andrei/skies/overcast_sky.rad ~/MantaRay/Andrei/radFiles/Glass_70.mat /home/lio/MantaRay/Andrei/radFiles/Glass_70_geo.rad ~/MantaRay/Andrei/radFiles/opaque_materials.mat /home/lio/MantaRay/Andrei/radFiles/FloorMat_0.7_geo.rad /home/lio/MantaRay/Andrei/radFiles/Cladding_0.5_geo.rad /home/lio/MantaRay/Andrei/radFiles/ConcreteWhite_0.8_geo.rad /home/lio/MantaRay/Andrei/radFiles/ConcreteStructure_0.3_geo.rad /home/lio/MantaRay/Andrei/radFiles/ConcreteGrey_0.5_geo.rad /home/lio/MantaRay/Andrei/radFiles/IntWalls_0.9_geo.rad /home/lio/MantaRay/Andrei/radFiles/Pipes_0.03_geo.rad /home/lio/MantaRay/Andrei/radFiles/ConcreteDarker_0.1_geo.rad /home/lio/MantaRay/Andrei/radFiles/Frames_0.6_geo.rad /home/lio/MantaRay/Andrei/radFiles/Black_0.01_geo.rad /home/lio/MantaRay/Andrei/radFiles/CurvedCeiling_0.8_geo.rad /home/lio/MantaRay/Andrei/radFiles/IntWalls_0.8_geo.rad /home/lio/MantaRay/Andrei/radFiles/FloorBox_0.75_geo.rad > ~/MantaRay/Andrei/octrees/Scene_Overcast10klux.oct
echo ~/MantaRay/Andrei/octrees/Scene_Overcast10klux.oct""",
    fireLogs=True,
    lastRunTime=1124.7714,
    name="oconv Scene_Overcast10klux.oct",
    suppressWarnings=False,
    results="/home/lio/MantaRay/Andrei/octrees/Scene_Overcast10klux.oct",
    commands="""mkdir -p ~/MantaRay/Andrei/octrees/
oconv -r 2048 -w -f ~/MantaRay/Andrei/skies/overcast_sky.rad ~/MantaRay/Andrei/radFiles/Glass_70.mat /home/lio/MantaRay/Andrei/radFiles/Glass_70_geo.rad ~/MantaRay/Andrei/radFiles/opaque_materials.mat /home/lio/MantaRay/Andrei/radFiles/FloorMat_0.7_geo.rad /home/lio/MantaRay/Andrei/radFiles/Cladding_0.5_geo.rad /home/lio/MantaRay/Andrei/radFiles/ConcreteWhite_0.8_geo.rad /home/lio/MantaRay/Andrei/radFiles/ConcreteStructure_0.3_geo.rad /home/lio/MantaRay/Andrei/radFiles/ConcreteGrey_0.5_geo.rad /home/lio/MantaRay/Andrei/radFiles/IntWalls_0.9_geo.rad /home/lio/MantaRay/Andrei/radFiles/Pipes_0.03_geo.rad /home/lio/MantaRay/Andrei/radFiles/ConcreteDarker_0.1_geo.rad /home/lio/MantaRay/Andrei/radFiles/Frames_0.6_geo.rad /home/lio/MantaRay/Andrei/radFiles/Black_0.01_geo.rad /home/lio/MantaRay/Andrei/radFiles/CurvedCeiling_0.8_geo.rad /home/lio/MantaRay/Andrei/radFiles/IntWalls_0.8_geo.rad /home/lio/MantaRay/Andrei/radFiles/FloorBox_0.75_geo.rad > ~/MantaRay/Andrei/octrees/Scene_Overcast10klux.oct
echo ~/MantaRay/Andrei/octrees/Scene_Overcast10klux.oct""")  # -> Stdout, Stderr_, Ran
panel_40 = Panel(overrides_17.Output)
panel_41 = Panel(executessh_15.Stderr_)
octree_overcast = Text(executessh_15.Stdout)

resolution = ValueList({"750x330": 750, "1500x750": 1500, "3000x1500": 3000, "5000x2500": 5000, "7000x3500": 7000, "8000x4000": 8000, "16000x8000": 16000, "20000x12000": 20000}, selected="5000x2500")
x = Number(resolution)

view = CreateView(Viewport="Perspective")  # -> ViewfileContent, ImageRatio
# mkdir -p ~/MantaRay/TestingRemote/images/
# mkdir -p ~/MantaRay/TestingRemote/ambientFiles/
# vwrays -ff -x 500 -y 400 -vf /home/lio/MantaRay/TestingRemote/views/Perspective2.vf -pa 1 | rtrace -as 0 -ab 3 -aa 0.2 -ad 128 -af ~/MantaRay/TestingRemote/ambientFiles/ambfile2_2022_10_06_0844_38.af -w -n 63 `vwrays -d -ff -x 500 -y 400 -vf /home/lio/MantaRay/TestingRemote/views/Perspective2.vf -pa 1` -ffc /home/lio/MantaRay/TestingRemote/octrees/my_test_scene.oct > ~/MantaRay/TestingRemote/images/2022_10_06_0844_38_Perspective_render.hdr
# echo ~/MantaRay/TestingRemote/images/2022_10_06_0844_38_Perspective_render.hdr
panel_42 = Panel(view.ViewfileContent)
panel_43 = Panel("""mkdir -p <proj>/views/
echo "<vf>" > <proj>/views/<target>.vf
echo <proj>/views/<target>.vf""")
concat_2 = Concatenate(FragmentA="Perspective", FragmentB="2")
vf = Text(view.ViewfileContent)
overrides_18 = ApplyOverrides(Input=panel_43, Vf=graft(vf), Target=graft(concat_2))  # -> Output, DynamicOutput
executessh_16 = ExecuteSSH(
    _SSHCommands_=overrides_18.DynamicOutput,
    Run=Toggle(True),
    addPrefix=True,
    description="""mkdir -p ~/MantaRay/Andrei/views/
echo "rvu -vtv -vp 76.210958985352 16.4300937305602 1.83584927923156 -vd -0.349680913647465 0.927360836447747 0.133135786524922 -vu 0.0469732080515546 -0.124573895254805 0.991097806649975 -vh 103.466 -vv 50.000" > ~/MantaRay/Andrei/views/Perspective2.vf
echo ~/MantaRay/Andrei/views/Perspective2.vf""",
    fireLogs=False,
    lastRunTime=82.0515,
    suppressWarnings=False,
    results="/home/lio/MantaRay/Andrei/views/Perspective2.vf",
    commands="""mkdir -p ~/MantaRay/Andrei/views/
echo "rvu -vtv -vp 76.210958985352 16.4300937305602 1.83584927923156 -vd -0.349680913647465 0.927360836447747 0.133135786524922 -vu 0.0469732080515546 -0.124573895254805 0.991097806649975 -vh 103.466 -vv 50.000" > ~/MantaRay/Andrei/views/Perspective2.vf
echo ~/MantaRay/Andrei/views/Perspective2.vf""")  # -> Stdout, Stderr_, Ran

# ----
# Set focus zone to RAD
# to calculate parameters
type = ValueList({"Interior": "I", "Exterior": "E"}, selected="Interior")
zone = Box({Plane=PlaneXY(67.34687306, 14.8177948, 0), X=Domain(0, 14.49025655), Y=Domain(0, 18.20965901), Z=Domain(0, 13.53214381)})
zone_2 = GhPythonScript(zoneBox=zone, type=type)  # -> out, zone; inputs zoneBox: Box
# ---------- zone_2: Python ----------
__author__ = "mm1013"
__version__ = "2022.10.06"

import rhinoscriptsyntax as rs
import Rhino.Geometry as rg

import Grasshopper.Kernel as gh

#e = gh.GH_RuntimeMessageLevel.Error
w = gh.GH_RuntimeMessageLevel.Warning

zone =""

testPlane = rg.Plane(rg.Point3d(0,0,0), zoneBox.Plane.XAxis, zoneBox.Plane.YAxis)
if testPlane != rg.Plane.WorldXY:
    ghenv.Component.AddRuntimeMessage(w, "Bounding box must have XY as base plane")
else:
    zone = "ZONE={type} {Xmin:.2f} {Xmax:.2f} {Ymin:.2f} {Ymax:.2f} {Zmin:.2f} {Zmax:.2f}\n".format( \
    type=type, Xmin = zoneBox.X.Min, Xmax = zoneBox.X.Max, Ymin = zoneBox.Y.Min, Ymax = zoneBox.Y.Max, Zmin = zoneBox.Z.Min, Zmax = zoneBox.Z.Max)
# ---------- end zone_2 ----------

panel_44 = Panel("<time>_<view>_render.hdr")
panel_45 = Panel("-ab 3 -ad 2048")

resolution_2 = ValueList({"750x330": 750, "1500x750": 1500, "3000x1500": 3000, "5000x2500": 5000, "7000x3500": 7000, "8000x4000": 8000, "16000x8000": 16000, "20000x12000": 20000}, selected="1500x750")
x_2 = Number(resolution_2)

# ----
# attempt to do overcast discretized sky (rtcontrib tutorial p20)
panel_47 = Panel("gensky 3 21 10 -c -a 51 -o 0 -m 0 -b 22.86")
falsestart_8 = LBFalseStartToggle(False)
panel_48 = Panel("""gensky 3 21 10 -c -a 51 -o 0 -m 0 -b 22.86 \
|rcalc -i '3 2 <zenithbr> <groundbr>' \
-e '$1=<groundbr>'""")
executessh_17 = ExecuteSSH(
    _SSHCommands_=panel_47,
    Run=falsestart_8,
    addPrefix=True,
    fireLogs=False,
    lastRunTime=5,
    suppressWarnings=False,
    results="""# gensky 3 21 10 -c -a 51 -o 0 -m 0 -b 22.86
# Local solar time: 9.88
# Solar altitude and azimuth: 31.9 -38.5
# Ground ambient level: 17.8

void brightfunc skyfunc
2 skybr skybright.cal
0
3 2 2.29e+01 3.56e+00""",
    commands="gensky 3 21 10 -c -a 51 -o 0 -m 0 -b 22.86")  # -> Stdout, Stderr_, Ran
python_5 = GhPythonScript(x=executessh_17.Stdout)  # -> a
# ---------- python_5: Python ----------
__author__ = "mm1013"
__version__ = "2022.09.27"

import rhinoscriptsyntax as rs

a = float(x.split("\n")[3].split(" ")[-1])
# ---------- end python_5 ----------
python_6 = GhPythonScript(x=executessh_17.Stdout)  # -> a
# ---------- python_6: Python ----------
__author__ = "mm1013"
__version__ = "2022.09.27"

import rhinoscriptsyntax as rs

a = float(x.split(" ")[-2])
# ---------- end python_6 ----------
panel_49 = Panel(executessh_17.Stdout)
overrides_19 = ApplyOverrides(Input=panel_48, Zenithbr=graft(python_6), Groundbr=graft(python_5))  # -> Output, DynamicOutput
executessh_18 = ExecuteSSH(
    _SSHCommands_=overrides_19.Output,
    Run=executessh_17.Ran,
    addPrefix=True,
    fireLogs=False,
    lastRunTime=6,
    suppressWarnings=False,
    stderr="3 2 22.9 17.8: cannot open",
    commands="""gensky 3 21 10 -c -a 51 -o 0 -m 0 -b 22.86 \
|rcalc -i '3 2 22.9 17.8' \
-e '$1=17.8'""")  # -> Stdout, Stderr_, Ran
panel_50 = Panel(executessh_18.Stderr_)

panel_51 = Panel("""rpict -vf <vf> -x <x> -y <y> <radOptions> <oct> |
pfilt -x /4 -y /4 -1 -r 0.7 > <proj>/images/<target>_colors_filt.hdr
echo <proj>/images/<target>_colors_filt.hdr""")
panel_52 = Panel("C:\MantaRayLinux\TestingRemote\images\2022_10_04_1601_04_Perspective1_render.hdr")
division = Division(B=2.5)
falsestart_9 = LBFalseStartToggle(False)
falsestart_10 = LBFalseStartToggle(False)

executessh_19 = ExecuteSSH(
    _SSHCommands_="pkill rtrace",
    Run=Button(),
    addPrefix=True,
    fireLogs=False,
    lastRunTime=21,
    suppressWarnings=False,
    commands="pkill rtrace")  # -> Stdout, Stderr_, Ran

falsestart_11 = LBFalseStartToggle(False)
download_3 = Download(
    SftpPaths=panel_52,
    Run=falsestart_10,
    stdouts="C:\Users\mm1013\MantaRay\TestingRemote\2022_10_04_1601_04_Perspective1_render.hdr")  # -> FilePaths, Status, Ran

panel_53 = Panel("""pkill rtpict
pkill rtrace""")
executessh_20 = ExecuteSSH(
    _SSHCommands_=panel_53,
    Run=Button(),
    addPrefix=True,
    fireLogs=False,
    lastRunTime=4,
    suppressWarnings=False,
    commands="""pkill rtpict
pkill rtrace""")  # -> Stdout, Stderr_, Ran

panel_54 = Panel("/home/mss/MantaRay/UnnamedProject/myRenderX.hdr")

# ----
# Using pfilt to downscale image
# radius per Mark Stock:
# http://markjstock.org/radmisc/aa0_test/final.html
panel_55 = Panel("pfilt -x /2 -y /2 -1 -r 0.7 <file> > <file-.>_filtered.hdr;echo <file-.>_filtered.hdr")

panel_56 = Panel("""ra_tiff <hdrFiles> <proj>/images/<target-.>.tif
convert <proj>/images/<target-.>.tif <proj>/images/<target-.>.png
echo <proj>/images/<target-.>.png""")

# ---- group: Extracted Coordinates
pt = Point()

# ----
panel_57 = Panel("falsecolor -lw 0 -s 50 -n 10 -m 1.79 -l DF -p <rad-.>_exposed.hdr -i <irrad> -cp > <rad-.>_fc4_lw0.hdr;echo <rad-.>_fc4_lw0.hdr")
panel_58 = Panel("""pcond -h <rad> <rad-.>_exposed2.hdr
pcomb <rad-.>_exposed2.hdr -s 0.2 <fc> > <rad-.>_overlay.hdr
echo <rad-.>_overlay.hdr""")
panel_59 = Panel("""rpict -vf <vf> -x <x> -y <y> <radOptions> <oct> |
pfilt -x /4 -y /4 -1 -r 0.7 > <proj>/images/<target>_normals_filt.hdr
echo <proj>/images/<target>_normals_filt.hdr""")
panel_60 = Panel("pcomb -o <hdr> | pcompos -x 2 -y 2 - -<x> -<y> | pvalue -h -H -df | total -if3 -m | sed -r 's/[\t]+/1/g'")

# ---- group: Extracted Coordinates
pt_2 = Point([Point(811, 630, 0), Point(812, 668, 0), Point(814, 715, 0), Point(816, 753, 0), Point(816, 798, 0), Point(1312, 468, 0), Point(1308, 506, 0), Point(1305, 547, 0), Point(1305, 574, 0), Point(1299, 606, 0), Point(1627, 410, 0), Point(1619, 440, 0), Point(1614, 468, 0), Point(1608, 500, 0), Point(132, 21, 0)])

# ----
item_2 = ListItem(List=pt_2, Index=0, Wrap=True)
pdecon = Deconstruct(Point=pt_2)  # -> XComponent, YComponent, ZComponent

# ----
# normalshader
# source = https://discourse.radiance-online.org/t/rendering-of-normal-map/2471/3
panel_61 = Panel("echo <pw> | sudo -S echo \"<shader>\" > /usr/local/radiance/lib/normalshader.cal")
panel_62 = Panel("""{
  normalshader.cal

  Look in RADIANCE/lib/rayinit.cal for more info on builtin funcs and vars
}

red = (Nx + 1)/2;
green = (Ny + 1)/2;
blue = (Nz + 1)/2;""")
overrides_20 = ApplyOverrides(Input=panel_61, Pw=graft("YYOURPASSWORD"), Shader=graft(panel_62))  # -> Output, DynamicOutput
executessh_21 = ExecuteSSH(
    _SSHCommands_=overrides_20.DynamicOutput,
    Run=Toggle(True),
    addPrefix=True,
    description="""echo YYOURPASSWORD | sudo -S echo "{
  normalshader.cal

  Look in RADIANCE/lib/rayinit.cal for more info on builtin funcs and vars
}

red = (Nx + 1)/2;
green = (Ny + 1)/2;
blue = (Nz + 1)/2;" > /usr/local/radiance/lib/normalshader.cal""",
    fireLogs=False,
    lastRunTime=52.1463,
    suppressWarnings=False,
    stderr="bash: /usr/local/radiance/lib/normalshader.cal: Permission denied",
    commands="""echo YYOURPASSWORD | sudo -S echo "{
  normalshader.cal

  Look in RADIANCE/lib/rayinit.cal for more info on builtin funcs and vars
}

red = (Nx + 1)/2;
green = (Ny + 1)/2;
blue = (Nz + 1)/2;" > /usr/local/radiance/lib/normalshader.cal""")  # -> Stdout, Stderr_, Ran
panel_63 = Panel(overrides_20.Output)
panel_64 = Panel(executessh_21.Stderr_)

# ----
# normalshader
panel_65 = Panel("echo \"<mat>\" > <LinuxHome>/radFiles/mat_normalglow.mat;echo <LinuxHome>/radFiles/mat_normalglow.mat")
panel_66 = Panel("""# Materials
void glow normalglow
0
0
4 1.0 1.0 1.0 -1

normalglow colorfunc normalshadermaterial
4 red green blue normalshader.cal
0
0""")
overrides_21 = ApplyOverrides(Input=panel_65, Mat=graft(panel_66))  # -> Output, DynamicOutput
falsestart_12 = LBFalseStartToggle(False)
executessh_22 = ExecuteSSH(
    _SSHCommands_=overrides_21.DynamicOutput,
    Run=falsestart_12,
    addPrefix=True,
    description="""echo "# Materials
void glow normalglow
0
0
4 1.0 1.0 1.0 -1

normalglow colorfunc normalshadermaterial
4 red green blue normalshader.cal
0
0" > ~/MantaRay/Andrei/radFiles/mat_normalglow.mat;echo ~/MantaRay/Andrei/radFiles/mat_normalglow.mat""",
    fireLogs=False,
    lastRunTime=12,
    suppressWarnings=False,
    results="/home/lio/MantaRay/TestingRemote/radFiles/mat_normalglow.mat",
    commands="""echo "# Materials
void glow normalglow
0
0
4 1.0 1.0 1.0 -1

normalglow colorfunc normalshadermaterial
4 red green blue normalshader.cal
0
0" > ~/MantaRay/TestingRemote/radFiles/mat_normalglow.mat;echo ~/MantaRay/TestingRemote/radFiles/mat_normalglow.mat""")  # -> Stdout, Stderr_, Ran

panel_67 = Panel("xform -m normalshadermaterial <rad> > <rad-.>_black.rad;echo \"<rad-.>_black.rad\"")
falsestart_13 = LBFalseStartToggle(False)
scene_rads_2 = Text(entwine_3)
overrides_22 = ApplyOverrides(Input=panel_67, Rad=graft(scene_rads_2))  # -> Output, DynamicOutput
python_7 = GhPythonScript(x=flatten(scene_rads_2))  # -> a; inputs x: list; same code as python_4
panel_68 = Panel("""mkdir -p <proj>/octrees/
oconv -r 2048 -w -f <rads> > <proj>/octrees/<target>
echo <proj>/octrees/<target>""")
and_2 = GateAnd(A=python_7, B=falsestart_13)
normalshadermat = Text(executessh_22.Stdout)
executessh_23 = ExecuteSSH(
    _SSHCommands=overrides_22.Output,
    Run=and_2,
    addPrefix=True,
    description="""- - -



- - -



- - -



- - -



- - -



- - -



- - -



- - -



- - -



- - -



- - -



- - -



- - -



- - -



- - -""",
    fireLogs=False,
    lastRunTime=2494,
    suppressWarnings=False,
    results=["~/MantaRay/TestingRemote/radFiles/RevitJintInnerCW_Glass_80_mat_black.rad", "~/MantaRay/TestingRemote/radFiles/RevitJintInnerDoors_80_mat_black.rad", "~/MantaRay/TestingRemote/radFiles/Skylights_65_mat_black.rad", "~/MantaRay/TestingRemote/radFiles/GlassInt_74_mat_black.rad", "~/MantaRay/TestingRemote/radFiles/RevitJfacadeFacadesCWglass_74_mat_black.rad", "~/MantaRay/TestingRemote/radFiles/RevitJfacadeWindowGlass_74_mat_black.rad", "~/MantaRay/TestingRemote/radFiles/Skylights_55_mat_black.rad", "~/MantaRay/TestingRemote/radFiles/RevitJfacadeDoorPanel_70_mat_black.rad", "/home/lio/MantaRay/TestingRemote/radFiles/RevitJintInnerCW_Glass_80_black.rad", "/home/lio/MantaRay/TestingRemote/radFiles/RevitJintInnerDoors_80_black.rad", "/home/lio/MantaRay/TestingRemote/radFiles/Skylights_65_black.rad", "/home/lio/MantaRay/TestingRemote/radFiles/GlassInt_74_black.rad", "/home/lio/MantaRay/TestingRemote/radFiles/RevitJfacadeFacadesCWglass_74_black.rad", "/home/lio/MantaRay/TestingRemote/radFiles/RevitJfacadeWindowGlass_74_black.rad", "/home/lio/MantaRay/TestingRemote/radFiles/Skylights_55_black.rad", "/home/lio/MantaRay/TestingRemote/radFiles/RevitJfacadeDoorPanel_70_black.rad", "~/MantaRay/TestingRemote/radFiles/opaque_materials_black.rad", "/home/lio/MantaRay/TestingRemote/radFiles/RevitJintInnerCWs_50_black.rad", "/home/lio/MantaRay/TestingRemote/radFiles/RANSLUCENT_black.rad", "/home/lio/MantaRay/TestingRemote/radFiles/Ceilings_70_black.rad", "/home/lio/MantaRay/TestingRemote/radFiles/RevitJintInnerDoors_50_black.rad", "/home/lio/MantaRay/TestingRemote/radFiles/RevitJintInnerWalls_50_black.rad", "/home/lio/MantaRay/TestingRemote/radFiles/Roofs_20_black.rad", "/home/lio/MantaRay/TestingRemote/radFiles/RevitJfacadeFacadesCladding_50_black.rad", "/home/lio/MantaRay/TestingRemote/radFiles/RoofMullions_70_black.rad", "/home/lio/MantaRay/TestingRemote/radFiles/Frames_50_black.rad", "/home/lio/MantaRay/TestingRemote/radFiles/SlabWall_50_black.rad", "/home/lio/MantaRay/TestingRemote/radFiles/SlabFloor_30_black.rad", "/home/lio/MantaRay/TestingRemote/radFiles/WallInterior_70_black.rad", "/home/lio/MantaRay/TestingRemote/radFiles/Doors_50_black.rad", "/home/lio/MantaRay/TestingRemote/radFiles/RevitJfacadeFacadesWall_50_black.rad", "/home/lio/MantaRay/TestingRemote/radFiles/Floors_20_black.rad", "/home/lio/MantaRay/TestingRemote/radFiles/ByggD_30_black.rad", "/home/lio/MantaRay/TestingRemote/radFiles/Furniture_black.rad", "/home/lio/MantaRay/TestingRemote/radFiles/Curves_black.rad", "/home/lio/MantaRay/TestingRemote/radFiles/ByggE_30_black.rad", "/home/lio/MantaRay/TestingRemote/radFiles/ContextBright_70_black.rad", "/home/lio/MantaRay/TestingRemote/radFiles/RevitJfacadeDoors_55_black.rad", "/home/lio/MantaRay/TestingRemote/radFiles/RevitJfacadeWindowsFrames_70_black.rad", "/home/lio/MantaRay/TestingRemote/radFiles/RevitJfacadeFacadesFrames_70_black.rad"],
    commands=["xform -m normalshadermaterial ~/MantaRay/TestingRemote/radFiles/RevitJintInnerCW_Glass_80_mat.mat > ~/MantaRay/TestingRemote/radFiles/RevitJintInnerCW_Glass_80_mat_black.rad;echo \"~/MantaRay/TestingRemote/radFiles/RevitJintInnerCW_Glass_80_mat_black.rad\"", "xform -m normalshadermaterial ~/MantaRay/TestingRemote/radFiles/Skylights_65_mat.mat > ~/MantaRay/TestingRemote/radFiles/Skylights_65_mat_black.rad;echo \"~/MantaRay/TestingRemote/radFiles/Skylights_65_mat_black.rad\"", "xform -m normalshadermaterial ~/MantaRay/TestingRemote/radFiles/GlassInt_74_mat.mat > ~/MantaRay/TestingRemote/radFiles/GlassInt_74_mat_black.rad;echo \"~/MantaRay/TestingRemote/radFiles/GlassInt_74_mat_black.rad\"", "xform -m normalshadermaterial ~/MantaRay/TestingRemote/radFiles/RevitJfacadeWindowGlass_74_mat.mat > ~/MantaRay/TestingRemote/radFiles/RevitJfacadeWindowGlass_74_mat_black.rad;echo \"~/MantaRay/TestingRemote/radFiles/RevitJfacadeWindowGlass_74_mat_black.rad\"", "xform -m normalshadermaterial ~/MantaRay/TestingRemote/radFiles/RevitJintInnerDoors_80_mat.mat > ~/MantaRay/TestingRemote/radFiles/RevitJintInnerDoors_80_mat_black.rad;echo \"~/MantaRay/TestingRemote/radFiles/RevitJintInnerDoors_80_mat_black.rad\"", "xform -m normalshadermaterial ~/MantaRay/TestingRemote/radFiles/RevitJfacadeFacadesCWglass_74_mat.mat > ~/MantaRay/TestingRemote/radFiles/RevitJfacadeFacadesCWglass_74_mat_black.rad;echo \"~/MantaRay/TestingRemote/radFiles/RevitJfacadeFacadesCWglass_74_mat_black.rad\""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])  # -> Stdout, Stderr_, Ran
entwine_7 = Entwine(Branch00=normalshadermat, Branch01=executessh_23.Stdout, FlattenInputs=True)
panel_69 = Panel(overrides_21.Output)
join_4 = TextJoin(Text=flatten(entwine_7), Join=" ")
overrides_23 = ApplyOverrides(Input=panel_68, Rads=graft(join_4), Target=graft("myNormalsScene.oct"))  # -> Output, DynamicOutput
python_8 = GhPythonScript(x=flatten(executessh_23.Stdout))  # -> a; inputs x: list; same code as python_4
panel_70 = Panel(executessh_23.Stdout)
and_3 = GateAnd(A=python_8, B=executessh_23.Ran)
executessh_24 = ExecuteSSH(
    _SSHCommands=overrides_23.DynamicOutput,
    Run=and_3,
    addPrefix=True,
    description="""mkdir -p ~/MantaRay/Andrei/octrees/
oconv -r 2048 -w -f /home/lio/MantaRay/TestingRemote/radFiles/mat_normalglow.mat ~/MantaRay/TestingRemote/radFiles/RevitJintInnerCW_Glass_80_mat_black.rad ~/MantaRay/TestingRemote/radFiles/RevitJintInnerDoors_80_mat_black.rad ~/MantaRay/TestingRemote/radFiles/Skylights_65_mat_black.rad ~/MantaRay/TestingRemote/radFiles/GlassInt_74_mat_black.rad ~/MantaRay/TestingRemote/radFiles/RevitJfacadeFacadesCWglass_74_mat_black.rad ~/MantaRay/TestingRemote/radFiles/RevitJfacadeWindowGlass_74_mat_black.rad ~/MantaRay/TestingRemote/radFiles/Skylights_55_mat_black.rad ~/MantaRay/TestingRemote/radFiles/RevitJfacadeDoorPanel_70_mat_black.rad /home/lio/MantaRay/TestingRemote/radFiles/RevitJintInnerCW_Glass_80_black.rad /home/lio/MantaRay/TestingRemote/radFiles/RevitJintInnerDoors_80_black.rad /home/lio/MantaRay/TestingRemote/radFiles/Skylights_65_black.rad /home/lio/MantaRay/TestingRemote/radFiles/GlassInt_74_black.rad /home/lio/MantaRay/TestingRemote/radFiles/RevitJfacadeFacadesCWglass_74_black.rad /home/lio/MantaRay/TestingRemote/radFiles/RevitJfacadeWindowGlass_74_black.rad /home/lio/MantaRay/TestingRemote/radFiles/Skylights_55_black.rad /home/lio/MantaRay/TestingRemote/radFiles/RevitJfacadeDoorPanel_70_black.rad > ~/MantaRay/Andrei/octrees/myNormalsScene.oct
echo ~/MantaRay/Andrei/octrees/myNormalsScene.oct""",
    fireLogs=False,
    lastRunTime=65176,
    suppressWarnings=False,
    results="/home/lio/simulation/Boston_Skylights/octrees/myNormalsScene.oct",
    commands="""mkdir -p ~/simulation/Boston_Skylights/octrees/
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""")  # -> Stdout, Stderr_, Ran

# ----
# Remote Connect
# Be sure to check the above profile files if your EXPORT PATH=radiance stuff is included
# export PATH=$PATH:/usr/local/radiance/bin:/usr/local/accelerad/bin;export RAYPATH=.:/usr/local/accelerad/lib:/usr/local/radiance/lib;export DISPLAY=$(ip route list default | awk '{print $3}'):0;export LIBGL_ALWAYS_INDIRECT=1;export LD_LIBRARY_PATH=/usr/local/accelerad/bin:$LD_LIBRARY_PATH
panel_71 = Panel(". /etc/profile;. ~/.profile")

connect_2 = ConnectSSHFTP(
    User="lio",
    Ip="10.71.5.181",
    ProjectName="Andrei",
    Password="_prompt",
    _port="2222",
    Connect=Toggle(True),
    Prefixes=panel_71)  # -> Status, Prefixes, Run

panel_72 = Panel(connect_2.Status)

# ----
# Overview of all running tasks in linux
panel_73 = Panel("ps -aux | grep '<AllRadProgs>'")
logviewer_2 = LogViewer(Number=10)  # -> CurrentTasks, Logs
default = DefaultMSS(data=flatten(panel_73), default_value_flattened=flatten(logviewer_2.CurrentTasks))
panel_74 = Panel(logviewer_2.Logs)

executessh_25 = ExecuteSSH(
    _SSHCommands_=default,
    Run=Toggle(True),
    addPrefix=True,
    fireLogs=False,
    lastRunTime=61.9911,
    suppressWarnings=False,
    results="""root           6  0.0  0.0      0     0 ?        I<   Mar03   0:00 [kworker/0:0H-events_highpri]
root          26  0.0  0.0      0     0 ?        I<   Mar03   0:00 [kworker/2:0H-events_highpri]
root          32  0.0  0.0      0     0 ?        I<   Mar03   0:00 [kworker/3:0H-events_highpri]
root          38  0.0  0.0      0     0 ?        I<   Mar03   0:00 [kworker/4:0H-events_highpri]
root          50  0.0  0.0      0     0 ?        I<   Mar03   0:00 [kworker/6:0H-events_highpri]
root          62  0.0  0.0      0     0 ?        I<   Mar03   0:00 [kworker/8:0H-events_highpri]
root          74  0.0  0.0      0     0 ?        I<   Mar03   0:00 [kworker/10:0H-events_highpri]
root          80  0.0  0.0      0     0 ?        I<   Mar03   0:00 [kworker/11:0H-events_highpri]
root          92  0.0  0.0      0     0 ?        I<   Mar03   0:00 [kworker/13:0H-events_highpri]
root         104  0.0  0.0      0     0 ?        I<   Mar03   0:00 [kworker/15:0H-events_highpri]
root         110  0.0  0.0      0     0 ?        I<   Mar03   0:00 [kworker/16:0H-events_highpri]
root         140  0.0  0.0      0     0 ?        I<   Mar03   0:00 [kworker/21:0H-events_highpri]
root         164  0.0  0.0      0     0 ?        I<   Mar03   0:00 [kworker/25:0H-events_highpri]
root         188  0.0  0.0      0     0 ?        I<   Mar03   0:00 [kworker/29:0H-events_highpri]
root         194  0.0  0.0      0     0 ?        I<   Mar03   0:00 [kworker/30:0H-events_highpri]
root         200  0.0  0.0      0     0 ?        I<   Mar03   0:00 [kworker/31:0H-events_highpri]
root         218  0.0  0.0      0     0 ?        I<   Mar03   0:00 [kworker/34:0H-events_highpri]
root         224  0.0  0.0      0     0 ?        I<   Mar03   0:00 [kworker/35:0H-events_highpri]
root         230  0.0  0.0      0     0 ?        I<   Mar03   0:00 [kworker/36:0H-events_highpri]
root         242  0.0  0.0      0     0 ?        I<   Mar03   0:00 [kworker/38:0H-events_highpri]
root         248  0.0  0.0      0     0 ?        I<   Mar03   0:00 [kworker/39:0H-events_highpri]
root         254  0.0  0.0      0     0 ?        I<   Mar03   0:00 [kworker/40:0H-events_highpri]
root         266  0.0  0.0      0     0 ?        I<   Mar03   0:00 [kworker/42:0H-events_highpri]
root         272  0.0  0.0      0     0 ?        I<   Mar03   0:00 [kworker/43:0H-events_highpri]
root         284  0.0  0.0      0     0 ?        I<   Mar03   0:00 [kworker/45:0H-events_highpri]
root         290  0.0  0.0      0     0 ?        I<   Mar03   0:00 [kworker/46:0H-events_highpri]
root         296  0.0  0.0      0     0 ?        I<   Mar03   0:00 [kworker/47:0H-events_highpri]
root         302  0.0  0.0      0     0 ?        I<   Mar03   0:00 [kworker/48:0H-events_highpri]
root         308  0.0  0.0      0     0 ?        I<   Mar03   0:00 [kworker/49:0H-events_highpri]
root         314  0.0  0.0      0     0 ?        I<   Mar03   0:00 [kworker/50:0H-events_highpri]
root         320  0.0  0.0      0     0 ?        I<   Mar03   0:00 [kworker/51:0H-events_highpri]
root         344  0.0  0.0      0     0 ?        I<   Mar03   0:00 [kworker/55:0H-events_highpri]
root         350  0.0  0.0      0     0 ?        I<   Mar03   0:00 [kworker/56:0H-events_highpri]
root         362  0.0  0.0      0     0 ?        I<   Mar03   0:00 [kworker/58:0H-events_highpri]
root         392  0.0  0.0      0     0 ?        I<   Mar03   0:00 [kworker/63:0H-events_highpri]
root         393  0.0  0.0      0     0 ?        S    Mar03   0:00 [kdevtmpfs]
root         410  0.0  0.0      0     0 ?        I    Mar03   0:00 [kworker/7:1-events]
root         458  0.0  0.0      0     0 ?        I<   Mar03   0:00 [tpm_dev_wq]
root         462  0.0  0.0      0     0 ?        I<   Mar03   0:00 [devfreq_wq]
root         529  0.0  0.0      0     0 ?        I    Mar03   0:11 [kworker/55:1-events]
root        1162  0.0  0.0      0     0 ?        I    Mar03   0:00 [kworker/17:2-events]
root        1361  0.0  0.5 107920 11300 ?        Ssl  Mar03   0:00 /usr/bin/python3 /usr/share/unattended-upgrades/unattended-upgrade-shutdown --wait-for-signal
root       27020  0.0  0.0      0     0 ?        I    Mar03   0:00 [kworker/3:2-events]
root       27102  0.0  0.0      0     0 ?        I    Mar03   0:00 [kworker/7:0-events]
root       52256  0.0  0.0      0     0 ?        I    Mar04   0:00 [kworker/61:0-events]
root       55313  0.0  0.0      0     0 ?        I    Mar05   0:00 [kworker/6:2-events]
root       58586  0.0  0.0      0     0 ?        I    Mar06   0:00 [kworker/5:1-events]
root       61350  0.0  0.0      0     0 ?        I    Mar07   0:00 [kworker/9:1-events]
root       63211  0.0  0.0      0     0 ?        I    Mar08   0:00 [kworker/18:2-events]
root       63217  0.0  0.0      0     0 ?        I    Mar08   0:04 [kworker/44:0-events]
root       64307  0.0  0.2  22500  5444 ?        Ss   Mar08   0:01 /lib/systemd/systemd-udevd
root       75407  0.0  0.0      0     0 ?        I    Mar08   0:00 [kworker/13:1-events]
root       75920  0.0  0.0      0     0 ?        I    Mar08   0:00 [kworker/6:1-events]
root       77179  0.0  0.0      0     0 ?        I    Mar09   0:04 [kworker/28:1-events]
root       78111  0.0  0.0      0     0 ?        I    Mar10   0:00 [kworker/43:2-events]
root       80208  0.0  0.0      0     0 ?        I    Mar11   0:00 [kworker/62:2-events]
root       80863  0.0  0.0      0     0 ?        I    Mar11   0:00 [kworker/8:2-events]
root       80865  0.0  0.0      0     0 ?        I    Mar11   0:02 [kworker/8:3-events]
root       82668  0.0  0.0      0     0 ?        I    00:00   0:00 [kworker/45:0-events]
root       82857  0.0  0.0      0     0 ?        I    03:11   0:00 [kworker/48:2-events]
root       83185  0.0  0.0      0     0 ?        I    05:53   0:00 [kworker/2:2-events]
root       83460  0.0  0.0      0     0 ?        I    05:53   0:00 [kworker/10:2-events]
root       83988  0.0  0.0      0     0 ?        I    13:09   0:00 [kworker/14:1-events]
root       84879  0.0  0.0      0     0 ?        I    19:35   0:00 [kworker/u128:1-events_power_efficient]
root       85515  0.0  0.0      0     0 ?        I    20:02   0:00 [kworker/u128:0-events_power_efficient]
lio        86369  0.0  0.1   7024  3504 ?        Ss   20:13   0:00 bash -c . /etc/profile;. ~/.profile;ps -aux | grep 'arch2rad\|bgraph\|bsdf2klems\|bsdf2rad\|bsdf2ttree\|bsdfview\|cnt\|compamb\|cv\|dayfact\|dcglare\|dctimestep\|dgraph\|epw2wea\|ev\|fieldcomb\|findglare\|gcomp\|genBSDF\|genblinds\|genbox\|genclock\|gendaymtx\|genklemsamp\|genprism\|genrev\|gensky\|genskyvec\|gensurf\|genworm\|getbbox\|getinfo\|glare\|glarendx\|glrad\|histo\|icalc\|igraph\|lampcolor\|libmeta.a\|lookamb\|macbethcal\|meta\|meta2bmp\|meta2tga\|metafile\|mgf2meta\|mgf2rad\|mkillum\|mkpmap\|mksource\|neaten\|normpat\|normtiff\|obj2mesh\|obj2rad\|objline\|objview\|oconv\|pabopto2bsdf\|pabopto2xyz\|pcomb\|pcompos\|pcond\|pdfblur\|pexpand\|pextrem\|pfilt\|pflip\|phisto\|pinterp\|pkgBSDF\|plotin\|pmapdump\|pmblur\|pmblur2\|pmdblur\|protate\|psign\|psketch\|psmeta\|psort\|pvalue\|ra_bmp\|ra_gif\|ra_pict\|ra_ppm\|ra_ps\|ra_rgbe\|ra_t16\|ra_t8\|ra_tiff\|ra_xyze\|rad\|rad2mgf\|raddepend\|ran2tiff\|ranimate\|ranimove\|rcalc\|rcode2bmp\|rcode_depth\|rcode_ident\|rcode_norm\|rcollate\|rcontrib\|rcrop\|replmarks\|rfluxmtx\|rhcopy\|rhinfo\|rholo\|rhoptimize\|rhpict\|rlam\|rmtxop\|robjutil\|rpict\|rpiece\|rsensor\|rsplit\|rtpict\|rtrace\|rvu\|tabfunc\|tmesh2rad\|total\|trad\|ttyimage\|vwrays\|vwright\|wrapBSDF\|x11meta\|xform\|xglaresrc\|ximage\|xshowtrace\|falsecolor'
lio        86374  0.0  0.1   7388  3532 ?        S    20:13   0:00 grep arch2rad\|bgraph\|bsdf2klems\|bsdf2rad\|bsdf2ttree\|bsdfview\|cnt\|compamb\|cv\|dayfact\|dcglare\|dctimestep\|dgraph\|epw2wea\|ev\|fieldcomb\|findglare\|gcomp\|genBSDF\|genblinds\|genbox\|genclock\|gendaymtx\|genklemsamp\|genprism\|genrev\|gensky\|genskyvec\|gensurf\|genworm\|getbbox\|getinfo\|glare\|glarendx\|glrad\|histo\|icalc\|igraph\|lampcolor\|libmeta.a\|lookamb\|macbethcal\|meta\|meta2bmp\|meta2tga\|metafile\|mgf2meta\|mgf2rad\|mkillum\|mkpmap\|mksource\|neaten\|normpat\|normtiff\|obj2mesh\|obj2rad\|objline\|objview\|oconv\|pabopto2bsdf\|pabopto2xyz\|pcomb\|pcompos\|pcond\|pdfblur\|pexpand\|pextrem\|pfilt\|pflip\|phisto\|pinterp\|pkgBSDF\|plotin\|pmapdump\|pmblur\|pmblur2\|pmdblur\|protate\|psign\|psketch\|psmeta\|psort\|pvalue\|ra_bmp\|ra_gif\|ra_pict\|ra_ppm\|ra_ps\|ra_rgbe\|ra_t16\|ra_t8\|ra_tiff\|ra_xyze\|rad\|rad2mgf\|raddepend\|ran2tiff\|ranimate\|ranimove\|rcalc\|rcode2bmp\|rcode_depth\|rcode_ident\|rcode_norm\|rcollate\|rcontrib\|rcrop\|replmarks\|rfluxmtx\|rhcopy\|rhinfo\|rholo\|rhoptimize\|rhpict\|rlam\|rmtxop\|robjutil\|rpict\|rpiece\|rsensor\|rsplit\|rtpict\|rtrace\|rvu\|tabfunc\|tmesh2rad\|total\|trad\|ttyimage\|vwrays\|vwright\|wrapBSDF\|x11meta\|xform\|xglaresrc\|ximage\|xshowtrace\|falsecolor""",
    commands="ps -aux | grep 'arch2rad\|bgraph\|bsdf2klems\|bsdf2rad\|bsdf2ttree\|bsdfview\|cnt\|compamb\|cv\|dayfact\|dcglare\|dctimestep\|dgraph\|epw2wea\|ev\|fieldcomb\|findglare\|gcomp\|genBSDF\|genblinds\|genbox\|genclock\|gendaymtx\|genklemsamp\|genprism\|genrev\|gensky\|genskyvec\|gensurf\|genworm\|getbbox\|getinfo\|glare\|glarendx\|glrad\|histo\|icalc\|igraph\|lampcolor\|libmeta.a\|lookamb\|macbethcal\|meta\|meta2bmp\|meta2tga\|metafile\|mgf2meta\|mgf2rad\|mkillum\|mkpmap\|mksource\|neaten\|normpat\|normtiff\|obj2mesh\|obj2rad\|objline\|objview\|oconv\|pabopto2bsdf\|pabopto2xyz\|pcomb\|pcompos\|pcond\|pdfblur\|pexpand\|pextrem\|pfilt\|pflip\|phisto\|pinterp\|pkgBSDF\|plotin\|pmapdump\|pmblur\|pmblur2\|pmdblur\|protate\|psign\|psketch\|psmeta\|psort\|pvalue\|ra_bmp\|ra_gif\|ra_pict\|ra_ppm\|ra_ps\|ra_rgbe\|ra_t16\|ra_t8\|ra_tiff\|ra_xyze\|rad\|rad2mgf\|raddepend\|ran2tiff\|ranimate\|ranimove\|rcalc\|rcode2bmp\|rcode_depth\|rcode_ident\|rcode_norm\|rcollate\|rcontrib\|rcrop\|replmarks\|rfluxmtx\|rhcopy\|rhinfo\|rholo\|rhoptimize\|rhpict\|rlam\|rmtxop\|robjutil\|rpict\|rpiece\|rsensor\|rsplit\|rtpict\|rtrace\|rvu\|tabfunc\|tmesh2rad\|total\|trad\|ttyimage\|vwrays\|vwright\|wrapBSDF\|x11meta\|xform\|xglaresrc\|ximage\|xshowtrace\|falsecolor'")  # -> Stdout, Stderr_, Ran
python_9 = GhPythonScript(x=executessh_25.Stdout)  # -> a
# ---------- python_9: Python ----------
__author__ = "mm1013"
__version__ = "2022.08.30"

import rhinoscriptsyntax as rs

a = [l for l in x.split("\n") if "grep" not in l]
# ---------- end python_9 ----------
panel_75 = Panel(python_9)

# ----
# sunny sky (SET LAT AND LON)
panel_76 = Panel("gensky 7 4 <h>:00CEST +s -a <lat> -o <lon>")
falsestart_14 = LBFalseStartToggle(False)
series = Series(Start=8, Step=1, Count=10)
bool_4 = Boolean(falsestart_14)
and_append_the_ground_2 = Panel("""##The 1 will be multiplie with brightfunc
skyfunc glow sky_glow
0
0
4 1 1 1 0

##Set to 1 as it will be multiplied with the gensky result
sky_glow source sky
0
0
4 0 0 1 180

##Set to 1 as it will be multiplied with the gensky result
skyfunc glow ground_glow
0
0
4 1 1 1 0

##The ground pane
ground_glow source ground
0
0
4 0 0 -1 180""")
panel_77 = Panel("""mkdir -p <proj>/skies/
echo "<sky>" > <proj>/skies/<target>
echo "<proj>/skies/<target>"
""")
python_10 = GhPythonScript(x=series)  # -> a; inputs x: Int32
# ---------- python_10: Python ----------
__author__ = "mm1013"
__version__ = "2022.08.30"

import rhinoscriptsyntax as rs

a = "%02d00" % x
# ---------- end python_10 ----------
hours = Number(python_10)
hours_2 = Text(python_10)

overrides_24 = ApplyOverrides(Input=panel_76, H=graft(series), Lat=graft("59.9"), Lon=graft("10.7"))  # -> Output, DynamicOutput
executessh_26 = ExecuteSSH(
    _SSHCommands_=overrides_24.DynamicOutput,
    Run=bool_4,
    addPrefix=True,
    description="""gensky 7 4 8:00CEST +s -a 59.9 -o 10.7


- - -

gensky 7 4 9:00CEST +s -a 59.9 -o 10.7


- - -

gensky 7 4 10:00CEST +s -a 59.9 -o 10.7


- - -

gensky 7 4 11:00CEST +s -a 59.9 -o 10.7


- - -

gensky 7 4 12:00CEST +s -a 59.9 -o 10.7


- - -

gensky 7 4 13:00CEST +s -a 59.9 -o 10.7


- - -

gensky 7 4 14:00CEST +s -a 59.9 -o 10.7


- - -

gensky 7 4 15:00CEST +s -a 59.9 -o 10.7


- - -

gensky 7 4 16:00CEST +s -a 59.9 -o 10.7


- - -

gensky 7 4 17:00CEST +s -a 59.9 -o 10.7""",
    fireLogs=False,
    lastRunTime=39,
    suppressWarnings=False,
    results=["""# gensky 7 4 8:00CEST +s -a 59.9 -o 10.7
# Local solar time: 5.22
# Solar altitude and azimuth: 14.1 -111.6
# Ground ambient level: 8.8

void light solar
0
0
3 3.92e+06 3.92e+06 3.92e+06

solar source sun
0
0
4 0.901641 0.357186 0.243849 0.5

void brightfunc skyfunc
2 skybr skybright.cal
0
7 1 3.81e+00 5.41e+00 3.08e-01 0.901641 0.357186 0.243849""", """# gensky 7 4 9:00CEST +s -a 59.9 -o 10.7
# Local solar time: 6.22
# Solar altitude and azimuth: 21.4 -99.3
# Ground ambient level: 10.8

void light solar
0
0
3 5.36e+06 5.36e+06 5.36e+06

solar source sun
0
0
4 0.919246 0.149788 0.364073 0.5

void brightfunc skyfunc
2 skybr skybright.cal
0
7 1 4.88e+00 9.62e+00 3.41e-01 0.919246 0.149788 0.364073""", """# gensky 7 4 10:00CEST +s -a 59.9 -o 10.7
# Local solar time: 7.22
# Solar altitude and azimuth: 28.8 -86.4
# Ground ambient level: 12.6

void light solar
0
0
3 6.07e+06 6.07e+06 6.07e+06

solar source sun
0
0
4 0.874207 -0.054485 0.482486 0.5

void brightfunc skyfunc
2 skybr skybright.cal
0
7 1 6.11e+00 1.37e+01 3.90e-01 0.874207 -0.054485 0.482486""", """# gensky 7 4 11:00CEST +s -a 59.9 -o 10.7
# Local solar time: 8.22
# Solar altitude and azimuth: 36.2 -72.6
# Ground ambient level: 13.8

void light solar
0
0
3 6.48e+06 6.48e+06 6.48e+06

solar source sun
0
0
4 0.769592 -0.241712 0.591018 0.5

void brightfunc skyfunc
2 skybr skybright.cal
0
7 1 7.51e+00 1.74e+01 4.56e-01 0.769592 -0.241712 0.591018""", """# gensky 7 4 12:00CEST +s -a 59.9 -o 10.7
# Local solar time: 9.22
# Solar altitude and azimuth: 43.0 -56.9
# Ground ambient level: 14.6

void light solar
0
0
3 6.72e+06 6.72e+06 6.72e+06

solar source sun
0
0
4 0.612531 -0.399135 0.682273 0.5

void brightfunc skyfunc
2 skybr skybright.cal
0
7 1 9.05e+00 2.04e+01 5.41e-01 0.612531 -0.399135 0.682273""", """# gensky 7 4 13:00CEST +s -a 59.9 -o 10.7
# Local solar time: 10.22
# Solar altitude and azimuth: 48.6 -38.7
# Ground ambient level: 15.0

void light solar
0
0
3 6.86e+06 6.86e+06 6.86e+06

solar source sun
0
0
4 0.413727 -0.516025 0.750032 0.5

void brightfunc skyfunc
2 skybr skybright.cal
0
7 1 1.06e+01 2.26e+01 6.32e-01 0.413727 -0.516025 0.750032"""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],
    commands=["gensky 7 4 12:00CEST +s -a 59.9 -o 10.7", "gensky 7 4 8:00CEST +s -a 59.9 -o 10.7", "gensky 7 4 9:00CEST +s -a 59.9 -o 10.7", "gensky 7 4 13:00CEST +s -a 59.9 -o 10.7", "gensky 7 4 15:00CEST +s -a 59.9 -o 10.7", "gensky 7 4 16:00CEST +s -a 59.9 -o 10.7", "gensky 7 4 17:00CEST +s -a 59.9 -o 10.7"])  # -> Stdout, Stderr_, Ran

panel_78 = Panel(executessh_26.Stdout)
concat_3 = Concatenate(FragmentC="##Will control the gradient of the sky", FragmentA=executessh_26.Stdout, FragmentB=and_append_the_ground_2)

overrides_25 = ApplyOverrides(Input=panel_77, Sky=graft(concat_3), Target=graft("sunny_sky_<h>.rad"), H=graft(series))  # -> Output, DynamicOutput
executessh_27 = ExecuteSSH(
    _SSHCommands_=overrides_25.DynamicOutput,
    Run=executessh_26.Ran,
    addPrefix=True,
    description="""mkdir -p ~/MantaRay/Andrei/skies/
echo "##Will control the gradient of the sky
# gensky 7 4 8:00CEST +s -a 59.9 -o 10.7
# Local solar time: 5.22
# Solar altitude and azimuth: 14.1 -111.6
# Ground ambient level: 8.8

void light solar
0
0
3 3.92e+06 3.92e+06 3.92e+06

solar source sun
0
0
4 0.901641 0.357186 0.243849 0.5

void brightfunc skyfunc
2 skybr skybright.cal
0
7 1 3.81e+00 5.41e+00 3.08e-01 0.901641 0.357186 0.243849

##The 1 will be multiplie with brightfunc
skyfunc glow sky_glow
0
0
4 1 1 1 0

##Set to 1 as it will be multiplied with the gensky result
sky_glow source sky
0
0
4 0 0 1 180

##Set to 1 as it will be multiplied with the gensky result
skyfunc glow ground_glow
0
0
4 1 1 1 0

##The ground pane
ground_glow source ground
0
0
4 0 0 -1 180" > ~/MantaRay/Andrei/skies/sunny_sky_8.rad
echo "~/MantaRay/Andrei/skies/sunny_sky_8.rad"


- - -

mkdir -p ~/MantaRay/Andrei/skies/
echo "##Will control the gradient of the sky
# gensky 7 4 9:00CEST +s -a 59.9 -o 10.7
# Local solar time: 6.22
# Solar altitude and azimuth: 21.4 -99.3
# Ground ambient level: 10.8

void light solar
0
0
3 5.36e+06 5.36e+06 5.36e+06

solar source sun
0
0
4 0.919246 0.149788 0.364073 0.5

void brightfunc skyfunc
2 skybr skybright.cal
0
7 1 4.88e+00 9.62e+00 3.41e-01 0.919246 0.149788 0.364073

##The 1 will be multiplie with brightfunc
skyfunc glow sky_glow
0
0
4 1 1 1 0

##Set to 1 as it will be multiplied with the gensky result
sky_glow source sky
0
0
4 0 0 1 180

##Set to 1 as it will be multiplied with the gensky result
skyfunc glow ground_glow
0
0
4 1 1 1 0

##The ground pane
ground_glow source ground
0
0
4 0 0 -1 180" > ~/MantaRay/Andrei/skies/sunny_sky_9.rad
echo "~/MantaRay/Andrei/skies/sunny_sky_9.rad"


- - -

mkdir -p ~/MantaRay/Andrei/skies/
echo "##Will control the gradient of the sky
# gensky 7 4 10:00CEST +s -a 59.9 -o 10.7
# Local solar time: 7.22
# Solar altitude and azimuth: 28.8 -86.4
# Ground ambient level: 12.6

void light solar
0
0
3 6.07e+06 6.07e+06 6.07e+06

solar source sun
0
0
4 0.874207 -0.054485 0.482486 0.5

void brightfunc skyfunc
2 skybr skybright.cal
0
7 1 6.11e+00 1.37e+01 3.90e-01 0.874207 -0.054485 0.482486

##The 1 will be multiplie with brightfunc
skyfunc glow sky_glow
0
0
4 1 1 1 0

##Set to 1 as it will be multiplied with the gensky result
sky_glow source sky
0
0
4 0 0 1 180

##Set to 1 as it will be multiplied with the gensky result
skyfunc glow ground_glow
0
0
4 1 1 1 0

##The ground pane
ground_glow source ground
0
0
4 0 0 -1 180" > ~/MantaRay/Andrei/skies/sunny_sky_10.rad
echo "~/MantaRay/Andrei/skies/sunny_sky_10.rad"


- - -

mkdir -p ~/MantaRay/Andrei/skies/
echo "##Will control the gradient of the sky
# gensky 7 4 11:00CEST +s -a 59.9 -o 10.7
# Local solar time: 8.22
# Solar altitude and azimuth: 36.2 -72.6
# Ground ambient level: 13.8

void light solar
0
0
3 6.48e+06 6.48e+06 6.48e+06

solar source sun
0
0
4 0.769592 -0.241712 0.591018 0.5

void brightfunc skyfunc
2 skybr skybright.cal
0
7 1 7.51e+00 1.74e+01 4.56e-01 0.769592 -0.241712 0.591018

##The 1 will be multiplie with brightfunc
skyfunc glow sky_glow
0
0
4 1 1 1 0

##Set to 1 as it will be multiplied with the gensky result
sky_glow source sky
0
0
4 0 0 1 180

##Set to 1 as it will be multiplied with the gensky result
skyfunc glow ground_glow
0
0
4 1 1 1 0

##The ground pane
ground_glow source ground
0
0
4 0 0 -1 180" > ~/MantaRay/Andrei/skies/sunny_sky_11.rad
echo "~/MantaRay/Andrei/skies/sunny_sky_11.rad"


- - -

mkdir -p ~/MantaRay/Andrei/skies/
echo "##Will control the gradient of the sky
# gensky 7 4 12:00CEST +s -a 59.9 -o 10.7
# Local solar time: 9.22
# Solar altitude and azimuth: 43.0 -56.9
# Ground ambient level: 14.6

void light solar
0
0
3 6.72e+06 6.72e+06 6.72e+06

solar source sun
0
0
4 0.612531 -0.399135 0.682273 0.5

void brightfunc skyfunc
2 skybr skybright.cal
0
7 1 9.05e+00 2.04e+01 5.41e-01 0.612531 -0.399135 0.682273

##The 1 will be multiplie with brightfunc
skyfunc glow sky_glow
0
0
4 1 1 1 0

##Set to 1 as it will be multiplied with the gensky result
sky_glow source sky
0
0
4 0 0 1 180

##Set to 1 as it will be multiplied with the gensky result
skyfunc glow ground_glow
0
0
4 1 1 1 0

##The ground pane
ground_glow source ground
0
0
4 0 0 -1 180" > ~/MantaRay/Andrei/skies/sunny_sky_12.rad
echo "~/MantaRay/Andrei/skies/sunny_sky_12.rad"


- - -

mkdir -p ~/MantaRay/Andrei/skies/
echo "##Will control the gradient of the sky
# gensky 7 4 13:00CEST +s -a 59.9 -o 10.7
# Local solar time: 10.22
# Solar altitude and azimuth: 48.6 -38.7
# Ground ambient level: 15.0

void light solar
0
0
3 6.86e+06 6.86e+06 6.86e+06

solar source sun
0
0
4 0.413727 -0.516025 0.750032 0.5

void brightfunc skyfunc
2 skybr skybright.cal
0
7 1 1.06e+01 2.26e+01 6.32e-01 0.413727 -0.516025 0.750032

##The 1 will be multiplie with brightfunc
skyfunc glow sky_glow
0
0
4 1 1 1 0

##Set to 1 as it will be multiplied with the gensky result
sky_glow source sky
0
0
4 0 0 1 180

##Set to 1 as it will be multiplied with the gensky result
skyfunc glow ground_glow
0
0
4 1 1 1 0

##The ground pane
ground_glow source ground
0
0
4 0 0 -1 180" > ~/MantaRay/Andrei/skies/sunny_sky_13.rad
echo "~/MantaRay/Andrei/skies/sunny_sky_13.rad"


- - -

mkdir -p ~/MantaRay/Andrei/skies/
echo "##Will control the gradient of the sky
# gensky 7 4 14:00CEST +s -a 59.9 -o 10.7
# Local solar time: 11.22
# Solar altitude and azimuth: 52.2 -17.7
# Ground ambient level: 15.1

void light solar
0
0
3 6.93e+06 6.93e+06 6.93e+06

solar source sun
0
0
4 0.186727 -0.584417 0.789677 0.5

void brightfunc skyfunc
2 skybr skybright.cal
0
7 1 1.18e+01 2.39e+01 7.04e-01 0.186727 -0.584417 0.789677

##The 1 will be multiplie with brightfunc
skyfunc glow sky_glow
0
0
4 1 1 1 0

##Set to 1 as it will be multiplied with the gensky result
sky_glow source sky
0
0
4 0 0 1 180

##Set to 1 as it will be multiplied with the gensky result
skyfunc glow ground_glow
0
0
4 1 1 1 0

##The ground pane
ground_glow source ground
0
0
4 0 0 -1 180" > ~/MantaRay/Andrei/skies/sunny_sky_14.rad
echo "~/MantaRay/Andrei/skies/sunny_sky_14.rad"


- - -

mkdir -p ~/MantaRay/Andrei/skies/
echo "##Will control the gradient of the sky
# gensky 7 4 15:00CEST +s -a 59.9 -o 10.7
# Local solar time: 12.22
# Solar altitude and azimuth: 53.0 5.1
# Ground ambient level: 15.2

void light solar
0
0
3 6.94e+06 6.94e+06 6.94e+06

solar source sun
0
0
4 -0.052997 -0.599649 0.798507 0.5

void brightfunc skyfunc
2 skybr skybright.cal
0
7 1 1.21e+01 2.42e+01 7.23e-01 -0.052997 -0.599649 0.798507

##The 1 will be multiplie with brightfunc
skyfunc glow sky_glow
0
0
4 1 1 1 0

##Set to 1 as it will be multiplied with the gensky result
sky_glow source sky
0
0
4 0 0 1 180

##Set to 1 as it will be multiplied with the gensky result
skyfunc glow ground_glow
0
0
4 1 1 1 0

##The ground pane
ground_glow source ground
0
0
4 0 0 -1 180" > ~/MantaRay/Andrei/skies/sunny_sky_15.rad
echo "~/MantaRay/Andrei/skies/sunny_sky_15.rad"


- - -

mkdir -p ~/MantaRay/Andrei/skies/
echo "##Will control the gradient of the sky
# gensky 7 4 16:00CEST +s -a 59.9 -o 10.7
# Local solar time: 13.22
# Solar altitude and azimuth: 50.9 27.3
# Ground ambient level: 15.1

void light solar
0
0
3 6.91e+06 6.91e+06 6.91e+06

solar source sun
0
0
4 -0.289110 -0.560683 0.775919 0.5

void brightfunc skyfunc
2 skybr skybright.cal
0
7 1 1.13e+01 2.35e+01 6.77e-01 -0.289110 -0.560683 0.775919

##The 1 will be multiplie with brightfunc
skyfunc glow sky_glow
0
0
4 1 1 1 0

##Set to 1 as it will be multiplied with the gensky result
sky_glow source sky
0
0
4 0 0 1 180

##Set to 1 as it will be multiplied with the gensky result
skyfunc glow ground_glow
0
0
4 1 1 1 0

##The ground pane
ground_glow source ground
0
0
4 0 0 -1 180" > ~/MantaRay/Andrei/skies/sunny_sky_16.rad
echo "~/MantaRay/Andrei/skies/sunny_sky_16.rad"


- - -

mkdir -p ~/MantaRay/Andrei/skies/
echo "##Will control the gradient of the sky
# gensky 7 4 17:00CEST +s -a 59.9 -o 10.7
# Local solar time: 14.22
# Solar altitude and azimuth: 46.3 47.1
# Ground ambient level: 14.8

void light solar
0
0
3 6.81e+06 6.81e+06 6.81e+06

solar source sun
0
0
4 -0.505520 -0.470175 0.723454 0.5

void brightfunc skyfunc
2 skybr skybright.cal
0
7 1 9.93e+00 2.18e+01 5.92e-01 -0.505520 -0.470175 0.723454

##The 1 will be multiplie with brightfunc
skyfunc glow sky_glow
0
0
4 1 1 1 0

##Set to 1 as it will be multiplied with the gensky result
sky_glow source sky
0
0
4 0 0 1 180

##Set to 1 as it will be multiplied with the gensky result
skyfunc glow ground_glow
0
0
4 1 1 1 0

##The ground pane
ground_glow source ground
0
0
4 0 0 -1 180" > ~/MantaRay/Andrei/skies/sunny_sky_17.rad
echo "~/MantaRay/Andrei/skies/sunny_sky_17.rad"
""",
    fireLogs=False,
    lastRunTime=45,
    suppressWarnings=False,
    results=["""_JOIN_
_JOIN_
~/MantaRay/TestingRemote/skies/sunny_sky_8.rad""", """_JOIN_
_JOIN_
~/MantaRay/TestingRemote/skies/sunny_sky_9.rad""", """_JOIN_
_JOIN_
~/MantaRay/TestingRemote/skies/sunny_sky_10.rad""", """_JOIN_
_JOIN_
~/MantaRay/TestingRemote/skies/sunny_sky_11.rad""", """_JOIN_
_JOIN_
~/MantaRay/TestingRemote/skies/sunny_sky_12.rad""", """_JOIN_
_JOIN_
~/MantaRay/TestingRemote/skies/sunny_sky_13.rad""", """_JOIN_
_JOIN_
~/MantaRay/TestingRemote/skies/sunny_sky_14.rad""", """_JOIN_
_JOIN_
~/MantaRay/TestingRemote/skies/sunny_sky_15.rad""", """_JOIN_
_JOIN_
~/MantaRay/TestingRemote/skies/sunny_sky_16.rad""", """_JOIN_
_JOIN_
~/MantaRay/TestingRemote/skies/sunny_sky_17.rad"""],
    commands=["""mkdir -p ~/MantaRay/TestingRemote/skies/
_JOIN_
echo "##Will control the gradient of the sky
# gensky 7 4 10:00CEST +s -a 59.9 -o 10.7
# Local solar time: 7.22
# Solar altitude and azimuth: 28.8 -86.4
# Ground ambient level: 12.6

void light solar
0
0
3 6.07e+06 6.07e+06 6.07e+06

solar source sun
0
0
4 0.874207 -0.054485 0.482486 0.5

void brightfunc skyfunc
2 skybr skybright.cal
0
7 1 6.11e+00 1.37e+01 3.90e-01 0.874207 -0.054485 0.482486

##The 1 will be multiplie with brightfunc
skyfunc glow sky_glow
0
0
4 1 1 1 0

##Set to 1 as it will be multiplied with the gensky result
sky_glow source sky
0
0
4 0 0 1 180

##Set to 1 as it will be multiplied with the gensky result
skyfunc glow ground_glow
0
0
4 1 1 1 0

##The ground pane
ground_glow source ground
0
0
4 0 0 -1 180" > ~/MantaRay/TestingRemote/skies/sunny_sky_10.rad
_JOIN_
echo "~/MantaRay/TestingRemote/skies/sunny_sky_10.rad"
""", """mkdir -p ~/MantaRay/TestingRemote/skies/
_JOIN_
echo "##Will control the gradient of the sky
# gensky 7 4 9:00CEST +s -a 59.9 -o 10.7
# Local solar time: 6.22
# Solar altitude and azimuth: 21.4 -99.3
# Ground ambient level: 10.8

void light solar
0
0
3 5.36e+06 5.36e+06 5.36e+06

solar source sun
0
0
4 0.919246 0.149788 0.364073 0.5

void brightfunc skyfunc
2 skybr skybright.cal
0
7 1 4.88e+00 9.62e+00 3.41e-01 0.919246 0.149788 0.364073

##The 1 will be multiplie with brightfunc
skyfunc glow sky_glow
0
0
4 1 1 1 0

##Set to 1 as it will be multiplied with the gensky result
sky_glow source sky
0
0
4 0 0 1 180

##Set to 1 as it will be multiplied with the gensky result
skyfunc glow ground_glow
0
0
4 1 1 1 0

##The ground pane
ground_glow source ground
0
0
4 0 0 -1 180" > ~/MantaRay/TestingRemote/skies/sunny_sky_9.rad
_JOIN_
echo "~/MantaRay/TestingRemote/skies/sunny_sky_9.rad"
""", """mkdir -p ~/MantaRay/TestingRemote/skies/
_JOIN_
echo "##Will control the gradient of the sky
# gensky 7 4 14:00CEST +s -a 59.9 -o 10.7
# Local solar time: 11.22
# Solar altitude and azimuth: 52.2 -17.7
# Ground ambient level: 15.1

void light solar
0
0
3 6.93e+06 6.93e+06 6.93e+06

solar source sun
0
0
4 0.186727 -0.584417 0.789677 0.5

void brightfunc skyfunc
2 skybr skybright.cal
0
7 1 1.18e+01 2.39e+01 7.04e-01 0.186727 -0.584417 0.789677

##The 1 will be multiplie with brightfunc
skyfunc glow sky_glow
0
0
4 1 1 1 0

##Set to 1 as it will be multiplied with the gensky result
sky_glow source sky
0
0
4 0 0 1 180

##Set to 1 as it will be multiplied with the gensky result
skyfunc glow ground_glow
0
0
4 1 1 1 0

##The ground pane
ground_glow source ground
0
0
4 0 0 -1 180" > ~/MantaRay/TestingRemote/skies/sunny_sky_14.rad
_JOIN_
echo "~/MantaRay/TestingRemote/skies/sunny_sky_14.rad"
""", """mkdir -p ~/MantaRay/TestingRemote/skies/
_JOIN_
echo "##Will control the gradient of the sky
# gensky 7 4 12:00CEST +s -a 59.9 -o 10.7
# Local solar time: 9.22
# Solar altitude and azimuth: 43.0 -56.9
# Ground ambient level: 14.6

void light solar
0
0
3 6.72e+06 6.72e+06 6.72e+06

solar source sun
0
0
4 0.612531 -0.399135 0.682273 0.5

void brightfunc skyfunc
2 skybr skybright.cal
0
7 1 9.05e+00 2.04e+01 5.41e-01 0.612531 -0.399135 0.682273

##The 1 will be multiplie with brightfunc
skyfunc glow sky_glow
0
0
4 1 1 1 0

##Set to 1 as it will be multiplied with the gensky result
sky_glow source sky
0
0
4 0 0 1 180

##Set to 1 as it will be multiplied with the gensky result
skyfunc glow ground_glow
0
0
4 1 1 1 0

##The ground pane
ground_glow source ground
0
0
4 0 0 -1 180" > ~/MantaRay/TestingRemote/skies/sunny_sky_12.rad
_JOIN_
echo "~/MantaRay/TestingRemote/skies/sunny_sky_12.rad"
""", """mkdir -p ~/MantaRay/TestingRemote/skies/
_JOIN_
echo "##Will control the gradient of the sky
# gensky 7 4 8:00CEST +s -a 59.9 -o 10.7
# Local solar time: 5.22
# Solar altitude and azimuth: 14.1 -111.6
# Ground ambient level: 8.8

void light solar
0
0
3 3.92e+06 3.92e+06 3.92e+06

solar source sun
0
0
4 0.901641 0.357186 0.243849 0.5

void brightfunc skyfunc
2 skybr skybright.cal
0
7 1 3.81e+00 5.41e+00 3.08e-01 0.901641 0.357186 0.243849

##The 1 will be multiplie with brightfunc
skyfunc glow sky_glow
0
0
4 1 1 1 0

##Set to 1 as it will be multiplied with the gensky result
sky_glow source sky
0
0
4 0 0 1 180

##Set to 1 as it will be multiplied with the gensky result
skyfunc glow ground_glow
0
0
4 1 1 1 0

##The ground pane
ground_glow source ground
0
0
4 0 0 -1 180" > ~/MantaRay/TestingRemote/skies/sunny_sky_8.rad
_JOIN_
echo "~/MantaRay/TestingRemote/skies/sunny_sky_8.rad"
""", """mkdir -p ~/MantaRay/TestingRemote/skies/
_JOIN_
echo "##Will control the gradient of the sky
# gensky 7 4 16:00CEST +s -a 59.9 -o 10.7
# Local solar time: 13.22
# Solar altitude and azimuth: 50.9 27.3
# Ground ambient level: 15.1

void light solar
0
0
3 6.91e+06 6.91e+06 6.91e+06

solar source sun
0
0
4 -0.289110 -0.560683 0.775919 0.5

void brightfunc skyfunc
2 skybr skybright.cal
0
7 1 1.13e+01 2.35e+01 6.77e-01 -0.289110 -0.560683 0.775919

##The 1 will be multiplie with brightfunc
skyfunc glow sky_glow
0
0
4 1 1 1 0

##Set to 1 as it will be multiplied with the gensky result
sky_glow source sky
0
0
4 0 0 1 180

##Set to 1 as it will be multiplied with the gensky result
skyfunc glow ground_glow
0
0
4 1 1 1 0

##The ground pane
ground_glow source ground
0
0
4 0 0 -1 180" > ~/MantaRay/TestingRemote/skies/sunny_sky_16.rad
_JOIN_
echo "~/MantaRay/TestingRemote/skies/sunny_sky_16.rad"
"""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])  # -> Stdout, Stderr_, Ran

item_3 = ListItem(List=executessh_27.Stdout, Index=0, Wrap=True)  # -> Item1, Item

overrides_26 = ApplyOverrides(Input="head <target>", Target=graft(item_3.Item1))  # -> Output, DynamicOutput
executessh_28 = ExecuteSSH(
    _SSHCommands_=overrides_26.DynamicOutput,
    Run=executessh_27.Ran,
    addPrefix=True,
    description="""head ~/MantaRay/TestingRemote/skies/sunny_sky_8.rad


- - -

head ~/MantaRay/TestingRemote/skies/sunny_sky_9.rad


- - -

head ~/MantaRay/TestingRemote/skies/sunny_sky_10.rad


- - -

head ~/MantaRay/TestingRemote/skies/sunny_sky_11.rad


- - -

head ~/MantaRay/TestingRemote/skies/sunny_sky_12.rad


- - -

head ~/MantaRay/TestingRemote/skies/sunny_sky_13.rad


- - -

head ~/MantaRay/TestingRemote/skies/sunny_sky_14.rad


- - -

head ~/MantaRay/TestingRemote/skies/sunny_sky_15.rad


- - -

head ~/MantaRay/TestingRemote/skies/sunny_sky_16.rad


- - -

head ~/MantaRay/TestingRemote/skies/sunny_sky_17.rad""",
    fireLogs=False,
    lastRunTime=40,
    suppressWarnings=False,
    results=["""##Will control the gradient of the sky
# gensky 7 4 8:00CEST +s -a 59.9 -o 10.7
# Local solar time: 5.22
# Solar altitude and azimuth: 14.1 -111.6
# Ground ambient level: 8.8

void light solar
0
0
3 3.92e+06 3.92e+06 3.92e+06""", """##Will control the gradient of the sky
# gensky 7 4 9:00CEST +s -a 59.9 -o 10.7
# Local solar time: 6.22
# Solar altitude and azimuth: 21.4 -99.3
# Ground ambient level: 10.8

void light solar
0
0
3 5.36e+06 5.36e+06 5.36e+06""", """##Will control the gradient of the sky
# gensky 7 4 10:00CEST +s -a 59.9 -o 10.7
# Local solar time: 7.22
# Solar altitude and azimuth: 28.8 -86.4
# Ground ambient level: 12.6

void light solar
0
0
3 6.07e+06 6.07e+06 6.07e+06""", """##Will control the gradient of the sky
# gensky 7 4 11:00CEST +s -a 59.9 -o 10.7
# Local solar time: 8.22
# Solar altitude and azimuth: 36.2 -72.6
# Ground ambient level: 13.8

void light solar
0
0
3 6.48e+06 6.48e+06 6.48e+06""", """##Will control the gradient of the sky
# gensky 7 4 12:00CEST +s -a 59.9 -o 10.7
# Local solar time: 9.22
# Solar altitude and azimuth: 43.0 -56.9
# Ground ambient level: 14.6

void light solar
0
0
3 6.72e+06 6.72e+06 6.72e+06""", """##Will control the gradient of the sky
# gensky 7 4 13:00CEST +s -a 59.9 -o 10.7
# Local solar time: 10.22
# Solar altitude and azimuth: 48.6 -38.7
# Ground ambient level: 15.0

void light solar
0
0
3 6.86e+06 6.86e+06 6.86e+06""", """##Will control the gradient of the sky
# gensky 7 4 14:00CEST +s -a 59.9 -o 10.7
# Local solar time: 11.22
# Solar altitude and azimuth: 52.2 -17.7
# Ground ambient level: 15.1

void light solar
0
0
3 6.93e+06 6.93e+06 6.93e+06""", """##Will control the gradient of the sky
# gensky 7 4 15:00CEST +s -a 59.9 -o 10.7
# Local solar time: 12.22
# Solar altitude and azimuth: 53.0 5.1
# Ground ambient level: 15.2

void light solar
0
0
3 6.94e+06 6.94e+06 6.94e+06""", """##Will control the gradient of the sky
# gensky 7 4 16:00CEST +s -a 59.9 -o 10.7
# Local solar time: 13.22
# Solar altitude and azimuth: 50.9 27.3
# Ground ambient level: 15.1

void light solar
0
0
3 6.91e+06 6.91e+06 6.91e+06""", """##Will control the gradient of the sky
# gensky 7 4 17:00CEST +s -a 59.9 -o 10.7
# Local solar time: 14.22
# Solar altitude and azimuth: 46.3 47.1
# Ground ambient level: 14.8

void light solar
0
0
3 6.81e+06 6.81e+06 6.81e+06"""],
    commands=["head ~/MantaRay/TestingRemote/skies/sunny_sky_8.rad", "head ~/MantaRay/TestingRemote/skies/sunny_sky_9.rad", "head ~/MantaRay/TestingRemote/skies/sunny_sky_11.rad", "head ~/MantaRay/TestingRemote/skies/sunny_sky_10.rad", "head ~/MantaRay/TestingRemote/skies/sunny_sky_12.rad", "head ~/MantaRay/TestingRemote/skies/sunny_sky_13.rad", "head ~/MantaRay/TestingRemote/skies/sunny_sky_15.rad", "head ~/MantaRay/TestingRemote/skies/sunny_sky_14.rad", "head ~/MantaRay/TestingRemote/skies/sunny_sky_17.rad"])  # -> Stdout, Stderr_, Ran

panel_79 = Panel(executessh_28.Stdout)

panel_80 = Panel("""mkdir -p <proj>/views/
echo "<vf>" > <proj>/views/<target>.vf
echo <proj>/views/<target>.vf""")
concat_4 = Concatenate(FragmentA="Perspective", FragmentB="1")

# ----
# Doubleclick Me To update view
view_2 = CreateView(Viewport="Perspective")  # -> ViewfileContent, ImageRatio

panel_81 = Panel(view_2.ViewfileContent)
vf_2 = Text(view_2.ViewfileContent)
overrides_27 = ApplyOverrides(Input=panel_80, Vf=graft(vf_2), Target=graft(concat_4))  # -> Output, DynamicOutput
executessh_29 = ExecuteSSH(
    _SSHCommands_=overrides_27.DynamicOutput,
    Run=Toggle(True),
    addPrefix=True,
    description="""mkdir -p ~/MantaRay/Andrei/views/
echo "rvu -vtv -vp 76.210958985352 16.4300937305602 1.83584927923156 -vd -0.349680913647465 0.927360836447747 0.133135786524922 -vu 0.0469732080515546 -0.124573895254805 0.991097806649975 -vh 103.466 -vv 50.000" > ~/MantaRay/Andrei/views/Perspective1.vf
echo ~/MantaRay/Andrei/views/Perspective1.vf""",
    fireLogs=False,
    lastRunTime=59.6468,
    suppressWarnings=False,
    results="/home/lio/MantaRay/Andrei/views/Perspective1.vf",
    commands="""mkdir -p ~/MantaRay/Andrei/views/
echo "rvu -vtv -vp 76.210958985352 16.4300937305602 1.83584927923156 -vd -0.349680913647465 0.927360836447747 0.133135786524922 -vu 0.0469732080515546 -0.124573895254805 0.991097806649975 -vh 103.466 -vv 50.000" > ~/MantaRay/Andrei/views/Perspective1.vf
echo ~/MantaRay/Andrei/views/Perspective1.vf""")  # -> Stdout, Stderr_, Ran

# ----
# VIEW
file_exists = Panel("[ -f <out> ] && echo \"1\" || echo \"0\"")
item_4 = ListItem(List=flatten(executessh_29.Stdout), Index=0, Wrap=True)
panel_82 = Panel(executessh_29.Stdout)
overrides_28 = ApplyOverrides(Input=file_exists, Out=graft(item_4))  # -> Output, DynamicOutput
executessh_30 = ExecuteSSH(
    _SSHCommands_=overrides_28.DynamicOutput,
    Run=executessh_15.Ran,
    addPrefix=True,
    description="[ -f /home/lio/MantaRay/Andrei/views/Perspective1.vf ] && echo \"1\" || echo \"0\"",
    fireLogs=False,
    lastRunTime=53.4918,
    suppressWarnings=False,
    results="1",
    commands="[ -f /home/lio/MantaRay/Andrei/views/Perspective1.vf ] && echo \"1\" || echo \"0\"")  # -> Stdout, Stderr_, Ran

# ----
# Parallel ACCELERAD RTRACE render
# echo "rvu -vtv -vp 0.5 4.5 1.6 -vd 0.830824 -1.13002 -0.181063 -vu 0 0 1 -vh 98.2132 -vv 79.2785 -vo 0 -va 0 -vs 0 -vl 0" > <proj>/views/myview.vf;echo <proj>/views/myview.vf
run_2 = LBFalseStartToggle(False)
octree = Text(executessh_15.Stdout)
viewfile = Text(executessh_29.Stdout)
panel_83 = Panel("""mkdir -p <proj>/images/
vwrays -ff -x <x> -y <y> -vf <vf> -pa 1 | accelerad_rtrace <radOptions> -w `vwrays -d -ff -x <x> -y <y> -vf <vf> -pa 1` -ffc <oct> > <proj>/images/<target-.>.hdr
echo <proj>/images/<target-.>.hdr""")
overrides_29 = ApplyOverrides(
    Input=panel_83,
    X=graft("600"),
    Y=graft("300"),
    Vf=graft(viewfile),
    RadOptions=graft("-as 0 -ab 3 -aa 0.2 -ad 128"),
    Oct=graft(octree),
    Target=graft("accelerad_rtrace_rendering.png"),
    Af=graft("ambfile2_<time>.af"))  # -> Output, DynamicOutput
executessh_31 = ExecuteSSH(
    _SSHCommands_=overrides_29.DynamicOutput,
    Run=run_2,
    addPrefix=True,
    description="""mkdir -p ~/MantaRay/Andrei/images/
vwrays -ff -x 600 -y 300 -vf /home/lio/MantaRay/Andrei/views/Perspective1.vf -pa 1 | accelerad_rtrace -as 0 -ab 3 -aa 0.2 -ad 128 -w `vwrays -d -ff -x 600 -y 300 -vf /home/lio/MantaRay/Andrei/views/Perspective1.vf -pa 1` -ffc /home/lio/MantaRay/Andrei/octrees/Scene_Overcast10klux.oct > ~/MantaRay/Andrei/images/accelerad_rtrace_rendering.hdr
echo ~/MantaRay/Andrei/images/accelerad_rtrace_rendering.hdr""",
    fireLogs=False,
    lastRunTime=535,
    suppressWarnings=False,
    results="/home/mss/simulation/Boston_Skylights/images/accelerad_rtrace_rendering.hdr",
    stderr="""accelerad_rtrace: internal - A supported NVIDIA GPU could not be found
(/media/nathaniel/DATA/Accelerad/src/rt/optix_radiance.c:255)""",
    commands="""mkdir -p ~/simulation/Boston_Skylights/images/
vwrays -ff -x 600 -y 300 -vf /home/mss/MantaRay/UnnamedProject/views/Perspective1.vf -pa 1 | accelerad_rtrace -as 0 -ab 3 -aa 0.2 -ad 128 -w `vwrays -d -ff -x 600 -y 300 -vf /home/mss/MantaRay/UnnamedProject/views/Perspective1.vf -pa 1` -ffc /home/mss/MantaRay/UnnamedProject/octrees/my_test_scene.oct > ~/simulation/Boston_Skylights/images/accelerad_rtrace_rendering.hdr
echo ~/simulation/Boston_Skylights/images/accelerad_rtrace_rendering.hdr""")  # -> Stdout, Stderr_, Ran

# ----
# Parallel RTPICT render (luminance)
viewfile_2 = Text(executessh_29.Stdout)
octree_2 = Text(octree_overcast)
panel_84 = Panel("""mkdir -p <proj>/images/
rm -r <proj>/images/<target>
rtpict -n 11 -w -ov <proj>/images/<target> -vf <vf> -x <x> -y <y> <radOptions> <oct>;echo <proj>/images/<target>""")
resolution_3 = ValueList({"750x330": 750, "1500x750": 1500, "3000x1500": 3000, "5000x2500": 5000, "7000x3500": 7000, "8000x4000": 8000}, selected="5000x2500")
panel_85 = Panel("<time>_rtpict_rendering_aa0_<x>_sunny_ad32_<h>")
division_2 = Division(A=resolution_3, B=2)
run_3 = LBFalseStartToggle(False)
python_11 = GhPythonScript(update=run_3)  # -> time; inputs update: tree
# ---------- python_11: Python ----------
__author__ = "mm1013"
__version__ = "2022.08.30"

import rhinoscriptsyntax as rs

from datetime import datetime
dt = datetime.now()

time = "%02d_%02d_%02d_%02d%02d" % (dt.year, dt.month, dt.day, dt.hour, dt.minute)
# ---------- end python_11 ----------
hours_3 = Number("0")

multiplication = Multiplication(A=division_2, B=4)
multiplication_2 = Multiplication(A=resolution_3, B=4)

# ----
# Using PCOND to set automatic exposure
# and convert to PNG
panel_86 = Panel("""pcond -h <hdr> <hdr-.>_exposed.hdr
ra_tiff <hdr-.>_exposed.hdr <hdr-.>_exposed.tif
convert <hdr-.>_exposed.tif <hdr-.>_exposed.png
echo <hdr-.>_exposed.png""")
overrides_30 = ApplyOverrides(Input=panel_86, Hdr=graft(executessh_31.Stdout))  # -> Output, DynamicOutput
executessh_32 = ExecuteSSH(
    _SSHCommands_=overrides_30.DynamicOutput,
    Run=executessh_31.Ran,
    addPrefix=True,
    description="""pcond -h /home/mss/simulation/Boston_Skylights/images/accelerad_rtrace_rendering.hdr /home/mss/simulation/Boston_Skylights/images/accelerad_rtrace_rendering_exposed.hdr
ra_tiff /home/mss/simulation/Boston_Skylights/images/accelerad_rtrace_rendering_exposed.hdr /home/mss/simulation/Boston_Skylights/images/accelerad_rtrace_rendering_exposed.tif
convert /home/mss/simulation/Boston_Skylights/images/accelerad_rtrace_rendering_exposed.tif /home/mss/simulation/Boston_Skylights/images/accelerad_rtrace_rendering_exposed.png
echo /home/mss/simulation/Boston_Skylights/images/accelerad_rtrace_rendering_exposed.png""",
    fireLogs=False,
    lastRunTime=546,
    suppressWarnings=False,
    results="/home/mss/MantaRay/UnnamedProject/images/rtrace_rendering_exposed.png",
    commands="""pcond -h /home/mss/MantaRay/UnnamedProject/images/rtrace_rendering.hdr /home/mss/MantaRay/UnnamedProject/images/rtrace_rendering_exposed.hdr
ra_tiff /home/mss/MantaRay/UnnamedProject/images/rtrace_rendering_exposed.hdr /home/mss/MantaRay/UnnamedProject/images/rtrace_rendering_exposed.tif
convert /home/mss/MantaRay/UnnamedProject/images/rtrace_rendering_exposed.tif /home/mss/MantaRay/UnnamedProject/images/rtrace_rendering_exposed.png
echo /home/mss/MantaRay/UnnamedProject/images/rtrace_rendering_exposed.png""")  # -> Stdout, Stderr_, Ran
download_4 = Download(
    LinuxFilePaths=executessh_32.Stdout,
    Run=executessh_32.Ran,
    stdouts="C:\Users\mm1013\MantaRay\UnnamedProject\rtrace_rendering_exposed.png")  # -> FilePaths, Status, Ran
imageviewer_2 = LBImageViewer(ImagePath_=download_4.FilePaths, _scale_="1.5", DisableClickable=False, SaveImgWithCoords=False, scale=1.5)  # -> ImagePath, Values, GIF

panel_87 = Panel(executessh_31.Stderr_)
overrides_31 = ApplyOverrides(
    Input=panel_51,
    Vf=graft(viewfile_2),
    X=graft(multiplication_2),
    Y=graft(multiplication),
    Target=graft(panel_85),
    RadOptions=graft("-ab 0 -ad 1 -aa 1 -w -av 1 1 1"),
    Oct=graft(octree_2),
    Time=graft(python_11),
    H=graft(hours_3))  # -> Output, DynamicOutput
overrides_32 = ApplyOverrides(Input="<proj>/images/<target>", X=graft(resolution_3), Target=graft(panel_85), Time=graft(python_11), H=graft(hours_3))  # -> Output, DynamicOutput
panel_88 = Panel(overrides_31.DynamicOutput)
overrides_33 = ApplyOverrides(
    Input=panel_84,
    Vf=graft(viewfile_2),
    X=graft(resolution_3),
    Y=graft(division_2),
    Target=graft(panel_85),
    RadOptions=graft("-ab 3 -ad 16 -aa 0"),
    Oct=graft(octree_2),
    Time=graft(python_11),
    H=graft(hours_3))  # -> Output, DynamicOutput
overrides_34 = ApplyOverrides(Input="ls <target>", Target=graft(overrides_32.Output))  # -> Output, DynamicOutput
executessh_33 = ExecuteSSH(
    _SSHCommands=overrides_31.DynamicOutput,
    Run=run_3,
    addPrefix=True,
    description="""rpict -vf /home/lio/MantaRay/Andrei/views/Perspective1.vf -x 20000 -y 10000 -ab 0 -ad 1 -aa 1 -w -av 1 1 1 /home/lio/MantaRay/Andrei/octrees/Scene_Overcast10klux.oct |
pfilt -x /4 -y /4 -1 -r 0.7 > ~/MantaRay/Andrei/images/2023_03_11_1204_rtpict_rendering_aa0_20000_sunny_ad32_0_colors_filt.hdr
echo ~/MantaRay/Andrei/images/2023_03_11_1204_rtpict_rendering_aa0_20000_sunny_ad32_0_colors_filt.hdr""",
    fireLogs=True,
    lastRunTime=80956,
    name="rpict for colors",
    suppressWarnings=True,
    results="/home/lio/simulation/Boston_Skylights/images/2023_01_09_1607_rtpict_rendering_aa0_20000_sunny_ad32_0_colors_filt.hdr",
    commands="""rpict -vf /home/lio/MantaRay/TestingRemote/views/Perspective1.vf -x 20000 -y 10000 -ab 0 -ad 1 -aa 1 -w -av 1 1 1 /home/lio/simulation/Boston_Skylights/octrees/my_test_scene.oct |
pfilt -x /4 -y /4 -1 -r 0.7 > ~/simulation/Boston_Skylights/images/2023_01_09_1607_rtpict_rendering_aa0_20000_sunny_ad32_0_colors_filt.hdr
echo ~/simulation/Boston_Skylights/images/2023_01_09_1607_rtpict_rendering_aa0_20000_sunny_ad32_0_colors_filt.hdr""")  # -> Stdout, Stderr, Ran
panel_89 = Panel(overrides_33.Output)
executessh_34 = ExecuteSSH(
    _SSHCommands=overrides_33.DynamicOutput,
    Run=run_3,
    addPrefix=True,
    description="""mkdir -p ~/MantaRay/Andrei/images/
rm -r ~/MantaRay/Andrei/images/2023_03_11_1204_rtpict_rendering_aa0_5000_sunny_ad32_0
rtpict -n 11 -w -ov ~/MantaRay/Andrei/images/2023_03_11_1204_rtpict_rendering_aa0_5000_sunny_ad32_0 -vf /home/lio/MantaRay/Andrei/views/Perspective1.vf -x 5000 -y 2500 -ab 3 -ad 16 -aa 0 /home/lio/MantaRay/Andrei/octrees/Scene_Overcast10klux.oct;echo ~/MantaRay/Andrei/images/2023_03_11_1204_rtpict_rendering_aa0_5000_sunny_ad32_0""",
    fireLogs=True,
    lastRunTime=219626,
    name="rtpict luminance",
    suppressWarnings=True,
    results="/home/lio/simulation/Boston_Skylights/images/2023_01_09_1607_rtpict_rendering_aa0_5000_sunny_ad32_0",
    commands="""mkdir -p ~/simulation/Boston_Skylights/images/
rm -r ~/simulation/Boston_Skylights/images/2023_01_09_1607_rtpict_rendering_aa0_5000_sunny_ad32_0
rtpict -n 11 -w -ov ~/simulation/Boston_Skylights/images/2023_01_09_1607_rtpict_rendering_aa0_5000_sunny_ad32_0 -vf /home/lio/MantaRay/TestingRemote/views/Perspective1.vf -x 5000 -y 2500 -ab 3 -ad 16 -aa 0 /home/lio/simulation/Boston_Skylights/octrees/my_test_scene.oct;echo ~/simulation/Boston_Skylights/images/2023_01_09_1607_rtpict_rendering_aa0_5000_sunny_ad32_0""")  # -> Stdout, Stderr, Ran
executessh_35 = ExecuteSSH(
    _SSHCommands_=overrides_34.DynamicOutput,
    Run=executessh_34.Ran,
    addPrefix=True,
    description="ls ~/MantaRay/Andrei/images/2023_03_11_1204_rtpict_rendering_aa0_5000_sunny_ad32_0",
    fireLogs=False,
    lastRunTime=14,
    suppressWarnings=False,
    results="radiance.hdr",
    commands="ls ~/simulation/Boston_Skylights/images/2023_01_09_1607_rtpict_rendering_aa0_5000_sunny_ad32_0")  # -> Stdout, Stderr_, Ran
panel_91 = Panel(executessh_34.Stdout)
concat_5 = Concatenate(FragmentA=overrides_32.Output, FragmentB="radiance.hdr", JoinSeparator="/")
download_5 = Download(
    SftpPaths=flatten(executessh_33.Stdout),
    Run=executessh_33.Ran,
    stdouts="C:\Users\mm1013\MantaRay\TestingRemote\2023_01_09_1607_rtpict_rendering_aa0_20000_sunny_ad32_0_colors_filt.hdr")  # -> FilePaths, Status, Ran
panel_93 = Panel(executessh_34.Stderr)
split = TextSplit(Text=executessh_35.Stdout)
concat_6 = Concatenate(FragmentA=overrides_32.Output, FragmentB=split, JoinSeparator="/")
imageviewer_3 = LBImageViewer(ImagePath_=download_5.FilePaths, _scale_=1, DisableClickable=False, SaveImgWithCoords=False, scale=1)  # -> ImagePath, Values, GIF
overrides_35 = ApplyOverrides(Input=panel_55, File=graft(concat_6))  # -> Output, DynamicOutput
panel_94 = Panel(concat_6)
executessh_36 = ExecuteSSH(
    _SSHCommands_=overrides_35.DynamicOutput,
    Run=executessh_34.Ran,
    addPrefix=True,
    description="pfilt -x /2 -y /2 -1 -r 0.7 ~/MantaRay/Andrei/images/2023_03_11_1204_rtpict_rendering_aa0_5000_sunny_ad32_0/radiance.hdr > ~/MantaRay/Andrei/images/2023_03_11_1204_rtpict_rendering_aa0_5000_sunny_ad32_0/radiance_filtered.hdr;echo ~/MantaRay/Andrei/images/2023_03_11_1204_rtpict_rendering_aa0_5000_sunny_ad32_0/radiance_filtered.hdr",
    fireLogs=False,
    lastRunTime=1592,
    suppressWarnings=False,
    results="/home/lio/simulation/Boston_Skylights/images/2023_01_09_1607_rtpict_rendering_aa0_5000_sunny_ad32_0/radiance_filtered.hdr",
    commands="pfilt -x /2 -y /2 -1 -r 0.7 ~/simulation/Boston_Skylights/images/2023_01_09_1607_rtpict_rendering_aa0_5000_sunny_ad32_0/radiance.hdr > ~/simulation/Boston_Skylights/images/2023_01_09_1607_rtpict_rendering_aa0_5000_sunny_ad32_0/radiance_filtered.hdr;echo ~/simulation/Boston_Skylights/images/2023_01_09_1607_rtpict_rendering_aa0_5000_sunny_ad32_0/radiance_filtered.hdr")  # -> Stdout, Stderr_, Ran
panel_96 = Panel(executessh_36.Stdout)
overrides_36 = ApplyOverrides(Input=panel_56, HdrFiles=graft(concat_5), Target=graft("render_original.png"))  # -> Output, DynamicOutput
panel_97 = Panel(overrides_36.Output)
executessh_37 = ExecuteSSH(
    _SSHCommands_=overrides_36.DynamicOutput,
    Run=executessh_36.Ran,
    addPrefix=True,
    description="""ra_tiff ~/MantaRay/Andrei/images/2023_03_11_1204_rtpict_rendering_aa0_5000_sunny_ad32_0/radiance.hdr ~/MantaRay/Andrei/images/render_original.tif
convert ~/MantaRay/Andrei/images/render_original.tif ~/MantaRay/Andrei/images/render_original.png
echo ~/MantaRay/Andrei/images/render_original.png""",
    fireLogs=False,
    lastRunTime=4214,
    suppressWarnings=False,
    results="/home/lio/simulation/Boston_Skylights/images/render_original.png",
    commands="""ra_tiff ~/simulation/Boston_Skylights/images/2023_01_09_1607_rtpict_rendering_aa0_5000_sunny_ad32_0/radiance.hdr ~/simulation/Boston_Skylights/images/render_original.tif
convert ~/simulation/Boston_Skylights/images/render_original.tif ~/simulation/Boston_Skylights/images/render_original.png
echo ~/simulation/Boston_Skylights/images/render_original.png""")  # -> Stdout, Stderr_, Ran
download_6 = Download(
    SftpPaths=flatten(executessh_37.Stdout),
    Run=executessh_36.Ran,
    stdouts="C:\Users\mm1013\MantaRay\TestingRemote\render_original.png")  # -> FilePaths, Status, Ran
item_5 = ListItem(List=download_6.FilePaths, Index=0, Wrap=True)
multiplication_3 = Multiplication(A=division_2, B=4)
multiplication_4 = Multiplication(A=resolution_3, B=4)
overrides_37 = ApplyOverrides(
    Input=panel_59,
    Vf=graft(viewfile_2),
    X=graft(multiplication_4),
    Y=graft(multiplication_3),
    Target=graft(panel_85),
    RadOptions=graft("-ab 0 -ad 1 -aa 1 -w -av 1 1 1"),
    Oct=graft(executessh_24.Stdout),
    Time=graft(python_11),
    H=graft(hours_3))  # -> Output, DynamicOutput
panel_98 = Panel(overrides_37.DynamicOutput)
executessh_38 = ExecuteSSH(
    _SSHCommands=overrides_37.DynamicOutput,
    Run=run_3,
    addPrefix=True,
    description="""rpict -vf /home/lio/MantaRay/Andrei/views/Perspective1.vf -x 20000 -y 10000 -ab 0 -ad 1 -aa 1 -w -av 1 1 1 /home/lio/simulation/Boston_Skylights/octrees/myNormalsScene.oct |
pfilt -x /4 -y /4 -1 -r 0.7 > ~/MantaRay/Andrei/images/2023_03_11_1204_rtpict_rendering_aa0_20000_sunny_ad32_0_normals_filt.hdr
echo ~/MantaRay/Andrei/images/2023_03_11_1204_rtpict_rendering_aa0_20000_sunny_ad32_0_normals_filt.hdr""",
    fireLogs=False,
    lastRunTime=32065,
    suppressWarnings=True,
    results="/home/lio/simulation/Boston_Skylights/images/2023_01_09_1607_rtpict_rendering_aa0_20000_sunny_ad32_0_normals_filt.hdr",
    commands="""rpict -vf /home/lio/MantaRay/TestingRemote/views/Perspective1.vf -x 20000 -y 10000 -ab 0 -ad 1 -aa 1 -w -av 1 1 1 /home/lio/simulation/Boston_Skylights/octrees/myNormalsScene.oct |
pfilt -x /4 -y /4 -1 -r 0.7 > ~/simulation/Boston_Skylights/images/2023_01_09_1607_rtpict_rendering_aa0_20000_sunny_ad32_0_normals_filt.hdr
echo ~/simulation/Boston_Skylights/images/2023_01_09_1607_rtpict_rendering_aa0_20000_sunny_ad32_0_normals_filt.hdr""")  # -> Stdout, Stderr, Ran
download_7 = Download(
    SftpPaths=flatten(executessh_38.Stdout),
    Run=executessh_38.Ran,
    stdouts="C:\Users\mm1013\MantaRay\TestingRemote\2023_01_09_1607_rtpict_rendering_aa0_20000_sunny_ad32_0_normals_filt.hdr")  # -> FilePaths, Status, Ran
denoiser = DenoiseImage(
    InputImage=item_5,
    PathToDenoisr="C:\Denoiser_v1.6\Denoiser.exe",
    AlbedoImage=download_5.FilePaths,
    NormalsImage=download_7.FilePaths)  # disabled
imageviewer_4 = LBImageViewer(ImagePath_=download_7.FilePaths, _scale_=1, DisableClickable=False, SaveImgWithCoords=False, scale=1)  # -> ImagePath, Values, GIF

# ----
# OCTREE (Sunny - 10 hourly skies!)
scene_rads_3 = Text(entwine_3)
falsestart_15 = LBFalseStartToggle(False)
python_12 = GhPythonScript(x=flatten(scene_rads_3))  # -> a; inputs x: list; same code as python_4
entwine_8 = Entwine(Branch02=scene_rads_3, FlattenInputs=True)  # -> flatten(Radfiles)
panel_99 = Panel("""mkdir -p <proj>/octrees/
oconv -r 2048 -f -w <rads> > <proj>/octrees/<target>
echo <proj>/octrees/<target>""")
join_5 = TextJoin(Text=entwine_8, Join=" ")
panel_100 = Panel("oconv -r 2048 -i <oldOct> -f <newRads> > <proj>/octrees/<target>_<h>.oct;echo <proj>/octrees/<target>_<h>.oct")
sky_sunny = Text(graft(item_3.Item1))
hours_4 = Text(hours_2)

overrides_38 = ApplyOverrides(Input=panel_99, Rads=graft(join_5), Target=graft("my_test_scene_NOSKY.oct"))  # -> Output, DynamicOutput
executessh_39 = ExecuteSSH(
    _SSHCommands_=overrides_38.DynamicOutput,
    Run=[python_12, falsestart_15],
    addPrefix=True,
    description="""mkdir -p ~/MantaRay/Andrei/octrees/
oconv -r 2048 -f -w ~/MantaRay/Andrei/radFiles/Glass_70.mat /home/lio/MantaRay/Andrei/radFiles/Glass_70_geo.rad ~/MantaRay/Andrei/radFiles/opaque_materials.mat /home/lio/MantaRay/Andrei/radFiles/FloorMat_0.7_geo.rad /home/lio/MantaRay/Andrei/radFiles/Cladding_0.5_geo.rad /home/lio/MantaRay/Andrei/radFiles/ConcreteWhite_0.8_geo.rad /home/lio/MantaRay/Andrei/radFiles/ConcreteStructure_0.3_geo.rad /home/lio/MantaRay/Andrei/radFiles/ConcreteGrey_0.5_geo.rad /home/lio/MantaRay/Andrei/radFiles/IntWalls_0.9_geo.rad /home/lio/MantaRay/Andrei/radFiles/Pipes_0.03_geo.rad /home/lio/MantaRay/Andrei/radFiles/ConcreteDarker_0.1_geo.rad /home/lio/MantaRay/Andrei/radFiles/Frames_0.6_geo.rad /home/lio/MantaRay/Andrei/radFiles/Black_0.01_geo.rad /home/lio/MantaRay/Andrei/radFiles/CurvedCeiling_0.8_geo.rad /home/lio/MantaRay/Andrei/radFiles/IntWalls_0.8_geo.rad /home/lio/MantaRay/Andrei/radFiles/FloorBox_0.75_geo.rad > ~/MantaRay/Andrei/octrees/my_test_scene_NOSKY.oct
echo ~/MantaRay/Andrei/octrees/my_test_scene_NOSKY.oct""",
    fireLogs=False,
    lastRunTime=0,
    suppressWarnings=False,
    commands="""mkdir -p ~/MantaRay/UnnamedProject/octrees/
oconv -r 2048 -f -w ~/MantaRay/UnnamedProject/radFiles/Glass_70_mat.mat ~/MantaRay/UnnamedProject/radFiles/Glass_70.rad ~/MantaRay/UnnamedProject/radFiles/opaque_materials.mat ~/MantaRay/UnnamedProject/radFiles/CurvedCeiling_0.80.rad ~/MantaRay/UnnamedProject/radFiles/ConcreteGrey_0.5.rad ~/MantaRay/UnnamedProject/radFiles/ConcreteDarker_0.1.rad ~/MantaRay/UnnamedProject/radFiles/Cladding_0.5.rad ~/MantaRay/UnnamedProject/radFiles/ConcreteStructure_0.3.rad ~/MantaRay/UnnamedProject/radFiles/Black_0.01.rad ~/MantaRay/UnnamedProject/radFiles/Floor_FloorMat_0.7.rad ~/MantaRay/UnnamedProject/radFiles/ConcreteWhite_0.8.rad ~/MantaRay/UnnamedProject/radFiles/IntWalls_0.9.rad ~/MantaRay/UnnamedProject/radFiles/IntWalls_0.80.rad ~/MantaRay/UnnamedProject/radFiles/Pipes_0.03.rad ~/MantaRay/UnnamedProject/radFiles/FloorBox_0.75.rad ~/MantaRay/UnnamedProject/radFiles/Frames_0.6.rad > ~/MantaRay/UnnamedProject/octrees/my_test_scene_NOSKY.oct
echo ~/MantaRay/UnnamedProject/octrees/my_test_scene_NOSKY.oct""")  # -> Stdout, Stderr_, Ran
overrides_39 = ApplyOverrides(
    Input=panel_100,
    OldOct=graft(executessh_39.Stdout),
    NewRads=graft(sky_sunny),
    Target=graft("my_test_scene"),
    H=graft(hours_4))  # -> Output, DynamicOutput

panel_101 = Panel(executessh_39.Stdout)

executessh_40 = ExecuteSSH(
    _SSHCommands_=overrides_39.DynamicOutput,
    Run=executessh_39.Ran,
    addPrefix=True,
    description="""oconv -r 2048 -i  -f ~/MantaRay/TestingRemote/skies/sunny_sky_8.rad > ~/MantaRay/Andrei/octrees/my_test_scene_0800.oct;echo ~/MantaRay/Andrei/octrees/my_test_scene_0800.oct


- - -

oconv -r 2048 -i  -f ~/MantaRay/TestingRemote/skies/sunny_sky_9.rad > ~/MantaRay/Andrei/octrees/my_test_scene_0900.oct;echo ~/MantaRay/Andrei/octrees/my_test_scene_0900.oct


- - -

oconv -r 2048 -i  -f ~/MantaRay/TestingRemote/skies/sunny_sky_10.rad > ~/MantaRay/Andrei/octrees/my_test_scene_1000.oct;echo ~/MantaRay/Andrei/octrees/my_test_scene_1000.oct


- - -

oconv -r 2048 -i  -f ~/MantaRay/TestingRemote/skies/sunny_sky_11.rad > ~/MantaRay/Andrei/octrees/my_test_scene_1100.oct;echo ~/MantaRay/Andrei/octrees/my_test_scene_1100.oct


- - -

oconv -r 2048 -i  -f ~/MantaRay/TestingRemote/skies/sunny_sky_12.rad > ~/MantaRay/Andrei/octrees/my_test_scene_1200.oct;echo ~/MantaRay/Andrei/octrees/my_test_scene_1200.oct


- - -

oconv -r 2048 -i  -f ~/MantaRay/TestingRemote/skies/sunny_sky_13.rad > ~/MantaRay/Andrei/octrees/my_test_scene_1300.oct;echo ~/MantaRay/Andrei/octrees/my_test_scene_1300.oct


- - -

oconv -r 2048 -i  -f ~/MantaRay/TestingRemote/skies/sunny_sky_14.rad > ~/MantaRay/Andrei/octrees/my_test_scene_1400.oct;echo ~/MantaRay/Andrei/octrees/my_test_scene_1400.oct


- - -

oconv -r 2048 -i  -f ~/MantaRay/TestingRemote/skies/sunny_sky_15.rad > ~/MantaRay/Andrei/octrees/my_test_scene_1500.oct;echo ~/MantaRay/Andrei/octrees/my_test_scene_1500.oct


- - -

oconv -r 2048 -i  -f ~/MantaRay/TestingRemote/skies/sunny_sky_16.rad > ~/MantaRay/Andrei/octrees/my_test_scene_1600.oct;echo ~/MantaRay/Andrei/octrees/my_test_scene_1600.oct


- - -

oconv -r 2048 -i  -f ~/MantaRay/TestingRemote/skies/sunny_sky_17.rad > ~/MantaRay/Andrei/octrees/my_test_scene_1700.oct;echo ~/MantaRay/Andrei/octrees/my_test_scene_1700.oct""",
    fireLogs=False,
    lastRunTime=0,
    suppressWarnings=False)  # -> Stdout, Stderr_, Ran

# ----
# overture should now automatically be included in rtpict
# Parallel RTPICT render with ambient cache
viewfile_3 = Text(executessh_29.Stdout)
octree_3 = Text(executessh_40.Stdout)
modifierlist = Text(flatten(cluster.name_mod))
octree_overcast_2 = Text(octree_overcast)
entwine_9 = Entwine(Branch00=octree_overcast_2, Branch01=octree_3, FlattenInputs=True)  # -> flatten(Result)
division_3 = Division(A=resolution, B=1.5)
octree_4 = Text(graft(entwine_9))
list = ItemSelector(
    octree_4,
    {"/home/lio/MantaRay/Andrei/octrees/Scene_Overcast10klux.oct"}, selected="/home/lio/MantaRay/Andrei/octrees/Scene_Overcast10klux.oct")
y = Number(division_3)
eval = Evaluate(F="x=y", x=octree_4, y=list)
panel_102 = Panel("-ab 3 -ad 4096 -lw 0.0003 -aa 0.1 -ar 256 -as 1024")
panel_103 = Panel("""mkdir -p <proj>/images/
rtpict -n <cpus-1> -w -vf <vf> -x 400 -y 300 <radOptions> -af <ambFile> <oct> > /dev/null
rtpict -n <cpus-1> -w -vf <vf> -x <x> -y <y> <radOptions> -af <ambFile> <oct> | pfilt -x /2 -y /2 > <proj>/images/<target>;echo <proj>/images/<target>""")
x_3 = Number(x)
y_2 = Number(y)
run_4 = LBFalseStartToggle(False)
python_13 = GhPythonScript()  # -> time; inputs update: tree
# ---------- python_13: Python ----------
#if not update:
#    return self.time
"""Provides a scripting component.
    Inputs:
        x: The x script variable
        y: The y script variable
    Output:
        a: The a output variable"""
        
__author__ = "mm1013"
__version__ = "2022.08.30"
        
import rhinoscriptsyntax as rs
        
from datetime import datetime
dt = datetime.now()
        
time = "%02d_%02d_%02d_%02d%02d_%02d" % (dt.year, dt.month, dt.day, dt.hour, dt.minute, dt.second)
# ---------- end python_13 ----------

# ----
# exclude frames
panel_104 = Panel("frames")
python_14 = GhPythonScript(opaqueModifiers=modifierlist, search=panel_104)  # -> a; inputs opaqueModifiers: list, search: list
# ---------- python_14: Python ----------
__author__ = "mm1013"
__version__ = "2022.09.05"

import rhinoscriptsyntax as rs
#import Grasshopper.DataTree as dt
import ghpythonlib.treehelpers as th


o = []
for l in search:
    o.append([s for s in opaqueModifiers if l.lower() in s.lower()])
    

a = th.list_to_tree(o)
# ---------- end python_14 ----------
overrides_40 = ApplyOverrides(Input="-ae <modifier>", Modifier=graft(python_14))  # -> Output, DynamicOutput
join_6 = TextJoin(Text=flatten(overrides_40.Output), Join=" ")

hours_5 = Text(hours_2)
entwine_10 = Entwine(Branch00="ovc", Branch01=hours_5, FlattenInputs=True)  # -> flatten(Result)
cull_4 = CullPattern(List=graft(entwine_10), CullPattern=eval)  # -> flatten(List)
hours_6 = Text(cull_4)

# ----
# Parallel RTRACE render (illuminance)
# echo "rvu -vtv -vp 0.5 4.5 1.6 -vd 0.830824 -1.13002 -0.181063 -vu 0 0 1 -vh 98.2132 -vv 79.2785 -vo 0 -va 0 -vs 0 -vl 0" > <proj>/views/myview.vf;echo <proj>/views/myview.vf
run_5 = LBFalseStartToggle(False)
panel_105 = Panel("""mkdir -p <proj>/images/
vwrays -ff -x <x> -y <y> -vf <vf> -pa 1 | rtrace -i <radOptions> -af <af> -w -n 11 `vwrays -d -ff -x <x> -y <y> -vf <vf> -pa 1` -ffc <oct> > <proj>/images/<target-.>.hdr
echo <proj>/images/<target-.>.hdr""")
octree_5 = Text(executessh_15.Stdout)
viewfile_4 = Text(executessh_29.Stdout)
# -ab 2 -aa 0.2 -ad 512
panel_106 = Panel("<time>_<view>_render_illum.hdr")

python_15 = GhPythonScript(x=viewfile_4)  # -> a
# ---------- python_15: Python ----------
__author__ = "mm1013"
__version__ = "2022.09.13"

import rhinoscriptsyntax as rs

a = x.split("/")[-1].split(".")[0]
# ---------- end python_15 ----------

# ----
# Parallel RTRACE render
# echo "rvu -vtv -vp 0.5 4.5 1.6 -vd 0.830824 -1.13002 -0.181063 -vu 0 0 1 -vh 98.2132 -vv 79.2785 -vo 0 -va 0 -vs 0 -vl 0" > <proj>/views/myview.vf;echo <proj>/views/myview.vf
octree_6 = Text(executessh_15.Stdout)
viewfile_5 = Text(executessh_29.Stdout)
# mkdir -p <LinuxHome>/images/
# vwrays -ff -x <x> -y <y> -vf <vf> -pa 1
panel_107 = Panel("""mkdir -p <LinuxHome>/images/
mkdir -p <LinuxHome>/ambientFiles/
vwrays -ff -x <x> -y <y> -vf <vf> -pa 1 | rtrace <radOptions> -af <LinuxHome>/ambientFiles/<af> -w -n <cpus> `vwrays -d -ff -x <x> -y <y> -vf <vf> -pa 1` -ffc -e <LinuxHome>/ambientFiles/<target-.>.err <oct> > <LinuxHome>/images/<target-.>.hdr
echo <LinuxHome>/images/<target-.>.hdr""")
run_6 = LBFalseStartToggle(False)
panel_108 = Panel("-as 0 -ab 2 -aa 0.0 -ad 32")
overrides_41 = ApplyOverrides(
    Input=panel_107,
    X=graft("2500"),
    Y=graft("2000"),
    Vf=graft("<vf>"),
    RadOptions=graft(panel_108),
    Oct=graft(octree_6),
    Target=graft(panel_44),
    Af=graft("<af>"),
    Time=graft("<time>"),
    View=graft("<view>"))  # -> Output, DynamicOutput

python_16 = GhPythonScript(x=viewfile_5)  # -> a; same code as python_15
python_17 = GhPythonScript(update=overrides_41.Output)  # -> time; inputs update: tree; same code as python_13

overrides_42 = ApplyOverrides(
    Input=panel_105,
    X=graft("2500"),
    Y=graft("2000"),
    Vf=graft(viewfile_4),
    RadOptions=graft(panel_108),
    Oct=graft(octree_5),
    Target=graft(panel_106),
    Af=graft("ambfile2_<time>.af"),
    Time=graft(python_17),
    View=graft(python_15))  # -> Output, DynamicOutput
executessh_41 = ExecuteSSH(
    _SSHCommands_=overrides_42.DynamicOutput,
    Run=run_5,
    addPrefix=True,
    description="""mkdir -p ~/MantaRay/Andrei/images/
vwrays -ff -x 2500 -y 2000 -vf /home/lio/MantaRay/Andrei/views/Perspective1.vf -pa 1 | rtrace -i -as 0 -ab 2 -aa 0.0 -ad 32 -af ambfile2_2023_03_12_2113_00.af -w -n 11 `vwrays -d -ff -x 2500 -y 2000 -vf /home/lio/MantaRay/Andrei/views/Perspective1.vf -pa 1` -ffc /home/lio/MantaRay/Andrei/octrees/Scene_Overcast10klux.oct > ~/MantaRay/Andrei/images/2023_03_12_2113_00_Perspective1_render_illum.hdr
echo ~/MantaRay/Andrei/images/2023_03_12_2113_00_Perspective1_render_illum.hdr""",
    fireLogs=False,
    lastRunTime=86167,
    suppressWarnings=False,
    results="/home/lio/MantaRay/Andrei/images/2023_01_18_1002_49_Perspective1_render_illum.hdr",
    commands="""mkdir -p ~/MantaRay/Andrei/images/
vwrays -ff -x 2500 -y 2000 -vf /home/lio/MantaRay/Andrei/views/Perspective1.vf -pa 1 | rtrace -i -as 0 -ab 2 -aa 0.0 -ad 32 -af ambfile2_2023_01_18_1002_49.af -w -n 11 `vwrays -d -ff -x 2500 -y 2000 -vf /home/lio/MantaRay/Andrei/views/Perspective1.vf -pa 1` -ffc /home/lio/MantaRay/Andrei/octrees/my_test_scene.oct > ~/MantaRay/Andrei/images/2023_01_18_1002_49_Perspective1_render_illum.hdr
echo ~/MantaRay/Andrei/images/2023_01_18_1002_49_Perspective1_render_illum.hdr""")  # -> Stdout, Stderr_, Ran

panel_109 = Panel(overrides_41.Output)
overrides_43 = ApplyOverrides(
    Input=overrides_41.DynamicOutput,
    Time=graft(python_17),
    View=graft("Perspective"),
    Vf=graft(executessh_16.Stdout),
    Af=graft("ambfile2_<time>.af"))  # -> Output, DynamicOutput

executessh_42 = ExecuteSSH(
    _SSHCommands_=overrides_43.Output,
    Run=run_6,
    addPrefix=True,
    fireLogs=False,
    lastRunTime=130752,
    suppressWarnings=False,
    results="/home/lio/MantaRay/Andrei/images/2023_01_18_1002_49_Perspective_render.hdr",
    commands="""mkdir -p ~/MantaRay/Andrei/images/
mkdir -p ~/MantaRay/Andrei/ambientFiles/
vwrays -ff -x 2500 -y 2000 -vf /home/lio/MantaRay/Andrei/views/Perspective2.vf -pa 1 | rtrace -as 0 -ab 2 -aa 0.0 -ad 32 -af ~/MantaRay/Andrei/ambientFiles/ambfile2_2023_01_18_1002_49.af -w -n 63 `vwrays -d -ff -x 2500 -y 2000 -vf /home/lio/MantaRay/Andrei/views/Perspective2.vf -pa 1` -ffc -e ~/MantaRay/Andrei/ambientFiles/2023_01_18_1002_49_Perspective_render.err /home/lio/MantaRay/Andrei/octrees/my_test_scene.oct > ~/MantaRay/Andrei/images/2023_01_18_1002_49_Perspective_render.hdr
echo ~/MantaRay/Andrei/images/2023_01_18_1002_49_Perspective_render.hdr""")  # -> Stdout, Stderr_, Ran

overrides_44 = ApplyOverrides(
    Input="cat <LinuxHome>/ambientFiles/<target-.>.err",
    Target=graft(panel_44),
    Time=graft(python_17),
    View=graft("Perspective"))  # -> Output, DynamicOutput
executessh_43 = ExecuteSSH(
    _SSHCommands_=overrides_44.DynamicOutput,
    Run=executessh_42.Ran,
    addPrefix=True,
    description="cat ~/MantaRay/Andrei/ambientFiles/2023_03_12_2113_00_Perspective_render.err",
    fireLogs=False,
    lastRunTime=12,
    suppressWarnings=False,
    results="""**************
*** PID 12526: rtrace -as 0 -ab 2 -aa 0.0 -ad 32 -af /home/lio/MantaRay/Andrei/ambientFiles/ambfile2_2023_01_18_1002_49.af -w -n 63 -x 2500 -y 1240 -ffc -e /home/lio/MantaRay/Andrei/ambientFiles/2023_01_18_1002_49_Perspective_render.err /home/lio/MantaRay/Andrei/octrees/my_test_scene.oct""",
    commands="cat ~/MantaRay/Andrei/ambientFiles/2023_01_18_1002_49_Perspective_render.err")  # -> Stdout, Stderr_, Ran
panel_110 = Panel(executessh_43.Stdout)
python_18 = GhPythonScript(errIn=executessh_43.Stdout)  # -> pid, run
# ---------- python_18: Python ----------
__author__ = "mm1013"
__version__ = "2022.10.06"

import rhinoscriptsyntax as rs

start = errIn.split(":")[0].split(" ")[-1]
print(start)
try:
    pid = int(start)
    run = True
except:
    run = False
# ---------- end python_18 ----------
falsestart_16 = LBFalseStartToggle(False)
overrides_45 = ApplyOverrides(Input="kill <pid>", Pid=graft(python_18.pid))  # -> Output, DynamicOutput
executessh_44 = ExecuteSSH(
    _SSHCommands_=overrides_45.Output,
    Run=flatten([python_18.run, falsestart_16]),
    addPrefix=True,
    fireLogs=False,
    lastRunTime=0,
    suppressWarnings=False)  # -> Stdout, Stderr_, Ran

convertpaths_2 = ConvertPaths(I=executessh_42.Stdout)  # -> Linux, Windows, Sftp
or = GateOr(A=falsestart_9, B=executessh_42.Ran)
panel_111 = Panel(convertpaths_2.Linux)

# ----
# Using PCOND to set automatic exposure
# and convert to PNG
panel_112 = Panel("""pcond -h <hdr> <hdr-.>_exposed.hdr
ra_tiff <hdr-.>_exposed.hdr <hdr-.>_exposed.tif
convert <hdr-.>_exposed.tif <hdr-.>_exposed.png
echo <hdr-.>_exposed.png""")
overrides_46 = ApplyOverrides(Input=panel_112, Hdr=graft(executessh_41.Stdout))  # -> Output, DynamicOutput
executessh_45 = ExecuteSSH(
    _SSHCommands_=overrides_46.DynamicOutput,
    Run=executessh_41.Ran,
    addPrefix=True,
    description="""pcond -h /home/lio/MantaRay/Andrei/images/2023_01_18_1002_49_Perspective1_render_illum.hdr /home/lio/MantaRay/Andrei/images/2023_01_18_1002_49_Perspective1_render_illum_exposed.hdr
ra_tiff /home/lio/MantaRay/Andrei/images/2023_01_18_1002_49_Perspective1_render_illum_exposed.hdr /home/lio/MantaRay/Andrei/images/2023_01_18_1002_49_Perspective1_render_illum_exposed.tif
convert /home/lio/MantaRay/Andrei/images/2023_01_18_1002_49_Perspective1_render_illum_exposed.tif /home/lio/MantaRay/Andrei/images/2023_01_18_1002_49_Perspective1_render_illum_exposed.png
echo /home/lio/MantaRay/Andrei/images/2023_01_18_1002_49_Perspective1_render_illum_exposed.png""",
    fireLogs=False,
    lastRunTime=2124,
    suppressWarnings=False,
    results="/home/lio/MantaRay/Andrei/images/2023_01_18_1002_49_Perspective1_render_illum_exposed.png",
    commands="""pcond -h /home/lio/MantaRay/Andrei/images/2023_01_18_1002_49_Perspective1_render_illum.hdr /home/lio/MantaRay/Andrei/images/2023_01_18_1002_49_Perspective1_render_illum_exposed.hdr
ra_tiff /home/lio/MantaRay/Andrei/images/2023_01_18_1002_49_Perspective1_render_illum_exposed.hdr /home/lio/MantaRay/Andrei/images/2023_01_18_1002_49_Perspective1_render_illum_exposed.tif
convert /home/lio/MantaRay/Andrei/images/2023_01_18_1002_49_Perspective1_render_illum_exposed.tif /home/lio/MantaRay/Andrei/images/2023_01_18_1002_49_Perspective1_render_illum_exposed.png
echo /home/lio/MantaRay/Andrei/images/2023_01_18_1002_49_Perspective1_render_illum_exposed.png""")  # -> Stdout, Stderr_, Ran
download_8 = Download(
    LinuxFilePaths=executessh_45.Stdout,
    Run=executessh_45.Ran,
    stdouts="C:\Users\mm1013\MantaRay\Andrei\2023_01_18_1002_49_Perspective1_render_illum_exposed.png")  # -> FilePaths, Status, Ran
imageviewer_5 = LBImageViewer(ImagePath_=download_8.FilePaths, _scale_="1.5", DisableClickable=False, SaveImgWithCoords=False, scale=1.5)  # -> ImagePath, Values, GIF

# ----
# False color with illuminance curves
# on top of luminance picture
panel_113 = Panel("falsecolor -s 9000 -l lux -p <rad-.>_exposed.hdr -i <irrad> -cl -log 2 > <rad-.>_fc.hdr;echo <rad-.>_fc.hdr")
overrides_47 = ApplyOverrides(Input=panel_113, Rad=graft(executessh_42.Stdout), Irrad=graft(executessh_41.Stdout))  # -> Output, DynamicOutput
executessh_46 = ExecuteSSH(
    _SSHCommands_=overrides_47.DynamicOutput,
    Run=[or, executessh_41.Ran],
    addPrefix=True,
    description="falsecolor -s 9000 -l lux -p /home/lio/MantaRay/Andrei/images/2023_01_18_1002_49_Perspective_render_exposed.hdr -i /home/lio/MantaRay/Andrei/images/2023_01_18_1002_49_Perspective1_render_illum.hdr -cl -log 2 > /home/lio/MantaRay/Andrei/images/2023_01_18_1002_49_Perspective_render_fc.hdr;echo /home/lio/MantaRay/Andrei/images/2023_01_18_1002_49_Perspective_render_fc.hdr",
    fireLogs=False,
    lastRunTime=39,
    suppressWarnings=False,
    results="/home/lio/MantaRay/Andrei/images/2023_01_18_1002_49_Perspective_render_fc.hdr",
    stderr="""/home/lio/MantaRay/Andrei/images/2023_01_18_1002_49_Perspective_render_exposed.hdr: bad picture size
<stdin>: bad picture size
Bad header!""",
    commands="falsecolor -s 9000 -l lux -p /home/lio/MantaRay/Andrei/images/2023_01_18_1002_49_Perspective_render_exposed.hdr -i /home/lio/MantaRay/Andrei/images/2023_01_18_1002_49_Perspective1_render_illum.hdr -cl -log 2 > /home/lio/MantaRay/Andrei/images/2023_01_18_1002_49_Perspective_render_fc.hdr;echo /home/lio/MantaRay/Andrei/images/2023_01_18_1002_49_Perspective_render_fc.hdr")  # -> Stdout, Stderr_, Ran
download_9 = Download(
    LinuxFilePaths=executessh_46.Stdout,
    Run=executessh_46.Ran,
    stdouts="C:\Users\mm1013\MantaRay\UnnamedProject\2022_09_28_1341_29_Perspective1_render_fc.hdr")  # -> FilePaths, Status, Ran
imageviewer_6 = LBImageViewer(ImagePath_=download_9.FilePaths, _scale_="2", DisableClickable=False, SaveImgWithCoords=False, scale=2)  # -> ImagePath, Values, GIF

# ----
# False color with illuminance curves
# on top of luminance picture
panel_114 = Panel("""pcond -h <irrad> <irrad-.>_exposed.hdr
falsecolor -s 9000 -d 0 -l lux -p <irrad-.>_exposed.hdr -i <irrad> -cl -log 2 > <rad-.>_fc.hdr;echo <rad-.>_fc.hdr""")
overrides_48 = ApplyOverrides(Input=panel_114, Rad=graft(executessh_42.Stdout), Irrad=graft(executessh_41.Stdout))  # -> Output, DynamicOutput
executessh_47 = ExecuteSSH(
    _SSHCommands_=overrides_48.DynamicOutput,
    Run=[or, executessh_41.Ran],
    addPrefix=True,
    description="""pcond -h /home/lio/MantaRay/Andrei/images/2023_01_18_1002_49_Perspective1_render_illum.hdr /home/lio/MantaRay/Andrei/images/2023_01_18_1002_49_Perspective1_render_illum_exposed.hdr
falsecolor -s 9000 -d 0 -l lux -p /home/lio/MantaRay/Andrei/images/2023_01_18_1002_49_Perspective1_render_illum_exposed.hdr -i /home/lio/MantaRay/Andrei/images/2023_01_18_1002_49_Perspective1_render_illum.hdr -cl -log 2 > /home/lio/MantaRay/Andrei/images/2023_01_18_1002_49_Perspective_render_fc.hdr;echo /home/lio/MantaRay/Andrei/images/2023_01_18_1002_49_Perspective_render_fc.hdr""",
    fireLogs=False,
    lastRunTime=5852,
    suppressWarnings=False,
    results="/home/lio/MantaRay/Andrei/images/2023_01_18_1002_49_Perspective_render_fc.hdr",
    commands="""pcond -h /home/lio/MantaRay/Andrei/images/2023_01_18_1002_49_Perspective1_render_illum.hdr /home/lio/MantaRay/Andrei/images/2023_01_18_1002_49_Perspective1_render_illum_exposed.hdr
falsecolor -s 9000 -d 0 -l lux -p /home/lio/MantaRay/Andrei/images/2023_01_18_1002_49_Perspective1_render_illum_exposed.hdr -i /home/lio/MantaRay/Andrei/images/2023_01_18_1002_49_Perspective1_render_illum.hdr -cl -log 2 > /home/lio/MantaRay/Andrei/images/2023_01_18_1002_49_Perspective_render_fc.hdr;echo /home/lio/MantaRay/Andrei/images/2023_01_18_1002_49_Perspective_render_fc.hdr""")  # -> Stdout, Stderr_, Ran
download_10 = Download(
    LinuxFilePaths=executessh_47.Stdout,
    Run=executessh_47.Ran,
    stdouts="C:\Users\mm1013\MantaRay\Andrei\2023_01_18_1002_49_Perspective_render_fc.hdr")  # -> FilePaths, Status, Ran
imageviewer_7 = LBImageViewer(ImagePath_=download_10.FilePaths, _scale_="2", DisableClickable=False, SaveImgWithCoords=False, scale=2)  # -> ImagePath, Values, GIF

overrides_49 = ApplyOverrides(Input=panel_57, Rad=graft(executessh_42.Stdout), Irrad=graft(executessh_41.Stdout))  # -> Output, DynamicOutput
executessh_48 = ExecuteSSH(
    _SSHCommands_=overrides_49.DynamicOutput,
    Run=[or, executessh_41.Ran],
    addPrefix=True,
    description="falsecolor -lw 0 -s 50 -n 10 -m 1.79 -l DF -p /home/lio/MantaRay/Andrei/images/2023_01_18_1002_49_Perspective_render_exposed.hdr -i /home/lio/MantaRay/Andrei/images/2023_01_18_1002_49_Perspective1_render_illum.hdr -cp > /home/lio/MantaRay/Andrei/images/2023_01_18_1002_49_Perspective_render_fc4_lw0.hdr;echo /home/lio/MantaRay/Andrei/images/2023_01_18_1002_49_Perspective_render_fc4_lw0.hdr",
    fireLogs=False,
    lastRunTime=45,
    suppressWarnings=False,
    results="/home/lio/MantaRay/Andrei/images/2023_01_18_1002_49_Perspective_render_fc4_lw0.hdr",
    stderr="""/home/lio/MantaRay/Andrei/images/2023_01_18_1002_49_Perspective_render_exposed.hdr: bad picture size
<stdin>: bad picture size
Bad header!""",
    commands="falsecolor -lw 0 -s 50 -n 10 -m 1.79 -l DF -p /home/lio/MantaRay/Andrei/images/2023_01_18_1002_49_Perspective_render_exposed.hdr -i /home/lio/MantaRay/Andrei/images/2023_01_18_1002_49_Perspective1_render_illum.hdr -cp > /home/lio/MantaRay/Andrei/images/2023_01_18_1002_49_Perspective_render_fc4_lw0.hdr;echo /home/lio/MantaRay/Andrei/images/2023_01_18_1002_49_Perspective_render_fc4_lw0.hdr")  # -> Stdout, Stderr_, Ran
overrides_50 = ApplyOverrides(Input=panel_58, Rad=graft(executessh_41.Stdout), Fc=graft(executessh_48.Stdout))  # -> Output, DynamicOutput
subtraction = Subtraction(A="2000", B=pdecon.YComponent)
executessh_49 = ExecuteSSH(
    _SSHCommands_=overrides_50.DynamicOutput,
    Run=[or, executessh_41.Ran],
    addPrefix=True,
    description="""pcond -h /home/lio/MantaRay/Andrei/images/2023_01_18_1002_49_Perspective1_render_illum.hdr /home/lio/MantaRay/Andrei/images/2023_01_18_1002_49_Perspective1_render_illum_exposed2.hdr
pcomb /home/lio/MantaRay/Andrei/images/2023_01_18_1002_49_Perspective1_render_illum_exposed2.hdr -s 0.2 /home/lio/MantaRay/Andrei/images/2023_01_18_1002_49_Perspective_render_fc4_lw0.hdr > /home/lio/MantaRay/Andrei/images/2023_01_18_1002_49_Perspective1_render_illum_overlay.hdr
echo /home/lio/MantaRay/Andrei/images/2023_01_18_1002_49_Perspective1_render_illum_overlay.hdr""",
    fireLogs=False,
    lastRunTime=549,
    suppressWarnings=False,
    results="/home/lio/MantaRay/Andrei/images/2023_01_18_1002_49_Perspective1_render_illum_overlay.hdr",
    stderr="/home/lio/MantaRay/Andrei/images/2023_01_18_1002_49_Perspective_render_fc4_lw0.hdr: bad picture size",
    commands="""pcond -h /home/lio/MantaRay/Andrei/images/2023_01_18_1002_49_Perspective1_render_illum.hdr /home/lio/MantaRay/Andrei/images/2023_01_18_1002_49_Perspective1_render_illum_exposed2.hdr
pcomb /home/lio/MantaRay/Andrei/images/2023_01_18_1002_49_Perspective1_render_illum_exposed2.hdr -s 0.2 /home/lio/MantaRay/Andrei/images/2023_01_18_1002_49_Perspective_render_fc4_lw0.hdr > /home/lio/MantaRay/Andrei/images/2023_01_18_1002_49_Perspective1_render_illum_overlay.hdr
echo /home/lio/MantaRay/Andrei/images/2023_01_18_1002_49_Perspective1_render_illum_overlay.hdr""")  # -> Stdout, Stderr_, Ran
overrides_51 = ApplyOverrides(Input=panel_60, Hdr=graft(executessh_41.Stdout), X=graft(pdecon.XComponent), Y=graft(subtraction))  # -> Output, DynamicOutput
download_11 = Download(
    LinuxFilePaths=executessh_49.Stdout,
    Run=executessh_49.Ran,
    stdouts="C:\Users\mm1013\MantaRay\UnnamedProject\2022_09_28_1341_29_Perspective1_render_illum_overlay.hdr")  # -> FilePaths, Status, Ran
item_6 = ListItem(List=flatten(overrides_51.Output), Index=0, Wrap=True)
panel_115 = Panel(item_6)
imageviewer_8 = LBImageViewer(ImagePath_=download_11.FilePaths, _scale_="2", DisableClickable=False, SaveImgWithCoords=False, scale=2)  # -> ImagePath, Values, GIF

# ----
# https://discourse.radiance-online.org/t/rad-program-for-generating-parameters/6026
panel_116 = Panel("""rpict= rtpict -n <cpus>
RESOLUTION= 600
QUALITY= H
DETAIL= M
EXPOSURE= +0.1
UP= Z
INDIRECT= 2
VARIABILITY= M
REPORT= 1
<zone>
OCTREE=<oct>
view=<vn> -vf <v>""")
panel_117 = Panel("""echo "<RIF>" > <LinuxHome>/<target>
rad -n -s <LinuxHome>/<target> OPTFILE=<LinuxHome>/render.opt
echo <LinuxHome>/render.opt""")
falsestart_17 = LBFalseStartToggle(False)

# ----
# RENDER WITH RAD (rif files)
octree_7 = Data(octree_overcast, ParamAccess=0)
panel_118 = Panel("""rtpict -w -n <cpus> @<options> -x 500 -y 400 -vf <vf> -af <target-.>.amb <oct> > <LinuxHome>/<target-.>_overture.hdr
rtpict -w -n <cpus> @<options> -vf <vf> -af <target-.>.amb <oct> > <LinuxHome>/<target>
echo <LinuxHome>/<target>""")
panel_119 = Panel("""pcond -h <hdr> <hdr-.>_exposed.hdr
ra_tiff <hdr-.>_exposed.hdr <hdr-.>_exposed.tif
convert <hdr-.>_exposed.tif <hdr-.>_exposed.png
echo <hdr-.>_exposed.png""")

overrides_52 = ApplyOverrides(
    Input=panel_117,
    RIF=graft(panel_116),
    Target=graft("scene.rif"),
    Oct=graft(octree_7),
    Zone=graft(zone_2.zone),
    Vn=graft("Perspective"),
    V=graft(executessh_16.Stdout))  # -> Output, DynamicOutput
executessh_50 = ExecuteSSH(
    _SSHCommands_=overrides_52.Output,
    Run=falsestart_17,
    addPrefix=True,
    fireLogs=False,
    lastRunTime=5,
    suppressWarnings=False,
    results="/home/mss/MantaRay/UnnamedProject/render.opt",
    commands="""echo "rpict= rtpict -n 11
RESOLUTION= 600
QUALITY= H
DETAIL= M
EXPOSURE= +0.1
UP= Z
INDIRECT= 2
VARIABILITY= M
REPORT= 1
ZONE=I 0.00 14.49 0.00 18.21 0.00 13.53

OCTREE=/home/mss/MantaRay/UnnamedProject/octrees/my_test_scene.oct
view=Perspective -vf /home/mss/MantaRay/UnnamedProject/views/Perspective2.vf" > ~/MantaRay/UnnamedProject/scene.rif
rad -n -s ~/MantaRay/UnnamedProject/scene.rif OPTFILE=~/MantaRay/UnnamedProject/render.opt
echo ~/MantaRay/UnnamedProject/render.opt""")  # -> Stdout, Stderr_, Ran
overrides_53 = ApplyOverrides(Input="cat <target>", Target=graft(executessh_50.Stdout))  # -> Output, DynamicOutput
executessh_51 = ExecuteSSH(
    _SSHCommands_=overrides_53.Output,
    Run=executessh_50.Ran,
    addPrefix=True,
    fireLogs=False,
    lastRunTime=13,
    suppressWarnings=False,
    results="""-dp 2048
-ar 200
-ms 0.19
-ds .2
-dt .05
-dc .75
-dr 3
-ss 16
-st .01
-ab 3
-aa .1
-ad 1536
-as 768
-av 0.47 0.47 0.47
-lr 12
-lw 1e-5""",
    commands="cat /home/mss/MantaRay/UnnamedProject/render.opt")  # -> Stdout, Stderr_, Ran
panel_120 = Panel(executessh_51.Stdout)

overrides_54 = ApplyOverrides(
    Input=panel_118,
    Oct=graft(octree_7),
    Target=graft("myRender.hdr"),
    Options=graft(executessh_50.Stdout),
    Vf=graft(executessh_16.Stdout))  # -> Output, DynamicOutput
executessh_52 = ExecuteSSH(
    _SSHCommands=overrides_54.Output,
    Run=falsestart_11,
    addPrefix=True,
    fireLogs=False,
    lastRunTime=1324742,
    suppressWarnings=False,
    results="/home/mss/MantaRay/UnnamedProject/myRender.hdr",
    commands="""rtpict -w -n 11 @/home/mss/MantaRay/UnnamedProject/render.opt -x 500 -y 400 -vf /home/mss/MantaRay/UnnamedProject/views/Perspective2.vf -af myRender.amb /home/mss/MantaRay/UnnamedProject/octrees/my_test_scene.oct > ~/MantaRay/UnnamedProject/myRender_overture.hdr
rtpict -w -n 11 @/home/mss/MantaRay/UnnamedProject/render.opt -vf /home/mss/MantaRay/UnnamedProject/views/Perspective2.vf -af myRender.amb /home/mss/MantaRay/UnnamedProject/octrees/my_test_scene.oct > ~/MantaRay/UnnamedProject/myRender.hdr
echo ~/MantaRay/UnnamedProject/myRender.hdr""")  # -> Stdout, Stderr_, Ran
overrides_55 = ApplyOverrides(Input=panel_119, Hdr=graft(executessh_52.Stdout))  # -> Output, DynamicOutput
executessh_53 = ExecuteSSH(
    _SSHCommands_=overrides_55.DynamicOutput,
    Run=executessh_52.Ran,
    addPrefix=True,
    description="""pcond -h /home/mss/MantaRay/UnnamedProject/myRender.hdr /home/mss/MantaRay/UnnamedProject/myRender_exposed.hdr
ra_tiff /home/mss/MantaRay/UnnamedProject/myRender_exposed.hdr /home/mss/MantaRay/UnnamedProject/myRender_exposed.tif
convert /home/mss/MantaRay/UnnamedProject/myRender_exposed.tif /home/mss/MantaRay/UnnamedProject/myRender_exposed.png
echo /home/mss/MantaRay/UnnamedProject/myRender_exposed.png""",
    fireLogs=False,
    lastRunTime=6,
    suppressWarnings=False,
    results="/home/mss/MantaRay/UnnamedProject/myRender_exposed.png",
    commands="""pcond -h /home/mss/MantaRay/UnnamedProject/myRender.hdr /home/mss/MantaRay/UnnamedProject/myRender_exposed.hdr
ra_tiff /home/mss/MantaRay/UnnamedProject/myRender_exposed.hdr /home/mss/MantaRay/UnnamedProject/myRender_exposed.tif
convert /home/mss/MantaRay/UnnamedProject/myRender_exposed.tif /home/mss/MantaRay/UnnamedProject/myRender_exposed.png
echo /home/mss/MantaRay/UnnamedProject/myRender_exposed.png""")  # -> Stdout, Stderr_, Ran
download_12 = Download(
    LinuxFilePaths=executessh_53.Stdout,
    Run=executessh_53.Ran,
    stdouts="C:\Users\mm1013\MantaRay\UnnamedProject\myRender_exposed.png")  # -> FilePaths, Status, Ran
imageviewer_9 = LBImageViewer(ImagePath_=download_12.FilePaths, _scale_="1.5", DisableClickable=False, SaveImgWithCoords=False, scale=1.5)  # -> ImagePath, Values, GIF

panel_121 = Panel(overrides_54.Output)

# ----
# Parallel RTPICT render (luminance) no cache
viewfile_6 = Text(executessh_29.Stdout)
octree_8 = Text(executessh_40.Stdout)
octree_overcast_3 = Text(octree_overcast)
division_4 = Division(A=resolution_2, B=1.5)
entwine_11 = Entwine(Branch00=octree_overcast_3, Branch01=octree_8, FlattenInputs=True)  # -> flatten(Result)
octree_9 = Text(graft(entwine_11))
list_2 = ItemSelector(
    octree_9,
    {"/home/lio/MantaRay/Andrei/octrees/Scene_Overcast10klux.oct"}, selected="/home/lio/MantaRay/Andrei/octrees/Scene_Overcast10klux.oct")
panel_122 = Panel("""mkdir -p <proj>/images/
rtpict -n <cpus-1> -w -vf <vf> -x <x> -y <y> <radOptions> <oct> | pfilt -x /4 -y /4 -r 0.7 > <proj>/images/<target>;echo <proj>/images/<target>""")
eval_2 = Evaluate(F="x=y", x=octree_9, y=list_2)
x_4 = Number(x_2)
run_7 = LBFalseStartToggle(False)

y_3 = Number(division_4)

# ----
# Parallel RTPICT render (Illuminance)
# (takes 2.5X longer than above...)
# mkdir -p <proj>/images/
# rtpict -i -w -n 30 -vf <vf> -x <x> -y <y> <radOptions> <oct> | pfilt -x /4 -y /4 -r 0.7 > <proj>/images/<target>;echo <proj>/images/<target>
panel_123 = Panel("""mkdir -p <proj>/images/
rtpict -i -w -n <cpus-2> -vf <vf> -x <x> -y <y> <radOptions> <oct> | pfilt -x /4 -y /4 -r 0.7 > <proj>/images/<target>;echo <proj>/images/<target>""")
run_8 = LBFalseStartToggle(False)
x_5 = Number(x_2)
y_4 = Number(y_3)

hours_7 = Text(hours_2)
entwine_12 = Entwine(Branch00="ovc", Branch01=hours_7, FlattenInputs=True)  # -> flatten(Result)
cull_5 = CullPattern(List=graft(entwine_12), CullPattern=eval_2)  # -> flatten(List)
hours_8 = Text(cull_5)

merge = Merge(Data1=panel_102, Data2=list, Data3=join_6, Data4=Button())  # -> flatten(Result)
python_19 = GhPythonScript(update=merge)  # -> time; inputs update: tree; same code as python_13

overrides_56 = ApplyOverrides(Input="ambfile_<time>.af", Time=graft(python_19))  # -> Output, DynamicOutput
overrides_57 = ApplyOverrides(
    Input=panel_103,
    Vf=graft(viewfile_3),
    RadOptions=graft(panel_102),
    AmbFile=graft(overrides_56.DynamicOutput),
    Oct=graft(list),
    X=graft(x_3),
    Y=graft(y_2),
    Target=graft("<time>_rtpict_rendering_aa0.1_<x>_sunny_ad4096_<h>.hdr"),
    Time=graft("<time>"),
    H=graft(hours_6))  # -> Output, DynamicOutput

overrides_58 = ApplyOverrides(Input=overrides_57.DynamicOutput, Time=graft(python_13))  # -> Output, DynamicOutput
executessh_54 = ExecuteSSH(
    _SSHCommands_=overrides_58.DynamicOutput,
    Run=run_4,
    addPrefix=True,
    description="""mkdir -p ~/MantaRay/Andrei/images/
rtpict -n 62 -w -vf /home/lio/MantaRay/Andrei/views/Perspective1.vf -x 400 -y 300 -ab 3 -ad 4096 -lw 0.0003 -aa 0.1 -ar 256 -as 1024 -af ambfile_2023_03_12_2113_03.af

# This is a MantaRay Dictionary
# Globals will be updated in Execute component
# Locals will not!
# This tail is ignored by the Execute component /home/lio/MantaRay/Andrei/octrees/Scene_Overcast10klux.oct > /dev/null
rtpict -n 62 -w -vf /home/lio/MantaRay/Andrei/views/Perspective1.vf -x 5000 -y 3333.333333 -ab 3 -ad 4096 -lw 0.0003 -aa 0.1 -ar 256 -as 1024 -af ambfile_2023_03_12_2113_03.af

# This is a MantaRay Dictionary
# Globals will be updated in Execute component
# Locals will not!
# This tail is ignored by the Execute component /home/lio/MantaRay/Andrei/octrees/Scene_Overcast10klux.oct | pfilt -x /2 -y /2 > ~/MantaRay/Andrei/images/2023_03_11_1204_07_rtpict_rendering_aa0.1_5000_sunny_ad4096_ovc.hdr;echo ~/MantaRay/Andrei/images/2023_03_11_1204_07_rtpict_rendering_aa0.1_5000_sunny_ad4096_ovc.hdr


- - -

mkdir -p ~/MantaRay/Andrei/images/
rtpict -n 62 -w -vf /home/lio/MantaRay/Andrei/views/Perspective1.vf -x 400 -y 300 -ab 3 -ad 4096 -lw 0.0003 -aa 0.1 -ar 256 -as 1024 -af ambfile_2023_03_12_2113_03.af

# This is a MantaRay Dictionary
# Globals will be updated in Execute component
# Locals will not!
# This tail is ignored by the Execute component /home/lio/MantaRay/Andrei/octrees/Scene_Overcast10klux.oct > /dev/null
rtpict -n 62 -w -vf /home/lio/MantaRay/Andrei/views/Perspective1.vf -x 5000 -y 3333.333333 -ab 3 -ad 4096 -lw 0.0003 -aa 0.1 -ar 256 -as 1024 -af ambfile_2023_03_12_2113_03.af

# This is a MantaRay Dictionary
# Globals will be updated in Execute component
# Locals will not!
# This tail is ignored by the Execute component /home/lio/MantaRay/Andrei/octrees/Scene_Overcast10klux.oct | pfilt -x /2 -y /2 > ~/MantaRay/Andrei/images/2023_03_11_1204_07_rtpict_rendering_aa0.1_5000_sunny_ad4096_0800.hdr;echo ~/MantaRay/Andrei/images/2023_03_11_1204_07_rtpict_rendering_aa0.1_5000_sunny_ad4096_0800.hdr


- - -

mkdir -p ~/MantaRay/Andrei/images/
rtpict -n 62 -w -vf /home/lio/MantaRay/Andrei/views/Perspective1.vf -x 400 -y 300 -ab 3 -ad 4096 -lw 0.0003 -aa 0.1 -ar 256 -as 1024 -af ambfile_2023_03_12_2113_03.af

# This is a MantaRay Dictionary
# Globals will be updated in Execute component
# Locals will not!
# This tail is ignored by the Execute component /home/lio/MantaRay/Andrei/octrees/Scene_Overcast10klux.oct > /dev/null
rtpict -n 62 -w -vf /home/lio/MantaRay/Andrei/views/Perspective1.vf -x 5000 -y 3333.333333 -ab 3 -ad 4096 -lw 0.0003 -aa 0.1 -ar 256 -as 1024 -af ambfile_2023_03_12_2113_03.af

# This is a MantaRay Dictionary
# Globals will be updated in Execute component
# Locals will not!
# This tail is ignored by the Execute component /home/lio/MantaRay/Andrei/octrees/Scene_Overcast10klux.oct | pfilt -x /2 -y /2 > ~/MantaRay/Andrei/images/2023_03_11_1204_07_rtpict_rendering_aa0.1_5000_sunny_ad4096_0900.hdr;echo ~/MantaRay/Andrei/images/2023_03_11_1204_07_rtpict_rendering_aa0.1_5000_sunny_ad4096_0900.hdr


- - -

mkdir -p ~/MantaRay/Andrei/images/
rtpict -n 62 -w -vf /home/lio/MantaRay/Andrei/views/Perspective1.vf -x 400 -y 300 -ab 3 -ad 4096 -lw 0.0003 -aa 0.1 -ar 256 -as 1024 -af ambfile_2023_03_12_2113_03.af

# This is a MantaRay Dictionary
# Globals will be updated in Execute component
# Locals will not!
# This tail is ignored by the Execute component /home/lio/MantaRay/Andrei/octrees/Scene_Overcast10klux.oct > /dev/null
rtpict -n 62 -w -vf /home/lio/MantaRay/Andrei/views/Perspective1.vf -x 5000 -y 3333.333333 -ab 3 -ad 4096 -lw 0.0003 -aa 0.1 -ar 256 -as 1024 -af ambfile_2023_03_12_2113_03.af

# This is a MantaRay Dictionary
# Globals will be updated in Execute component
# Locals will not!
# This tail is ignored by the Execute component /home/lio/MantaRay/Andrei/octrees/Scene_Overcast10klux.oct | pfilt -x /2 -y /2 > ~/MantaRay/Andrei/images/2023_03_11_1204_07_rtpict_rendering_aa0.1_5000_sunny_ad4096_1000.hdr;echo ~/MantaRay/Andrei/images/2023_03_11_1204_07_rtpict_rendering_aa0.1_5000_sunny_ad4096_1000.hdr


- - -

mkdir -p ~/MantaRay/Andrei/images/
rtpict -n 62 -w -vf /home/lio/MantaRay/Andrei/views/Perspective1.vf -x 400 -y 300 -ab 3 -ad 4096 -lw 0.0003 -aa 0.1 -ar 256 -as 1024 -af ambfile_2023_03_12_2113_03.af

# This is a MantaRay Dictionary
# Globals will be updated in Execute component
# Locals will not!
# This tail is ignored by the Execute component /home/lio/MantaRay/Andrei/octrees/Scene_Overcast10klux.oct > /dev/null
rtpict -n 62 -w -vf /home/lio/MantaRay/Andrei/views/Perspective1.vf -x 5000 -y 3333.333333 -ab 3 -ad 4096 -lw 0.0003 -aa 0.1 -ar 256 -as 1024 -af ambfile_2023_03_12_2113_03.af

# This is a MantaRay Dictionary
# Globals will be updated in Execute component
# Locals will not!
# This tail is ignored by the Execute component /home/lio/MantaRay/Andrei/octrees/Scene_Overcast10klux.oct | pfilt -x /2 -y /2 > ~/MantaRay/Andrei/images/2023_03_11_1204_07_rtpict_rendering_aa0.1_5000_sunny_ad4096_1100.hdr;echo ~/MantaRay/Andrei/images/2023_03_11_1204_07_rtpict_rendering_aa0.1_5000_sunny_ad4096_1100.hdr


- - -

mkdir -p ~/MantaRay/Andrei/images/
rtpict -n 62 -w -vf /home/lio/MantaRay/Andrei/views/Perspective1.vf -x 400 -y 300 -ab 3 -ad 4096 -lw 0.0003 -aa 0.1 -ar 256 -as 1024 -af ambfile_2023_03_12_2113_03.af

# This is a MantaRay Dictionary
# Globals will be updated in Execute component
# Locals will not!
# This tail is ignored by the Execute component /home/lio/MantaRay/Andrei/octrees/Scene_Overcast10klux.oct > /dev/null
rtpict -n 62 -w -vf /home/lio/MantaRay/Andrei/views/Perspective1.vf -x 5000 -y 3333.333333 -ab 3 -ad 4096 -lw 0.0003 -aa 0.1 -ar 256 -as 1024 -af ambfile_2023_03_12_2113_03.af

# This is a MantaRay Dictionary
# Globals will be updated in Execute component
# Locals will not!
# This tail is ignored by the Execute component /home/lio/MantaRay/Andrei/octrees/Scene_Overcast10klux.oct | pfilt -x /2 -y /2 > ~/MantaRay/Andrei/images/2023_03_11_1204_07_rtpict_rendering_aa0.1_5000_sunny_ad4096_1200.hdr;echo ~/MantaRay/Andrei/images/2023_03_11_1204_07_rtpict_rendering_aa0.1_5000_sunny_ad4096_1200.hdr


- - -

mkdir -p ~/MantaRay/Andrei/images/
rtpict -n 62 -w -vf /home/lio/MantaRay/Andrei/views/Perspective1.vf -x 400 -y 300 -ab 3 -ad 4096 -lw 0.0003 -aa 0.1 -ar 256 -as 1024 -af ambfile_2023_03_12_2113_03.af

# This is a MantaRay Dictionary
# Globals will be updated in Execute component
# Locals will not!
# This tail is ignored by the Execute component /home/lio/MantaRay/Andrei/octrees/Scene_Overcast10klux.oct > /dev/null
rtpict -n 62 -w -vf /home/lio/MantaRay/Andrei/views/Perspective1.vf -x 5000 -y 3333.333333 -ab 3 -ad 4096 -lw 0.0003 -aa 0.1 -ar 256 -as 1024 -af ambfile_2023_03_12_2113_03.af

# This is a MantaRay Dictionary
# Globals will be updated in Execute component
# Locals will not!
# This tail is ignored by the Execute component /home/lio/MantaRay/Andrei/octrees/Scene_Overcast10klux.oct | pfilt -x /2 -y /2 > ~/MantaRay/Andrei/images/2023_03_11_1204_07_rtpict_rendering_aa0.1_5000_sunny_ad4096_1300.hdr;echo ~/MantaRay/Andrei/images/2023_03_11_1204_07_rtpict_rendering_aa0.1_5000_sunny_ad4096_1300.hdr


- - -

mkdir -p ~/MantaRay/Andrei/images/
rtpict -n 62 -w -vf /home/lio/MantaRay/Andrei/views/Perspective1.vf -x 400 -y 300 -ab 3 -ad 4096 -lw 0.0003 -aa 0.1 -ar 256 -as 1024 -af ambfile_2023_03_12_2113_03.af

# This is a MantaRay Dictionary
# Globals will be updated in Execute component
# Locals will not!
# This tail is ignored by the Execute component /home/lio/MantaRay/Andrei/octrees/Scene_Overcast10klux.oct > /dev/null
rtpict -n 62 -w -vf /home/lio/MantaRay/Andrei/views/Perspective1.vf -x 5000 -y 3333.333333 -ab 3 -ad 4096 -lw 0.0003 -aa 0.1 -ar 256 -as 1024 -af ambfile_2023_03_12_2113_03.af

# This is a MantaRay Dictionary
# Globals will be updated in Execute component
# Locals will not!
# This tail is ignored by the Execute component /home/lio/MantaRay/Andrei/octrees/Scene_Overcast10klux.oct | pfilt -x /2 -y /2 > ~/MantaRay/Andrei/images/2023_03_11_1204_07_rtpict_rendering_aa0.1_5000_sunny_ad4096_1400.hdr;echo ~/MantaRay/Andrei/images/2023_03_11_1204_07_rtpict_rendering_aa0.1_5000_sunny_ad4096_1400.hdr


- - -

mkdir -p ~/MantaRay/Andrei/images/
rtpict -n 62 -w -vf /home/lio/MantaRay/Andrei/views/Perspective1.vf -x 400 -y 300 -ab 3 -ad 4096 -lw 0.0003 -aa 0.1 -ar 256 -as 1024 -af ambfile_2023_03_12_2113_03.af

# This is a MantaRay Dictionary
# Globals will be updated in Execute component
# Locals will not!
# This tail is ignored by the Execute component /home/lio/MantaRay/Andrei/octrees/Scene_Overcast10klux.oct > /dev/null
rtpict -n 62 -w -vf /home/lio/MantaRay/Andrei/views/Perspective1.vf -x 5000 -y 3333.333333 -ab 3 -ad 4096 -lw 0.0003 -aa 0.1 -ar 256 -as 1024 -af ambfile_2023_03_12_2113_03.af

# This is a MantaRay Dictionary
# Globals will be updated in Execute component
# Locals will not!
# This tail is ignored by the Execute component /home/lio/MantaRay/Andrei/octrees/Scene_Overcast10klux.oct | pfilt -x /2 -y /2 > ~/MantaRay/Andrei/images/2023_03_11_1204_07_rtpict_rendering_aa0.1_5000_sunny_ad4096_1500.hdr;echo ~/MantaRay/Andrei/images/2023_03_11_1204_07_rtpict_rendering_aa0.1_5000_sunny_ad4096_1500.hdr


- - -

mkdir -p ~/MantaRay/Andrei/images/
rtpict -n 62 -w -vf /home/lio/MantaRay/Andrei/views/Perspective1.vf -x 400 -y 300 -ab 3 -ad 4096 -lw 0.0003 -aa 0.1 -ar 256 -as 1024 -af ambfile_2023_03_12_2113_03.af

# This is a MantaRay Dictionary
# Globals will be updated in Execute component
# Locals will not!
# This tail is ignored by the Execute component /home/lio/MantaRay/Andrei/octrees/Scene_Overcast10klux.oct > /dev/null
rtpict -n 62 -w -vf /home/lio/MantaRay/Andrei/views/Perspective1.vf -x 5000 -y 3333.333333 -ab 3 -ad 4096 -lw 0.0003 -aa 0.1 -ar 256 -as 1024 -af ambfile_2023_03_12_2113_03.af

# This is a MantaRay Dictionary
# Globals will be updated in Execute component
# Locals will not!
# This tail is ignored by the Execute component /home/lio/MantaRay/Andrei/octrees/Scene_Overcast10klux.oct | pfilt -x /2 -y /2 > ~/MantaRay/Andrei/images/2023_03_11_1204_07_rtpict_rendering_aa0.1_5000_sunny_ad4096_1600.hdr;echo ~/MantaRay/Andrei/images/2023_03_11_1204_07_rtpict_rendering_aa0.1_5000_sunny_ad4096_1600.hdr


- - -

mkdir -p ~/MantaRay/Andrei/images/
rtpict -n 62 -w -vf /home/lio/MantaRay/Andrei/views/Perspective1.vf -x 400 -y 300 -ab 3 -ad 4096 -lw 0.0003 -aa 0.1 -ar 256 -as 1024 -af ambfile_2023_03_12_2113_03.af

# This is a MantaRay Dictionary
# Globals will be updated in Execute component
# Locals will not!
# This tail is ignored by the Execute component /home/lio/MantaRay/Andrei/octrees/Scene_Overcast10klux.oct > /dev/null
rtpict -n 62 -w -vf /home/lio/MantaRay/Andrei/views/Perspective1.vf -x 5000 -y 3333.333333 -ab 3 -ad 4096 -lw 0.0003 -aa 0.1 -ar 256 -as 1024 -af ambfile_2023_03_12_2113_03.af

# This is a MantaRay Dictionary
# Globals will be updated in Execute component
# Locals will not!
# This tail is ignored by the Execute component /home/lio/MantaRay/Andrei/octrees/Scene_Overcast10klux.oct | pfilt -x /2 -y /2 > ~/MantaRay/Andrei/images/2023_03_11_1204_07_rtpict_rendering_aa0.1_5000_sunny_ad4096_1700.hdr;echo ~/MantaRay/Andrei/images/2023_03_11_1204_07_rtpict_rendering_aa0.1_5000_sunny_ad4096_1700.hdr""",
    fireLogs=False,
    lastRunTime=0,
    suppressWarnings=False)  # -> Stdout, Stderr_, Ran
download_13 = Download(LinuxFilePaths=executessh_54.Stdout, Run=executessh_54.Ran)  # -> FilePaths, Status, Ran
imageviewer_10 = LBImageViewer(ImagePath_=download_13.FilePaths, _scale_=2, DisableClickable=False, SaveImgWithCoords=False, scale=2)  # -> ImagePath, Values, GIF

y_5 = Number(y_3)

overrides_59 = ApplyOverrides(
    Input=panel_122,
    Vf=graft(viewfile_6),
    X=graft(x_4),
    Y=graft(y_5),
    RadOptions=graft("-ab 3 -ad 16 -aa 0"),
    Oct=graft(list_2),
    Target=graft("<time>_rtpict_rendering_aa0_<x>_sunny_ad16_<h>.hdr"),
    Time=graft("<time>"),
    H=graft(hours_8))  # -> Output, DynamicOutput

python_20 = GhPythonScript(update=flatten(overrides_59.Output))  # -> time; inputs update: tree; same code as python_13

overrides_60 = ApplyOverrides(
    Input=panel_123,
    Vf=graft(viewfile_6),
    X=graft(x_5),
    Y=graft(y_4),
    RadOptions=graft("-ab 3 -ad 16 -aa 0"),
    Oct=graft(list_2),
    Target=graft("<time>_rtpict_rendering_aa0_<x>_sunny_ad8_<h>_illum.hdr"),
    Time=graft(python_20),
    H=graft(hours_8))  # -> Output, DynamicOutput
executessh_55 = ExecuteSSH(
    _SSHCommands_=flatten(overrides_60.DynamicOutput),
    Run=run_8,
    addPrefix=True,
    description="""mkdir -p ~/MantaRay/Andrei/images/
rtpict -i -w -n 61 -vf /home/lio/MantaRay/Andrei/views/Perspective1.vf -x 1500 -y 1000 -ab 3 -ad 16 -aa 0 /home/lio/MantaRay/Andrei/octrees/Scene_Overcast10klux.oct | pfilt -x /4 -y /4 -r 0.7 > ~/MantaRay/Andrei/images/2023_03_12_2113_03_rtpict_rendering_aa0_1500_sunny_ad8_ovc_illum.hdr;echo ~/MantaRay/Andrei/images/2023_03_12_2113_03_rtpict_rendering_aa0_1500_sunny_ad8_ovc_illum.hdr
mkdir -p ~/MantaRay/Andrei/images/
rtpict -i -w -n 61 -vf /home/lio/MantaRay/Andrei/views/Perspective1.vf -x 1500 -y 1000 -ab 3 -ad 16 -aa 0 /home/lio/MantaRay/Andrei/octrees/Scene_Overcast10klux.oct | pfilt -x /4 -y /4 -r 0.7 > ~/MantaRay/Andrei/images/2023_03_12_2113_03_rtpict_rendering_aa0_1500_sunny_ad8_0800_illum.hdr;echo ~/MantaRay/Andrei/images/2023_03_12_2113_03_rtpict_rendering_aa0_1500_sunny_ad8_0800_illum.hdr
mkdir -p ~/MantaRay/Andrei/images/
rtpict -i -w -n 61 -vf /home/lio/MantaRay/Andrei/views/Perspective1.vf -x 1500 -y 1000 -ab 3 -ad 16 -aa 0 /home/lio/MantaRay/Andrei/octrees/Scene_Overcast10klux.oct | pfilt -x /4 -y /4 -r 0.7 > ~/MantaRay/Andrei/images/2023_03_12_2113_03_rtpict_rendering_aa0_1500_sunny_ad8_0900_illum.hdr;echo ~/MantaRay/Andrei/images/2023_03_12_2113_03_rtpict_rendering_aa0_1500_sunny_ad8_0900_illum.hdr
mkdir -p ~/MantaRay/Andrei/images/
rtpict -i -w -n 61 -vf /home/lio/MantaRay/Andrei/views/Perspective1.vf -x 1500 -y 1000 -ab 3 -ad 16 -aa 0 /home/lio/MantaRay/Andrei/octrees/Scene_Overcast10klux.oct | pfilt -x /4 -y /4 -r 0.7 > ~/MantaRay/Andrei/images/2023_03_12_2113_03_rtpict_rendering_aa0_1500_sunny_ad8_1000_illum.hdr;echo ~/MantaRay/Andrei/images/2023_03_12_2113_03_rtpict_rendering_aa0_1500_sunny_ad8_1000_illum.hdr
mkdir -p ~/MantaRay/Andrei/images/
rtpict -i -w -n 61 -vf /home/lio/MantaRay/Andrei/views/Perspective1.vf -x 1500 -y 1000 -ab 3 -ad 16 -aa 0 /home/lio/MantaRay/Andrei/octrees/Scene_Overcast10klux.oct | pfilt -x /4 -y /4 -r 0.7 > ~/MantaRay/Andrei/images/2023_03_12_2113_03_rtpict_rendering_aa0_1500_sunny_ad8_1100_illum.hdr;echo ~/MantaRay/Andrei/images/2023_03_12_2113_03_rtpict_rendering_aa0_1500_sunny_ad8_1100_illum.hdr
mkdir -p ~/MantaRay/Andrei/images/
rtpict -i -w -n 61 -vf /home/lio/MantaRay/Andrei/views/Perspective1.vf -x 1500 -y 1000 -ab 3 -ad 16 -aa 0 /home/lio/MantaRay/Andrei/octrees/Scene_Overcast10klux.oct | pfilt -x /4 -y /4 -r 0.7 > ~/MantaRay/Andrei/images/2023_03_12_2113_03_rtpict_rendering_aa0_1500_sunny_ad8_1200_illum.hdr;echo ~/MantaRay/Andrei/images/2023_03_12_2113_03_rtpict_rendering_aa0_1500_sunny_ad8_1200_illum.hdr
mkdir -p ~/MantaRay/Andrei/images/
rtpict -i -w -n 61 -vf /home/lio/MantaRay/Andrei/views/Perspective1.vf -x 1500 -y 1000 -ab 3 -ad 16 -aa 0 /home/lio/MantaRay/Andrei/octrees/Scene_Overcast10klux.oct | pfilt -x /4 -y /4 -r 0.7 > ~/MantaRay/Andrei/images/2023_03_12_2113_03_rtpict_rendering_aa0_1500_sunny_ad8_1300_illum.hdr;echo ~/MantaRay/Andrei/images/2023_03_12_2113_03_rtpict_rendering_aa0_1500_sunny_ad8_1300_illum.hdr
mkdir -p ~/MantaRay/Andrei/images/
rtpict -i -w -n 61 -vf /home/lio/MantaRay/Andrei/views/Perspective1.vf -x 1500 -y 1000 -ab 3 -ad 16 -aa 0 /home/lio/MantaRay/Andrei/octrees/Scene_Overcast10klux.oct | pfilt -x /4 -y /4 -r 0.7 > ~/MantaRay/Andrei/images/2023_03_12_2113_03_rtpict_rendering_aa0_1500_sunny_ad8_1400_illum.hdr;echo ~/MantaRay/Andrei/images/2023_03_12_2113_03_rtpict_rendering_aa0_1500_sunny_ad8_1400_illum.hdr
mkdir -p ~/MantaRay/Andrei/images/
rtpict -i -w -n 61 -vf /home/lio/MantaRay/Andrei/views/Perspective1.vf -x 1500 -y 1000 -ab 3 -ad 16 -aa 0 /home/lio/MantaRay/Andrei/octrees/Scene_Overcast10klux.oct | pfilt -x /4 -y /4 -r 0.7 > ~/MantaRay/Andrei/images/2023_03_12_2113_03_rtpict_rendering_aa0_1500_sunny_ad8_1500_illum.hdr;echo ~/MantaRay/Andrei/images/2023_03_12_2113_03_rtpict_rendering_aa0_1500_sunny_ad8_1500_illum.hdr
mkdir -p ~/MantaRay/Andrei/images/
rtpict -i -w -n 61 -vf /home/lio/MantaRay/Andrei/views/Perspective1.vf -x 1500 -y 1000 -ab 3 -ad 16 -aa 0 /home/lio/MantaRay/Andrei/octrees/Scene_Overcast10klux.oct | pfilt -x /4 -y /4 -r 0.7 > ~/MantaRay/Andrei/images/2023_03_12_2113_03_rtpict_rendering_aa0_1500_sunny_ad8_1600_illum.hdr;echo ~/MantaRay/Andrei/images/2023_03_12_2113_03_rtpict_rendering_aa0_1500_sunny_ad8_1600_illum.hdr
mkdir -p ~/MantaRay/Andrei/images/
rtpict -i -w -n 61 -vf /home/lio/MantaRay/Andrei/views/Perspective1.vf -x 1500 -y 1000 -ab 3 -ad 16 -aa 0 /home/lio/MantaRay/Andrei/octrees/Scene_Overcast10klux.oct | pfilt -x /4 -y /4 -r 0.7 > ~/MantaRay/Andrei/images/2023_03_12_2113_03_rtpict_rendering_aa0_1500_sunny_ad8_1700_illum.hdr;echo ~/MantaRay/Andrei/images/2023_03_12_2113_03_rtpict_rendering_aa0_1500_sunny_ad8_1700_illum.hdr""",
    fireLogs=False,
    lastRunTime=0,
    suppressWarnings=False)  # -> Stdout, Stderr_, Ran
overrides_61 = ApplyOverrides(Input=overrides_59.DynamicOutput, Time=graft(python_20))  # -> Output, DynamicOutput
executessh_56 = ExecuteSSH(
    _SSHCommands_=flatten(overrides_61.DynamicOutput),
    Run=run_7,
    addPrefix=True,
    description="""mkdir -p ~/MantaRay/Andrei/images/
rtpict -n 62 -w -vf /home/lio/MantaRay/Andrei/views/Perspective1.vf -x 1500 -y 1000 -ab 3 -ad 16 -aa 0 /home/lio/MantaRay/Andrei/octrees/Scene_Overcast10klux.oct | pfilt -x /4 -y /4 -r 0.7 > ~/MantaRay/Andrei/images/2023_03_12_2113_03_rtpict_rendering_aa0_1500_sunny_ad16_ovc.hdr;echo ~/MantaRay/Andrei/images/2023_03_12_2113_03_rtpict_rendering_aa0_1500_sunny_ad16_ovc.hdr
mkdir -p ~/MantaRay/Andrei/images/
rtpict -n 62 -w -vf /home/lio/MantaRay/Andrei/views/Perspective1.vf -x 1500 -y 1000 -ab 3 -ad 16 -aa 0 /home/lio/MantaRay/Andrei/octrees/Scene_Overcast10klux.oct | pfilt -x /4 -y /4 -r 0.7 > ~/MantaRay/Andrei/images/2023_03_12_2113_03_rtpict_rendering_aa0_1500_sunny_ad16_0800.hdr;echo ~/MantaRay/Andrei/images/2023_03_12_2113_03_rtpict_rendering_aa0_1500_sunny_ad16_0800.hdr
mkdir -p ~/MantaRay/Andrei/images/
rtpict -n 62 -w -vf /home/lio/MantaRay/Andrei/views/Perspective1.vf -x 1500 -y 1000 -ab 3 -ad 16 -aa 0 /home/lio/MantaRay/Andrei/octrees/Scene_Overcast10klux.oct | pfilt -x /4 -y /4 -r 0.7 > ~/MantaRay/Andrei/images/2023_03_12_2113_03_rtpict_rendering_aa0_1500_sunny_ad16_0900.hdr;echo ~/MantaRay/Andrei/images/2023_03_12_2113_03_rtpict_rendering_aa0_1500_sunny_ad16_0900.hdr
mkdir -p ~/MantaRay/Andrei/images/
rtpict -n 62 -w -vf /home/lio/MantaRay/Andrei/views/Perspective1.vf -x 1500 -y 1000 -ab 3 -ad 16 -aa 0 /home/lio/MantaRay/Andrei/octrees/Scene_Overcast10klux.oct | pfilt -x /4 -y /4 -r 0.7 > ~/MantaRay/Andrei/images/2023_03_12_2113_03_rtpict_rendering_aa0_1500_sunny_ad16_1000.hdr;echo ~/MantaRay/Andrei/images/2023_03_12_2113_03_rtpict_rendering_aa0_1500_sunny_ad16_1000.hdr
mkdir -p ~/MantaRay/Andrei/images/
rtpict -n 62 -w -vf /home/lio/MantaRay/Andrei/views/Perspective1.vf -x 1500 -y 1000 -ab 3 -ad 16 -aa 0 /home/lio/MantaRay/Andrei/octrees/Scene_Overcast10klux.oct | pfilt -x /4 -y /4 -r 0.7 > ~/MantaRay/Andrei/images/2023_03_12_2113_03_rtpict_rendering_aa0_1500_sunny_ad16_1100.hdr;echo ~/MantaRay/Andrei/images/2023_03_12_2113_03_rtpict_rendering_aa0_1500_sunny_ad16_1100.hdr
mkdir -p ~/MantaRay/Andrei/images/
rtpict -n 62 -w -vf /home/lio/MantaRay/Andrei/views/Perspective1.vf -x 1500 -y 1000 -ab 3 -ad 16 -aa 0 /home/lio/MantaRay/Andrei/octrees/Scene_Overcast10klux.oct | pfilt -x /4 -y /4 -r 0.7 > ~/MantaRay/Andrei/images/2023_03_12_2113_03_rtpict_rendering_aa0_1500_sunny_ad16_1200.hdr;echo ~/MantaRay/Andrei/images/2023_03_12_2113_03_rtpict_rendering_aa0_1500_sunny_ad16_1200.hdr
mkdir -p ~/MantaRay/Andrei/images/
rtpict -n 62 -w -vf /home/lio/MantaRay/Andrei/views/Perspective1.vf -x 1500 -y 1000 -ab 3 -ad 16 -aa 0 /home/lio/MantaRay/Andrei/octrees/Scene_Overcast10klux.oct | pfilt -x /4 -y /4 -r 0.7 > ~/MantaRay/Andrei/images/2023_03_12_2113_03_rtpict_rendering_aa0_1500_sunny_ad16_1300.hdr;echo ~/MantaRay/Andrei/images/2023_03_12_2113_03_rtpict_rendering_aa0_1500_sunny_ad16_1300.hdr
mkdir -p ~/MantaRay/Andrei/images/
rtpict -n 62 -w -vf /home/lio/MantaRay/Andrei/views/Perspective1.vf -x 1500 -y 1000 -ab 3 -ad 16 -aa 0 /home/lio/MantaRay/Andrei/octrees/Scene_Overcast10klux.oct | pfilt -x /4 -y /4 -r 0.7 > ~/MantaRay/Andrei/images/2023_03_12_2113_03_rtpict_rendering_aa0_1500_sunny_ad16_1400.hdr;echo ~/MantaRay/Andrei/images/2023_03_12_2113_03_rtpict_rendering_aa0_1500_sunny_ad16_1400.hdr
mkdir -p ~/MantaRay/Andrei/images/
rtpict -n 62 -w -vf /home/lio/MantaRay/Andrei/views/Perspective1.vf -x 1500 -y 1000 -ab 3 -ad 16 -aa 0 /home/lio/MantaRay/Andrei/octrees/Scene_Overcast10klux.oct | pfilt -x /4 -y /4 -r 0.7 > ~/MantaRay/Andrei/images/2023_03_12_2113_03_rtpict_rendering_aa0_1500_sunny_ad16_1500.hdr;echo ~/MantaRay/Andrei/images/2023_03_12_2113_03_rtpict_rendering_aa0_1500_sunny_ad16_1500.hdr
mkdir -p ~/MantaRay/Andrei/images/
rtpict -n 62 -w -vf /home/lio/MantaRay/Andrei/views/Perspective1.vf -x 1500 -y 1000 -ab 3 -ad 16 -aa 0 /home/lio/MantaRay/Andrei/octrees/Scene_Overcast10klux.oct | pfilt -x /4 -y /4 -r 0.7 > ~/MantaRay/Andrei/images/2023_03_12_2113_03_rtpict_rendering_aa0_1500_sunny_ad16_1600.hdr;echo ~/MantaRay/Andrei/images/2023_03_12_2113_03_rtpict_rendering_aa0_1500_sunny_ad16_1600.hdr
mkdir -p ~/MantaRay/Andrei/images/
rtpict -n 62 -w -vf /home/lio/MantaRay/Andrei/views/Perspective1.vf -x 1500 -y 1000 -ab 3 -ad 16 -aa 0 /home/lio/MantaRay/Andrei/octrees/Scene_Overcast10klux.oct | pfilt -x /4 -y /4 -r 0.7 > ~/MantaRay/Andrei/images/2023_03_12_2113_03_rtpict_rendering_aa0_1500_sunny_ad16_1700.hdr;echo ~/MantaRay/Andrei/images/2023_03_12_2113_03_rtpict_rendering_aa0_1500_sunny_ad16_1700.hdr""",
    fireLogs=False,
    lastRunTime=0,
    suppressWarnings=False)  # -> Stdout, Stderr_, Ran

# ----
# orig dimensions
panel_124 = Panel("getinfo <f>")
overrides_62 = ApplyOverrides(Input=panel_124, F=graft(executessh_55.Stdout))  # -> Output, DynamicOutput
x_6 = Number(x_2)
executessh_57 = ExecuteSSH(
    _SSHCommands_=overrides_62.DynamicOutput,
    Run=executessh_55.Ran,
    addPrefix=True,
    description="getinfo <f>",
    fireLogs=False,
    lastRunTime=0,
    suppressWarnings=False)  # -> Stdout, Stderr_, Ran
division_5 = Division(A=x_6, B=4)
python_21 = GhPythonScript(x=executessh_57.Stdout)  # -> out, org_y
# ---------- python_21: Python ----------
__author__ = "mm1013"
__version__ = "2022.08.31"

import rhinoscriptsyntax as rs

lines = x.replace("\r","").split("\n")

for l in lines:
    line = l.strip()
    if line.startswith("rtrace"):
        print "RTRACE"
        li = line.split("-y")
        
        print li[1].strip().split(" ")[0]
        org_y = int(li[1].strip().split(" ")[0])
    elif line.startswith("pfilt"):
        print "PFIlT"
        li = line.split("-y")
        
        print li[1].strip().split(" ")[0]
        org_y = org_y / float(li[1].strip().split(" ")[0].replace("/",""))
# ---------- end python_21 ----------

panel_125 = Panel("""pcond -h <hdr> <hdr-.>_exposed.hdr
ra_tiff <hdr-.>_exposed.hdr <hdr-.>_exposed.tif
convert <hdr-.>_exposed.tif <hdr-.>_exposed.png
echo <hdr-.>_exposed.png""")
panel_126 = Panel("""ra_tiff <hdr-.>.hdr <hdr-.>.tif
convert <hdr-.>.tif <hdr-.>.png
echo <hdr-.>.png""")
entwine_13 = Entwine(Branch00=panel_125, Branch01=panel_126, FlattenInputs=True)
overrides_63 = ApplyOverrides(Input=entwine_13, Hdr=graft(executessh_56.Stdout))  # -> Output, DynamicOutput
executessh_58 = ExecuteSSH(
    _SSHCommands_=overrides_63.DynamicOutput,
    Run=executessh_56.Ran,
    addPrefix=True,
    description="""pcond -h <hdr> <hdr>_exposed.hdr
ra_tiff <hdr>_exposed.hdr <hdr>_exposed.tif
convert <hdr>_exposed.tif <hdr>_exposed.png
echo <hdr>_exposed.png


- - -

ra_tiff <hdr>.hdr <hdr>.tif
convert <hdr>.tif <hdr>.png
echo <hdr>.png""",
    fireLogs=False,
    lastRunTime=0,
    suppressWarnings=False)  # -> Stdout, Stderr_, Ran
download_14 = Download(LinuxFilePaths=executessh_58.Stdout, Run=executessh_58.Ran)  # -> flatten(FilePaths), Status, Ran
item_7 = ListItem(List=download_14.FilePaths, Index=0, Wrap=True)  # -> Item, Item1

# ----
# blurring the irrad
panel_127 = Panel("pfilt -x /3 -y /3 -r 1 <file> | pfilt -1 -x <x> -y <y> > <file-.>_filteredBlur.hdr;ra_tiff <file-.>_filteredBlur.hdr <file-.>_filteredBlur.tif;echo <file-.>_filteredBlur.hdr")
overrides_64 = ApplyOverrides(Input=panel_127, File=graft(executessh_55.Stdout), X=graft(division_5), Y=graft(python_21.org_y))  # -> Output, DynamicOutput
executessh_59 = ExecuteSSH(
    _SSHCommands_=overrides_64.DynamicOutput,
    Run=executessh_55.Ran,
    addPrefix=True,
    description="pfilt -x /3 -y /3 -r 1 <file> | pfilt -1 -x 375 -y <y> > <file>_filteredBlur.hdr;ra_tiff <file>_filteredBlur.hdr <file>_filteredBlur.tif;echo <file>_filteredBlur.hdr",
    fireLogs=False,
    lastRunTime=0,
    suppressWarnings=False)  # -> Stdout, Stderr_, Ran

# ----
# FalseColor
panel_128 = Panel("""pfilt -x /2 -y /2 -r 0.7 <irrad> | falsecolor -s 2000 -l lux -lw 200 -lh 300 > <irrad-.>_fc2.hdr
ra_tiff <irrad-.>_fc2.hdr <irrad-.>_fc2.tif
convert <irrad-.>_fc2.tif <irrad-.>_fc2.png
rm <irrad-.>_fc2.hdr
rm <irrad-.>_fc2.tif
echo <irrad-.>_fc2.png""")
overrides_65 = ApplyOverrides(Input=panel_128, Irrad=graft(executessh_55.Stdout))  # -> Output, DynamicOutput
executessh_60 = ExecuteSSH(
    _SSHCommands_=overrides_65.DynamicOutput,
    Run=executessh_55.Ran,
    addPrefix=True,
    description="""pfilt -x /2 -y /2 -r 0.7 <irrad> | falsecolor -s 2000 -l lux -lw 200 -lh 300 > <irrad>_fc2.hdr
ra_tiff <irrad>_fc2.hdr <irrad>_fc2.tif
convert <irrad>_fc2.tif <irrad>_fc2.png
rm <irrad>_fc2.hdr
rm <irrad>_fc2.tif
echo <irrad>_fc2.png""",
    fireLogs=False,
    lastRunTime=0,
    suppressWarnings=False)  # -> Stdout, Stderr_, Ran
download_15 = Download(LinuxFilePaths=executessh_60.Stdout, Run=executessh_60.Ran)  # -> FilePaths, Status, Ran

# ----
# overlay illuminance falsecolor on luminance picture
panel_129 = Panel("""pcond -h <rad> | pfilt -x /2 -y /2 -r 0.7 > <rad-.>exposed_sd.hdr
pfilt -x /2 -y /2 -r 0.7 <irrad> > <irrad-.>_sd.hdr
falsecolor -s 2000 -l lux -lw 200 -lh 300 -p <rad-.>exposed_sd.hdr -i <irrad-.>_sd.hdr -cl > <rad-.>_fc.hdr
ra_tiff <rad-.>_fc.hdr <rad-.>_fc.tif
convert <rad-.>_fc.tif <rad-.>_fc.png
echo <rad-.>_fc.hdr""")
panel_130 = Panel("-log 2")
overrides_66 = ApplyOverrides(Input=panel_129, Rad=graft(executessh_56.Stdout), Irrad=graft(executessh_59.Stdout))  # -> Output, DynamicOutput
executessh_61 = ExecuteSSH(
    _SSHCommands_=overrides_66.DynamicOutput,
    Run=[executessh_55.Ran, executessh_56.Ran],
    addPrefix=True,
    description="""pcond -h <rad> | pfilt -x /2 -y /2 -r 0.7 > <rad>exposed_sd.hdr
pfilt -x /2 -y /2 -r 0.7 <irrad> > <irrad>_sd.hdr
falsecolor -s 2000 -l lux -lw 200 -lh 300 -p <rad>exposed_sd.hdr -i <irrad>_sd.hdr -cl > <rad>_fc.hdr
ra_tiff <rad>_fc.hdr <rad>_fc.tif
convert <rad>_fc.tif <rad>_fc.png
echo <rad>_fc.hdr""",
    fireLogs=False,
    lastRunTime=0,
    suppressWarnings=False)  # -> Stdout, Stderr_, Ran
download_16 = Download(LinuxFilePaths=executessh_61.Stdout, Run=executessh_61.Ran)  # -> FilePaths, Status, Ran

imageviewer_11 = LBImageViewer(ImagePath_=item_7.Item, _scale_=3, DisableClickable=False, SaveImgWithCoords=False, scale=3)  # -> ImagePath, Values, GIF
imageviewer_12 = LBImageViewer(ImagePath_=download_15.FilePaths, _scale_=2, DisableClickable=False, SaveImgWithCoords=False, scale=2)  # -> ImagePath, Values, GIF
imageviewer_13 = LBImageViewer(ImagePath_=download_16.FilePaths, _scale_=2, DisableClickable=False, SaveImgWithCoords=False, scale=2)  # -> ImagePath, Values, GIF

# ----
# Using PCOND to set automatic exposure
# and convert to PNG
panel_131 = Panel("""pcond -h <hdr> <hdr-.>_exposed.hdr
ra_tiff <hdr-.>_exposed.hdr <hdr-.>_exposed.tif
convert <hdr-.>_exposed.tif <hdr-.>_exposed.png
echo <hdr-.>_exposed.png""")
overrides_67 = ApplyOverrides(Input=panel_131, Hdr=graft(executessh_42.Stdout))  # -> Output, DynamicOutput
executessh_62 = ExecuteSSH(
    _SSHCommands_=overrides_67.DynamicOutput,
    Run=or,
    addPrefix=True,
    description="""pcond -h /home/lio/MantaRay/Andrei/images/2023_01_18_1002_49_Perspective_render.hdr /home/lio/MantaRay/Andrei/images/2023_01_18_1002_49_Perspective_render_exposed.hdr
ra_tiff /home/lio/MantaRay/Andrei/images/2023_01_18_1002_49_Perspective_render_exposed.hdr /home/lio/MantaRay/Andrei/images/2023_01_18_1002_49_Perspective_render_exposed.tif
convert /home/lio/MantaRay/Andrei/images/2023_01_18_1002_49_Perspective_render_exposed.tif /home/lio/MantaRay/Andrei/images/2023_01_18_1002_49_Perspective_render_exposed.png
echo /home/lio/MantaRay/Andrei/images/2023_01_18_1002_49_Perspective_render_exposed.png""",
    fireLogs=False,
    lastRunTime=2688,
    suppressWarnings=False,
    results="/home/lio/MantaRay/Andrei/images/2023_01_18_1002_49_Perspective_render_exposed.png",
    commands="""pcond -h /home/lio/MantaRay/Andrei/images/2023_01_18_1002_49_Perspective_render.hdr /home/lio/MantaRay/Andrei/images/2023_01_18_1002_49_Perspective_render_exposed.hdr
ra_tiff /home/lio/MantaRay/Andrei/images/2023_01_18_1002_49_Perspective_render_exposed.hdr /home/lio/MantaRay/Andrei/images/2023_01_18_1002_49_Perspective_render_exposed.tif
convert /home/lio/MantaRay/Andrei/images/2023_01_18_1002_49_Perspective_render_exposed.tif /home/lio/MantaRay/Andrei/images/2023_01_18_1002_49_Perspective_render_exposed.png
echo /home/lio/MantaRay/Andrei/images/2023_01_18_1002_49_Perspective_render_exposed.png""")  # -> Stdout, Stderr_, Ran
download_17 = Download(
    LinuxFilePaths=executessh_62.Stdout,
    Run=executessh_62.Ran,
    stdouts="C:\Users\mm1013\MantaRay\Andrei\2023_01_18_1002_49_Perspective_render_exposed.png")  # -> FilePaths, Status, Ran

denoiser_2 = DenoiseImage(InputImage=download_17.FilePaths, PathToDenoisr="C:\Denoiser_v1.6\Denoiser.exe")

imageviewer_14 = LBImageViewer(ImagePath_=denoiser_2, _scale_="1", DisableClickable=False, SaveImgWithCoords=False, scale=1)  # -> ImagePath, Values, GIF

# ----
# Using PCOND to set automatic exposure
# and convert to PNG
# pcompos -a 15 -b 1 1 1 -s 5 <proj>/mtxs/skyRenders/skyTregenza*.hdr > <proj>/mtxs/skyRenders/all.hdr
panel_132 = Panel("pcond -h <hdr> <hdr-.>_exposed.hdr;echo <hdr-.>_exposed.hdr")
panel_133 = Panel("psign -h 15 <h> | pcompos <target> 0 0 - 570 20 > <target-.>_s.hdr;echo <target-.>_s.hdr")
hours_9 = Number(hours)
panel_134 = Panel("""pcompos -a 3 -s 10 -b 0.2 0.2 0.2 <hdrFiles> > <proj>/images/<target>
ra_tiff <proj>/images/<target> <proj>/images/<target-.>.tif
convert <proj>/images/<target-.>.tif <proj>/images/<target-.>.png
echo <proj>/images/<target-.>.png""")
panel_135 = Panel("""pcond -h <hdr> <hdr-.>_exposed.hdr
ra_tiff <hdr-.>_exposed.hdr <hdr-.>_exposed.tif
convert <hdr-.>_exposed.tif <hdr-.>_exposed.png
echo <hdr-.>_exposed.png""")
# -la for titel: pcompos -la -a 3 -s 10 -b 1 1 1 <hdrFiles> > <proj>/images/<target>
# echo <proj>/images/<target>
panel_136 = Panel("combined.hdr")

overrides_68 = ApplyOverrides(Input=panel_132, Hdr=graft(executessh_36.Stdout))  # -> Output, DynamicOutput
executessh_63 = ExecuteSSH(
    _SSHCommands_=overrides_68.DynamicOutput,
    Run=executessh_36.Ran,
    addPrefix=True,
    description="pcond -h /home/lio/simulation/Boston_Skylights/images/2023_01_09_1607_rtpict_rendering_aa0_5000_sunny_ad32_0/radiance_filtered.hdr /home/lio/simulation/Boston_Skylights/images/2023_01_09_1607_rtpict_rendering_aa0_5000_sunny_ad32_0/radiance_filtered_exposed.hdr;echo /home/lio/simulation/Boston_Skylights/images/2023_01_09_1607_rtpict_rendering_aa0_5000_sunny_ad32_0/radiance_filtered_exposed.hdr",
    fireLogs=False,
    lastRunTime=537,
    suppressWarnings=False,
    results="/home/lio/simulation/Boston_Skylights/images/2023_01_09_1607_rtpict_rendering_aa0_5000_sunny_ad32_0/radiance_filtered_exposed.hdr",
    commands="pcond -h /home/lio/simulation/Boston_Skylights/images/2023_01_09_1607_rtpict_rendering_aa0_5000_sunny_ad32_0/radiance_filtered.hdr /home/lio/simulation/Boston_Skylights/images/2023_01_09_1607_rtpict_rendering_aa0_5000_sunny_ad32_0/radiance_filtered_exposed.hdr;echo /home/lio/simulation/Boston_Skylights/images/2023_01_09_1607_rtpict_rendering_aa0_5000_sunny_ad32_0/radiance_filtered_exposed.hdr")  # -> Stdout, Stderr_, Ran
overrides_69 = ApplyOverrides(Input=panel_133, H=graft(hours_9), Target=graft(executessh_63.Stdout))  # -> Output, DynamicOutput
imageviewer_15 = LBImageViewer(ImagePath_=download_7.FilePaths, _scale_="1", DisableClickable=False, SaveImgWithCoords=False, scale=1)  # -> ImagePath, Values, GIF
imageviewer_16 = LBImageViewer(ImagePath_=download_5.FilePaths, _scale_="1", DisableClickable=False, SaveImgWithCoords=False, scale=1)  # -> ImagePath, Values, GIF
lng = ListLength(List=flatten(executessh_63.Stdout))
imageviewer_17 = LBImageViewer(ImagePath_=item_5, _scale_="1", DisableClickable=False, SaveImgWithCoords=False, scale=1)  # -> ImagePath, Values, GIF
imageviewer_18 = LBImageViewer(ImagePath_=denoiser, _scale_="1", DisableClickable=False, SaveImgWithCoords=False, scale=1)  # -> ImagePath, Values, GIF
python_22 = GhPythonScript(cnt=lng, run=executessh_63.Ran)  # -> out, ran; inputs cnt: Int32, run: Boolean
# ---------- python_22: Python ----------
__author__ = "mm1013"
__version__ = "2022.08.30"

import rhinoscriptsyntax as rs

ran = cnt > 1 and run
# ---------- end python_22 ----------
executessh_64 = ExecuteSSH(
    _SSHCommands_=overrides_69.DynamicOutput,
    Run=python_22.ran,
    addPrefix=True,
    description="""psign -h 15 800 | pcompos /home/lio/simulation/Boston_Skylights/images/2023_01_09_1607_rtpict_rendering_aa0_5000_sunny_ad32_0/radiance_filtered_exposed.hdr 0 0 - 570 20 > /home/lio/simulation/Boston_Skylights/images/2023_01_09_1607_rtpict_rendering_aa0_5000_sunny_ad32_0/radiance_filtered_exposed_s.hdr;echo /home/lio/simulation/Boston_Skylights/images/2023_01_09_1607_rtpict_rendering_aa0_5000_sunny_ad32_0/radiance_filtered_exposed_s.hdr


- - -

psign -h 15 900 | pcompos /home/lio/simulation/Boston_Skylights/images/2023_01_09_1607_rtpict_rendering_aa0_5000_sunny_ad32_0/radiance_filtered_exposed.hdr 0 0 - 570 20 > /home/lio/simulation/Boston_Skylights/images/2023_01_09_1607_rtpict_rendering_aa0_5000_sunny_ad32_0/radiance_filtered_exposed_s.hdr;echo /home/lio/simulation/Boston_Skylights/images/2023_01_09_1607_rtpict_rendering_aa0_5000_sunny_ad32_0/radiance_filtered_exposed_s.hdr


- - -

psign -h 15 1000 | pcompos /home/lio/simulation/Boston_Skylights/images/2023_01_09_1607_rtpict_rendering_aa0_5000_sunny_ad32_0/radiance_filtered_exposed.hdr 0 0 - 570 20 > /home/lio/simulation/Boston_Skylights/images/2023_01_09_1607_rtpict_rendering_aa0_5000_sunny_ad32_0/radiance_filtered_exposed_s.hdr;echo /home/lio/simulation/Boston_Skylights/images/2023_01_09_1607_rtpict_rendering_aa0_5000_sunny_ad32_0/radiance_filtered_exposed_s.hdr


- - -

psign -h 15 1100 | pcompos /home/lio/simulation/Boston_Skylights/images/2023_01_09_1607_rtpict_rendering_aa0_5000_sunny_ad32_0/radiance_filtered_exposed.hdr 0 0 - 570 20 > /home/lio/simulation/Boston_Skylights/images/2023_01_09_1607_rtpict_rendering_aa0_5000_sunny_ad32_0/radiance_filtered_exposed_s.hdr;echo /home/lio/simulation/Boston_Skylights/images/2023_01_09_1607_rtpict_rendering_aa0_5000_sunny_ad32_0/radiance_filtered_exposed_s.hdr


- - -

psign -h 15 1200 | pcompos /home/lio/simulation/Boston_Skylights/images/2023_01_09_1607_rtpict_rendering_aa0_5000_sunny_ad32_0/radiance_filtered_exposed.hdr 0 0 - 570 20 > /home/lio/simulation/Boston_Skylights/images/2023_01_09_1607_rtpict_rendering_aa0_5000_sunny_ad32_0/radiance_filtered_exposed_s.hdr;echo /home/lio/simulation/Boston_Skylights/images/2023_01_09_1607_rtpict_rendering_aa0_5000_sunny_ad32_0/radiance_filtered_exposed_s.hdr


- - -

psign -h 15 1300 | pcompos /home/lio/simulation/Boston_Skylights/images/2023_01_09_1607_rtpict_rendering_aa0_5000_sunny_ad32_0/radiance_filtered_exposed.hdr 0 0 - 570 20 > /home/lio/simulation/Boston_Skylights/images/2023_01_09_1607_rtpict_rendering_aa0_5000_sunny_ad32_0/radiance_filtered_exposed_s.hdr;echo /home/lio/simulation/Boston_Skylights/images/2023_01_09_1607_rtpict_rendering_aa0_5000_sunny_ad32_0/radiance_filtered_exposed_s.hdr


- - -

psign -h 15 1400 | pcompos /home/lio/simulation/Boston_Skylights/images/2023_01_09_1607_rtpict_rendering_aa0_5000_sunny_ad32_0/radiance_filtered_exposed.hdr 0 0 - 570 20 > /home/lio/simulation/Boston_Skylights/images/2023_01_09_1607_rtpict_rendering_aa0_5000_sunny_ad32_0/radiance_filtered_exposed_s.hdr;echo /home/lio/simulation/Boston_Skylights/images/2023_01_09_1607_rtpict_rendering_aa0_5000_sunny_ad32_0/radiance_filtered_exposed_s.hdr


- - -

psign -h 15 1500 | pcompos /home/lio/simulation/Boston_Skylights/images/2023_01_09_1607_rtpict_rendering_aa0_5000_sunny_ad32_0/radiance_filtered_exposed.hdr 0 0 - 570 20 > /home/lio/simulation/Boston_Skylights/images/2023_01_09_1607_rtpict_rendering_aa0_5000_sunny_ad32_0/radiance_filtered_exposed_s.hdr;echo /home/lio/simulation/Boston_Skylights/images/2023_01_09_1607_rtpict_rendering_aa0_5000_sunny_ad32_0/radiance_filtered_exposed_s.hdr


- - -

psign -h 15 1600 | pcompos /home/lio/simulation/Boston_Skylights/images/2023_01_09_1607_rtpict_rendering_aa0_5000_sunny_ad32_0/radiance_filtered_exposed.hdr 0 0 - 570 20 > /home/lio/simulation/Boston_Skylights/images/2023_01_09_1607_rtpict_rendering_aa0_5000_sunny_ad32_0/radiance_filtered_exposed_s.hdr;echo /home/lio/simulation/Boston_Skylights/images/2023_01_09_1607_rtpict_rendering_aa0_5000_sunny_ad32_0/radiance_filtered_exposed_s.hdr


- - -

psign -h 15 1700 | pcompos /home/lio/simulation/Boston_Skylights/images/2023_01_09_1607_rtpict_rendering_aa0_5000_sunny_ad32_0/radiance_filtered_exposed.hdr 0 0 - 570 20 > /home/lio/simulation/Boston_Skylights/images/2023_01_09_1607_rtpict_rendering_aa0_5000_sunny_ad32_0/radiance_filtered_exposed_s.hdr;echo /home/lio/simulation/Boston_Skylights/images/2023_01_09_1607_rtpict_rendering_aa0_5000_sunny_ad32_0/radiance_filtered_exposed_s.hdr""",
    fireLogs=False,
    lastRunTime=166,
    suppressWarnings=False,
    results=["/home/lio/MantaRay/TestingRemote/images/2023_01_09_1225_rtpict_rendering_aa0_1500_sunny_ad32_0/radiance_filtered_exposed_s.hdr", "/home/lio/MantaRay/TestingRemote/images/2023_01_09_1225_rtpict_rendering_aa0_1500_sunny_ad32_0/radiance_filtered_exposed_filtered_exposed_s.hdr", "/home/lio/MantaRay/TestingRemote/images/2023_01_09_1225_rtpict_rendering_aa0_1500_sunny_ad32_0/radiance_filtered_exposed_s_filtered_exposed_s.hdr", "/home/lio/MantaRay/TestingRemote/images/2023_01_09_1225_rtpict_rendering_aa0_1500_sunny_ad32_0/radiance_filtered_filtered_exposed_filtered_exposed_s.hdr", "/home/lio/MantaRay/TestingRemote/images/2023_01_09_1225_rtpict_rendering_aa0_1500_sunny_ad32_0/radiance_filtered_filtered_exposed_s_filtered_exposed_s.hdr", "/home/lio/MantaRay/TestingRemote/images/2023_01_09_1225_rtpict_rendering_aa0_1500_sunny_ad32_0/radiance_filtered_filtered_filtered_exposed_s.hdr", "/home/lio/MantaRay/TestingRemote/images/2023_01_09_1225_rtpict_rendering_aa0_1500_sunny_ad32_0/radiance_filtered_filtered_exposed_s.hdr", "/home/lio/MantaRay/TestingRemote/images/2023_01_09_1225_rtpict_rendering_aa0_1500_sunny_ad32_0/radiance_filtered_exposed_s.hdr"],
    stderr=["/home/lio/MantaRay/TestingRemote/images/2023_01_09_1225_rtpict_rendering_aa0_1500_sunny_ad32_0/radiance_filtered_exposed_filtered_exposed.hdr: bad picture size", "/home/lio/MantaRay/TestingRemote/images/2023_01_09_1225_rtpict_rendering_aa0_1500_sunny_ad32_0/radiance_filtered_exposed_s_filtered_exposed.hdr: bad picture size", "/home/lio/MantaRay/TestingRemote/images/2023_01_09_1225_rtpict_rendering_aa0_1500_sunny_ad32_0/radiance_filtered_filtered_exposed_filtered_exposed.hdr: bad picture size", "/home/lio/MantaRay/TestingRemote/images/2023_01_09_1225_rtpict_rendering_aa0_1500_sunny_ad32_0/radiance_filtered_filtered_exposed_s_filtered_exposed.hdr: bad picture size", "/home/lio/MantaRay/TestingRemote/images/2023_01_09_1225_rtpict_rendering_aa0_1500_sunny_ad32_0/radiance_filtered_filtered_filtered_exposed.hdr: bad picture size", "/home/lio/MantaRay/TestingRemote/images/2023_01_09_1225_rtpict_rendering_aa0_1500_sunny_ad32_0/radiance_filtered_filtered_exposed.hdr: bad picture size"],
    commands=["psign -h 15 1000 | pcompos /home/lio/MantaRay/TestingRemote/images/2023_01_09_1225_rtpict_rendering_aa0_1500_sunny_ad32_0/radiance_filtered_exposed_s_filtered_exposed.hdr 0 0 - 570 20 > /home/lio/MantaRay/TestingRemote/images/2023_01_09_1225_rtpict_rendering_aa0_1500_sunny_ad32_0/radiance_filtered_exposed_s_filtered_exposed_s.hdr;echo /home/lio/MantaRay/TestingRemote/images/2023_01_09_1225_rtpict_rendering_aa0_1500_sunny_ad32_0/radiance_filtered_exposed_s_filtered_exposed_s.hdr", "psign -h 15 900 | pcompos /home/lio/MantaRay/TestingRemote/images/2023_01_09_1225_rtpict_rendering_aa0_1500_sunny_ad32_0/radiance_filtered_exposed_filtered_exposed.hdr 0 0 - 570 20 > /home/lio/MantaRay/TestingRemote/images/2023_01_09_1225_rtpict_rendering_aa0_1500_sunny_ad32_0/radiance_filtered_exposed_filtered_exposed_s.hdr;echo /home/lio/MantaRay/TestingRemote/images/2023_01_09_1225_rtpict_rendering_aa0_1500_sunny_ad32_0/radiance_filtered_exposed_filtered_exposed_s.hdr", "psign -h 15 1200 | pcompos /home/lio/MantaRay/TestingRemote/images/2023_01_09_1225_rtpict_rendering_aa0_1500_sunny_ad32_0/radiance_filtered_filtered_exposed_s_filtered_exposed.hdr 0 0 - 570 20 > /home/lio/MantaRay/TestingRemote/images/2023_01_09_1225_rtpict_rendering_aa0_1500_sunny_ad32_0/radiance_filtered_filtered_exposed_s_filtered_exposed_s.hdr;echo /home/lio/MantaRay/TestingRemote/images/2023_01_09_1225_rtpict_rendering_aa0_1500_sunny_ad32_0/radiance_filtered_filtered_exposed_s_filtered_exposed_s.hdr", "psign -h 15 1100 | pcompos /home/lio/MantaRay/TestingRemote/images/2023_01_09_1225_rtpict_rendering_aa0_1500_sunny_ad32_0/radiance_filtered_filtered_exposed_filtered_exposed.hdr 0 0 - 570 20 > /home/lio/MantaRay/TestingRemote/images/2023_01_09_1225_rtpict_rendering_aa0_1500_sunny_ad32_0/radiance_filtered_filtered_exposed_filtered_exposed_s.hdr;echo /home/lio/MantaRay/TestingRemote/images/2023_01_09_1225_rtpict_rendering_aa0_1500_sunny_ad32_0/radiance_filtered_filtered_exposed_filtered_exposed_s.hdr", "psign -h 15 1300 | pcompos /home/lio/MantaRay/TestingRemote/images/2023_01_09_1225_rtpict_rendering_aa0_1500_sunny_ad32_0/radiance_filtered_filtered_filtered_exposed.hdr 0 0 - 570 20 > /home/lio/MantaRay/TestingRemote/images/2023_01_09_1225_rtpict_rendering_aa0_1500_sunny_ad32_0/radiance_filtered_filtered_filtered_exposed_s.hdr;echo /home/lio/MantaRay/TestingRemote/images/2023_01_09_1225_rtpict_rendering_aa0_1500_sunny_ad32_0/radiance_filtered_filtered_filtered_exposed_s.hdr", "psign -h 15 1400 | pcompos /home/lio/MantaRay/TestingRemote/images/2023_01_09_1225_rtpict_rendering_aa0_1500_sunny_ad32_0/radiance_filtered_filtered_exposed.hdr 0 0 - 570 20 > /home/lio/MantaRay/TestingRemote/images/2023_01_09_1225_rtpict_rendering_aa0_1500_sunny_ad32_0/radiance_filtered_filtered_exposed_s.hdr;echo /home/lio/MantaRay/TestingRemote/images/2023_01_09_1225_rtpict_rendering_aa0_1500_sunny_ad32_0/radiance_filtered_filtered_exposed_s.hdr", "psign -h 15 1500 | pcompos /home/lio/MantaRay/TestingRemote/images/2023_01_09_1225_rtpict_rendering_aa0_1500_sunny_ad32_0/radiance_filtered_exposed.hdr 0 0 - 570 20 > /home/lio/MantaRay/TestingRemote/images/2023_01_09_1225_rtpict_rendering_aa0_1500_sunny_ad32_0/radiance_filtered_exposed_s.hdr;echo /home/lio/MantaRay/TestingRemote/images/2023_01_09_1225_rtpict_rendering_aa0_1500_sunny_ad32_0/radiance_filtered_exposed_s.hdr"])  # -> Stdout, Stderr_, Ran
overrides_70 = ApplyOverrides(Input=panel_135, Hdr=graft(executessh_64.Stdout))  # -> Output, DynamicOutput

# ----
# save pngs exposed and raw
panel_137 = Panel("""ra_tiff <hdr-.>.hdr <hdr-.>.tif
convert <hdr-.>.tif <hdr-.>.png
rm <hdr-.>.tif
echo <hdr-.>.png""")
panel_138 = Panel("""pcond -h <hdr> <hdr-.>_exposed.hdr
ra_tiff <hdr-.>_exposed.hdr <hdr-.>_exposed.tif
convert <hdr-.>_exposed.tif <hdr-.>_exposed.png
rm <hdr-.>_exposed.tif
rm <hdr-.>_exposed.hdr
echo <hdr-.>_exposed.png""")
entwine_14 = Entwine(Branch00=panel_138, Branch01=panel_137, FlattenInputs=True)

overrides_71 = ApplyOverrides(Input=entwine_14, Hdr=graft(executessh_55.Stdout))  # -> Output, DynamicOutput
executessh_65 = ExecuteSSH(
    _SSHCommands_=overrides_71.DynamicOutput,
    Run=executessh_55.Ran,
    addPrefix=True,
    description="""pcond -h <hdr> <hdr>_exposed.hdr
ra_tiff <hdr>_exposed.hdr <hdr>_exposed.tif
convert <hdr>_exposed.tif <hdr>_exposed.png
rm <hdr>_exposed.tif
rm <hdr>_exposed.hdr
echo <hdr>_exposed.png


- - -

ra_tiff <hdr>.hdr <hdr>.tif
convert <hdr>.tif <hdr>.png
rm <hdr>.tif
echo <hdr>.png""",
    fireLogs=False,
    lastRunTime=0,
    suppressWarnings=False)  # -> Stdout, Stderr_, Ran
download_18 = Download(LinuxFilePaths=executessh_65.Stdout, Run=executessh_65.Ran)  # -> flatten(FilePaths), Status, Ran

item_8 = ListItem(List=download_18.FilePaths, Index=0, Wrap=True)  # -> Item, Item1

imageviewer_19 = LBImageViewer(ImagePath_=item_8.Item, _scale_=2, DisableClickable=False, SaveImgWithCoords=False, scale=2)  # -> ImagePath, Values, GIF
imageviewer_20 = LBImageViewer(ImagePath_=item_8.Item1, _scale_=2, DisableClickable=False, SaveImgWithCoords=False, scale=2)  # -> ImagePath, Values, GIF

# ----
# False color with illuminance curves
# on top of luminance picture
panel_139 = Panel("falsecolor -s 20000 -l lux -p <rad-.>_exposed.hdr -i <irrad> -log 2 > <rad-.>_fc2.hdr;echo <rad-.>_fc2.hdr")

overrides_72 = ApplyOverrides(Input=panel_139, Rad=graft(executessh_42.Stdout), Irrad=graft(executessh_41.Stdout))  # -> Output, DynamicOutput
executessh_66 = ExecuteSSH(
    _SSHCommands_=overrides_72.DynamicOutput,
    Run=[or, executessh_41.Ran],
    addPrefix=True,
    description="falsecolor -s 20000 -l lux -p /home/lio/MantaRay/Andrei/images/2023_01_18_1002_49_Perspective_render_exposed.hdr -i /home/lio/MantaRay/Andrei/images/2023_01_18_1002_49_Perspective1_render_illum.hdr -log 2 > /home/lio/MantaRay/Andrei/images/2023_01_18_1002_49_Perspective_render_fc2.hdr;echo /home/lio/MantaRay/Andrei/images/2023_01_18_1002_49_Perspective_render_fc2.hdr",
    fireLogs=False,
    lastRunTime=5822,
    suppressWarnings=False,
    results="/home/lio/MantaRay/Andrei/images/2023_01_18_1002_49_Perspective_render_fc2.hdr",
    commands="falsecolor -s 20000 -l lux -p /home/lio/MantaRay/Andrei/images/2023_01_18_1002_49_Perspective_render_exposed.hdr -i /home/lio/MantaRay/Andrei/images/2023_01_18_1002_49_Perspective1_render_illum.hdr -log 2 > /home/lio/MantaRay/Andrei/images/2023_01_18_1002_49_Perspective_render_fc2.hdr;echo /home/lio/MantaRay/Andrei/images/2023_01_18_1002_49_Perspective_render_fc2.hdr")  # -> Stdout, Stderr_, Ran
download_19 = Download(
    LinuxFilePaths=executessh_66.Stdout,
    Run=executessh_66.Ran,
    stdouts="C:\Users\mm1013\MantaRay\Andrei\2023_01_18_1002_49_Perspective_render_fc2.hdr")  # -> FilePaths, Status, Ran

imageviewer_21 = LBImageViewer(ImagePath_=download_19.FilePaths, _scale_="2", DisableClickable=False, SaveImgWithCoords=False, scale=2)  # -> ImagePath, Values, GIF

# ----
# False color with illuminance curves
# on top of luminance picture
panel_140 = Panel("falsecolor -s 10000 -pal hot -l lux -p <rad-.>_exposed.hdr -i <irrad> > <rad-.>_fc3.hdr;echo <rad-.>_fc3.hdr")

overrides_73 = ApplyOverrides(Input=panel_140, Rad=graft(executessh_42.Stdout), Irrad=graft(executessh_41.Stdout))  # -> Output, DynamicOutput
executessh_67 = ExecuteSSH(
    _SSHCommands_=overrides_73.DynamicOutput,
    Run=[or, executessh_41.Ran],
    addPrefix=True,
    description="falsecolor -s 10000 -pal hot -l lux -p /home/lio/MantaRay/Andrei/images/2023_01_18_1002_49_Perspective_render_exposed.hdr -i /home/lio/MantaRay/Andrei/images/2023_01_18_1002_49_Perspective1_render_illum.hdr > /home/lio/MantaRay/Andrei/images/2023_01_18_1002_49_Perspective_render_fc3.hdr;echo /home/lio/MantaRay/Andrei/images/2023_01_18_1002_49_Perspective_render_fc3.hdr",
    fireLogs=False,
    lastRunTime=40,
    suppressWarnings=False,
    results="/home/lio/MantaRay/Andrei/images/2023_01_18_1002_49_Perspective_render_fc3.hdr",
    stderr="""/home/lio/MantaRay/Andrei/images/2023_01_18_1002_49_Perspective_render_exposed.hdr: bad picture size
<stdin>: bad picture size
Bad header!""",
    commands="falsecolor -s 10000 -pal hot -l lux -p /home/lio/MantaRay/Andrei/images/2023_01_18_1002_49_Perspective_render_exposed.hdr -i /home/lio/MantaRay/Andrei/images/2023_01_18_1002_49_Perspective1_render_illum.hdr > /home/lio/MantaRay/Andrei/images/2023_01_18_1002_49_Perspective_render_fc3.hdr;echo /home/lio/MantaRay/Andrei/images/2023_01_18_1002_49_Perspective_render_fc3.hdr")  # -> Stdout, Stderr_, Ran
download_20 = Download(
    LinuxFilePaths=executessh_67.Stdout,
    Run=executessh_67.Ran,
    stdouts="C:\Users\mm1013\MantaRay\UnnamedProject\2022_09_28_1341_29_Perspective1_render_fc3.hdr")  # -> FilePaths, Status, Ran

imageviewer_22 = LBImageViewer(ImagePath_=download_20.FilePaths, _scale_="2", DisableClickable=False, SaveImgWithCoords=False, scale=2)  # -> ImagePath, Values, GIF

panel_141 = Panel(overrides_69.Output)
join_7 = TextJoin(Text=flatten(executessh_64.Stdout), Join=" ")

overrides_74 = ApplyOverrides(Input=panel_134, HdrFiles=graft(join_7), Target=graft(panel_136))  # -> Output, DynamicOutput

executessh_68 = ExecuteSSH(
    _SSHCommands_=overrides_74.Output,
    Run=executessh_64.Ran,
    addPrefix=True,
    fireLogs=False,
    lastRunTime=13,
    suppressWarnings=False,
    results="/home/lio/simulation/Boston_Skylights/images/combined.png",
    stderr="""/home/lio/MantaRay/TestingRemote/images/2023_01_09_1225_rtpict_rendering_aa0_1500_sunny_ad32_0/radiance_filtered_exposed_filtered_exposed_s.hdr: bad picture size
ra_tiff: bad Radiance picture
convert-im6.q16: no images defined `/home/lio/simulation/Boston_Skylights/images/combined.png' @ error/convert.c/ConvertImageCommand/3258.""",
    commands="""pcompos -a 3 -s 10 -b 0.2 0.2 0.2 /home/lio/MantaRay/TestingRemote/images/2023_01_09_1225_rtpict_rendering_aa0_1500_sunny_ad32_0/radiance_filtered_exposed_s.hdr /home/lio/MantaRay/TestingRemote/images/2023_01_09_1225_rtpict_rendering_aa0_1500_sunny_ad32_0/radiance_filtered_exposed_filtered_exposed_s.hdr /home/lio/MantaRay/TestingRemote/images/2023_01_09_1225_rtpict_rendering_aa0_1500_sunny_ad32_0/radiance_filtered_exposed_s_filtered_exposed_s.hdr /home/lio/MantaRay/TestingRemote/images/2023_01_09_1225_rtpict_rendering_aa0_1500_sunny_ad32_0/radiance_filtered_filtered_exposed_filtered_exposed_s.hdr /home/lio/MantaRay/TestingRemote/images/2023_01_09_1225_rtpict_rendering_aa0_1500_sunny_ad32_0/radiance_filtered_filtered_exposed_s_filtered_exposed_s.hdr /home/lio/MantaRay/TestingRemote/images/2023_01_09_1225_rtpict_rendering_aa0_1500_sunny_ad32_0/radiance_filtered_filtered_filtered_exposed_s.hdr /home/lio/MantaRay/TestingRemote/images/2023_01_09_1225_rtpict_rendering_aa0_1500_sunny_ad32_0/radiance_filtered_filtered_exposed_s.hdr /home/lio/MantaRay/TestingRemote/images/2023_01_09_1225_rtpict_rendering_aa0_1500_sunny_ad32_0/radiance_filtered_exposed_s.hdr > ~/simulation/Boston_Skylights/images/combined.hdr
ra_tiff ~/simulation/Boston_Skylights/images/combined.hdr ~/simulation/Boston_Skylights/images/combined.tif
convert ~/simulation/Boston_Skylights/images/combined.tif ~/simulation/Boston_Skylights/images/combined.png
echo ~/simulation/Boston_Skylights/images/combined.png""")  # -> Stdout, Stderr_, Ran

# ----
# False color with illuminance curves
# on top of luminance picture
panel_142 = Panel("falsecolor -s 50 -n 10 -m 1.79 -l DF -p <rad-.>_exposed.hdr -i <irrad> -cp > <rad-.>_fc4.hdr;echo <rad-.>_fc4.hdr")

overrides_75 = ApplyOverrides(Input=panel_142, Rad=graft(executessh_42.Stdout), Irrad=graft(executessh_41.Stdout))  # -> Output, DynamicOutput
executessh_69 = ExecuteSSH(
    _SSHCommands_=overrides_75.DynamicOutput,
    Run=[or, executessh_41.Ran],
    addPrefix=True,
    description="falsecolor -s 50 -n 10 -m 1.79 -l DF -p /home/lio/MantaRay/Andrei/images/2023_01_18_1002_49_Perspective_render_exposed.hdr -i /home/lio/MantaRay/Andrei/images/2023_01_18_1002_49_Perspective1_render_illum.hdr -cp > /home/lio/MantaRay/Andrei/images/2023_01_18_1002_49_Perspective_render_fc4.hdr;echo /home/lio/MantaRay/Andrei/images/2023_01_18_1002_49_Perspective_render_fc4.hdr",
    fireLogs=False,
    lastRunTime=37,
    suppressWarnings=False,
    results="/home/lio/MantaRay/Andrei/images/2023_01_18_1002_49_Perspective_render_fc4.hdr",
    stderr="""/home/lio/MantaRay/Andrei/images/2023_01_18_1002_49_Perspective_render_exposed.hdr: bad picture size
<stdin>: bad picture size
Bad header!""",
    commands="falsecolor -s 50 -n 10 -m 1.79 -l DF -p /home/lio/MantaRay/Andrei/images/2023_01_18_1002_49_Perspective_render_exposed.hdr -i /home/lio/MantaRay/Andrei/images/2023_01_18_1002_49_Perspective1_render_illum.hdr -cp > /home/lio/MantaRay/Andrei/images/2023_01_18_1002_49_Perspective_render_fc4.hdr;echo /home/lio/MantaRay/Andrei/images/2023_01_18_1002_49_Perspective_render_fc4.hdr")  # -> Stdout, Stderr_, Ran
download_21 = Download(
    LinuxFilePaths=executessh_69.Stdout,
    Run=executessh_69.Ran,
    stdouts="C:\Users\mm1013\MantaRay\UnnamedProject\2022_09_28_1341_29_Perspective1_render_fc4.hdr")  # -> FilePaths, Status, Ran
download_22 = Download(
    LinuxFilePaths=executessh_41.Stdout,
    Run=executessh_69.Ran,
    stdouts="C:\Users\mm1013\MantaRay\UnnamedProject\2022_09_28_1341_29_Perspective1_render_illum.hdr")  # -> FilePaths, Status, Ran; disabled
executessh_70 = ExecuteSSH(
    _SSHCommands_=overrides_51.DynamicOutput,
    Run=executessh_69.Ran,
    addPrefix=True,
    description="""pcomb -o /home/lio/MantaRay/Andrei/images/2023_01_18_1002_49_Perspective1_render_illum.hdr | pcompos -x 2 -y 2 - -811 -1370 | pvalue -h -H -df | total -if3 -m | sed -r 's/[\t]+/1/g'


- - -

pcomb -o /home/lio/MantaRay/Andrei/images/2023_01_18_1002_49_Perspective1_render_illum.hdr | pcompos -x 2 -y 2 - -812 -1332 | pvalue -h -H -df | total -if3 -m | sed -r 's/[\t]+/1/g'


- - -

pcomb -o /home/lio/MantaRay/Andrei/images/2023_01_18_1002_49_Perspective1_render_illum.hdr | pcompos -x 2 -y 2 - -814 -1285 | pvalue -h -H -df | total -if3 -m | sed -r 's/[\t]+/1/g'


- - -

pcomb -o /home/lio/MantaRay/Andrei/images/2023_01_18_1002_49_Perspective1_render_illum.hdr | pcompos -x 2 -y 2 - -816 -1247 | pvalue -h -H -df | total -if3 -m | sed -r 's/[\t]+/1/g'


- - -

pcomb -o /home/lio/MantaRay/Andrei/images/2023_01_18_1002_49_Perspective1_render_illum.hdr | pcompos -x 2 -y 2 - -816 -1202 | pvalue -h -H -df | total -if3 -m | sed -r 's/[\t]+/1/g'


- - -

pcomb -o /home/lio/MantaRay/Andrei/images/2023_01_18_1002_49_Perspective1_render_illum.hdr | pcompos -x 2 -y 2 - -1312 -1532 | pvalue -h -H -df | total -if3 -m | sed -r 's/[\t]+/1/g'


- - -

pcomb -o /home/lio/MantaRay/Andrei/images/2023_01_18_1002_49_Perspective1_render_illum.hdr | pcompos -x 2 -y 2 - -1308 -1494 | pvalue -h -H -df | total -if3 -m | sed -r 's/[\t]+/1/g'


- - -

pcomb -o /home/lio/MantaRay/Andrei/images/2023_01_18_1002_49_Perspective1_render_illum.hdr | pcompos -x 2 -y 2 - -1305 -1453 | pvalue -h -H -df | total -if3 -m | sed -r 's/[\t]+/1/g'


- - -

pcomb -o /home/lio/MantaRay/Andrei/images/2023_01_18_1002_49_Perspective1_render_illum.hdr | pcompos -x 2 -y 2 - -1305 -1426 | pvalue -h -H -df | total -if3 -m | sed -r 's/[\t]+/1/g'


- - -

pcomb -o /home/lio/MantaRay/Andrei/images/2023_01_18_1002_49_Perspective1_render_illum.hdr | pcompos -x 2 -y 2 - -1299 -1394 | pvalue -h -H -df | total -if3 -m | sed -r 's/[\t]+/1/g'


- - -

pcomb -o /home/lio/MantaRay/Andrei/images/2023_01_18_1002_49_Perspective1_render_illum.hdr | pcompos -x 2 -y 2 - -1627 -1590 | pvalue -h -H -df | total -if3 -m | sed -r 's/[\t]+/1/g'


- - -

pcomb -o /home/lio/MantaRay/Andrei/images/2023_01_18_1002_49_Perspective1_render_illum.hdr | pcompos -x 2 -y 2 - -1619 -1560 | pvalue -h -H -df | total -if3 -m | sed -r 's/[\t]+/1/g'


- - -

pcomb -o /home/lio/MantaRay/Andrei/images/2023_01_18_1002_49_Perspective1_render_illum.hdr | pcompos -x 2 -y 2 - -1614 -1532 | pvalue -h -H -df | total -if3 -m | sed -r 's/[\t]+/1/g'


- - -

pcomb -o /home/lio/MantaRay/Andrei/images/2023_01_18_1002_49_Perspective1_render_illum.hdr | pcompos -x 2 -y 2 - -1608 -1500 | pvalue -h -H -df | total -if3 -m | sed -r 's/[\t]+/1/g'


- - -

pcomb -o /home/lio/MantaRay/Andrei/images/2023_01_18_1002_49_Perspective1_render_illum.hdr | pcompos -x 2 -y 2 - -132 -1979 | pvalue -h -H -df | total -if3 -m | sed -r 's/[\t]+/1/g'""",
    fireLogs=False,
    lastRunTime=1755,
    suppressWarnings=False,
    results=["24.125124.125124.125", "21.5625121.5625121.5625", "17.875117.875117.875", "14.953125114.953125114.953125", "54.625154.625154.625", "23123123", "19.625119.625119.625", "16.5116.5116.5", "24.7578125124.7578125124.7578125", "55.625155.625155.625", "21.15625121.15625121.15625", "20.1875120.1875120.1875", "19119119", "17.59375117.59375117.59375", "55.625155.625155.625"],
    commands=["pcomb -o /home/mss/MantaRay/UnnamedProject/images/2022_09_28_1341_29_Perspective1_render_illum.hdr | pcompos -x 2 -y 2 - -811 -470 | pvalue -h -H -df | total -if3 -m | sed -r 's/[\t]+/1/g'", "pcomb -o /home/mss/MantaRay/UnnamedProject/images/2022_09_28_1341_29_Perspective1_render_illum.hdr | pcompos -x 2 -y 2 - -812 -432 | pvalue -h -H -df | total -if3 -m | sed -r 's/[\t]+/1/g'", "pcomb -o /home/mss/MantaRay/UnnamedProject/images/2022_09_28_1341_29_Perspective1_render_illum.hdr | pcompos -x 2 -y 2 - -1627 -690 | pvalue -h -H -df | total -if3 -m | sed -r 's/[\t]+/1/g'", "pcomb -o /home/mss/MantaRay/UnnamedProject/images/2022_09_28_1341_29_Perspective1_render_illum.hdr | pcompos -x 2 -y 2 - -1308 -594 | pvalue -h -H -df | total -if3 -m | sed -r 's/[\t]+/1/g'", "pcomb -o /home/mss/MantaRay/UnnamedProject/images/2022_09_28_1341_29_Perspective1_render_illum.hdr | pcompos -x 2 -y 2 - -1614 -632 | pvalue -h -H -df | total -if3 -m | sed -r 's/[\t]+/1/g'", "pcomb -o /home/mss/MantaRay/UnnamedProject/images/2022_09_28_1341_29_Perspective1_render_illum.hdr | pcompos -x 2 -y 2 - -132 -1079 | pvalue -h -H -df | total -if3 -m | sed -r 's/[\t]+/1/g'", "pcomb -o /home/mss/MantaRay/UnnamedProject/images/2022_09_28_1341_29_Perspective1_render_illum.hdr | pcompos -x 2 -y 2 - -1305 -553 | pvalue -h -H -df | total -if3 -m | sed -r 's/[\t]+/1/g'", "pcomb -o /home/mss/MantaRay/UnnamedProject/images/2022_09_28_1341_29_Perspective1_render_illum.hdr | pcompos -x 2 -y 2 - -816 -347 | pvalue -h -H -df | total -if3 -m | sed -r 's/[\t]+/1/g'", "pcomb -o /home/mss/MantaRay/UnnamedProject/images/2022_09_28_1341_29_Perspective1_render_illum.hdr | pcompos -x 2 -y 2 - -1305 -526 | pvalue -h -H -df | total -if3 -m | sed -r 's/[\t]+/1/g'", "pcomb -o /home/mss/MantaRay/UnnamedProject/images/2022_09_28_1341_29_Perspective1_render_illum.hdr | pcompos -x 2 -y 2 - -816 -302 | pvalue -h -H -df | total -if3 -m | sed -r 's/[\t]+/1/g'"])  # -> Stdout, Stderr_, Ran

imageviewer_23 = LBImageViewer(ImagePath_=download_21.FilePaths, _scale_="2", DisableClickable=False, SaveImgWithCoords=False, scale=2)  # -> ImagePath, Values, GIF

python_23 = GhPythonScript(val=executessh_70.Stdout)  # -> x, y, z, ln
# ---------- python_23: Python ----------
__author__ = "mm1013"
__version__ = "2022.09.28"

import rhinoscriptsyntax as rs

length = int(len(val)/3.0)
x = val[0:length]
y = val[length:2*length]
z = val[2*length:3*length]
ln = length
# ---------- end python_23 ----------
panel_143 = Panel(executessh_70.Stdout)
imageviewer_24 = LBImageViewer(ImagePath_=download_22.FilePaths, _scale_="2", DisableClickable=False, SaveImgWithCoords=False, scale=2)  # -> ImagePath, Values, GIF
panel_144 = Panel(imageviewer_23.Values)

# ==== cluster DefaultMSS
default_value_flattened = ClusterInput()
data = ClusterInput()
data_2 = Data(data)
merge = Merge(Data1=flatten(data_2), Data2="0")  # -> flatten(Result)
default_value_flattened_2 = Data(flatten(default_value_flattened))
lng = ListLength(List=merge)
equals = Equality(FirstNumber=lng, SecondNumber="1")  # -> Equality, Inequality
cull = CullPattern(List=data_2, CullPattern=invert(equals.Equality))
panel = Panel(equals.Equality)
cull_2 = CullPattern(List=default_value_flattened_2, CullPattern=equals.Equality)
data_3 = Data([cull, cull_2])
data_4 = ClusterOutput(data_3)

# ==== cluster LargestBREP
window_breps = ClusterInput()
window_breps_2 = Brep(window_breps)
debrep = DeconstructBrep(Brep=window_breps_2)  # -> Faces, Edges, Vertices
area = Area(Geometry=debrep.Faces)  # -> Area, Centroid
sort = SortList(Keys=area.Area, ValuesA=debrep.Faces)  # -> Keys, ValuesA
item = ListItem(List=sort.ValuesA, Index=-1, Wrap=True)
group = Group(Objects=flatten(item))
grouped = ClusterOutput(group)

# ==== cluster Cluster
mod = ClusterInput()
python = GhPythonScript(mod=mod)  # -> name_geo, name_mod; inputs mod: list
# ---------- python: Python ----------
__author__ = "mm1013"
__version__ = "2023.03.11"

import re

regex = re.compile('[^a-zA-Z0-9_.]')

import rhinoscriptsyntax as rs



name_geo = [regex.sub('_',m.split("\n")[0].split(" ")[2]) + "_geo" for m in mod]
name_mod = [regex.sub('_',m.split("\n")[0].split(" ")[2]) for m in mod]
# ---------- end python ----------
name_mod = ClusterOutput(python.name_mod)
name_geo = ClusterOutput(python.name_geo)

# ==== cluster Cluster_2
L = ClusterInput()
lng = ListLength(List=L)
default = DefaultMSS(data=flatten(lng), default_value_flattened=flatten("0"))
bool = Boolean(default)
bool_2 = ClusterOutput(bool)
