# Grasshopper definition TestTree.gh (Grasshopper 1.0.7)
# Copyright: 2021
# plug-ins: MantaRay

# ----
# Connect
panel = Panel("mss")
connect_ssh = ConnectSSH(User=panel, Ip="127.0.0.1", Password="_prompt", _port=22, Connect=Toggle(True))  # -> Status, Run
panel_2 = Panel(connect_ssh.Status)

panel_3 = Panel("""echo "HI";sleep 10
echo "well"; sleep 10""")
graft = GraftTree(Tree=panel_3, IncludeEmptyLists=True, IncludeNullItems=True)
executessh_wip = ExecuteSSHWIP(
    _SSHCommands_="sleep 10",
    Run=Toggle(True),
    addPrefix=True,
    commands="sleep 10",
    description="sleep 10",
    fireLogs=False,
    lastRunTime=9738.37,
    suppressWarnings=False)  # -> Stdout, Stderr_, Ran
executessh_wip_2 = ExecuteSSHWIP(
    _SSHCommands_=graft,
    Run=Toggle(False),
    addPrefix=True,
    description="echo \"HI\";sleep 10",
    fireLogs=False,
    lastRunTime=17,
    suppressWarnings=False)  # -> Stdout, Stderr_, Ran
panel_4 = Panel(executessh_wip.Stdout)
panel_5 = Panel(executessh_wip.Ran)
rec = DataRecorder(executessh_wip.Ran, DataLimit=-10, RecordData=True)
panel_6 = Panel(rec)
panel_7 = Panel(executessh_wip_2.Stdout)
