# Grasshopper definition Test_3Ph.gh (Grasshopper 1.0.7)
# Copyright: 2021
# Copyright: 2022-06-43
# Copyright: 2022-11-38
# Copyright: 2016 HLA
# plug-ins: MantaRay, LadybugGrasshopper, Human, HDTTreeUtils

# ----
# Overview of all running tasks in linux
panel = Panel("ps aux | grep '<AllRadProgs>'")
logviewer = LogViewer(Number=10)  # -> CurrentTasks, Logs
default = DefaultMSS(data=flatten(panel), default_value_flattened=flatten(logviewer.CurrentTasks))
executessh_wip = ExecuteSSHWIP(
    _SSHCommands_=default,
    Run=Toggle(True),
    addPrefix=True,
    description="ps aux | grep '<AllRadProgs>'",
    fireLogs=False,
    lastRunTime=9.1136,
    suppressWarnings=False,
    results="""mss       5699  0.0  0.0   8620  3172 ?        Ss   22:51   0:00 bash -c export PATH=$PATH:/usr/local/radiance/bin;export RAYPATH=.:/usr/local/radiance/lib;export DISPLAY=$(ip route list default | awk '{print $3}'):0;export LIBGL_ALWAYS_INDIRECT=1;ps aux | grep '<AllRadProgs>'
mss       5704  0.0  0.0   8168   712 ?        S    22:51   0:00 grep <AllRadProgs>""",
    commands="ps aux | grep '<AllRadProgs>'")  # -> Stdout, Stderr_, Ran
python = GhPythonScript(x=executessh_wip.Stdout)  # -> a
# ---------- python: Python ----------
__author__ = "mm1013"
__version__ = "2022.08.30"

import rhinoscriptsyntax as rs

a = [l for l in x.split("\n") if "grep" not in l]
# ---------- end python ----------
panel_2 = Panel(python)
panel_3 = Panel(logviewer.CurrentTasks)

panel_4 = Panel("""Mesh
Polysurface
Surface
Extrusion""")

# ----
# Connect
toggle = BooleanToggle(True)
connect = ConnectSSHFTP(User="mss", Ip="localhost", Password="_prompt", _port=22, Connect=toggle)  # -> Status, Prefixes, Run
panel_5 = Panel(connect.Prefixes)
panel_6 = Panel(connect.Status)

od_outdated = ColourSwatch(SwatchColor=RGBA(97, 97, 97, 150))
u_updated = ColourSwatch(SwatchColor=RGBA(208, 115, 230, 112))
toggle_2 = BooleanToggle(True)
g_general = ColourSwatch(SwatchColor=RGBA(245, 243, 237, 156))
o_outputs = ColourSwatch(SwatchColor=RGBA(160, 218, 242, 203))
s_settings = ColourSwatch(SwatchColor=RGBA(224, 145, 81, 154))
cc_core2 = ColourSwatch(SwatchColor=RGBA(230, 216, 186, 208))
y_yellow = ColourSwatch(SwatchColor=RGBA(247, 244, 64, 188))
i_inputs = ColourSwatch(SwatchColor=RGBA(125, 217, 98, 150))
c_core = ColourSwatch(SwatchColor=RGBA(235, 227, 206, 203))
r_red = ColourSwatch(SwatchColor=RGBA(242, 63, 63, 203))

# ----
# Setup globals
panel_7 = Panel("""proj
projname
projfolder""")
panel_8 = Panel("""~/simulation/boston
boston
/simulation/boston""")
global_overrides = GlobalOverrides(Keys=panel_7, Values=panel_8)
panel_9 = Panel(global_overrides)

colorgroups = CSharpScript(
    Colors=[i_inputs, s_settings, g_general, c_core, o_outputs, r_red, y_yellow, u_updated, od_outdated, cc_core2],
    Enable=toggle_2,
    Rename=Toggle(False),
    RunOnce=Button(),
    Debug=Toggle(False))  # -> out; inputs Colors: list of Color, Enable: Boolean, Rename: Boolean, RunOnce: Boolean, Debug: Boolean
# ---------- colorgroups: C# usings ----------
using System.Linq;
using System.Text;
using System.Reflection;
# ---------- colorgroups: C# ----------
    msg.Clear();


    this.Component.Message = "id: " + id.ToString();

    _debug = Debug; //Set to true to have all events printed in rhino log
    _rename = Rename;

    if (Enable)
    {
      msg.AppendFormat("Set up events on ID {0}\n", id);
      SetupDict(); // Create a dictionary of the input swatches
      SetEventHandlers(); // This would do the job.


    }
    else
    {
      RemoveEventHandlers();
    }
    if (RunOnce)
    {
      foreach(Grasshopper.Kernel.Special.GH_Group grp in Grasshopper.Instances.ActiveCanvas.Document.Objects.OfType<Grasshopper.Kernel.Special.GH_Group>())
      {
        ColorGroup(grp, null); // You decide if it should run once on all existing groups

      }
    }

    Print(msg.ToString());


    // Component setup
    Component.Description = "Set up event handlers to color groups based on prefixes such as 'in_' and 'out_'.\n"
      + "Please insert only swatcheds directly into the Colors input\n\n"
      + "MIT License. Copyright Mathias Sønderskov Schaltz 2022";
    Component.Params.Input[0].Description = "Please insert only swatcheds directly into the Colors input.\nRemember to rename them";
    Component.Params.Input[1].Description = "Toggle to run...";
    Component.Params.Input[2].Description = "Set to true if you want to automatically rename the groups and remove prefix. Default is false.";
    Component.Params.Input[3].Description = "Set to true to run it once and color all existing groups.";
    Component.Params.Input[Component.Params.Input.Count - 1].Description = "Set debug to true to get all the events printed in the rhino log";
# ---------- colorgroups: C# additional code ----------
  public static Random rnd = new Random();
  public int id = rnd.Next(0, 1000);
  StringBuilder msg = new StringBuilder();
  Dictionary<string, System.Drawing.Color> colorDict = new Dictionary<string, System.Drawing.Color>();

  bool _debug = false;
  bool _rename = false;

  public bool IdExists(int id)
  {
    IList<IGH_DocumentObject> objs = Grasshopper.Instances.ActiveCanvas.Document.Objects;
    return objs
      .OfType<IGH_Component>()
      .Where(ob => ob.NickName == this.Component.NickName)
      .Where(ob => ob.GetType().ToString() == "ScriptComponents.Component_CSNET_Script")
      .Where(ob => ob.Message == "id: " + id.ToString()).Any();

  }


  public void SetupDict()
  {
    colorDict.Clear();
    // Get all inputs to "Colors"
    IList<IGH_Param> colorSources = this.Component.Params.Input[0].Sources;
    if (colorSources.Count == 0)
    {
      throw new Exception("You forgot to setup the colors. Please input swatch components and rename them");
    }
    foreach(IGH_Param source in colorSources)
    {
      //if (source.Type.ToString() == "Grasshopper.Kernel.Types.GH_Colour")
      if (source is Grasshopper.Kernel.Special.GH_ColourSwatch)
      {
        string nickName = source.NickName.Split('_')[0].Trim() + "_";
        if(!colorDict.ContainsKey(nickName))
        {
          Grasshopper.Kernel.Special.GH_ColourSwatch swatch = (Grasshopper.Kernel.Special.GH_ColourSwatch) source;
          colorDict.Add(nickName, swatch.SwatchColour);
        }
        else
        {
          throw new Exception("Multiple swatches using the same name detected. Please rename");
        }
      }
      else
      {
        throw new Exception("Whacko! Why did you input a non-swatch into the Colors? " + source.Type.ToString());
      }

    }

    msg.AppendFormat("Set up the dictionaries with {0} colors\n", colorDict.Count);
    foreach(var pairs in colorDict)
    {
      msg.AppendFormat("{0} -> {1}\n", ("\"" + pairs.Key + "\"").PadRight(5 + colorDict.Keys.Select(k => k.Length).Max()), pairs.Value);
    }
  }

  public void SetEventHandlers()
  {

    // Always remove events first to avoid duplicates
    GrasshopperDocument.ObjectsAdded -= OnObjectsAdded;
    GrasshopperDocument.ObjectsDeleted -= OnObjectsRemoved;
    GrasshopperDocument.ObjectsDeleted -= OnDeleteThisComponent;

    // Attach events
    GrasshopperDocument.ObjectsAdded += OnObjectsAdded;
    GrasshopperDocument.ObjectsDeleted += OnObjectsRemoved;
    GrasshopperDocument.ObjectsDeleted += OnDeleteThisComponent;


    foreach(Grasshopper.Kernel.Special.GH_Group grp in GrasshopperDocument.Objects.OfType<Grasshopper.Kernel.Special.GH_Group>())
    {
      grp.ObjectChanged -= ColorGroup;
      grp.ObjectChanged += ColorGroup;

      //ColorGroup(grp, null); // Make sure to run it once
    }
    msg.AppendFormat("Added the eventhandlers on {0} existing groups and on future created groups\n", GrasshopperDocument.Objects.OfType<Grasshopper.Kernel.Special.GH_Group>().Count());
  }

  public void OnObjectsAdded(object sender, GH_DocObjectEventArgs e)
  {
    bool any = false;
    foreach (Grasshopper.Kernel.Special.GH_Group grp in e.Objects.OfType<Grasshopper.Kernel.Special.GH_Group>())
    {
      grp.ObjectChanged -= ColorGroup;
      grp.ObjectChanged += ColorGroup;
      any = true;
    }

    DebugWrite(any ? "Group Objects Added: Attaching Events to ObjectChanged" : "Objects Added - but no groups");
  }

  //Same but reversed
  public void OnObjectsRemoved(object sender, GH_DocObjectEventArgs e)
  {
    bool any = false;
    foreach (Grasshopper.Kernel.Special.GH_Group grp in e.Objects.OfType<Grasshopper.Kernel.Special.GH_Group>())
    {
      grp.ObjectChanged -= ColorGroup;
      any = true;
    }

    DebugWrite(any ? "Group Objects Removed, removing event" : "Objects Removed - although not a group");

  }



  public void RemoveEventHandlers()
  {
    GrasshopperDocument.ObjectsAdded -= OnObjectsAdded;
    GrasshopperDocument.ObjectsDeleted -= OnObjectsRemoved;


    foreach(Grasshopper.Kernel.Special.GH_Group grp in GrasshopperDocument.Objects.OfType<Grasshopper.Kernel.Special.GH_Group>())
    {
      grp.ObjectChanged -= ColorGroup;

    }
    msg.AppendFormat("Removed event handlers on document and on {0} groups\n", GrasshopperDocument.Objects.OfType<Grasshopper.Kernel.Special.GH_Group>().Count());

  }

  public void ColorGroup(object sender, EventArgs e)
  {
    if (!IdExists(id))
    {
      DebugWrite("Component not relevant. Disabling old id + " + id.ToString());
      RemoveEventHandlers();
      return;
    }

    Grasshopper.Kernel.Special.GH_Group grp = sender as Grasshopper.Kernel.Special.GH_Group;
    if (grp == null) return; //not type GH_Group
    //if (!grp.NickName.EndsWith("_")) return;

    string[] nameParts = grp.NickName.Split('_');
    if (nameParts.Length <= 1)
      return;
    string prefix = grp.NickName.Split('_')[0].Trim() + '_';

    string prefixes = String.Join(", ", colorDict.Keys.Select(k => "\"" + k + "\""));

    msg.Append("prefix " + prefix + "\n");
    if (colorDict.ContainsKey(prefix))
    {
      //if (grp.NickName.EndsWith("_"))
      grp.Colour = colorDict[prefix];
      if (_rename)
      {
        grp.NickName = grp.NickName.Replace(prefix, "");
      }

      DebugWrite("Colored " + grp.NickName);

    }
    else
    {
      DebugWrite("Group changed but not relevant: prefix " + prefix + " is not among " + prefixes);
    }

  }
  public void DebugWrite(string msg)
  {
    if (_debug)
    {
      Rhino.RhinoApp.WriteLine(String.Format("[ColGrps {0}]: {1}", id, msg));
    }
  }

  public void OnDeleteThisComponent(object sender, GH_DocObjectEventArgs e)
  {

    if (e.Objects.OfType<Grasshopper.Kernel.GH_Component>().Where(o => o.NickName == this.Component.NickName).Any())
    {
      DebugWrite("Removed template component. Removing all the eventhandlers");
      RemoveEventHandlers();
    }

  }
# ---------- end colorgroups ----------

fixparams = CSharpScript(FixOnce=Button(), Enable=toggle_2, Debug=Toggle(False))  # -> out; inputs FixOnce: Boolean, Enable: Boolean, Debug: Boolean
# ---------- fixparams: C# usings ----------
using System.Text;
using System.Linq;
using Grasshopper.Kernel.Special;
# ---------- fixparams: C# ----------
    _debug = Debug;
    _enable = Enable;
    msg.Clear();
    this.Component.Message = "id: " + id.ToString();




    if (Enable)
    {
      SetEventHandlers();
    }
    else
    {
      RemoveEventHandlers();
    }


    if (FixOnce)
    {
      FixAll();
    }

    Print(msg.ToString());

    // Component setup
    Component.Description = "Set up event handlers to change params to show nickname and not icon"
      + "\n\n"
      + "MIT License. Copyright Mathias Sønderskov Schaltz 2022";
    Component.Params.Input[0].Description = "Run me once on the document";
    Component.Params.Input[1].Description = "Toggle to enable event listener";
    Component.Params.Input[Component.Params.Input.Count - 1].Description = "Set debug to true to get all the events printed in the rhino log";
# ---------- fixparams: C# additional code ----------
  public static Random rnd = new Random();
  public int id = rnd.Next(0, 1000);
  StringBuilder msg = new StringBuilder();
  bool _debug = false;
  bool _enable = false;

  public Dictionary<IGH_ActiveObject, HashSet<GH_Group>> groupsPerObject = new Dictionary<IGH_ActiveObject, HashSet<GH_Group>>();


  public void OnObjectsAdded(object sender, GH_DocObjectEventArgs e)
  {
    if (!IdExists(id))
    {
      DebugWrite("[FixParam] Component not relevant. Disabling old id " + id.ToString());
      RemoveEventHandlers();
      return;
    }


    if(_enable)
    {
      foreach(IGH_Param par in e.Objects.OfType<IGH_Param>())
      {
        FixInputs(par);
      }
    }


  }

  public void FixAll()
  {
    //DebugWrite("Fixing all?");
    foreach(IGH_Param par in GrasshopperDocument.Objects.OfType<IGH_Param>())
    {

      FixInputs(par);
    }
  }




  public void FixInputs(IGH_ActiveObject obj)
  {



    IGH_Param par = obj as IGH_Param;
    if (par != null)
    {

      par.IconDisplayMode = GH_IconDisplayMode.name;


    }

  }


  public void SetEventHandlers()
  {

    GrasshopperDocument.ObjectsAdded -= OnObjectsAdded;
    GrasshopperDocument.ObjectsAdded += OnObjectsAdded;
    GrasshopperDocument.ObjectsDeleted -= OnDeleteThisComponent;
    GrasshopperDocument.ObjectsDeleted += OnDeleteThisComponent;
    msg.AppendFormat("Added the eventhandlers to OnObjectsAdded\n", GrasshopperDocument.Objects.OfType<Grasshopper.Kernel.Special.GH_Group>().Count());
  }

  public void RemoveEventHandlers()
  {
    GrasshopperDocument.ObjectsAdded -= OnObjectsAdded;
    GrasshopperDocument.ObjectsDeleted -= OnDeleteThisComponent;

    msg.AppendFormat("Removed wire event handlers on document\n", GrasshopperDocument.Objects.OfType<Grasshopper.Kernel.Special.GH_Group>().Count());

  }

  public void OnDeleteThisComponent(object sender, GH_DocObjectEventArgs e)
  {

    if (e.Objects.OfType<Grasshopper.Kernel.GH_Component>().Where(o => o.NickName == this.Component.NickName).Any())
    {
      DebugWrite("Removed template component. Removing all the eventhandlers");
      RemoveEventHandlers();
    }

  }

  public bool IdExists(int id)
  {
    IList<IGH_DocumentObject> objs = Grasshopper.Instances.ActiveCanvas.Document.Objects;
    return objs
      .OfType<IGH_Component>()
      .Where(ob => ob.NickName == this.Component.NickName)
      .Where(ob => ob.GetType().ToString() == "ScriptComponents.Component_CSNET_Script")
      .Where(ob => ob.Message == "id: " + id.ToString()).Any();

  }

  public void DebugWrite(string msg)
  {
    if (_debug)
    {
      Rhino.RhinoApp.WriteLine(String.Format("[FixParams {0}]: {1}", id, msg));
    }
  }
# ---------- end fixparams ----------

fixwires = CSharpScript(FixOnce=Button(), Enable=toggle_2, Debug=Toggle(False))  # -> out; inputs FixOnce: Boolean, Enable: Boolean, Debug: Boolean
# ---------- fixwires: C# ----------
    _debug = Debug;
    _enable = Enable;
    msg.Clear();
    this.Component.Message = "id: " + id.ToString();


    SetDictionary();

    if (Enable)
    {
      SetEventHandlers();
    }
    else
    {
      RemoveEventHandlers();
    }


    if (FixOnce)
    {
      FixAll();
    }

    Print(msg.ToString());
    
    // Component setup
    Component.Description = "Set up event handlers to change all wire types across groups to faint"
      + "\n\n"
      + "MIT License. Copyright Mathias Sønderskov Schaltz 2022";
    Component.Params.Input[0].Description = "Run me once on the document";
    Component.Params.Input[1].Description = "Toggle to enable event listener";
    Component.Params.Input[Component.Params.Input.Count - 1].Description = "Set debug to true to get all the events printed in the rhino log";
# ---------- fixwires: C# additional code ----------
  public static Random rnd = new Random();
  public int id = rnd.Next(0, 1000);
  StringBuilder msg = new StringBuilder();
  bool _debug = false;
  bool _enable = false;

  public Dictionary<IGH_ActiveObject, HashSet<GH_Group>> groupsPerObject = new Dictionary<IGH_ActiveObject, HashSet<GH_Group>>();


  public void OnSolutionExpired(object sender, GH_DocUndoEventArgs e)
  {
    if(_enable)
      FixAll();
  }

  public void FixAll()
  {
    //DebugWrite("Fixing all?");
    foreach(IGH_ActiveObject key in groupsPerObject.Keys.Where(k => groupsPerObject[k].Count() > 0))
    {

      FixInputs(key);
    }
  }



  public bool HasGroup(IGH_ActiveObject obj)
  {
    return groupsPerObject[obj].Count > 0;
  }


  public void FixInputs(IGH_ActiveObject obj)
  {

    if (!IdExists(id))
    {
      DebugWrite("Component not relevant. Disabling old id " + id.ToString());
      RemoveEventHandlers();
      return;
    }

    //List<List<IGH_ActiveObject>> parents = new List<List<IGH_ActiveObject>>();
    IGH_Param par = obj as IGH_Param;
    if (par != null && par.Sources != null)
    {


      IEnumerable<IGH_ActiveObject> p = par.Sources.Select(s => s.Attributes.GetTopLevel.DocObject as IGH_ActiveObject);
      //parents.Add(p);
      if(HasGroup(obj) && p.All(o => !HasGroupsInCommon(o, obj)) && par.WireDisplay != GH_ParamWireDisplay.faint)
      {
        DebugWrite("Fixing " + par.Attributes.GetTopLevel.DocObject.NickName);
        par.WireDisplay = GH_ParamWireDisplay.faint;
      }

    }

    IGH_Component comp = obj as IGH_Component;
    if (comp != null)
    {
      foreach(IGH_Param inp in comp.Params.Input)
      {

        IEnumerable<IGH_ActiveObject> p = inp.Sources.Select(i => i.Attributes.GetTopLevel.DocObject as IGH_ActiveObject);

        if(HasGroup(obj) && p.All(o => !HasGroupsInCommon(o, obj)) && inp.WireDisplay != GH_ParamWireDisplay.faint)
        {
          DebugWrite("Fixing " + inp.Attributes.GetTopLevel.DocObject.NickName);
          inp.WireDisplay = GH_ParamWireDisplay.faint;
        }
      }

    }



  }





  public void SetDictionary()
  {
    IList<IGH_DocumentObject> objects = Grasshopper.Instances.ActiveCanvas.Document.Objects.ToList();
    //Print(String.Join(", ", objects.Select(o => o.NickName)));

    groupsPerObject = objects
      .Where(o => o.GetType() != typeof(GH_Group))
      .OfType<IGH_ActiveObject>()
      .ToDictionary(o => o, o => new HashSet<GH_Group>());

    foreach(GH_Group grp in objects.OfType<GH_Group>())
    {

      foreach(IGH_ActiveObject obj in grp.ObjectsRecursive().OfType<IGH_ActiveObject>())
      {
        groupsPerObject[obj].Add(grp);

      }
    }



  }

  public bool HasGroupsInCommon(IGH_ActiveObject obj1, IGH_ActiveObject obj2)
  {
    HashSet<GH_Group> set1 = groupsPerObject[obj1];
    HashSet<GH_Group> set2 = groupsPerObject[obj2];

    set1.IntersectWith(set2);

    return set1.Any();
  }

  public void SetEventHandlers()
  {

    GrasshopperDocument.UndoStateChanged -= OnSolutionExpired;
    GrasshopperDocument.UndoStateChanged += OnSolutionExpired;
    GrasshopperDocument.ObjectsDeleted -= OnDeleteThisComponent;
    GrasshopperDocument.ObjectsDeleted += OnDeleteThisComponent;
    msg.AppendFormat("Added the eventhandlers to UndoStateChanged\n", GrasshopperDocument.Objects.OfType<Grasshopper.Kernel.Special.GH_Group>().Count());
  }

  public void RemoveEventHandlers()
  {
    GrasshopperDocument.UndoStateChanged -= OnSolutionExpired;
    GrasshopperDocument.ObjectsDeleted -= OnDeleteThisComponent;

    msg.AppendFormat("Removed wire event handlers on document\n", GrasshopperDocument.Objects.OfType<Grasshopper.Kernel.Special.GH_Group>().Count());

  }

  public void OnDeleteThisComponent(object sender, GH_DocObjectEventArgs e)
  {

    if (e.Objects.OfType<Grasshopper.Kernel.GH_Component>().Where(o => o.NickName == this.Component.NickName).Any())
    {
      DebugWrite("Removed template component. Removing all the eventhandlers");
      RemoveEventHandlers();
    }

  }

  public bool IdExists(int id)
  {
    IList<IGH_DocumentObject> objs = Grasshopper.Instances.ActiveCanvas.Document.Objects;
    return objs
      .OfType<IGH_Component>()
      .Where(ob => ob.NickName == this.Component.NickName)
      .Where(ob => ob.GetType().ToString() == "ScriptComponents.Component_CSNET_Script")
      .Where(ob => ob.Message == "id: " + id.ToString()).Any();

  }

  public void DebugWrite(string msg)
  {
    if (_debug)
    {
      Rhino.RhinoApp.WriteLine(String.Format("[FixWire {0}]: {1}", id, msg));
    }
  }
# ---------- end fixwires ----------

dpipeline = DynamicGeometryPipeline(
    LayerFilter="Daylight_Inputs::*",
    TypeFilter="Curve",
    NameFilter="*",
    GroupByLayer=False,
    GroupByType=False,
    IncludeHidden=True,
    IncludeLocked=True,
    enableFullPath=True,
    listenToAttributes=True)

# ----
# importing from rhino layers
dpipeline_2 = DynamicGeometryPipeline(
    LayerFilter="Daylight_Inputs::*",
    TypeFilter=panel_4,
    NameFilter="*",
    GroupByLayer=False,
    GroupByType=False,
    IncludeHidden=True,
    IncludeLocked=True,
    enableFullPath=True,
    listenToAttributes=True)
dam = DataDam(DataA=dpipeline_2, DataB=dpipeline, BufferDelay=10000000, BufferMode=0)  # -> DataA, DataB
objatts = ObjectAttributes(ObjectOrAttributes=dam.DataA)  # -> Name, LayerName, LayerFullPath, Color, MaterialName, LinetypeName, GroupIndices, PlotWeight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
objatts_2 = ObjectAttributes(ObjectOrAttributes=dam.DataB)  # -> Name, LayerName, LayerFullPath, Color, MaterialName, LinetypeName, GroupIndices, PlotWeight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
cset = CreateSet(List=objatts.LayerName)  # -> Set, Map
cset_2 = CreateSet(List=objatts_2.LayerName)  # -> Set, Map
assign_paths = AssignPaths(InputData=flatten(dam.DataA), PathsToAssign=flatten(cset.Map))
assign_paths_2 = AssignPaths(InputData=flatten(dam.DataB), PathsToAssign=flatten(cset_2.Map))
python_2 = GhPythonScript(layer_name=graft(cset.Set))  # -> is_opaque, is_transparent, is_grid, is_HB_Room, is_HB_Window, is_receiver
# ---------- python_2: Python ----------
__author__ = "mm1013"
__version__ = "2022.01.16"

import rhinoscriptsyntax as rs

is_grid = layer_name == "Grids" or layer_name == "_Curves"

if layer_name.startswith("HB_"):
    is_opaque = is_transparent = is_grid = False
    
    is_HB_Window = layer_name.endswith("%")
    is_HB_Room = layer_name == "HB_Rooms"
    
    
else:
    if is_grid:
        is_opaque = False
        is_transparent = False
        is_receiver = False
    else:
        is_receiver = layer_name.endswith("_BSDF")
        is_transparent = layer_name.endswith("%")
        if is_transparent:
            transmittance = layer_name.split("_")[-1].replace("%","")
        is_opaque = not is_transparent and not is_receiver
# ---------- end python_2 ----------
python_3 = GhPythonScript(layer_name=graft(cset_2.Set))  # -> is_opaque, is_transparent, is_grid, is_HB_Room, is_HB_Window
# ---------- python_3: Python ----------
__author__ = "mm1013"
__version__ = "2022.01.16"

import rhinoscriptsyntax as rs

is_grid = layer_name == "Grids" or layer_name == "_Curves"

if layer_name.startswith("HB_"):
    is_opaque = is_transparent = is_grid = False
    
    is_HB_Window = layer_name.endswith("%")
    is_HB_Room = layer_name == "HB_Rooms"
    
    
else:
    if is_grid:
        is_opaque = False
        is_transparent = False
    else:
        is_transparent = layer_name.endswith("%")
        if is_transparent:
            transmittance = layer_name.split("_")[-1].replace("%","")
        is_opaque = not is_transparent
# ---------- end python_3 ----------
layer_name = Text(cset_2.Set)
layer_name_2 = Text(cset.Set)
geo = Geometry(assign_paths_2)
geo_2 = Geometry(assign_paths)

# ----
# Template methods
# By Mathias Sønderskov Schaltz 2022
# Check for updates here https://github.com/Sonderwoods/GrasshopperScribbles
panel_10 = Panel(fixwires)
panel_11 = Panel(fixparams)
panel_12 = Panel(colorgroups)

logviewer_2 = LogViewer(Number=10)  # -> CurrentTasks, Logs

# ----
# Glass geometries
cull = CullPattern(List=geo_2, CullPattern=python_2.is_transparent)
cull_2 = CullPattern(List=graft(layer_name_2), CullPattern=graft(python_2.is_transparent))  # -> simplify(List)
python_4 = GhPythonScript(layer_name=cull_2)  # -> out, transmittance, name
# ---------- python_4: Python ----------
__author__ = "mm1013"
__version__ = "2022.01.16"

import rhinoscriptsyntax as rs

try:
    transmittance = layer_name.split("_")[-1].replace("%","")
    name = layer_name.replace("%","")
except:
    transmittance = None
    name = None
# ---------- end python_4 ----------
clean = CleanTree(
    RemoveNulls=True,
    RemoveInvalid=True,
    RemoveEmpty=True,
    Tree=simplify(cull),
    SynchronousTree1=simplify(python_4.name),
    SynchronousTree2=simplify(python_4.transmittance))  # -> Tree, SynchronousTree1, SynchronousTree2
meshit2 = MeshIt2(mesh_brep=graft(clean.Tree))
name = Text(clean.SynchronousTree1)
unflatten = UnflattenTree(Tree=meshit2, Guide=clean.Tree)
panel_13 = Panel(name)
geo_3 = Geometry(unflatten)
meshit2_2 = MeshIt2(mesh_brep=geo_3)
transmittance = Number(expr("x/100", clean.SynchronousTree2))
concat = Concatenate(FragmentA=name, FragmentB="_mat")
mesh = Mesh(meshit2_2)

# ----
# opaque geometries
cull_3 = CullPattern(List=graft(layer_name_2), CullPattern=graft(python_2.is_opaque))  # -> simplify(List)
cull_4 = CullPattern(List=geo_2, CullPattern=graft(python_2.is_opaque))  # -> simplify(List)
python_5 = GhPythonScript(layer_name=cull_3)  # -> out, reflectance
# ---------- python_5: Python ----------
__author__ = "mm1013"
__version__ = "2022.01.16"

import rhinoscriptsyntax as rs
try:
    reflectance = layer_name.split("_")[-1]
    
except:
    reflectance = None
# ---------- end python_5 ----------
clean_2 = CleanTree(
    RemoveNulls=True,
    RemoveInvalid=True,
    RemoveEmpty=True,
    Tree=cull_3,
    SynchronousTree1=cull_4,
    SynchronousTree2=python_5.reflectance)  # -> Tree, SynchronousTree1, SynchronousTree2
geo_4 = Geometry(clean_2.SynchronousTree1)
refl = Number(clean_2.SynchronousTree2)
name_2 = Text(clean_2.Tree)
meshit2_3 = MeshIt2(mesh_brep=geo_4)
concat_2 = Concatenate(FragmentA=name_2, FragmentB="_mat")

# ----
# Grid
cull_5 = CullPattern(List=graft(layer_name), CullPattern=graft(python_3.is_grid))  # -> simplify(List)
cull_6 = CullPattern(List=graft(layer_name_2), CullPattern=graft(python_2.is_grid))  # -> simplify(List)
cull_7 = CullPattern(List=geo, CullPattern=python_3.is_grid)  # -> simplify(List)
cull_8 = CullPattern(List=geo_2, CullPattern=python_2.is_grid)
clean_3 = CleanTree(RemoveNulls=True, RemoveInvalid=True, RemoveEmpty=True, Tree=cull_6, SynchronousTree1=simplify(cull_8))  # -> Tree, flatten(SynchronousTree1)
clean_4 = CleanTree(RemoveNulls=True, RemoveInvalid=True, RemoveEmpty=True, Tree=cull_5, SynchronousTree1=simplify(cull_7))  # -> Tree, SynchronousTree1
boundary = BoundarySurfaces(Edges=clean_4.SynchronousTree1)  # -> flatten(Surfaces)
geo_5 = Geometry(flatten([clean_3.SynchronousTree1, boundary]))
geo_6 = Geometry(graft(geo_5))

# ----
# Log of latest(10) SSH Commands
panel_14 = Panel(logviewer_2.Logs)
# Vertex order (and normal)
# 
# source : https://www.radiance-online.org/learning/tutorials/Tutorial-ThreePhaseMethod.pdf
# FILE NAMES: *.vmx - view matrix (data)
# *.hdr - view matrix (renderings)
# *.dmx - daylight matrix
# *.skv - sky vector
# *.smx – sky matrix
# *.xml - transmission matrix (the file is xml format)
# 
# *.rad - radiance scene data
# *.oct - octree file
# *.vf - view file
# *.dat - data
# 
# source : https://www.radiance-online.org/learning/tutorials/Tutorial-ThreePhaseMethod.pdf
image = ImageSampler(
    FilePath="C:\Users\mm1013\Desktop\window normals.png",
    Filter="Colour",
    Interpolate=True,
    Umax=1,
    Umin=0,
    Vmax=1,
    Vmin=0,
    Wrap=1)  # disabled
largest_brep = LargestBREP(window_breps=[<geometry referenced from the Rhino model> x224])

vertical_offset = Panel("0.75m")
grid_size = Panel("0.5m")
docunits = ConvertToDocumentUnits(ValueString=vertical_offset)
docunits_2 = ConvertToDocumentUnits(ValueString=grid_size)

# ----
# Grid
# Setting up grid points
geo_7 = Geometry(graft(geo_6))
rectangle = Rectangle(Plane=PlaneXY(0, 0, 0), XSize=Domain(-1, 1), YSize=Domain(-2, 2), Radius=0)  # -> Rectangle, Length
flip = Flip(Surface=geo_7, Guide=rectangle.Rectangle)  # -> Surface, Result
grid_size_2 = Number(docunits_2)
offset = Number(docunits)
custom_mesh_settings = SettingsCustom(
    StitchSeams=True,
    SimplePlanes=False,
    Refine=True,
    MinCount=16,
    MaxCount=400,
    AspectRatio=20,
    MaxDistance=0,
    MaxAngle=20,
    MinEdge=grid_size_2,
    MaxEdge=grid_size_2)
normals = Normals(geo=flip.Surface, amplitude=offset)  # -> center_2, norm_2, P
mesh_2 = MeshBrep(Brep=flip.Surface, Settings=custom_mesh_settings)
move = Move(Geometry=mesh_2, Motion=normals.norm_2)  # -> Geometry, Transform
facen = FaceNormals(Mesh=move.Geometry)  # -> Centers, Normals

prepare_3_phase_geo_and_wea = LBFalseStartToggle(False)
path = FilePath("C:\Users\mm1013\Documents\Rhino setup\DNK_DRY_OFFICIAL_2001-2010_epw-fil.epw")
panel_15 = Panel(path)
prep_octrees = LBFalseStartToggle(False)
prep_3ph = Boolean(prepare_3_phase_geo_and_wea)

# ----
# Create working folder
panel_16 = Panel("""mkdir -p <proj>
mkdir -p <proj>/obj
echo <proj>""")
overrides = ApplyOverrides(Input_=panel_16)  # -> Output, Pairs
executessh = ExecuteSSH(
    _SSHCommands_=overrides.Output,
    Run=prep_octrees,
    addPrefix=True,
    description="""mkdir -p ~/simulation/boston
mkdir -p ~/simulation/boston/obj
echo ~/simulation/boston""",
    fireLogs=True,
    lastRunTime=9,
    name="Create workingdir",
    suppressWarnings=False,
    results="/home/mss/simulation/boston",
    commands="""mkdir -p ~/simulation/boston
mkdir -p ~/simulation/boston/obj
echo ~/simulation/boston""")  # -> Stdout, Stderr_, Ran

overrides_2 = ApplyOverrides(Input="<projfolder>/radFiles")  # -> Output, Pairs
overrides_3 = ApplyOverrides(Input="<projfolder>")  # -> Output, Pairs
concat_3 = Concatenate(FragmentA=overrides_3.Output, FragmentB="/obj")

# ----
# Coupling windows with rooms (TESTY!!)
# Receivers / Apertures / BSDF files
cull_9 = CullPattern(List=geo_2, CullPattern=graft(python_2.is_receiver))  # -> simplify(List)
cull_10 = CullPattern(List=graft(layer_name_2), CullPattern=graft(python_2.is_receiver))  # -> simplify(List)
cull_11 = CullPattern(List=graft(layer_name_2), CullPattern=graft(python_2.is_receiver))  # -> simplify(List)
srf = Surface(geo_5)
clean_5 = CleanTree(
    RemoveNulls=True,
    RemoveInvalid=True,
    RemoveEmpty=True,
    Tree=cull_11,
    SynchronousTree1=cull_9,
    SynchronousTree2=python_5.reflectance,
    SynchronousTree3=cull_10)  # -> Tree, SynchronousTree1, SynchronousTree2, SynchronousTree3
name_3 = Text(clean_5.Tree)
geo_8 = Geometry(clean_5.SynchronousTree1)
long = LongestList(ListA=clean_5.SynchronousTree1, ListB=clean_5.SynchronousTree3, ListC=name_3, PaddingMode=2)  # -> ListA, ListB, ListC
cluster = Cluster_3(geo=geo_8)  # disabled
couplezonesandwindows = CoupleZonesAndWindows(WindowSurfaces=srf, WindowNames=flatten(long.ListC), SimulationSurfaces=flatten(geo_8), Tol1=0.1, Tol2=-1)  # -> SimulationSurface, WindowSurface, PathsPerWindow
lng = ListLength(List=srf)
series = Series(Start=0, Step=1, Count=lng)  # -> graft(Series)
roomnumber = Text(series)
panel_17 = Panel(series)
assign_paths_3 = AssignPaths(InputData=flatten(couplezonesandwindows.PathsPerWindow), PathsToAssign=flatten(couplezonesandwindows.PathsPerWindow))
assign_paths_4 = AssignPaths(InputData=flatten(long.ListB), PathsToAssign=flatten(couplezonesandwindows.PathsPerWindow))
assign_paths_5 = AssignPaths(InputData=flatten(long.ListC), PathsToAssign=flatten(couplezonesandwindows.PathsPerWindow))
long_2 = LongestList(ListA=series, ListB=couplezonesandwindows.WindowSurface, PaddingMode=2)  # -> ListA, ListB
dpath = DeconstructPath(Branch=assign_paths_3)
cset_3 = CreateSet(List=assign_paths_4)  # -> Set, simplify(graft(Map))
pshift = ShiftPaths(Data=dpath, Offset=1)
area = Area(Geometry=couplezonesandwindows.SimulationSurface)  # -> Area, Centroid
tag = TextTag(Location=area.Centroid, Text=roomnumber, Colour=ColourSwatch(SwatchColor=RGB(255, 255, 255)))
merge = Merge(Data1=pshift, Data2=cset_3.Map)
path_2 = ConstructPath(Indices=merge)
assign_paths_6 = AssignPaths(InputData=flatten(long_2.ListA), PathsToAssign=flatten(path_2))  # -> simplify(RestructuredData)
assign_paths_7 = AssignPaths(InputData=flatten(couplezonesandwindows.WindowSurface), PathsToAssign=flatten(path_2))  # -> simplify(RestructuredData)
assign_paths_8 = AssignPaths(InputData=flatten(assign_paths_5), PathsToAssign=flatten(path_2))  # -> simplify(RestructuredData)
item = ListItem(List=assign_paths_8, Index=0, Wrap=True)
item_2 = ListItem(List=assign_paths_6, Index=0, Wrap=True)
m = GhPythonScript(i=item_2)  # -> i1, simplify(i2); inputs i: Int32
# ---------- m: Python ----------
__author__ = "mm1013"
__version__ = "2022.08.21"

import rhinoscriptsyntax as rs

i1 = i
i2 = "%02d" % i
# ---------- end m ----------
concat_4 = Concatenate(FragmentA=m.i2, FragmentB=item)
meshit2_4 = MeshIt2(mesh_brep=assign_paths_7)
python_6 = GhPythonScript(x=concat_4)  # -> a
# ---------- python_6: Python ----------
__author__ = "mm1013"
__version__ = "2022.09.06"

import rhinoscriptsyntax as rs

a = x[:-5]
# ---------- end python_6 ----------
panel_18 = Panel(python_6)
falsestart = LBFalseStartToggle(False)
concat_5 = Concatenate(FragmentA=concat_3, FragmentB="/receivers")
mesh2obj = MeshToObj(
    Mesh=meshit2_4,
    Name=graft(python_6),
    MapFileName="mapping_windows_bsdf",
    ModifierName=graft(python_6),
    SubfolderOverride=concat_5,
    Run=falsestart)  # -> ObjFiles, MapFile, Run
concat_6 = Concatenate(FragmentA=overrides_2.Output, FragmentB="/receivers")
obj2rad = ObjToRad(
    ObjFiles=graft(mesh2obj.ObjFiles),
    MapFile=mesh2obj.MapFile,
    SubfolderOverride=concat_6,
    Run=mesh2obj.Run,
    stdouts="~/simulation/boston/radFiles/receivers/01_GlassCorridorBottom.rad")  # -> Status, RadFiles, Run
window_rad = Text(obj2rad.RadFiles)
pshift_2 = ShiftPaths(Data=python_6, Offset=-1)
unflatten_2 = UnflattenTree(Tree=window_rad, Guide=pshift_2)
panel_19 = Panel(unflatten_2)

# ----
# Opaque geometry
panel_20 = Panel("mapping_opaque")
modnames = Text(concat_2)
names = Text(name_2)
mesh_3 = Mesh(meshit2_3)
mesh2obj_2 = MeshToObj(
    Mesh=mesh_3,
    Name=graft(names),
    MapFileName=panel_20,
    ModifierName=graft(modnames),
    SubfolderOverride=concat_3,
    Run=executessh.Ran)  # -> ObjFiles, MapFile, Run
obj2rad_2 = ObjToRad(
    ObjFiles=mesh2obj_2.ObjFiles,
    MapFile=mesh2obj_2.MapFile,
    SubfolderOverride=overrides_2.Output,
    Run=mesh2obj_2.Run,
    stdouts="~/simulation/boston/radFiles/_Roofs_50.rad>JOIN<~/simulation/boston/radFiles/_Frames_50.rad>JOIN<~/simulation/boston/radFiles/_SkylightWall_70.rad>JOIN<~/simulation/boston/radFiles/_SlabCeiling_80.rad>JOIN<~/simulation/boston/radFiles/_SlabWall_50.rad>JOIN<~/simulation/boston/radFiles/_WallInterior_70.rad>JOIN<~/simulation/boston/radFiles/_Ground_10.rad>JOIN<~/simulation/boston/radFiles/_FacadeDark_30.rad")  # -> Status, RadFiles, Run
opaque_rad = Text(obj2rad_2.RadFiles)
panel_21 = Panel(opaque_rad)

# ----
# rad files
# Window geometry
panel_22 = Panel("mapping_windows")
mesh2obj_3 = MeshToObj(
    Mesh=mesh,
    Name=graft(name),
    MapFileName=panel_22,
    ModifierName=graft(concat),
    SubfolderOverride=concat_3,
    Run=executessh.Ran)  # -> ObjFiles, MapFile, Run
obj2rad_3 = ObjToRad(
    ObjFiles=mesh2obj_3.ObjFiles,
    MapFile=mesh2obj_3.MapFile,
    SubfolderOverride=overrides_2.Output,
    Run=mesh2obj_3.Run,
    stdouts="~/simulation/boston/radFiles/_GlassTak_70.rad")  # -> Status, RadFiles, Run
window_rad_2 = Text(obj2rad_3.RadFiles)

prep_3ph_2 = Boolean(prep_3ph)
and = GateAnd(A=executessh.Ran, B=prep_3ph_2)

# ----
# opaque materials
panel_23 = Panel("echo \"<mats>\" > <proj>/radFiles/<target>;echo \"<proj>/radFiles/<target>\"")
opaquegreymat = OpaqueGreyMat(Name=concat_2, Reflectance_0_1=refl, Specularity=0, Roughness=0)  # -> flatten(RadMaterials), RadMaterialList
join = TextJoin(Text=opaquegreymat.RadMaterials)
overrides_4 = ApplyOverrides(Input_=panel_23, Mats=graft(join), Target=graft("opaque_materials.mat"))  # -> Output, Pairs
executessh_wip_2 = ExecuteSSHWIP(
    _SSHCommands_=overrides_4.Output,
    Run=obj2rad_2.Run,
    addPrefix=True,
    description="""echo "void plastic _ContextMat_30_mat
0
0
5 0.300 0.300 0.300 0.000 0.000
void plastic _WallInt_70_mat
0
0
5 0.700 0.700 0.700 0.000 0.000
void plastic _SkylightWall_70_mat
0
0
5 0.700 0.700 0.700 0.000 0.000
void plastic _Frames1_50_mat
0
0
5 0.500 0.500 0.500 0.000 0.000
void plastic _Frames_50_mat
0
0
5 0.500 0.500 0.500 0.000 0.000
void plastic _WallInt1_70_mat
0
0
5 0.700 0.700 0.700 0.000 0.000
void plastic _HRRoof1_80_mat
0
0
5 0.800 0.800 0.800 0.000 0.000
void plastic _FramesCW_50_mat
0
0
5 0.500 0.500 0.500 0.000 0.000
void plastic _Doors_50_mat
0
0
5 0.500 0.500 0.500 0.000 0.000
void plastic _Roofs_50_mat
0
0
5 0.500 0.500 0.500 0.000 0.000
void plastic _WallExt_50_mat
0
0
5 0.500 0.500 0.500 0.000 0.000
void plastic _SlabJ_50_mat
0
0
5 0.500 0.500 0.500 0.000 0.000
void plastic _SlabWall_50_mat
0
0
5 0.500 0.500 0.500 0.000 0.000
void plastic _SlabFloor_30_mat
0
0
5 0.300 0.300 0.300 0.000 0.000
void plastic _SlabCeiling_80_mat
0
0
5 0.800 0.800 0.800 0.000 0.000
void plastic _FacadeDark_30_mat
0
0
5 0.300 0.300 0.300 0.000 0.000
void plastic _FacadeBright_70_mat
0
0
5 0.700 0.700 0.700 0.000 0.000" > ~/simulation/boston/radFiles/opaque_materials.mat;echo "~/simulation/boston/radFiles/opaque_materials.mat"
""",
    fireLogs=True,
    lastRunTime=48,
    name="opaqueMats",
    suppressWarnings=False,
    results="~/simulation/boston/radFiles/opaque_materials.mat",
    commands="""echo "void plastic _FacadeDark_30_mat
0
0
5 0.300 0.300 0.300 0.000 0.000
void plastic _Ground_10_mat
0
0
5 0.100 0.100 0.100 0.000 0.000
void plastic _WallInterior_70_mat
0
0
5 0.700 0.700 0.700 0.000 0.000
void plastic _SlabWall_50_mat
0
0
5 0.500 0.500 0.500 0.000 0.000
void plastic _SlabCeiling_80_mat
0
0
5 0.800 0.800 0.800 0.000 0.000
void plastic _SkylightWall_70_mat
0
0
5 0.700 0.700 0.700 0.000 0.000
void plastic _Frames_50_mat
0
0
5 0.500 0.500 0.500 0.000 0.000
void plastic _Roofs_50_mat
0
0
5 0.500 0.500 0.500 0.000 0.000" > ~/simulation/boston/radFiles/opaque_materials.mat;echo "~/simulation/boston/radFiles/opaque_materials.mat"
""")  # -> Stdout, Stderr_, Ran
opaque_mat = Text(executessh_wip_2.Stdout)

# ----
# Setup glass materials
python_7 = GhPythonScript(matname=concat)  # -> filename
# ---------- python_7: Python ----------
__author__ = "mm1013"
__version__ = "2022.07.06"

import rhinoscriptsyntax as rs

filename = matname.replace(" ","_").replace(".","_")
# ---------- end python_7 ----------
glassmat = GlassMat(Name=concat, Transmittance_0_1=transmittance)  # -> RadMaterials, RadMaterialList
# materials
panel_24 = Panel("echo \"<mats>\" > <proj>/radFiles/<target>;echo \"<proj>/radFiles/<target>\"")
overrides_5 = ApplyOverrides(Input_="<mat>.mat", Mat=graft(python_7))  # -> Output, Pairs
overrides_6 = ApplyOverrides(Input_=panel_24, Mats=graft(glassmat.RadMaterials), Target=graft(overrides_5.Output))  # -> Output, Pairs
executessh_wip_3 = ExecuteSSHWIP(
    _SSHCommands_=overrides_6.Output,
    Run=obj2rad_2.Run,
    addPrefix=True,
    description="""echo "void glass _GlassInt1_74_mat
0
0
3 0.806 0.806 0.806" > ~/simulation/boston/radFiles/_GlassInt1_74_mat.mat;echo "~/simulation/boston/radFiles/_GlassInt1_74_mat.mat"


- - -

echo "void glass _GlassFacade_74_mat
0
0
3 0.806 0.806 0.806" > ~/simulation/boston/radFiles/_GlassFacade_74_mat.mat;echo "~/simulation/boston/radFiles/_GlassFacade_74_mat.mat"


- - -

echo "void glass _GlassTak_70_mat
0
0
3 0.763 0.763 0.763" > ~/simulation/boston/radFiles/_GlassTak_70_mat.mat;echo "~/simulation/boston/radFiles/_GlassTak_70_mat.mat"
""",
    fireLogs=True,
    lastRunTime=49,
    name="glassMats",
    suppressWarnings=False,
    results="~/simulation/boston/radFiles/_GlassTak_70_mat.mat",
    commands="""echo "void glass _GlassTak_70_mat
0
0
3 0.763 0.763 0.763" > ~/simulation/boston/radFiles/_GlassTak_70_mat.mat;echo "~/simulation/boston/radFiles/_GlassTak_70_mat.mat"
""")  # -> Stdout, Stderr_, Ran
split = TextSplit(Text=executessh_wip_3.Stdout)
unflatten_3 = UnflattenTree(Tree=split, Guide=overrides_6.Output)

# ---- group: bsdf
# genblinds
panel_25 = Panel("genblinds blindmat blind 0.08 1 2 28 20 +r 0.12 | xform -rz -90 -rx -90 -t 0 0 -0.15 > <proj>/radFiles/<target>.rad;echo <proj>/radFiles/<target>.rad")
panel_26 = Panel("blinds_001")
falsestart_2 = LBFalseStartToggle(False)
overrides_7 = ApplyOverrides(Input_=panel_25, Target=graft(panel_26))  # -> Output, Pairs
bool = Boolean(falsestart_2)
executessh_2 = ExecuteSSH(
    _SSHCommands_=overrides_7.Output,
    Run=bool,
    addPrefix=True,
    description="genblinds blindmat blind 0.08 1 2 28 20 +r 0.12 | xform -rz -90 -rx -90 -t 0 0 -0.15 > ~/simulation/boston/radFiles/blinds_001.rad;echo ~/simulation/boston/radFiles/blinds_001.rad",
    fireLogs=False,
    lastRunTime=6,
    suppressWarnings=False)  # -> Stdout, Stderr_, Ran

# Check the modifiers you want to make BSDF materials with.
# If LT values are the same you can just choose to use one of them
window_rad_3 = Text(window_rad_2)
list = ItemSelector(window_rad_3, {"~/simulation/boston/radFiles/_GlassTak_70.rad"}, selected=[])

# 3 phase simulation
# Check the glass you want for multiphase
# (window groups)
window_rad_4 = Text(window_rad_2)
list_2 = ItemSelector(window_rad_4, {"~/simulation/boston/radFiles/_GlassTak_70.rad"}, selected=[])
window_rads = Text(list_2)

convertpaths = ConvertPaths(I=executessh_2.Stdout)  # -> Linux, Windows
panel_27 = Panel(executessh_2.Stdout)
radviewer = RadViewer(
    RadFiles=flatten(convertpaths.Windows),
    IsTwoSided=False,
    Polychromatic=True,
    ShowEdges=True,
    Transparent=True,
    ColorNames="blindmat",
    Colors=RGB(201, 214, 143))  # -> Geo, ModifierNames, Modifiers, FailedWireFrame

# ----
# setting dimensions
panel_28 = Panel("""getbbox <rad>
getbbox -h <rad>""")
overrides_8 = ApplyOverrides(Input_=panel_28, Rad=graft(executessh_2.Stdout))  # -> Output, Pairs
executessh_3 = ExecuteSSH(
    _SSHCommands_=overrides_8.Output,
    Run=executessh_2.Ran,
    addPrefix=True,
    description="""getbbox <rad>
getbbox -h <rad>""",
    fireLogs=False,
    lastRunTime=12,
    suppressWarnings=False)  # -> Stdout, Stderr_, Ran

# ----
# octrees for opaques (3ph)
and_2 = GateAnd(A=obj2rad_2.Run, B=executessh_wip_2.Ran)
opaque_mat_2 = Text(opaque_mat)
panel_29 = Panel("""mkdir -p <proj>/octrees
oconv -w -f <rads> > <proj>/octrees/<target>.oct;echo <proj>/octrees/<target>.oct""")
opaque_rad_2 = Text(opaque_rad)
entwine = Entwine(Branch00=opaque_mat_2, Branch01=opaque_rad_2, FlattenInputs=True)  # -> flatten(Result)
join_2 = TextJoin(Text=flatten(entwine), Join=" ")
overrides_9 = ApplyOverrides(Input_=panel_29, Rads=graft(join_2), Target=graft("opaque_scene"))  # -> Output, Pairs
executessh_wip_4 = ExecuteSSHWIP(
    _SSHCommands_=overrides_9.Output,
    Run=and_2,
    addPrefix=True,
    description="""mkdir -p ~/simulation/boston/octrees
oconv -w -f ~/simulation/boston/radFiles/opaque_materials.mat ~/simulation/boston/radFiles/_Roofs_50.rad ~/simulation/boston/radFiles/_Frames_50.rad ~/simulation/boston/radFiles/_SkylightWall_70.rad ~/simulation/boston/radFiles/_SlabCeiling_80.rad ~/simulation/boston/radFiles/_SlabWall_50.rad ~/simulation/boston/radFiles/_WallInterior_70.rad ~/simulation/boston/radFiles/_Ground_10.rad ~/simulation/boston/radFiles/_FacadeDark_30.rad > ~/simulation/boston/octrees/opaque_scene.oct;echo ~/simulation/boston/octrees/opaque_scene.oct""",
    fireLogs=False,
    lastRunTime=7,
    suppressWarnings=False,
    results="/home/mss/simulation/boston/octrees/opaque_scene.oct",
    commands="""mkdir -p ~/simulation/boston/octrees
oconv -w -f ~/simulation/boston/radFiles/opaque_materials.mat ~/simulation/boston/radFiles/_Roofs_50.rad ~/simulation/boston/radFiles/_Frames_50.rad ~/simulation/boston/radFiles/_SkylightWall_70.rad ~/simulation/boston/radFiles/_SlabCeiling_80.rad ~/simulation/boston/radFiles/_SlabWall_50.rad ~/simulation/boston/radFiles/_WallInterior_70.rad ~/simulation/boston/radFiles/_Ground_10.rad ~/simulation/boston/radFiles/_FacadeDark_30.rad > ~/simulation/boston/octrees/opaque_scene.oct;echo ~/simulation/boston/octrees/opaque_scene.oct""")  # -> Stdout, Stderr_, Ran
panel_30 = Panel(overrides_9.Output)
panel_31 = Panel(executessh_wip_4.Stdout)
octree = Text(executessh_wip_4.Stdout)

# ----
# Make sure zmax is below 0!
# Also pay attention to X/Y dims.
# Here ymax = 2 and xmax = 1
panel_32 = Panel(executessh_3.Stdout)

# ---- group: rflux comments
name_4 = Text(python_6)
panel_33 = Panel(name_4)
vertical_glazing_rfluxmtx = Panel("#@rfluxmtx h=kf u=Z")
overrides_10 = ApplyOverrides(Input_="void glow <windowMod> 0 0 4 1 1 1 0", WindowMod=graft(name_4))  # -> Output, Pairs
concat_7 = Concatenate(FragmentA=overrides_10.Output, FragmentB=vertical_glazing_rfluxmtx)

# ---- group: skydome
# Skydome
panel_34 = Panel("""mkdir -p <proj>/radFiles;
echo "<skyrad>" > <proj>/radFiles/skyglow_3ph.rad
echo "<proj>/radFiles/skyglow_3ph.rad"
""")
panel_35 = Panel("""#@rfluxmtx h=r1 u=+Y
void glow sky_glow
0
0
4 1 1 1 0
sky_glow source sky
0
0
4 0 0 1 180
#@rfluxmtx h=u u=+Y
void glow ground_glow
0
0
4 1 1 1 0
ground_glow source ground
0
0
4 0 0 -1 180""")
falsestart_3 = LBFalseStartToggle(False)
overrides_11 = ApplyOverrides(Input_=panel_34, Skyrad=graft(panel_35))  # -> Output, Pairs
executessh_4 = ExecuteSSH(
    _SSHCommands_=overrides_11.Output,
    Run=falsestart_3,
    addPrefix=True,
    description="""mkdir -p ~/simulation/boston/radFiles;
echo "#@rfluxmtx h=r1 u=+Y
void glow sky_glow
0
0
4 1 1 1 0
sky_glow source sky
0
0
4 0 0 1 180
#@rfluxmtx h=u u=+Y
void glow ground_glow
0
0
4 1 1 1 0
ground_glow source ground
0
0
4 0 0 -1 180" > ~/simulation/boston/radFiles/skyglow_3ph.rad
echo "~/simulation/boston/radFiles/skyglow_3ph.rad"
""",
    fireLogs=False,
    lastRunTime=14,
    suppressWarnings=False,
    results="~/simulation/boston/radFiles/skyglow_3ph.rad",
    commands="""mkdir -p ~/simulation/boston/radFiles;
echo "#@rfluxmtx h=r1 u=+Y
void glow sky_glow
0
0
4 1 1 1 0
sky_glow source sky
0
0
4 0 0 1 180
#@rfluxmtx h=u u=+Y
void glow ground_glow
0
0
4 1 1 1 0
ground_glow source ground
0
0
4 0 0 -1 180" > ~/simulation/boston/radFiles/skyglow_3ph.rad
echo "~/simulation/boston/radFiles/skyglow_3ph.rad"
""")  # -> Stdout, Stderr_, Ran
panel_36 = Panel(executessh_4.Stdout)
skyglow = Text(executessh_4.Stdout)

# ---- group: rflux comments
# adding rflux comments to windowRads
panel_37 = Panel("""echo "<rfluxmtx>" > <windowRad-.>_rflux.rad
cat <windowRad> >> <windowRad-.>_rflux.rad
echo <windowRad-.>_rflux.rad""")
overrides_12 = ApplyOverrides(Input_=panel_37, Rfluxmtx=graft(concat_7), WindowRad=graft(unflatten_2))  # -> Output, Pairs
executessh_5 = ExecuteSSH(
    _SSHCommands_=overrides_12.Output,
    Run=obj2rad.Run,
    addPrefix=True,
    description="""echo "void glow  0 0 4 1 1 1 0
#@rfluxmtx h=kf u=Z" > <windowRad>_rflux.rad
cat <windowRad> >> <windowRad>_rflux.rad
echo <windowRad>_rflux.rad""",
    fireLogs=True,
    lastRunTime=36,
    name="Add Comments",
    suppressWarnings=False,
    results=["/home/mss/simulation/boston/radFiles/receivers/00_GlassRoof_rflux.rad", "/home/mss/simulation/boston/radFiles/receivers/00_GlassCorridorTop_rflux.rad", "/home/mss/simulation/boston/radFiles/receivers/00_GlassCorridorBottom_rflux.rad", "/home/mss/simulation/boston/radFiles/receivers/01_GlassRoof_rflux.rad", "/home/mss/simulation/boston/radFiles/receivers/01_GlassCorridorTop_rflux.rad", "/home/mss/simulation/boston/radFiles/receivers/01_GlassCorridorBottom_rflux.rad"],
    commands=["""echo "void glow 00_GlassRoof 0 0 4 1 1 1 0
#@rfluxmtx h=kf u=Z" > ~/simulation/boston/radFiles/receivers/00_GlassRoof_rflux.rad
cat ~/simulation/boston/radFiles/receivers/00_GlassRoof.rad >> ~/simulation/boston/radFiles/receivers/00_GlassRoof_rflux.rad
echo ~/simulation/boston/radFiles/receivers/00_GlassRoof_rflux.rad""", """echo "void glow 00_GlassCorridorBottom 0 0 4 1 1 1 0
#@rfluxmtx h=kf u=Z" > ~/simulation/boston/radFiles/receivers/00_GlassCorridorBottom_rflux.rad
cat ~/simulation/boston/radFiles/receivers/00_GlassCorridorBottom.rad >> ~/simulation/boston/radFiles/receivers/00_GlassCorridorBottom_rflux.rad
echo ~/simulation/boston/radFiles/receivers/00_GlassCorridorBottom_rflux.rad""", """echo "void glow 01_GlassRoof 0 0 4 1 1 1 0
#@rfluxmtx h=kf u=Z" > ~/simulation/boston/radFiles/receivers/01_GlassRoof_rflux.rad
cat ~/simulation/boston/radFiles/receivers/01_GlassRoof.rad >> ~/simulation/boston/radFiles/receivers/01_GlassRoof_rflux.rad
echo ~/simulation/boston/radFiles/receivers/01_GlassRoof_rflux.rad""", """echo "void glow 01_GlassCorridorBottom 0 0 4 1 1 1 0
#@rfluxmtx h=kf u=Z" > ~/simulation/boston/radFiles/receivers/01_GlassCorridorBottom_rflux.rad
cat ~/simulation/boston/radFiles/receivers/01_GlassCorridorBottom.rad >> ~/simulation/boston/radFiles/receivers/01_GlassCorridorBottom_rflux.rad
echo ~/simulation/boston/radFiles/receivers/01_GlassCorridorBottom_rflux.rad""", """echo "void glow 00_GlassCorridorTop 0 0 4 1 1 1 0
#@rfluxmtx h=kf u=Z" > ~/simulation/boston/radFiles/receivers/00_GlassCorridorTop_rflux.rad
cat ~/simulation/boston/radFiles/receivers/00_GlassCorridorTop.rad >> ~/simulation/boston/radFiles/receivers/00_GlassCorridorTop_rflux.rad
echo ~/simulation/boston/radFiles/receivers/00_GlassCorridorTop_rflux.rad"""])  # -> Stdout, Stderr_, Ran
unflatten_4 = UnflattenTree(Tree=executessh_5.Stdout, Guide=pshift_2)
fenestrations_rad_rflux = Text(unflatten_4)

fenestrations_rad_rflux_2 = Text(fenestrations_rad_rflux)
overrides_13 = ApplyOverrides(Input_="head <file> -n 20", File=graft(fenestrations_rad_rflux_2))  # -> flatten(Output), Pairs
executessh_6 = ExecuteSSH(
    _SSHCommands_=overrides_13.Output,
    Run=executessh_5.Ran,
    addPrefix=True,
    description="head <file> -n 20",
    fireLogs=False,
    lastRunTime=8,
    suppressWarnings=False,
    results="""void glow 00_GlassRoof 0 0 4 1 1 1 0
#@rfluxmtx h=kf u=Z
# obj2rad -m /home/mss/simulation/boston/radFiles/receivers/mapping_windows_bsdf.map -f /home/mss/simulation/boston/radFiles/receivers/00_GlassRoof.obj
# Written with MantaRay plugin/GH_MeshToRad

00_GlassRoof polygon 00_GlassRoof_1.1
0
0
12
            49.167            190.874            120.314
            49.167            191.874            120.938
            50.167            191.874            120.938
            50.167            190.875            120.314

# Done processing file: /home/mss/simulation/boston/radFiles/receivers/00_GlassRoof.obj
# 8 lines, 8 statements, 0 unrecognized
_JOIN_
void glow 00_GlassCorridorTop 0 0 4 1 1 1 0
#@rfluxmtx h=kf u=Z
# obj2rad -m /home/mss/simulation/boston/radFiles/receivers/mapping_windows_bsdf.map -f /home/mss/simulation/boston/radFiles/receivers/00_GlassCorridorTop.obj
# Written with MantaRay plugin/GH_MeshToRad

00_GlassCorridorTop polygon 00_GlassCorridorTop_1.1
0
0
12
            50.437             185.64            117.602
            51.104             185.64            117.602
            51.104             185.64            116.868
            50.437             185.64            116.868

00_GlassCorridorTop polygon 00_GlassCorridorTop_1.2
0
0
12
             49.77             185.64            117.602
            50.437             185.64            117.602
_JOIN_
void glow 00_GlassCorridorBottom 0 0 4 1 1 1 0
#@rfluxmtx h=kf u=Z
# obj2rad -m /home/mss/simulation/boston/radFiles/receivers/mapping_windows_bsdf.map -f /home/mss/simulation/boston/radFiles/receivers/00_GlassCorridorBottom.obj
# Written with MantaRay plugin/GH_MeshToRad

00_GlassCorridorBottom polygon 00_GlassCorridorBottom_1.1
0
0
12
            51.027            185.727            116.715
            51.027            185.727            114.712
            50.281            185.727            114.712
            50.281            185.727            116.715

00_GlassCorridorBottom polygon 00_GlassCorridorBottom_1.2
0
0
12
             48.26             185.64            116.792
            49.694             185.64            116.792
_JOIN_
void glow 01_GlassRoof 0 0 4 1 1 1 0
#@rfluxmtx h=kf u=Z
# obj2rad -m /home/mss/simulation/boston/radFiles/receivers/mapping_windows_bsdf.map -f /home/mss/simulation/boston/radFiles/receivers/01_GlassRoof.obj
# Written with MantaRay plugin/GH_MeshToRad

01_GlassRoof polygon 01_GlassRoof_1.1
0
0
12
            53.781            189.607             120.65
            52.781            189.607            120.603
            52.767            190.107            120.891
            53.767            190.107            120.938

01_GlassRoof polygon 01_GlassRoof_1.2
0
0
12
            53.794            189.107            120.362
            52.794            189.107            120.315
_JOIN_
void glow 01_GlassCorridorTop 0 0 4 1 1 1 0
#@rfluxmtx h=kf u=Z
# obj2rad -m /home/mss/simulation/boston/radFiles/receivers/mapping_windows_bsdf.map -f /home/mss/simulation/boston/radFiles/receivers/01_GlassCorridorTop.obj
# Written with MantaRay plugin/GH_MeshToRad

01_GlassCorridorTop polygon 01_GlassCorridorTop_1.1
0
0
12
            54.674            185.615            117.602
            54.674            185.615            116.868
             53.24            185.615            116.868
             53.24            185.615            117.602

01_GlassCorridorTop polygon 01_GlassCorridorTop_1.2
0
0
12
            52.497             185.64            117.602
            53.164             185.64            117.602
_JOIN_
void glow 01_GlassCorridorBottom 0 0 4 1 1 1 0
#@rfluxmtx h=kf u=Z
# obj2rad -m /home/mss/simulation/boston/radFiles/receivers/mapping_windows_bsdf.map -f /home/mss/simulation/boston/radFiles/receivers/01_GlassCorridorBottom.obj
# Written with MantaRay plugin/GH_MeshToRad

01_GlassCorridorBottom polygon 01_GlassCorridorBottom_1.1
0
0
12
            54.674            185.615            116.792
            54.674            185.615            114.658
             53.24            185.615            114.658
             53.24            185.615            116.792

01_GlassCorridorBottom polygon 01_GlassCorridorBottom_1.2
0
0
12
            51.907            185.747            116.715
            52.653            185.747            116.715""",
    commands="""head /home/mss/simulation/boston/radFiles/receivers/00_GlassRoof_rflux.rad -n 20
_JOIN_
head /home/mss/simulation/boston/radFiles/receivers/00_GlassCorridorTop_rflux.rad -n 20
_JOIN_
head /home/mss/simulation/boston/radFiles/receivers/00_GlassCorridorBottom_rflux.rad -n 20
_JOIN_
head /home/mss/simulation/boston/radFiles/receivers/01_GlassRoof_rflux.rad -n 20
_JOIN_
head /home/mss/simulation/boston/radFiles/receivers/01_GlassCorridorTop_rflux.rad -n 20
_JOIN_
head /home/mss/simulation/boston/radFiles/receivers/01_GlassCorridorBottom_rflux.rad -n 20""")  # -> Stdout, Stderr_, Ran
panel_38 = Panel(executessh_6.Stdout)

# ----
cluster_2 = Cluster_2(l=executessh_3.Stdout)  # -> xstart_2, xend_2, ystart_2, yend_2, zmin
overrides_14 = ApplyOverrides(
    Input_="-dim <xstart> <xend> <ystart> <yend> <zmin> 0",
    Xstart=graft(cluster_2.xstart_2),
    Xend=graft(cluster_2.xend_2),
    Ystart=graft(cluster_2.ystart_2),
    Yend=graft(cluster_2.yend_2),
    Zmin=graft(cluster_2.zmin))  # -> Output, Pairs

and_3 = GateAnd()

# ---- group: one room
# VIEW (image based)
button = Button()
view_names = Panel("P1")
view = CreateView(Viewport=view_names, Update=button)  # -> ViewfileContent, ImageRatio
panel_39 = Panel("""mkdir -p <proj>/views/
echo "<vf>" > <proj>/views/<target>.vf
echo <proj>/views/<target>.vf""")
vf = Text(view.ViewfileContent)
overrides_15 = ApplyOverrides(Input=panel_39, Vf=graft(vf), Target=graft(view_names))  # -> Output, Pairs
file_exists = Panel("[ -f <out> ] && echo \"1\" || echo \"0\"")
execute_ssh_async = ExecuteSSHAsync(
    _SSHCommands_=overrides_15.Output,
    Run=button,
    addPrefix=True,
    addSuffix=True,
    description="""mkdir -p ~/simulation/test_project2/views/
echo "rvu -vtv -vp -22628.9361776861 -19649.1284922488 4599.01771764096 -vd 0.135656474653245 -0.99040997675779 -0.0261801226751789 -vu 0.00355272087214904 -0.025937945132412 0.999657241846781 -vh 88.272 -vv 50.000" > ~/simulation/test_project2/views/P1.vf
echo ~/simulation/test_project2/views/P1.vf""",
    fireLogs=False,
    stdouts="/home/mss/simulation/test_project2/views/P1.vf",
    suppressWarnings=False)  # -> Stdout, Stderr_, Log, port, Ran
item_3 = ListItem(List=flatten(execute_ssh_async.Stdout), Index=0, Wrap=True)
panel_40 = Panel(execute_ssh_async.Stdout)
overrides_16 = ApplyOverrides(Input=file_exists, Out=graft(item_3))  # -> Output, Pairs
execute_ssh_async_2 = ExecuteSSHAsync(
    _SSHCommands_=overrides_16.Output,
    addPrefix=True,
    addSuffix=True,
    description="[ -f /home/mss/simulation/test_project2/views/P1.vf ] && echo \"1\" || echo \"0\"",
    fireLogs=False,
    stdouts="1",
    suppressWarnings=False)  # -> Stdout, Stderr_, Log, port, Ran
viewfiles = Text(execute_ssh_async.Stdout)

# Skyvector, point in time (m:1)
panel_41 = Panel("DNK_DRY_OFFICIAL_2001-2010_epw-fil.epw")
python_8 = GhPythonScript(filename=panel_41)  # -> local_path
# ---------- python_8: Python ----------
__author__ = "mm1013"
__version__ = "2022.08.16"

import rhinoscriptsyntax as rs
if filename is not None:
    local_path = "\\".join(ghdoc.Path.split("\\")[:-1]) + "\\" + filename
else:
    local_path = "\\".join(ghdoc.Path.split("\\")[:-1]) + "\\"
# ---------- end python_8 ----------
importepw = LBImportEPW(epw_file=python_8)  # -> location, dry_bulb_temperature, dew_point_temperature, relative_humidity, wind_speed, wind_direction, direct_normal_rad, diffuse_horizontal_rad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; plug-in component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
panel_42 = Panel("""mkdir -p <proj>/skyvectors
gensky <m> <d> <h>:00<ts> +s -a <lat> -o -<lon> | genskyvec -m 1 > <proj>/skyvectors/<prefix>_CIEs_<m2><d2><h2>.vec
echo "<proj>/skyvectors/<prefix>_CIEs_<m2><d2><h2>.vec"
""")
decnstrloc = LBDeconstructLocation(location=importepw.location)  # -> name, latitude, longitude, time_zone, elevation; plug-in component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
panel_43 = Panel(decnstrloc.latitude)
panel_44 = Panel(decnstrloc.longitude)
m_2 = GhPythonScript(i="6")  # -> i1, i2; inputs i: Int32; same code as m
d = GhPythonScript(i="21")  # -> i1, i2; inputs i: Int32; same code as m
h = GhPythonScript(i="15")  # -> i1, i2; inputs i: Int32; same code as m
overrides_17 = ApplyOverrides(
    Input_=panel_42,
    Lat=graft(panel_43),
    Lon=graft(panel_44),
    Prefix=graft("DNK"),
    M=graft(m_2.i1),
    M2=graft(m_2.i2),
    D=graft(d.i1),
    D2=graft(d.i2),
    H=graft(h.i1),
    H2=graft(h.i2),
    Ts=graft("CEST"))  # -> Output, Pairs
falsestart_4 = LBFalseStartToggle(False)
executessh_7 = ExecuteSSH(
    _SSHCommands_=overrides_17.Output,
    Run=falsestart_4,
    addPrefix=True,
    description="""mkdir -p ~/simulation/boston/skyvectors
gensky 6 21 15:00CEST +s -a 55.8764 -o -12.4121 | genskyvec -m 1 > ~/simulation/boston/skyvectors/DNK_CIEs_062115.vec
echo "~/simulation/boston/skyvectors/DNK_CIEs_062115.vec"
""",
    fireLogs=True,
    lastRunTime=5,
    name="Create skyvector",
    suppressWarnings=False)  # -> Stdout, Stderr_, Ran
panel_45 = Panel(executessh_7.Stdout)
python_9 = GhPythonScript(x=executessh_7.Stdout)  # -> flatten(a)
# ---------- python_9: Python ----------
__author__ = "mm1013"
__version__ = "2022.08.21"

import rhinoscriptsyntax as rs

a = x.split("/")[-1].split(".")[0]
# ---------- end python_9 ----------

# ----
folder_exists = Panel("[ -f <proj> ] && echo \"1\" || echo \"0\"")
falsestart_5 = LBFalseStartToggle(False)

panel_46 = Panel("""0
0
0
0
0
0
0
0
1
1
1
1
1
1
1
1
1
1
0
0
0
0
0
0""")
int = Integer(panel_46)
dup = DuplicateData(Data=int, Number="365", Order=True)

# ---- group: one room
panel_47 = Panel("""0
0
0
0
0
0
0
0
1
1
1
1
1
1
1
1
1
1
0
0
0
0
0
0""")
int_2 = Integer(panel_47)
dup_2 = DuplicateData(Data=int_2, Number="365", Order=True)

# ----
# grid points
pt = Point(facen.Centers)
vec = Vector(facen.Normals)
overrides_18 = ApplyOverrides(Input="<projfolder>")  # -> Output, Pairs

concat_8 = Concatenate(FragmentA=overrides_18.Output, FragmentB="/points")

points2pts = PointsToPts(Points=pt, Vectors=vec, Name=series, SubfolderOverride=concat_8, Run=executessh.Ran)  # -> PtsFile, Run
ptsfile = Text(points2pts.PtsFile)

# ----
# preview pts files
# opt1 - cat directly from linux
panel_48 = Panel("cat <pts>")  # disabled
points = Text(ptsfile)  # disabled
overrides_19 = ApplyOverrides(Input_=panel_48, Pts=graft(points))  # -> Output, Pairs; disabled
toggle_3 = BooleanToggle(False)  # disabled
execute_ssh_async_3 = ExecuteSSHAsync(
    _SSHCommands_=overrides_19.Output,
    Run=toggle_3,
    addPrefix=True,
    addSuffix=True,
    description="""cat /home/mss/simulation/boston/points/0.pts
cat /home/mss/simulation/boston/points/1.pts""",
    fireLogs=False,
    suppressWarnings=False)  # -> Stdout, Stderr_, port, port_2, Ran; disabled
ptsview = PtsViewer(PtsString=execute_ssh_async_3.Stdout)  # disabled

# ----
# opt2 - read local windows pts file
points_2 = Text(ptsfile)  # disabled
convertpaths_2 = ConvertPaths(I=points_2)  # -> Linux, Windows; disabled
ptsview_2 = PtsViewer(PtsString=flatten(convertpaths_2.Windows))  # disabled

# ----
# WEA file
# create WEA file
panel_49 = Panel("<LinuxHome>/weatherData")
overrides_20 = ApplyOverrides(Input_=panel_49)  # -> Output, Pairs

python_10 = GhPythonScript(x=overrides_20.Output)  # -> a
# ---------- python_10: Python ----------
__author__ = "mm1013"
__version__ = "2022.07.02"

import rhinoscriptsyntax as rs

a = x[1:]
# ---------- end python_10 ----------

upload = Upload(
    LocalFilePaths=path,
    SubfolderOverride=python_10,
    Run=and,
    stdouts="~/simulation/weatherData/DNK_DRY_OFFICIAL_2001-2010_epw-fil.epw")  # -> Status, FilePaths, Run
overrides_21 = ApplyOverrides(Input_="epw2wea <epw> <epw-.>.wea 1>&2;echo <epw-.>.wea", Epw=graft(upload.FilePaths))  # -> Output, Pairs
executessh_wip_5 = ExecuteSSHWIP(
    _SSHCommands=overrides_21.Output,
    Run=upload.Run,
    addPrefix=True,
    description="epw2wea ~/simulation/weatherData/DNK_DRY_OFFICIAL_2001-2010_epw-fil.epw ~/simulation/weatherData/DNK_DRY_OFFICIAL_2001-2010_epw-fil.wea 1>&2;echo ~/simulation/weatherData/DNK_DRY_OFFICIAL_2001-2010_epw-fil.wea",
    fireLogs=True,
    lastRunTime=10,
    name="weaFile",
    suppressWarnings=True,
    results="/home/mss/simulation/weatherData/DNK_DRY_OFFICIAL_2001-2010_epw-fil.wea",
    stderr="""place SJAELSMARK_DNK
latitude 55.8764
longitude -12.41
time_zone -15.00
site_elevation 40
weather_data_file_units 1""",
    commands="epw2wea ~/simulation/weatherData/DNK_DRY_OFFICIAL_2001-2010_epw-fil.epw ~/simulation/weatherData/DNK_DRY_OFFICIAL_2001-2010_epw-fil.wea 1>&2;echo ~/simulation/weatherData/DNK_DRY_OFFICIAL_2001-2010_epw-fil.wea")  # -> Stdout, Stderr, Ran
panel_50 = Panel(executessh_wip_5.Stdout)
wea_file = Text(executessh_wip_5.Stdout)

panel_51 = Panel(executessh_wip_5.Stderr)

# ----
# Get diffuseHorizontal from EPW
panel_52 = Panel("rcalc -t, -e '$1=$16' <epw>")
overrides_22 = ApplyOverrides(Input_=panel_52, Epw=graft(upload.FilePaths))  # -> Output, Pairs
executessh_wip_6 = ExecuteSSHWIP(
    _SSHCommands_=overrides_22.Output,
    Run=upload.Run,
    addPrefix=True,
    description="rcalc -t, -e '$1=$16' ~/simulation/weatherData/DNK_DRY_OFFICIAL_2001-2010_epw-fil.epw",
    fireLogs=False,
    lastRunTime=11,
    suppressWarnings=False,
    results="""0
0
0
12
0
0
0
0
0
0
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""",
    commands="rcalc -t, -e '$1=$16' ~/simulation/weatherData/DNK_DRY_OFFICIAL_2001-2010_epw-fil.epw")  # -> Stdout, Stderr_, Ran
python_11 = GhPythonScript(inp=executessh_wip_6.Stdout)  # -> illum
# ---------- python_11: Python ----------
__author__ = "mm1013"
__version__ = "2022.07.04"

import rhinoscriptsyntax as rs

illum = [float(i) for i in inp.split("\n")][8:] #skipping headers
# ---------- end python_11 ----------

file_exists_2 = Panel("[ -f <out> ] && echo \"1\" || echo \"0\"")
panel_53 = Panel("out")  # disabled
applyglobals = ApplyGlobals(Input=file_exists_2, AdditionalKeys=panel_53, AdditionalValues=executessh_wip_5.Stdout)  # -> Output, Pairs; disabled
execute_ssh_async_4 = ExecuteSSHAsync(
    SSHCommands=applyglobals.Output,
    Run=upload.Run,
    addPrefix=True,
    addSuffix=True,
    fireLogs=False,
    stdouts="1",
    suppressWarnings=False)  # -> Stdout, Stderr, Log, port, Ran; disabled

# ----
# broken
panel_54 = Panel("50")
python_12 = GhPythonScript(inp=python_11, threshold=panel_54)  # -> on_off_sorted, port, illum, hoys_sorted, illum_sorted, hoys; inputs inp: list; disabled
# ---------- python_12: Python ----------
__author__ = "mm1013"
__version__ = "2022.07.04"

import rhinoscriptsyntax as rs
illum = inp
hoys = range(len(illum))
hoys_sorted = [hoy for _, hoy in sorted(zip(illum, hoys))]
illum_sorted = [il for il, _ in sorted(zip(illum, hoys))]

thres = int(len(illum) * float(threshold) / 100.0)

off = [0] * thres
on = [1] * (len(illum) - thres)
off.extend(on)

on_off_sorted = [o for _, o in sorted(zip(hoys_sorted, off))]



hoys_ = sorted(hoys_sorted[thres:])
# ---------- end python_12 ----------

# ----
# EN17037 Schedule
cluster_3 = Cluster(horizontaldiffrad=python_11)

_3dchart = Ladybug_3DChart(inputData=flatten(cluster_3), xScale="0.25", zScale="0")  # -> readMe, graphMesh, graphCurves, legend, legendBasePts, title, titleBasePts, dataPts, conditionalHOY; disabled; plug-in component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
ladybug = Ladybug_Ladybug()  # -> Vviiiiiiiiiizzz; disabled; plug-in component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

# ----
# Skies and Skymatrices (3ph + 2ph DDS)
# Annual sky-matrix 145 patches
panel_55 = Panel("gendaymtx -m 1 \"<wea>\" > <wea-.>_m1.smx;echo \"<wea-.>_m1.smx\"")
wea_file_2 = Text(wea_file)
overrides_23 = ApplyOverrides(Input=panel_55, Wea=graft(wea_file_2))  # -> Output, Pairs
executessh_wip_7 = ExecuteSSHWIP(
    _SSHCommands_=overrides_23.Output,
    Run=executessh_wip_5.Ran,
    addPrefix=True,
    description="gendaymtx -m 1 \"/home/mss/simulation/weatherData/DNK_DRY_OFFICIAL_2001-2010_epw-fil.wea\" > /home/mss/simulation/weatherData/DNK_DRY_OFFICIAL_2001-2010_epw-fil_m1.smx;echo \"/home/mss/simulation/weatherData/DNK_DRY_OFFICIAL_2001-2010_epw-fil_m1.smx\"",
    fireLogs=False,
    lastRunTime=1094,
    suppressWarnings=False,
    results="/home/mss/simulation/weatherData/DNK_DRY_OFFICIAL_2001-2010_epw-fil_m1.smx",
    commands="gendaymtx -m 1 \"/home/mss/simulation/weatherData/DNK_DRY_OFFICIAL_2001-2010_epw-fil.wea\" > /home/mss/simulation/weatherData/DNK_DRY_OFFICIAL_2001-2010_epw-fil_m1.smx;echo \"/home/mss/simulation/weatherData/DNK_DRY_OFFICIAL_2001-2010_epw-fil_m1.smx\"")  # -> Stdout, Stderr_, Ran
panel_56 = Panel(executessh_wip_7.Stdout)
skymtx = Text(executessh_wip_7.Stdout)

ptsfile_2 = Text(ptsfile)
octree_no_glass = Text(octree)
skymtx_2 = Text(executessh_wip_7.Stdout)

# ----
# Viewmatrix (grid based)
ptsfile_3 = Text(simplify(ptsfile))
glassname = Text(python_6)
fenestrations_rad_rflux_3 = Text(fenestrations_rad_rflux)
octree_no_glass_2 = Text(octree_no_glass)
roomnumber_2 = Text(roomnumber)
panel_57 = Panel("""mkdir -p <proj>/mtxs/3ph_vmx_grid
rfluxmtx -v -w -I+ <param> -n <cpus> -y <ptcount> - <receiver> -i <octree> < <ptsfile> > <proj>/mtxs/3ph_vmx_grid/<room>_<window>.vmx
echo <proj>/mtxs/3ph_vmx_grid/<room>_<window>.vmx""")
m_3 = GhPythonScript(i=roomnumber_2)  # -> i1, simplify(i2); inputs i: Int32; same code as m
falsestart_6 = LBFalseStartToggle(False)
overrides_24 = ApplyOverrides(Input_="wc -l < <ptsFile>", PtsFile=graft(ptsfile_3))  # -> Output, Pairs
abx = ABX(data=glassname, pathCount=1)  # -> data; inputs data: tree, pathCount: Int32
# ---------- abx: C# usings ----------
using System.Linq;
# ---------- abx: C# ----------
    DataTree<object> newTree = new DataTree<object>();
    _data.SimplifyPaths();
    var y = _data.Paths;
    if (pathCount < 1)
    {
      pathCount = 1;
    }


    for (int i = 0; i < _data.BranchCount; i++)
    {
      GH_Path oldPath = _data.Paths[i];
      GH_Path p = new GH_Path(oldPath.Indices.Take(pathCount).ToArray());


      newTree.AddRange(_data.Branches[i], p);
    }
    data = newTree;
# ---------- end abx ----------
executessh_wip_8 = ExecuteSSHWIP(
    _SSHCommands_=overrides_24.Output,
    Run=executessh_5.Ran,
    addPrefix=True,
    description="""wc -l < /home/mss/simulation/boston/points/0.pts


- - -

wc -l < /home/mss/simulation/boston/points/1.pts


- - -

wc -l < <ptsFile>


- - -

wc -l < <ptsFile>


- - -

wc -l < <ptsFile>


- - -

wc -l < <ptsFile>


- - -

wc -l < <ptsFile>


- - -

wc -l < <ptsFile>


- - -

wc -l < <ptsFile>


- - -

wc -l < <ptsFile>


- - -

wc -l < <ptsFile>


- - -

wc -l < <ptsFile>


- - -

wc -l < <ptsFile>


- - -

wc -l < <ptsFile>


- - -

wc -l < <ptsFile>


- - -

wc -l < <ptsFile>


- - -

wc -l < <ptsFile>


- - -

wc -l < <ptsFile>


- - -

wc -l < <ptsFile>


- - -

wc -l < <ptsFile>


- - -

wc -l < <ptsFile>


- - -

wc -l < <ptsFile>


- - -

wc -l < <ptsFile>""",
    fireLogs=False,
    lastRunTime=16,
    suppressWarnings=False,
    results=["116", "68"],
    commands="wc -l < /home/mss/simulation/boston/points/1.pts")  # -> Stdout, Stderr_, Ran
long_3 = LongestList(ListA=abx, ListB=fenestrations_rad_rflux_3, ListC=ptsfile_3, ListD=m_3.i2, ListE=executessh_wip_8.Stdout, PaddingMode=2)  # -> ListA, ListB, ListC, ListD, ListE
pt_count = Panel(executessh_wip_8.Stdout)
overrides_25 = ApplyOverrides(
    Input_=panel_57,
    Window=graft(long_3.ListA),
    Receiver=graft(long_3.ListB),
    Octree=graft(octree_no_glass_2),
    Ptsfile=graft(long_3.ListC),
    Room=graft(long_3.ListD),
    Ptcount=graft(long_3.ListE),
    Param=graft("-ab 1 -ad 512 -lw 1e-3"))  # -> flatten(Output), Pairs
executessh_wip_9 = ExecuteSSHWIP(
    _SSHCommands_=overrides_25.Output,
    Run=falsestart_6,
    addPrefix=True,
    description="""mkdir -p ~/simulation/boston/mtxs/3ph_vmx_grid
rfluxmtx -v -w -I+ -ab 1 -ad 512 -lw 1e-3 -n 11 -y 116 - <receiver> -i /home/mss/simulation/boston/octrees/opaque_scene.oct < /home/mss/simulation/boston/points/0.pts > ~/simulation/boston/mtxs/3ph_vmx_grid/00_.vmx
echo ~/simulation/boston/mtxs/3ph_vmx_grid/00_.vmx
mkdir -p ~/simulation/boston/mtxs/3ph_vmx_grid
rfluxmtx -v -w -I+ -ab 1 -ad 512 -lw 1e-3 -n 11 -y 68 - <receiver> -i /home/mss/simulation/boston/octrees/opaque_scene.oct < /home/mss/simulation/boston/points/1.pts > ~/simulation/boston/mtxs/3ph_vmx_grid/01_.vmx
echo ~/simulation/boston/mtxs/3ph_vmx_grid/01_.vmx
mkdir -p ~/simulation/boston/mtxs/3ph_vmx_grid
rfluxmtx -v -w -I+ -ab 1 -ad 512 -lw 1e-3 -n 11 -y <ptcount> - <receiver> -i /home/mss/simulation/boston/octrees/opaque_scene.oct < <ptsfile> > ~/simulation/boston/mtxs/3ph_vmx_grid/02_.vmx
echo ~/simulation/boston/mtxs/3ph_vmx_grid/02_.vmx
mkdir -p ~/simulation/boston/mtxs/3ph_vmx_grid
rfluxmtx -v -w -I+ -ab 1 -ad 512 -lw 1e-3 -n 11 -y <ptcount> - <receiver> -i /home/mss/simulation/boston/octrees/opaque_scene.oct < <ptsfile> > ~/simulation/boston/mtxs/3ph_vmx_grid/03_.vmx
echo ~/simulation/boston/mtxs/3ph_vmx_grid/03_.vmx
mkdir -p ~/simulation/boston/mtxs/3ph_vmx_grid
rfluxmtx -v -w -I+ -ab 1 -ad 512 -lw 1e-3 -n 11 -y <ptcount> - <receiver> -i /home/mss/simulation/boston/octrees/opaque_scene.oct < <ptsfile> > ~/simulation/boston/mtxs/3ph_vmx_grid/04_.vmx
echo ~/simulation/boston/mtxs/3ph_vmx_grid/04_.vmx
mkdir -p ~/simulation/boston/mtxs/3ph_vmx_grid
rfluxmtx -v -w -I+ -ab 1 -ad 512 -lw 1e-3 -n 11 -y <ptcount> - <receiver> -i /home/mss/simulation/boston/octrees/opaque_scene.oct < <ptsfile> > ~/simulation/boston/mtxs/3ph_vmx_grid/05_.vmx
echo ~/simulation/boston/mtxs/3ph_vmx_grid/05_.vmx
mkdir -p ~/simulation/boston/mtxs/3ph_vmx_grid
rfluxmtx -v -w -I+ -ab 1 -ad 512 -lw 1e-3 -n 11 -y <ptcount> - <receiver> -i /home/mss/simulation/boston/octrees/opaque_scene.oct < <ptsfile> > ~/simulation/boston/mtxs/3ph_vmx_grid/06_.vmx
echo ~/simulation/boston/mtxs/3ph_vmx_grid/06_.vmx
mkdir -p ~/simulation/boston/mtxs/3ph_vmx_grid
rfluxmtx -v -w -I+ -ab 1 -ad 512 -lw 1e-3 -n 11 -y <ptcount> - <receiver> -i /home/mss/simulation/boston/octrees/opaque_scene.oct < <ptsfile> > ~/simulation/boston/mtxs/3ph_vmx_grid/07_.vmx
echo ~/simulation/boston/mtxs/3ph_vmx_grid/07_.vmx
mkdir -p ~/simulation/boston/mtxs/3ph_vmx_grid
rfluxmtx -v -w -I+ -ab 1 -ad 512 -lw 1e-3 -n 11 -y <ptcount> - <receiver> -i /home/mss/simulation/boston/octrees/opaque_scene.oct < <ptsfile> > ~/simulation/boston/mtxs/3ph_vmx_grid/08_.vmx
echo ~/simulation/boston/mtxs/3ph_vmx_grid/08_.vmx
mkdir -p ~/simulation/boston/mtxs/3ph_vmx_grid
rfluxmtx -v -w -I+ -ab 1 -ad 512 -lw 1e-3 -n 11 -y <ptcount> - <receiver> -i /home/mss/simulation/boston/octrees/opaque_scene.oct < <ptsfile> > ~/simulation/boston/mtxs/3ph_vmx_grid/09_.vmx
echo ~/simulation/boston/mtxs/3ph_vmx_grid/09_.vmx
mkdir -p ~/simulation/boston/mtxs/3ph_vmx_grid
rfluxmtx -v -w -I+ -ab 1 -ad 512 -lw 1e-3 -n 11 -y <ptcount> - <receiver> -i /home/mss/simulation/boston/octrees/opaque_scene.oct < <ptsfile> > ~/simulation/boston/mtxs/3ph_vmx_grid/10_.vmx
echo ~/simulation/boston/mtxs/3ph_vmx_grid/10_.vmx
mkdir -p ~/simulation/boston/mtxs/3ph_vmx_grid
rfluxmtx -v -w -I+ -ab 1 -ad 512 -lw 1e-3 -n 11 -y <ptcount> - <receiver> -i /home/mss/simulation/boston/octrees/opaque_scene.oct < <ptsfile> > ~/simulation/boston/mtxs/3ph_vmx_grid/11_.vmx
echo ~/simulation/boston/mtxs/3ph_vmx_grid/11_.vmx
mkdir -p ~/simulation/boston/mtxs/3ph_vmx_grid
rfluxmtx -v -w -I+ -ab 1 -ad 512 -lw 1e-3 -n 11 -y <ptcount> - <receiver> -i /home/mss/simulation/boston/octrees/opaque_scene.oct < <ptsfile> > ~/simulation/boston/mtxs/3ph_vmx_grid/12_.vmx
echo ~/simulation/boston/mtxs/3ph_vmx_grid/12_.vmx
mkdir -p ~/simulation/boston/mtxs/3ph_vmx_grid
rfluxmtx -v -w -I+ -ab 1 -ad 512 -lw 1e-3 -n 11 -y <ptcount> - <receiver> -i /home/mss/simulation/boston/octrees/opaque_scene.oct < <ptsfile> > ~/simulation/boston/mtxs/3ph_vmx_grid/13_.vmx
echo ~/simulation/boston/mtxs/3ph_vmx_grid/13_.vmx
mkdir -p ~/simulation/boston/mtxs/3ph_vmx_grid
rfluxmtx -v -w -I+ -ab 1 -ad 512 -lw 1e-3 -n 11 -y <ptcount> - <receiver> -i /home/mss/simulation/boston/octrees/opaque_scene.oct < <ptsfile> > ~/simulation/boston/mtxs/3ph_vmx_grid/14_.vmx
echo ~/simulation/boston/mtxs/3ph_vmx_grid/14_.vmx
mkdir -p ~/simulation/boston/mtxs/3ph_vmx_grid
rfluxmtx -v -w -I+ -ab 1 -ad 512 -lw 1e-3 -n 11 -y <ptcount> - <receiver> -i /home/mss/simulation/boston/octrees/opaque_scene.oct < <ptsfile> > ~/simulation/boston/mtxs/3ph_vmx_grid/15_.vmx
echo ~/simulation/boston/mtxs/3ph_vmx_grid/15_.vmx
mkdir -p ~/simulation/boston/mtxs/3ph_vmx_grid
rfluxmtx -v -w -I+ -ab 1 -ad 512 -lw 1e-3 -n 11 -y <ptcount> - <receiver> -i /home/mss/simulation/boston/octrees/opaque_scene.oct < <ptsfile> > ~/simulation/boston/mtxs/3ph_vmx_grid/16_.vmx
echo ~/simulation/boston/mtxs/3ph_vmx_grid/16_.vmx
mkdir -p ~/simulation/boston/mtxs/3ph_vmx_grid
rfluxmtx -v -w -I+ -ab 1 -ad 512 -lw 1e-3 -n 11 -y <ptcount> - <receiver> -i /home/mss/simulation/boston/octrees/opaque_scene.oct < <ptsfile> > ~/simulation/boston/mtxs/3ph_vmx_grid/17_.vmx
echo ~/simulation/boston/mtxs/3ph_vmx_grid/17_.vmx
mkdir -p ~/simulation/boston/mtxs/3ph_vmx_grid
rfluxmtx -v -w -I+ -ab 1 -ad 512 -lw 1e-3 -n 11 -y <ptcount> - <receiver> -i /home/mss/simulation/boston/octrees/opaque_scene.oct < <ptsfile> > ~/simulation/boston/mtxs/3ph_vmx_grid/18_.vmx
echo ~/simulation/boston/mtxs/3ph_vmx_grid/18_.vmx
mkdir -p ~/simulation/boston/mtxs/3ph_vmx_grid
rfluxmtx -v -w -I+ -ab 1 -ad 512 -lw 1e-3 -n 11 -y <ptcount> - <receiver> -i /home/mss/simulation/boston/octrees/opaque_scene.oct < <ptsfile> > ~/simulation/boston/mtxs/3ph_vmx_grid/19_.vmx
echo ~/simulation/boston/mtxs/3ph_vmx_grid/19_.vmx
mkdir -p ~/simulation/boston/mtxs/3ph_vmx_grid
rfluxmtx -v -w -I+ -ab 1 -ad 512 -lw 1e-3 -n 11 -y <ptcount> - <receiver> -i /home/mss/simulation/boston/octrees/opaque_scene.oct < <ptsfile> > ~/simulation/boston/mtxs/3ph_vmx_grid/20_.vmx
echo ~/simulation/boston/mtxs/3ph_vmx_grid/20_.vmx
mkdir -p ~/simulation/boston/mtxs/3ph_vmx_grid
rfluxmtx -v -w -I+ -ab 1 -ad 512 -lw 1e-3 -n 11 -y <ptcount> - <receiver> -i /home/mss/simulation/boston/octrees/opaque_scene.oct < <ptsfile> > ~/simulation/boston/mtxs/3ph_vmx_grid/21_.vmx
echo ~/simulation/boston/mtxs/3ph_vmx_grid/21_.vmx
mkdir -p ~/simulation/boston/mtxs/3ph_vmx_grid
rfluxmtx -v -w -I+ -ab 1 -ad 512 -lw 1e-3 -n 11 -y <ptcount> - <receiver> -i /home/mss/simulation/boston/octrees/opaque_scene.oct < <ptsfile> > ~/simulation/boston/mtxs/3ph_vmx_grid/22_.vmx
echo ~/simulation/boston/mtxs/3ph_vmx_grid/22_.vmx""",
    fireLogs=True,
    lastRunTime=13,
    name="ViewMatrix grid",
    suppressWarnings=False,
    results="""/home/mss/simulation/boston/mtxs/3ph_vmx_grid/00_00_GlassRoof.vmx
_JOIN_
/home/mss/simulation/boston/mtxs/3ph_vmx_grid/00_00_GlassCorridorTop.vmx
_JOIN_
/home/mss/simulation/boston/mtxs/3ph_vmx_grid/00_00_GlassCorridorBottom.vmx
_JOIN_
/home/mss/simulation/boston/mtxs/3ph_vmx_grid/01_01_GlassRoof.vmx
_JOIN_
/home/mss/simulation/boston/mtxs/3ph_vmx_grid/01_01_GlassCorridorTop.vmx
_JOIN_
/home/mss/simulation/boston/mtxs/3ph_vmx_grid/01_01_GlassCorridorBottom.vmx""",
    commands="""mkdir -p ~/simulation/boston/mtxs/3ph_vmx_grid
rfluxmtx -v -w -I+ -ab 1 -ad 512 -lw 1e-3 -n 11 -y 116 - /home/mss/simulation/boston/radFiles/receivers/00_GlassRoof_rflux.rad -i /home/mss/simulation/boston/octrees/opaque_scene.oct < /home/mss/simulation/boston/points/0.pts > ~/simulation/boston/mtxs/3ph_vmx_grid/00_00_GlassRoof.vmx
echo ~/simulation/boston/mtxs/3ph_vmx_grid/00_00_GlassRoof.vmx
_JOIN_
mkdir -p ~/simulation/boston/mtxs/3ph_vmx_grid
rfluxmtx -v -w -I+ -ab 1 -ad 512 -lw 1e-3 -n 11 -y 116 - /home/mss/simulation/boston/radFiles/receivers/00_GlassCorridorTop_rflux.rad -i /home/mss/simulation/boston/octrees/opaque_scene.oct < /home/mss/simulation/boston/points/0.pts > ~/simulation/boston/mtxs/3ph_vmx_grid/00_00_GlassCorridorTop.vmx
echo ~/simulation/boston/mtxs/3ph_vmx_grid/00_00_GlassCorridorTop.vmx
_JOIN_
mkdir -p ~/simulation/boston/mtxs/3ph_vmx_grid
rfluxmtx -v -w -I+ -ab 1 -ad 512 -lw 1e-3 -n 11 -y 116 - /home/mss/simulation/boston/radFiles/receivers/00_GlassCorridorBottom_rflux.rad -i /home/mss/simulation/boston/octrees/opaque_scene.oct < /home/mss/simulation/boston/points/0.pts > ~/simulation/boston/mtxs/3ph_vmx_grid/00_00_GlassCorridorBottom.vmx
echo ~/simulation/boston/mtxs/3ph_vmx_grid/00_00_GlassCorridorBottom.vmx
_JOIN_
mkdir -p ~/simulation/boston/mtxs/3ph_vmx_grid
rfluxmtx -v -w -I+ -ab 1 -ad 512 -lw 1e-3 -n 11 -y 68 - /home/mss/simulation/boston/radFiles/receivers/01_GlassRoof_rflux.rad -i /home/mss/simulation/boston/octrees/opaque_scene.oct < /home/mss/simulation/boston/points/1.pts > ~/simulation/boston/mtxs/3ph_vmx_grid/01_01_GlassRoof.vmx
echo ~/simulation/boston/mtxs/3ph_vmx_grid/01_01_GlassRoof.vmx
_JOIN_
mkdir -p ~/simulation/boston/mtxs/3ph_vmx_grid
rfluxmtx -v -w -I+ -ab 1 -ad 512 -lw 1e-3 -n 11 -y 68 - /home/mss/simulation/boston/radFiles/receivers/01_GlassCorridorTop_rflux.rad -i /home/mss/simulation/boston/octrees/opaque_scene.oct < /home/mss/simulation/boston/points/1.pts > ~/simulation/boston/mtxs/3ph_vmx_grid/01_01_GlassCorridorTop.vmx
echo ~/simulation/boston/mtxs/3ph_vmx_grid/01_01_GlassCorridorTop.vmx
_JOIN_
mkdir -p ~/simulation/boston/mtxs/3ph_vmx_grid
rfluxmtx -v -w -I+ -ab 1 -ad 512 -lw 1e-3 -n 11 -y 68 - /home/mss/simulation/boston/radFiles/receivers/01_GlassCorridorBottom_rflux.rad -i /home/mss/simulation/boston/octrees/opaque_scene.oct < /home/mss/simulation/boston/points/1.pts > ~/simulation/boston/mtxs/3ph_vmx_grid/01_01_GlassCorridorBottom.vmx
echo ~/simulation/boston/mtxs/3ph_vmx_grid/01_01_GlassCorridorBottom.vmx""")  # -> Stdout, Stderr_, Ran
unflatten_5 = UnflattenTree(Tree=executessh_wip_9.Stdout, Guide=pshift_2)
vmx_grid = Text(unflatten_5)
panel_58 = Panel(vmx_grid)

# ----
# Daylight matrix (exterior)
glassname_2 = Text(python_6)
fenestrations_rad_rflux_4 = Text(fenestrations_rad_rflux)
octree_no_glass_3 = Text(octree_no_glass)
skyglow_2 = Text(skyglow)
panel_59 = Panel("""mkdir -p <proj>/mtxs/3ph_dmx;
rfluxmtx -w -v -ffa <param> -c 1000 -n <cpus> <receiver> <skyglow> -i <octree> > <proj>/mtxs/3ph_dmx/<receiverName>.dmx;echo "<proj>/mtxs/3ph_dmx/<receiverName>.dmx"
""")
abx_2 = ABX(data=glassname_2, pathCount=1)  # -> data; inputs data: tree, pathCount: Int32; same code as abx
overrides_26 = ApplyOverrides(
    Input_=panel_59,
    Param=graft("-ab 3 -ad 512 -lw 0.002"),
    Receiver=graft(fenestrations_rad_rflux_4),
    ReceiverName=graft(abx_2),
    Octree=graft(octree_no_glass_3),
    Skyglow=graft(skyglow_2))  # -> flatten(Output), Pairs
falsestart_7 = LBFalseStartToggle(False)
executessh_8 = ExecuteSSH(
    _SSHCommands=overrides_26.Output,
    Run=falsestart_7,
    addPrefix=True,
    description="""mkdir -p ~/simulation/boston/mtxs/3ph_dmx;
rfluxmtx -w -v -ffa -ab 3 -ad 512 -lw 0.002 -c 1000 -n 11 <receiver> ~/simulation/boston/radFiles/skyglow_3ph.rad -i /home/mss/simulation/boston/octrees/opaque_scene.oct > ~/simulation/boston/mtxs/3ph_dmx/.dmx;echo "~/simulation/boston/mtxs/3ph_dmx/.dmx"
""",
    fireLogs=True,
    lastRunTime=39505,
    name="DaylightMatrix",
    suppressWarnings=True,
    results="""~/simulation/boston/mtxs/3ph_dmx/00_GlassRoof.dmx
_JOIN_
~/simulation/boston/mtxs/3ph_dmx/00_GlassCorridorTop.dmx
_JOIN_
~/simulation/boston/mtxs/3ph_dmx/00_GlassCorridorBottom.dmx
_JOIN_
~/simulation/boston/mtxs/3ph_dmx/01_GlassRoof.dmx
_JOIN_
~/simulation/boston/mtxs/3ph_dmx/01_GlassCorridorTop.dmx
_JOIN_
~/simulation/boston/mtxs/3ph_dmx/01_GlassCorridorBottom.dmx""",
    stderr="""rfluxmtx: opening pipe to: rcontrib -fo+ -w -ab 3 -ad 512 -lw 0.002 -n 11 -fda -c 1000 -f reinhartb.cal -p MF=1,rNx=0,rNy=0,rNz=-1,Ux=0,Uy=1,Uz=0,RHS=+1 -bn Nrbins -b rbin -m sky_glow -bn 1 -b 'if(-Dx*0-Dy*0-Dz*1,0,-1)' -m ground_glow -y 145 '!oconv -f -i /home/mss/simulation/boston/octrees/opaque_scene.oct /home/mss/simulation/boston/radFiles/skyglow_3ph.rad'
rfluxmtx: sampling 145 directions
rfluxmtx: opening pipe to: rcontrib -fo+ -w -ab 3 -ad 512 -lw 0.002 -n 11 -fda -c 1000 -f reinhartb.cal -p MF=1,rNx=0,rNy=0,rNz=-1,Ux=0,Uy=1,Uz=0,RHS=+1 -bn Nrbins -b rbin -m sky_glow -bn 1 -b 'if(-Dx*0-Dy*0-Dz*1,0,-1)' -m ground_glow -y 145 '!oconv -f -i /home/mss/simulation/boston/octrees/opaque_scene.oct /home/mss/simulation/boston/radFiles/skyglow_3ph.rad'
rfluxmtx: sampling 145 directions (3 elements)
rfluxmtx: opening pipe to: rcontrib -fo+ -w -ab 3 -ad 512 -lw 0.002 -n 11 -fda -c 1000 -f reinhartb.cal -p MF=1,rNx=0,rNy=0,rNz=-1,Ux=0,Uy=1,Uz=0,RHS=+1 -bn Nrbins -b rbin -m sky_glow -bn 1 -b 'if(-Dx*0-Dy*0-Dz*1,0,-1)' -m ground_glow -y 145 '!oconv -f -i /home/mss/simulation/boston/octrees/opaque_scene.oct /home/mss/simulation/boston/radFiles/skyglow_3ph.rad'
rfluxmtx: sampling 145 directions (4 elements)
rfluxmtx: opening pipe to: rcontrib -fo+ -w -ab 3 -ad 512 -lw 0.002 -n 11 -fda -c 1000 -f reinhartb.cal -p MF=1,rNx=0,rNy=0,rNz=-1,Ux=0,Uy=1,Uz=0,RHS=+1 -bn Nrbins -b rbin -m sky_glow -bn 1 -b 'if(-Dx*0-Dy*0-Dz*1,0,-1)' -m ground_glow -y 145 '!oconv -f -i /home/mss/simulation/boston/octrees/opaque_scene.oct /home/mss/simulation/boston/radFiles/skyglow_3ph.rad'
rfluxmtx: sampling 145 directions (2 elements)
rfluxmtx: opening pipe to: rcontrib -fo+ -w -ab 3 -ad 512 -lw 0.002 -n 11 -fda -c 1000 -f reinhartb.cal -p MF=1,rNx=0,rNy=0,rNz=-1,Ux=0,Uy=1,Uz=0,RHS=+1 -bn Nrbins -b rbin -m sky_glow -bn 1 -b 'if(-Dx*0-Dy*0-Dz*1,0,-1)' -m ground_glow -y 145 '!oconv -f -i /home/mss/simulation/boston/octrees/opaque_scene.oct /home/mss/simulation/boston/radFiles/skyglow_3ph.rad'
rfluxmtx: sampling 145 directions (3 elements)
rfluxmtx: opening pipe to: rcontrib -fo+ -w -ab 3 -ad 512 -lw 0.002 -n 11 -fda -c 1000 -f reinhartb.cal -p MF=1,rNx=0,rNy=0,rNz=-1,Ux=0,Uy=1,Uz=0,RHS=+1 -bn Nrbins -b rbin -m sky_glow -bn 1 -b 'if(-Dx*0-Dy*0-Dz*1,0,-1)' -m ground_glow -y 145 '!oconv -f -i /home/mss/simulation/boston/octrees/opaque_scene.oct /home/mss/simulation/boston/radFiles/skyglow_3ph.rad'
rfluxmtx: sampling 145 directions (4 elements)""",
    commands="""mkdir -p ~/simulation/boston/mtxs/3ph_dmx;
rfluxmtx -w -v -ffa -ab 3 -ad 512 -lw 0.002 -c 1000 -n 11 /home/mss/simulation/boston/radFiles/receivers/00_GlassRoof_rflux.rad ~/simulation/boston/radFiles/skyglow_3ph.rad -i /home/mss/simulation/boston/octrees/opaque_scene.oct > ~/simulation/boston/mtxs/3ph_dmx/00_GlassRoof.dmx;echo "~/simulation/boston/mtxs/3ph_dmx/00_GlassRoof.dmx"
_JOIN_
mkdir -p ~/simulation/boston/mtxs/3ph_dmx;
rfluxmtx -w -v -ffa -ab 3 -ad 512 -lw 0.002 -c 1000 -n 11 /home/mss/simulation/boston/radFiles/receivers/00_GlassCorridorTop_rflux.rad ~/simulation/boston/radFiles/skyglow_3ph.rad -i /home/mss/simulation/boston/octrees/opaque_scene.oct > ~/simulation/boston/mtxs/3ph_dmx/00_GlassCorridorTop.dmx;echo "~/simulation/boston/mtxs/3ph_dmx/00_GlassCorridorTop.dmx"
_JOIN_
mkdir -p ~/simulation/boston/mtxs/3ph_dmx;
rfluxmtx -w -v -ffa -ab 3 -ad 512 -lw 0.002 -c 1000 -n 11 /home/mss/simulation/boston/radFiles/receivers/00_GlassCorridorBottom_rflux.rad ~/simulation/boston/radFiles/skyglow_3ph.rad -i /home/mss/simulation/boston/octrees/opaque_scene.oct > ~/simulation/boston/mtxs/3ph_dmx/00_GlassCorridorBottom.dmx;echo "~/simulation/boston/mtxs/3ph_dmx/00_GlassCorridorBottom.dmx"
_JOIN_
mkdir -p ~/simulation/boston/mtxs/3ph_dmx;
rfluxmtx -w -v -ffa -ab 3 -ad 512 -lw 0.002 -c 1000 -n 11 /home/mss/simulation/boston/radFiles/receivers/01_GlassRoof_rflux.rad ~/simulation/boston/radFiles/skyglow_3ph.rad -i /home/mss/simulation/boston/octrees/opaque_scene.oct > ~/simulation/boston/mtxs/3ph_dmx/01_GlassRoof.dmx;echo "~/simulation/boston/mtxs/3ph_dmx/01_GlassRoof.dmx"
_JOIN_
mkdir -p ~/simulation/boston/mtxs/3ph_dmx;
rfluxmtx -w -v -ffa -ab 3 -ad 512 -lw 0.002 -c 1000 -n 11 /home/mss/simulation/boston/radFiles/receivers/01_GlassCorridorTop_rflux.rad ~/simulation/boston/radFiles/skyglow_3ph.rad -i /home/mss/simulation/boston/octrees/opaque_scene.oct > ~/simulation/boston/mtxs/3ph_dmx/01_GlassCorridorTop.dmx;echo "~/simulation/boston/mtxs/3ph_dmx/01_GlassCorridorTop.dmx"
_JOIN_
mkdir -p ~/simulation/boston/mtxs/3ph_dmx;
rfluxmtx -w -v -ffa -ab 3 -ad 512 -lw 0.002 -c 1000 -n 11 /home/mss/simulation/boston/radFiles/receivers/01_GlassCorridorBottom_rflux.rad ~/simulation/boston/radFiles/skyglow_3ph.rad -i /home/mss/simulation/boston/octrees/opaque_scene.oct > ~/simulation/boston/mtxs/3ph_dmx/01_GlassCorridorBottom.dmx;echo "~/simulation/boston/mtxs/3ph_dmx/01_GlassCorridorBottom.dmx"
""")  # -> Stdout, Stderr, Ran
panel_60 = Panel(executessh_8.Stdout)
unflatten_6 = UnflattenTree(Tree=executessh_8.Stdout, Guide=pshift_2)
dmx = Text(unflatten_6)

# ---- group: bsdf
# Construct BSDF file
window_mat = Text(unflatten_3)
window_rads_2 = Text(window_rads)
convertpaths_3 = ConvertPaths(I=flatten([list, window_mat]))  # -> Linux, Windows
python_13 = GhPythonScript(x=window_rads_2)  # -> a
# ---------- python_13: Python ----------
__author__ = "mm1013"
__version__ = "2022.08.20"

import rhinoscriptsyntax as rs
a = ".".join(x.split("/")[-1].split(".")[:-1])
# ---------- end python_13 ----------
radviewer_2 = RadViewer(
    RadFiles=flatten(convertpaths_3.Windows),
    IsTwoSided=False,
    Polychromatic=True,
    ShowEdges=True,
    Transparent=True,
    ColorNames=["blindmat", "GlassSouth_70_mat", "GlassWest_70_mat", "_GlassBSDF_70_mat", "_GlassFacade_74_mat"],
    Colors=[RGB(201, 214, 143), RGB(117, 124, 152), RGB(211, 158, 127), RGB(170, 207, 137), RGB(107, 227, 228)])  # -> Geo, ModifierNames, Modifiers, FailedWireFrame
glassname_3 = Text(python_13)
panel_61 = Panel(radviewer_2.Modifiers)

# ----
# make sure your normals of th
# receiver rad is pointing inwards!
# ie it should be red on the outside when
# two sided is enabled.
convertpaths_4 = ConvertPaths(I=window_rads_2)  # -> Linux, Windows
radviewer_3 = RadViewer(
    RadFiles=flatten(convertpaths_4.Windows),
    IsTwoSided=True,
    Polychromatic=True,
    ShowEdges=True,
    Transparent=True,
    ColorNames=["_GlassBSDF_70_mat", "_GlassFacade_74_mat", "_GlassInt_74_mat", "_GlassTak_70_mat"],
    Colors=[RGB(227, 191, 239), RGB(172, 242, 105), RGB(202, 235, 113), RGB(236, 241, 124)])  # -> Geo, ModifierNames, Modifiers, FailedWireFrame

name_5 = Text(radviewer_2.ModifierNames)

# ----
# modifiers
blinds_material = Panel("void plastic blindmat 0 0 5 .8 .8 .8 0 .01")
glass_modifier = Text(radviewer_2.Modifiers)
panel_62 = Panel("echo \"<modifiers>\" > <proj>/radFiles/BSDF_Mods_<name>.rad;echo <proj>/radFiles/BSDF_Mods_<name>.rad")
concat_9 = Concatenate(FragmentA=glass_modifier, FragmentC=blinds_material)
name_6 = Text(name_5)
overrides_27 = ApplyOverrides(Input_=panel_62, Modifiers=graft(concat_9), Name=graft(name_6))  # -> Output, Pairs
executessh_9 = ExecuteSSH(
    _SSHCommands_=overrides_27.Output,
    Run=executessh_3.Ran,
    addPrefix=True,
    description="""echo "
void plastic blindmat 0 0 5 .8 .8 .8 0 .01" > ~/simulation/boston/radFiles/BSDF_Mods_<name>.rad;echo ~/simulation/boston/radFiles/BSDF_Mods_<name>.rad""",
    fireLogs=False,
    lastRunTime=6,
    suppressWarnings=False)  # -> Stdout, Stderr_, Ran

# ---- group: one room
name_7 = Text(name_5)
panel_63 = Panel(name_7)
vertical_glazing_rfluxmtx_2 = Panel("#@rfluxmtx h=kf u=Z")
overrides_28 = ApplyOverrides(Input_="void glow <windowMod> 0 0 4 1 1 1 0", WindowMod=graft(name_7))  # -> Output, Pairs
concat_10 = Concatenate(FragmentA=overrides_28.Output, FragmentB=vertical_glazing_rfluxmtx_2)

# adding rflux comments to windowRads
panel_64 = Panel("""echo "<rfluxmtx>" > <windowRad-.>_rflux.rad
cat <windowRad> >> <windowRad-.>_rflux.rad
echo <windowRad-.>_rflux.rad""")
window_rads_3 = Text(window_rads_2)
overrides_29 = ApplyOverrides(Input_=panel_64, Rfluxmtx=graft(concat_10), WindowRad=graft(window_rads_3))  # -> flatten(Output), Pairs
falsestart_8 = LBFalseStartToggle(False)
executessh_10 = ExecuteSSH(
    _SSHCommands_=overrides_29.Output,
    Run=falsestart_8,
    addPrefix=True,
    description="""echo "void glow <windowMod> 0 0 4 1 1 1 0
#@rfluxmtx h=kf u=Z" > <windowRad>_rflux.rad
cat <windowRad> >> <windowRad>_rflux.rad
echo <windowRad>_rflux.rad""",
    fireLogs=False,
    lastRunTime=5,
    suppressWarnings=False)  # -> Stdout, Stderr_, Ran
fenestrations_rad_rflux_5 = Text(executessh_10.Stdout)

fenestrations_rad_rflux_6 = Text(fenestrations_rad_rflux_5)
overrides_30 = ApplyOverrides(Input_="head <file> -n 20", File=graft(fenestrations_rad_rflux_6))  # -> flatten(Output), Pairs
executessh_11 = ExecuteSSH(
    _SSHCommands_=overrides_30.Output,
    Run=executessh_10.Ran,
    addPrefix=True,
    description="head <file> -n 20",
    fireLogs=False,
    lastRunTime=18,
    suppressWarnings=False)  # -> Stdout, Stderr_, Ran
panel_65 = Panel(executessh_11.Stdout)

# Viewmatrix (grid based)
fenestrations_rad_rflux_7 = Text(fenestrations_rad_rflux_5)
ptsfile_4 = Text(ptsfile_2)
panel_66 = Panel("""mkdir -p <proj>/mtxs/3phGrid
rfluxmtx -v -w -I+ <param> -n <cpus> -y <ptcount> - <receiver> -i <octree> < <ptsfile> > <proj>/mtxs/3phGrid/room_<window>.vmx
echo <proj>/mtxs/3phGrid/room_<window>.vmx""")
glassname_4 = Text(glassname_3)
octree_no_glass_4 = Text(octree_no_glass)
overrides_31 = ApplyOverrides(Input_="wc -l < <ptsFile>", PtsFile=graft(ptsfile_4))  # -> Output, Pairs
falsestart_9 = LBFalseStartToggle(False)
executessh_wip_10 = ExecuteSSHWIP(
    _SSHCommands_=overrides_31.Output,
    Run=falsestart_9,
    addPrefix=True,
    description="""wc -l < /home/mss/simulation/boston/points/0.pts


- - -

wc -l < /home/mss/simulation/boston/points/1.pts


- - -

wc -l < <ptsFile>


- - -

wc -l < <ptsFile>


- - -

wc -l < <ptsFile>


- - -

wc -l < <ptsFile>


- - -

wc -l < <ptsFile>


- - -

wc -l < <ptsFile>


- - -

wc -l < <ptsFile>


- - -

wc -l < <ptsFile>


- - -

wc -l < <ptsFile>


- - -

wc -l < <ptsFile>


- - -

wc -l < <ptsFile>


- - -

wc -l < <ptsFile>


- - -

wc -l < <ptsFile>


- - -

wc -l < <ptsFile>


- - -

wc -l < <ptsFile>


- - -

wc -l < <ptsFile>


- - -

wc -l < <ptsFile>


- - -

wc -l < <ptsFile>


- - -

wc -l < <ptsFile>


- - -

wc -l < <ptsFile>


- - -

wc -l < <ptsFile>""",
    fireLogs=False,
    lastRunTime=5,
    suppressWarnings=False)  # -> Stdout, Stderr_, Ran
overrides_32 = ApplyOverrides(
    Input_=panel_66,
    Window=graft(glassname_4),
    Receiver=graft(fenestrations_rad_rflux_7),
    Octree=graft(octree_no_glass_4),
    Ptsfile=graft(ptsfile_4),
    Ptcount=graft(executessh_wip_10.Stdout),
    Param=graft("-ab 2 -ad 1024 -lw 1e-3"))  # -> Output, Pairs
executessh_wip_11 = ExecuteSSHWIP(
    _SSHCommands_=overrides_32.Output,
    Run=executessh_wip_10.Ran,
    addPrefix=True,
    description="""mkdir -p ~/simulation/boston/mtxs/3phGrid
rfluxmtx -v -w -I+ -ab 2 -ad 1024 -lw 1e-3 -n 11 -y <ptcount> - <receiver> -i /home/mss/simulation/boston/octrees/opaque_scene.oct < /home/mss/simulation/boston/points/0.pts > ~/simulation/boston/mtxs/3phGrid/room_<window>.vmx
echo ~/simulation/boston/mtxs/3phGrid/room_<window>.vmx


- - -

mkdir -p ~/simulation/boston/mtxs/3phGrid
rfluxmtx -v -w -I+ -ab 2 -ad 1024 -lw 1e-3 -n 11 -y <ptcount> - <receiver> -i /home/mss/simulation/boston/octrees/opaque_scene.oct < /home/mss/simulation/boston/points/1.pts > ~/simulation/boston/mtxs/3phGrid/room_<window>.vmx
echo ~/simulation/boston/mtxs/3phGrid/room_<window>.vmx


- - -

mkdir -p ~/simulation/boston/mtxs/3phGrid
rfluxmtx -v -w -I+ -ab 2 -ad 1024 -lw 1e-3 -n 11 -y <ptcount> - <receiver> -i /home/mss/simulation/boston/octrees/opaque_scene.oct < <ptsfile> > ~/simulation/boston/mtxs/3phGrid/room_<window>.vmx
echo ~/simulation/boston/mtxs/3phGrid/room_<window>.vmx


- - -

mkdir -p ~/simulation/boston/mtxs/3phGrid
rfluxmtx -v -w -I+ -ab 2 -ad 1024 -lw 1e-3 -n 11 -y <ptcount> - <receiver> -i /home/mss/simulation/boston/octrees/opaque_scene.oct < <ptsfile> > ~/simulation/boston/mtxs/3phGrid/room_<window>.vmx
echo ~/simulation/boston/mtxs/3phGrid/room_<window>.vmx


- - -

mkdir -p ~/simulation/boston/mtxs/3phGrid
rfluxmtx -v -w -I+ -ab 2 -ad 1024 -lw 1e-3 -n 11 -y <ptcount> - <receiver> -i /home/mss/simulation/boston/octrees/opaque_scene.oct < <ptsfile> > ~/simulation/boston/mtxs/3phGrid/room_<window>.vmx
echo ~/simulation/boston/mtxs/3phGrid/room_<window>.vmx


- - -

mkdir -p ~/simulation/boston/mtxs/3phGrid
rfluxmtx -v -w -I+ -ab 2 -ad 1024 -lw 1e-3 -n 11 -y <ptcount> - <receiver> -i /home/mss/simulation/boston/octrees/opaque_scene.oct < <ptsfile> > ~/simulation/boston/mtxs/3phGrid/room_<window>.vmx
echo ~/simulation/boston/mtxs/3phGrid/room_<window>.vmx


- - -

mkdir -p ~/simulation/boston/mtxs/3phGrid
rfluxmtx -v -w -I+ -ab 2 -ad 1024 -lw 1e-3 -n 11 -y <ptcount> - <receiver> -i /home/mss/simulation/boston/octrees/opaque_scene.oct < <ptsfile> > ~/simulation/boston/mtxs/3phGrid/room_<window>.vmx
echo ~/simulation/boston/mtxs/3phGrid/room_<window>.vmx


- - -

mkdir -p ~/simulation/boston/mtxs/3phGrid
rfluxmtx -v -w -I+ -ab 2 -ad 1024 -lw 1e-3 -n 11 -y <ptcount> - <receiver> -i /home/mss/simulation/boston/octrees/opaque_scene.oct < <ptsfile> > ~/simulation/boston/mtxs/3phGrid/room_<window>.vmx
echo ~/simulation/boston/mtxs/3phGrid/room_<window>.vmx


- - -

mkdir -p ~/simulation/boston/mtxs/3phGrid
rfluxmtx -v -w -I+ -ab 2 -ad 1024 -lw 1e-3 -n 11 -y <ptcount> - <receiver> -i /home/mss/simulation/boston/octrees/opaque_scene.oct < <ptsfile> > ~/simulation/boston/mtxs/3phGrid/room_<window>.vmx
echo ~/simulation/boston/mtxs/3phGrid/room_<window>.vmx


- - -

mkdir -p ~/simulation/boston/mtxs/3phGrid
rfluxmtx -v -w -I+ -ab 2 -ad 1024 -lw 1e-3 -n 11 -y <ptcount> - <receiver> -i /home/mss/simulation/boston/octrees/opaque_scene.oct < <ptsfile> > ~/simulation/boston/mtxs/3phGrid/room_<window>.vmx
echo ~/simulation/boston/mtxs/3phGrid/room_<window>.vmx


- - -

mkdir -p ~/simulation/boston/mtxs/3phGrid
rfluxmtx -v -w -I+ -ab 2 -ad 1024 -lw 1e-3 -n 11 -y <ptcount> - <receiver> -i /home/mss/simulation/boston/octrees/opaque_scene.oct < <ptsfile> > ~/simulation/boston/mtxs/3phGrid/room_<window>.vmx
echo ~/simulation/boston/mtxs/3phGrid/room_<window>.vmx


- - -

mkdir -p ~/simulation/boston/mtxs/3phGrid
rfluxmtx -v -w -I+ -ab 2 -ad 1024 -lw 1e-3 -n 11 -y <ptcount> - <receiver> -i /home/mss/simulation/boston/octrees/opaque_scene.oct < <ptsfile> > ~/simulation/boston/mtxs/3phGrid/room_<window>.vmx
echo ~/simulation/boston/mtxs/3phGrid/room_<window>.vmx


- - -

mkdir -p ~/simulation/boston/mtxs/3phGrid
rfluxmtx -v -w -I+ -ab 2 -ad 1024 -lw 1e-3 -n 11 -y <ptcount> - <receiver> -i /home/mss/simulation/boston/octrees/opaque_scene.oct < <ptsfile> > ~/simulation/boston/mtxs/3phGrid/room_<window>.vmx
echo ~/simulation/boston/mtxs/3phGrid/room_<window>.vmx


- - -

mkdir -p ~/simulation/boston/mtxs/3phGrid
rfluxmtx -v -w -I+ -ab 2 -ad 1024 -lw 1e-3 -n 11 -y <ptcount> - <receiver> -i /home/mss/simulation/boston/octrees/opaque_scene.oct < <ptsfile> > ~/simulation/boston/mtxs/3phGrid/room_<window>.vmx
echo ~/simulation/boston/mtxs/3phGrid/room_<window>.vmx


- - -

mkdir -p ~/simulation/boston/mtxs/3phGrid
rfluxmtx -v -w -I+ -ab 2 -ad 1024 -lw 1e-3 -n 11 -y <ptcount> - <receiver> -i /home/mss/simulation/boston/octrees/opaque_scene.oct < <ptsfile> > ~/simulation/boston/mtxs/3phGrid/room_<window>.vmx
echo ~/simulation/boston/mtxs/3phGrid/room_<window>.vmx


- - -

mkdir -p ~/simulation/boston/mtxs/3phGrid
rfluxmtx -v -w -I+ -ab 2 -ad 1024 -lw 1e-3 -n 11 -y <ptcount> - <receiver> -i /home/mss/simulation/boston/octrees/opaque_scene.oct < <ptsfile> > ~/simulation/boston/mtxs/3phGrid/room_<window>.vmx
echo ~/simulation/boston/mtxs/3phGrid/room_<window>.vmx


- - -

mkdir -p ~/simulation/boston/mtxs/3phGrid
rfluxmtx -v -w -I+ -ab 2 -ad 1024 -lw 1e-3 -n 11 -y <ptcount> - <receiver> -i /home/mss/simulation/boston/octrees/opaque_scene.oct < <ptsfile> > ~/simulation/boston/mtxs/3phGrid/room_<window>.vmx
echo ~/simulation/boston/mtxs/3phGrid/room_<window>.vmx


- - -

mkdir -p ~/simulation/boston/mtxs/3phGrid
rfluxmtx -v -w -I+ -ab 2 -ad 1024 -lw 1e-3 -n 11 -y <ptcount> - <receiver> -i /home/mss/simulation/boston/octrees/opaque_scene.oct < <ptsfile> > ~/simulation/boston/mtxs/3phGrid/room_<window>.vmx
echo ~/simulation/boston/mtxs/3phGrid/room_<window>.vmx


- - -

mkdir -p ~/simulation/boston/mtxs/3phGrid
rfluxmtx -v -w -I+ -ab 2 -ad 1024 -lw 1e-3 -n 11 -y <ptcount> - <receiver> -i /home/mss/simulation/boston/octrees/opaque_scene.oct < <ptsfile> > ~/simulation/boston/mtxs/3phGrid/room_<window>.vmx
echo ~/simulation/boston/mtxs/3phGrid/room_<window>.vmx


- - -

mkdir -p ~/simulation/boston/mtxs/3phGrid
rfluxmtx -v -w -I+ -ab 2 -ad 1024 -lw 1e-3 -n 11 -y <ptcount> - <receiver> -i /home/mss/simulation/boston/octrees/opaque_scene.oct < <ptsfile> > ~/simulation/boston/mtxs/3phGrid/room_<window>.vmx
echo ~/simulation/boston/mtxs/3phGrid/room_<window>.vmx


- - -

mkdir -p ~/simulation/boston/mtxs/3phGrid
rfluxmtx -v -w -I+ -ab 2 -ad 1024 -lw 1e-3 -n 11 -y <ptcount> - <receiver> -i /home/mss/simulation/boston/octrees/opaque_scene.oct < <ptsfile> > ~/simulation/boston/mtxs/3phGrid/room_<window>.vmx
echo ~/simulation/boston/mtxs/3phGrid/room_<window>.vmx


- - -

mkdir -p ~/simulation/boston/mtxs/3phGrid
rfluxmtx -v -w -I+ -ab 2 -ad 1024 -lw 1e-3 -n 11 -y <ptcount> - <receiver> -i /home/mss/simulation/boston/octrees/opaque_scene.oct < <ptsfile> > ~/simulation/boston/mtxs/3phGrid/room_<window>.vmx
echo ~/simulation/boston/mtxs/3phGrid/room_<window>.vmx


- - -

mkdir -p ~/simulation/boston/mtxs/3phGrid
rfluxmtx -v -w -I+ -ab 2 -ad 1024 -lw 1e-3 -n 11 -y <ptcount> - <receiver> -i /home/mss/simulation/boston/octrees/opaque_scene.oct < <ptsfile> > ~/simulation/boston/mtxs/3phGrid/room_<window>.vmx
echo ~/simulation/boston/mtxs/3phGrid/room_<window>.vmx""",
    fireLogs=True,
    lastRunTime=7585,
    name="ViewMatrix grid",
    suppressWarnings=False)  # -> Stdout, Stderr_, Ran
vmx_grid_2 = Text(executessh_wip_11.Stdout)

# VIEWMATRIX (image based)
panel_67 = Panel("""mkdir -p <proj>/mtxs/3ph_view_<viewname>;
cd <proj>;
vwrays -vf <vf> -x <x> -y <y> -pj 0.7 -c 9 -ff | rfluxmtx -v -ffc `vwrays -vf <vf> -x <x> -y <y> -d` -o <proj>/mtxs/3ph_view_<viewname>/<windowgroup>_%03d.hdr <param> -c 9 -n <cpus> - <windowRad> -i <opaqueOctree>;
echo "<proj>/mtxs/3ph_view_<viewname>/<windowgroup>_%03d.hdr"
""")
fenestrations_rad_rflux_8 = Text(fenestrations_rad_rflux_5)
glassname_5 = Text(glassname_3)
viewnames = Data(view_names)
viewfiles_2 = Text(viewfiles)
octree_no_glass_5 = Text(octree_no_glass)
crossref = CrossReference(ListA=glassname_5, ListB=viewnames, CrossMode=1)  # -> ListA, ListB
crossref_2 = CrossReference(ListA=viewnames, ListB=fenestrations_rad_rflux_8, CrossMode=1)  # -> ListA, ListB
crossref_3 = CrossReference(ListA=viewfiles_2, ListB=fenestrations_rad_rflux_8, CrossMode=1)  # -> ListA, ListB
overrides_33 = ApplyOverrides(
    Input_=panel_67,
    Windowgroup=graft(crossref.ListA),
    Viewname=graft(crossref.ListB),
    WindowRad=graft(crossref_2.ListB),
    Vf=graft(crossref_3.ListA),
    OpaqueOctree=graft(octree_no_glass_5),
    X=graft("600"),
    Y=graft("400"),
    Param=graft("-ab 1 -ad 512 -lw 2e-4"))  # -> flatten(Output), Pairs
falsestart_10 = LBFalseStartToggle(False)
executessh_12 = ExecuteSSH(
    _SSHCommands_=overrides_33.Output,
    Run=falsestart_10,
    addPrefix=True,
    description="""mkdir -p ~/simulation/boston/mtxs/3ph_view_P1;
cd ~/simulation/boston;
vwrays -vf /home/mss/simulation/test_project2/views/P1.vf -x 600 -y 400 -pj 0.7 -c 9 -ff | rfluxmtx -v -ffc `vwrays -vf /home/mss/simulation/test_project2/views/P1.vf -x 600 -y 400 -d` -o ~/simulation/boston/mtxs/3ph_view_P1/<windowgroup>_%03d.hdr -ab 1 -ad 512 -lw 2e-4 -c 9 -n 11 - <windowRad> -i /home/mss/simulation/boston/octrees/opaque_scene.oct;
echo "~/simulation/boston/mtxs/3ph_view_P1/<windowgroup>_%03d.hdr"
""",
    fireLogs=True,
    lastRunTime=515215,
    name="Viewmatrix (image)",
    suppressWarnings=False)  # -> Stdout, Stderr_, Ran
panel_68 = Panel(overrides_33.Output)
hi_res_override = Panel(executessh_12.Stdout)
viewmatrix_img = Text(executessh_12.Stdout)

# Daylight matrix (exterior)
fenestrations_rad_rflux_9 = Text(fenestrations_rad_rflux_5)
glassname_6 = Text(glassname_3)
octree_no_glass_6 = Text(octree_no_glass)
skyglow_3 = Text(skyglow)
panel_69 = Panel("""mkdir -p <proj>/mtxs/3ph_dmx;
rfluxmtx -w -v -ff <param> -c 1000 -n <cpus> <receiver> <skyglow> -i <octree> > <proj>/mtxs/3ph_dmx/<receiverName>.dmx;echo "<proj>/mtxs/3ph_dmx/<receiverName>.dmx"
""")
overrides_34 = ApplyOverrides(
    Input_=panel_69,
    Param=graft("-ab 2 -ad 512 -lw 0.002"),
    Receiver=graft(fenestrations_rad_rflux_9),
    ReceiverName=graft(glassname_6),
    Octree=graft(octree_no_glass_6),
    Skyglow=graft(skyglow_3))  # -> flatten(Output), Pairs
falsestart_11 = LBFalseStartToggle(False)
executessh_13 = ExecuteSSH(
    _SSHCommands=overrides_34.Output,
    Run=falsestart_11,
    addPrefix=True,
    description="""mkdir -p ~/simulation/boston/mtxs/3ph_dmx;
rfluxmtx -w -v -ff -ab 2 -ad 512 -lw 0.002 -c 1000 -n 11 <receiver> ~/simulation/boston/radFiles/skyglow_3ph.rad -i /home/mss/simulation/boston/octrees/opaque_scene.oct > ~/simulation/boston/mtxs/3ph_dmx/<receiverName>.dmx;echo "~/simulation/boston/mtxs/3ph_dmx/<receiverName>.dmx"
""",
    fireLogs=True,
    lastRunTime=28743,
    name="DaylightMatrix",
    suppressWarnings=True)  # -> Stdout, Stderr, Ran
panel_70 = Panel(executessh_13.Stdout)
dmx_2 = Text(executessh_13.Stdout)

# ----
# preview rad files
window_mat_2 = Text(unflatten_3)
opaque_mat_3 = Text(opaque_mat)
opaque_rad_3 = Text(opaque_rad)
window_rad_5 = Text(window_rad_2)

entwine_2 = Entwine(Branch00=window_mat_2, Branch01=window_rad_5, FlattenInputs=True)  # -> flatten(Result)
entwine_3 = Entwine(Branch00=opaque_mat_3, Branch01=opaque_rad_3, FlattenInputs=True)  # -> flatten(Result)
convertpaths_5 = ConvertPaths(I=entwine_2)  # -> Linux, Windows

convertpaths_6 = ConvertPaths(I=entwine_3)  # -> Linux, Windows
radviewer_4 = RadViewer(
    RadFiles=flatten(convertpaths_6.Windows),
    DisplayName="opaques",
    IsTwoSided=True,
    Polychromatic=False,
    ShowEdges=True,
    Transparent=False,
    ColorNames=["_GlassTak_70_mat", "_Roofs_50_mat", "_Frames_50_mat", "_SkylightWall_70_mat", "_SlabCeiling_80_mat", "_SlabWall_50_mat", "_WallInterior_70_mat", "_Ground_10_mat", "_FacadeDark_30_mat"],
    Colors=[RGB(162, 204, 232), RGB(119, 113, 248), RGB(230, 134, 190), RGB(110, 233, 137), RGB(234, 107, 206), RGB(165, 228, 136), RGB(186, 204, 171), RGB(180, 226, 238), RGB(180, 220, 116)])  # -> Geo, ModifierNames, Modifiers, FailedWireFrame
radviewer_5 = RadViewer(
    RadFiles=flatten(convertpaths_5.Windows),
    DisplayName="windows",
    IsTwoSided=True,
    Polychromatic=False,
    ShowEdges=True,
    Transparent=False,
    ColorNames=["_GlassTak_70_mat", "_Roofs_50_mat", "_Frames_50_mat", "_SkylightWall_70_mat", "_SlabCeiling_80_mat", "_SlabWall_50_mat", "_WallInterior_70_mat", "_Ground_10_mat", "_FacadeDark_30_mat"],
    Colors=[RGB(162, 204, 232), RGB(119, 113, 248), RGB(230, 134, 190), RGB(110, 233, 137), RGB(234, 107, 206), RGB(165, 228, 136), RGB(186, 204, 171), RGB(180, 226, 238), RGB(180, 220, 116)])  # -> Geo, ModifierNames, Modifiers, FailedWireFrame

panel_71 = Panel(convertpaths_6.Windows)

# ---- group: bsdf (continued)
panel_72 = Panel(name_5)

# ----
# glass pane geometry
panel_73 = Panel("""<mat> polygon window
0
0
12 0 0 0
0 <y> 0
<x> <y> 0
<x> 0 0""")
python_14 = GhPythonScript(l=executessh_3.Stdout)  # -> out, xmax, ymax; inputs l: list; same code as python
panel_74 = Panel("echo \"<window>\" > <proj>/radFiles/BSDF_Geo_<name>.rad;echo <proj>/radFiles/BSDF_Geo_<name>.rad")
panel_75 = Panel(python_14.out)
overrides_35 = ApplyOverrides(Input_=panel_73, Mat=graft(panel_72), X=graft(python_14.xmax), Y=graft(python_14.ymax))  # -> Output, Pairs
name_8 = Text(name_5)
overrides_36 = ApplyOverrides(Input_=panel_74, Window=graft(overrides_35.Output), Name=graft(name_8))  # -> Output, Pairs
executessh_14 = ExecuteSSH(
    _SSHCommands_=overrides_36.Output,
    Run=executessh_3.Ran,
    addPrefix=True,
    description="""echo "<mat> polygon window
0
0
12 0 0 0
0 <y> 0
<x> <y> 0
<x> 0 0" > ~/simulation/boston/radFiles/BSDF_Geo_<name>.rad;echo ~/simulation/boston/radFiles/BSDF_Geo_<name>.rad""",
    fireLogs=False,
    lastRunTime=13,
    suppressWarnings=False)  # -> Stdout, Stderr_, Ran

# ----
# GenBSDF
panel_76 = Panel("mkdir -p <proj>/BSDF;genBSDF -n <cpus> <dim> <radFiles> > <proj>/BSDF/<target>.xml;echo \"<proj>/BSDF/<target>.xml\"")
blindsgeo = Text(executessh_2.Stdout)
modifiers = Text(executessh_9.Stdout)
glassgeo = Text(executessh_14.Stdout)
merge_2 = Merge(Data1=flatten(modifiers), Data2=flatten(blindsgeo), Data3=flatten(glassgeo))
join_3 = TextJoin(Text=merge_2, Join=" ")
blindsname = Text(panel_26)
name_9 = Text(name_5)
concat_11 = Concatenate(FragmentA=blindsname, FragmentC="_", FragmentB=name_9)
panel_77 = Panel(concat_11)
overrides_37 = ApplyOverrides(Input_=panel_76, RadFiles=graft(join_3), Dim=graft(overrides_14.Output), Target=graft(concat_11))  # -> Output, Pairs
executessh_15 = ExecuteSSH(
    _SSHCommands=overrides_37.Output,
    Run=[executessh_9.Ran, executessh_14.Ran],
    addPrefix=True,
    description="mkdir -p ~/simulation/boston/BSDF;genBSDF -n 11 -dim <xstart> <xend> <ystart> <yend> <zmin> 0 <radFiles> > ~/simulation/boston/BSDF/blinds_001_.xml;echo \"~/simulation/boston/BSDF/blinds_001_.xml\"",
    fireLogs=False,
    lastRunTime=150197,
    suppressWarnings=True)  # -> Stdout, Stderr, Ran

convertpaths_7 = ConvertPaths(I=merge_2)  # -> Linux, Windows
radviewer_6 = RadViewer(
    RadFiles=flatten(convertpaths_7.Windows),
    IsTwoSided=False,
    Polychromatic=True,
    ShowEdges=True,
    Transparent=True,
    ColorNames=["blindmat", "_GlassBSDF_70_mat"],
    Colors=[RGB(225, 103, 226), RGB(155, 133, 174)])  # -> Geo, ModifierNames, Modifiers, FailedWireFrame

# ---- group: bsdf (continued)
panel_78 = Panel(executessh_15.Stdout)

# ----
# import BSDFS
panel_79 = Panel("C:\Users\mm1013\Downloads\8mm MS-F 6014 Rot 90.xml")
overrides_38 = ApplyOverrides(Input_="<projfolder>")  # -> Output, Pairs
upload_2 = Upload(
    LocalFilePaths=panel_79,
    SubfolderOverride=overrides_38.Output,
    Run=Toggle(True),
    stdouts="~/simulation/boston/8mm MS-F 6014 Rot 90.xml")  # -> Status, FilePaths, Ran
bsdf_venetian = Text(flatten(executessh_15.Stdout))
bsdf_micro = Text(flatten(upload_2.FilePaths))
panel_80 = Panel("""micro
venetian""")
panel_81 = Panel(upload_2.FilePaths)
entwine_4 = Entwine(Branch00=bsdf_micro, Branch01=bsdf_venetian, FlattenInputs=True)
graft = GraftTree(Tree=panel_80, IncludeEmptyLists=True, IncludeNullItems=True)
skymtx_3 = Text(skymtx)
clean_6 = CleanTree(RemoveNulls=True, RemoveInvalid=True, RemoveEmpty=True, Tree=entwine_4, SynchronousTree1=graft)  # -> Tree, SynchronousTree1

# ---- group: one room
# Dctimestep (matrixmultiplication for image based)
# mkdir -p "<proj>/mtxs/3ph_view_<view>"
# dctimestep -h <vmx> <bsdf> <dmx> <sv> > "~/simulation/hi_<aperture>_<skyname>.hdr"
# echo "~/simulation/hi_<aperture>_<skyname>.hdr"
# rmtxop <vmx> <bsdf> <dmx> <smx> | rmtxop -fa -c 47.4 119.9 11.6 - > "<proj>/results/3ph_view_<view>"/<aperture>.ill
# "<proj>/results/3ph_view_<view>"
panel_82 = Panel("""mkdir -p <proj>/mtxs/3ph_view_<view>
dctimestep -h <vmx> <bsdf> <dmx> <sv> > <proj>/mtxs/3ph_view_<view>/<aperture>_<skyname>.hdr
echo <proj>/mtxs/3ph_view_<view>/<aperture>_<skyname>.hdr""")
aperturename = Text(glassname_3)
viewnames_2 = Data(view_names)
skyvector = Text(executessh_7.Stdout)
skyname = Text(python_9)
vmx = Text(viewmatrix_img)
dmx_3 = Text(dmx_2)
bsdf = Text(executessh_15.Stdout)
crossref_4 = CrossReference(ListA=vmx, ListB=bsdf, ListC=viewnames_2, ListD=skyname, CrossMode=1)  # -> ListA, ListB, ListC, ListD
crossref_5 = CrossReference(ListA=aperturename, ListB=bsdf, ListC=viewnames_2, ListD=skyvector, CrossMode=1)  # -> ListA, ListB, ListC, ListD
crossref_6 = CrossReference(ListA=dmx_3, ListB=bsdf, ListC=viewnames_2, ListD=skyname, CrossMode=1)  # -> ListA, ListB, ListC, ListD
overrides_39 = ApplyOverrides(
    Input_=panel_82,
    Vmx=graft(crossref_4.ListA),
    Aperture=graft(crossref_5.ListA),
    Sv=graft(crossref_5.ListD),
    Dmx=graft(crossref_6.ListA),
    Bsdf=graft(crossref_6.ListB),
    View=graft(crossref_6.ListC),
    Skyname=graft(crossref_6.ListD))  # -> graft(Output), Pairs
panel_83 = Panel(overrides_39.Output)
falsestart_12 = LBFalseStartToggle(False)
executessh_16 = ExecuteSSH(
    _SSHCommands_=overrides_39.Output,
    Run=falsestart_12,
    addPrefix=True,
    description="""mkdir -p ~/simulation/boston/mtxs/3ph_view_P1
dctimestep -h <vmx> <bsdf> <dmx> <sv> > ~/simulation/boston/mtxs/3ph_view_P1/<aperture>_<skyname>.hdr
echo ~/simulation/boston/mtxs/3ph_view_P1/<aperture>_<skyname>.hdr""",
    fireLogs=True,
    lastRunTime=7065,
    name="DcTimeStep",
    suppressWarnings=False)  # -> flatten(Stdout), Stderr_, Ran
panel_84 = Panel("""C:\Users\mm1013\simulation\test_project2\mtxs\3ph_view_P1\GlassSouth_70_DNK_CIEs_062115.hdr
C:\Users\mm1013\simulation\test_project2\mtxs\3ph_view_P1\GlassWest_70_DNK_CIEs_062115.hdr""")
convertpaths_8 = ConvertPaths(I=executessh_16.Stdout)  # -> Linux, Windows
panel_85 = Panel(convertpaths_8.Windows)
imageviewer = LBImageViewer(ImagePath_=convertpaths_8.Windows, _scale_=1, DisableClickable=False, SaveImgWithCoords=False, scale=1)  # -> ImagePath, Values, GIF

panel_86 = Panel("""normtiff <file> <file-.>.tif
convert <file-.>.tif <file-.>.png
echo <file-.>.png""")
overrides_40 = ApplyOverrides(Input_=panel_86, File=graft(executessh_16.Stdout))  # -> Output, Pairs
executessh_17 = ExecuteSSH(
    _SSHCommands_=flatten(overrides_40.Output),
    Run=executessh_16.Ran,
    addPrefix=True,
    description="""normtiff <file> <file>.tif
convert <file>.tif <file>.png
echo <file>.png""",
    fireLogs=False,
    lastRunTime=5,
    suppressWarnings=False)  # -> Stdout, Stderr_, Ran

# ----
# rmtxop (matrixmultiplication for grid based)
glassname_7 = Text(python_6)
abx_3 = ABX(data=glassname_7, pathCount=1)  # -> data; inputs data: tree, pathCount: Int32; same code as abx
panel_87 = Panel("""mkdir -p <proj>/results/3PhGrid
rmtxop <vmx> "<bsdf>" <dmx> <smx> | rmtxop -fa -c 47.4 119.9 11.6 - | rcollate -t > <proj>/results/3PhGrid/<room>_<aperture>_<bsdfName>.ill
echo "<proj>/results/3PhGrid/<room>_<aperture>_<bsdfName>.ill"
""")
roomnumber_3 = Text(roomnumber)
vmx_grid_3 = Text(vmx_grid)
aperturename_2 = Text(abx_3)
dmx_4 = Text(dmx)
m_4 = GhPythonScript(i=roomnumber_3)  # -> i1, simplify(i2); inputs i: Int32; same code as m
long_4 = LongestList(ListA=m_4.i2, ListB=aperturename_2, PaddingMode=2)  # -> ListA, ListB
overrides_41 = ApplyOverrides(
    Input_=panel_87,
    Vmx=graft(vmx_grid_3),
    Aperture=graft(aperturename_2),
    Dmx=graft(dmx_4),
    Bsdf=graft("<bsdf>"),
    Smx=graft(skymtx_3),
    BsdfName=graft("<bsdfName>"),
    Room=graft(long_4.ListA))  # -> graft(Output), Pairs
overrides_42 = ApplyOverrides(Input_=flatten(overrides_41.Output), Bsdf=graft(clean_6.Tree), BsdfName=graft(clean_6.SynchronousTree1))  # -> graft(Output), Pairs
falsestart_13 = LBFalseStartToggle(False)

executessh_wip_12 = ExecuteSSHWIP(
    _SSHCommands_=overrides_42.Output,
    Run=falsestart_13,
    addPrefix=True,
    description="""mkdir -p ~/simulation/boston/results/3PhGrid
rmtxop <vmx> "~/simulation/boston/8mm MS-F 6014 Rot 90.xml" <dmx> /home/mss/simulation/weatherData/DNK_DRY_OFFICIAL_2001-2010_epw-fil_m1.smx | rmtxop -fa -c 47.4 119.9 11.6 - | rcollate -t > ~/simulation/boston/results/3PhGrid/00__micro.ill
echo "~/simulation/boston/results/3PhGrid/00__micro.ill"


- - -

mkdir -p ~/simulation/boston/results/3PhGrid
rmtxop <vmx> "~/simulation/boston/8mm MS-F 6014 Rot 90.xml" <dmx> /home/mss/simulation/weatherData/DNK_DRY_OFFICIAL_2001-2010_epw-fil_m1.smx | rmtxop -fa -c 47.4 119.9 11.6 - | rcollate -t > ~/simulation/boston/results/3PhGrid/01__micro.ill
echo "~/simulation/boston/results/3PhGrid/01__micro.ill"


- - -

mkdir -p ~/simulation/boston/results/3PhGrid
rmtxop <vmx> "~/simulation/boston/8mm MS-F 6014 Rot 90.xml" <dmx> /home/mss/simulation/weatherData/DNK_DRY_OFFICIAL_2001-2010_epw-fil_m1.smx | rmtxop -fa -c 47.4 119.9 11.6 - | rcollate -t > ~/simulation/boston/results/3PhGrid/02__micro.ill
echo "~/simulation/boston/results/3PhGrid/02__micro.ill"


- - -

mkdir -p ~/simulation/boston/results/3PhGrid
rmtxop <vmx> "~/simulation/boston/8mm MS-F 6014 Rot 90.xml" <dmx> /home/mss/simulation/weatherData/DNK_DRY_OFFICIAL_2001-2010_epw-fil_m1.smx | rmtxop -fa -c 47.4 119.9 11.6 - | rcollate -t > ~/simulation/boston/results/3PhGrid/03__micro.ill
echo "~/simulation/boston/results/3PhGrid/03__micro.ill"


- - -

mkdir -p ~/simulation/boston/results/3PhGrid
rmtxop <vmx> "~/simulation/boston/8mm MS-F 6014 Rot 90.xml" <dmx> /home/mss/simulation/weatherData/DNK_DRY_OFFICIAL_2001-2010_epw-fil_m1.smx | rmtxop -fa -c 47.4 119.9 11.6 - | rcollate -t > ~/simulation/boston/results/3PhGrid/04__micro.ill
echo "~/simulation/boston/results/3PhGrid/04__micro.ill"


- - -

mkdir -p ~/simulation/boston/results/3PhGrid
rmtxop <vmx> "~/simulation/boston/8mm MS-F 6014 Rot 90.xml" <dmx> /home/mss/simulation/weatherData/DNK_DRY_OFFICIAL_2001-2010_epw-fil_m1.smx | rmtxop -fa -c 47.4 119.9 11.6 - | rcollate -t > ~/simulation/boston/results/3PhGrid/05__micro.ill
echo "~/simulation/boston/results/3PhGrid/05__micro.ill"


- - -

mkdir -p ~/simulation/boston/results/3PhGrid
rmtxop <vmx> "~/simulation/boston/8mm MS-F 6014 Rot 90.xml" <dmx> /home/mss/simulation/weatherData/DNK_DRY_OFFICIAL_2001-2010_epw-fil_m1.smx | rmtxop -fa -c 47.4 119.9 11.6 - | rcollate -t > ~/simulation/boston/results/3PhGrid/06__micro.ill
echo "~/simulation/boston/results/3PhGrid/06__micro.ill"


- - -

mkdir -p ~/simulation/boston/results/3PhGrid
rmtxop <vmx> "~/simulation/boston/8mm MS-F 6014 Rot 90.xml" <dmx> /home/mss/simulation/weatherData/DNK_DRY_OFFICIAL_2001-2010_epw-fil_m1.smx | rmtxop -fa -c 47.4 119.9 11.6 - | rcollate -t > ~/simulation/boston/results/3PhGrid/07__micro.ill
echo "~/simulation/boston/results/3PhGrid/07__micro.ill"


- - -

mkdir -p ~/simulation/boston/results/3PhGrid
rmtxop <vmx> "~/simulation/boston/8mm MS-F 6014 Rot 90.xml" <dmx> /home/mss/simulation/weatherData/DNK_DRY_OFFICIAL_2001-2010_epw-fil_m1.smx | rmtxop -fa -c 47.4 119.9 11.6 - | rcollate -t > ~/simulation/boston/results/3PhGrid/08__micro.ill
echo "~/simulation/boston/results/3PhGrid/08__micro.ill"


- - -

mkdir -p ~/simulation/boston/results/3PhGrid
rmtxop <vmx> "~/simulation/boston/8mm MS-F 6014 Rot 90.xml" <dmx> /home/mss/simulation/weatherData/DNK_DRY_OFFICIAL_2001-2010_epw-fil_m1.smx | rmtxop -fa -c 47.4 119.9 11.6 - | rcollate -t > ~/simulation/boston/results/3PhGrid/09__micro.ill
echo "~/simulation/boston/results/3PhGrid/09__micro.ill"


- - -

mkdir -p ~/simulation/boston/results/3PhGrid
rmtxop <vmx> "~/simulation/boston/8mm MS-F 6014 Rot 90.xml" <dmx> /home/mss/simulation/weatherData/DNK_DRY_OFFICIAL_2001-2010_epw-fil_m1.smx | rmtxop -fa -c 47.4 119.9 11.6 - | rcollate -t > ~/simulation/boston/results/3PhGrid/10__micro.ill
echo "~/simulation/boston/results/3PhGrid/10__micro.ill"


- - -

mkdir -p ~/simulation/boston/results/3PhGrid
rmtxop <vmx> "~/simulation/boston/8mm MS-F 6014 Rot 90.xml" <dmx> /home/mss/simulation/weatherData/DNK_DRY_OFFICIAL_2001-2010_epw-fil_m1.smx | rmtxop -fa -c 47.4 119.9 11.6 - | rcollate -t > ~/simulation/boston/results/3PhGrid/11__micro.ill
echo "~/simulation/boston/results/3PhGrid/11__micro.ill"


- - -

mkdir -p ~/simulation/boston/results/3PhGrid
rmtxop <vmx> "~/simulation/boston/8mm MS-F 6014 Rot 90.xml" <dmx> /home/mss/simulation/weatherData/DNK_DRY_OFFICIAL_2001-2010_epw-fil_m1.smx | rmtxop -fa -c 47.4 119.9 11.6 - | rcollate -t > ~/simulation/boston/results/3PhGrid/12__micro.ill
echo "~/simulation/boston/results/3PhGrid/12__micro.ill"


- - -

mkdir -p ~/simulation/boston/results/3PhGrid
rmtxop <vmx> "~/simulation/boston/8mm MS-F 6014 Rot 90.xml" <dmx> /home/mss/simulation/weatherData/DNK_DRY_OFFICIAL_2001-2010_epw-fil_m1.smx | rmtxop -fa -c 47.4 119.9 11.6 - | rcollate -t > ~/simulation/boston/results/3PhGrid/13__micro.ill
echo "~/simulation/boston/results/3PhGrid/13__micro.ill"


- - -

mkdir -p ~/simulation/boston/results/3PhGrid
rmtxop <vmx> "~/simulation/boston/8mm MS-F 6014 Rot 90.xml" <dmx> /home/mss/simulation/weatherData/DNK_DRY_OFFICIAL_2001-2010_epw-fil_m1.smx | rmtxop -fa -c 47.4 119.9 11.6 - | rcollate -t > ~/simulation/boston/results/3PhGrid/14__micro.ill
echo "~/simulation/boston/results/3PhGrid/14__micro.ill"


- - -

mkdir -p ~/simulation/boston/results/3PhGrid
rmtxop <vmx> "~/simulation/boston/8mm MS-F 6014 Rot 90.xml" <dmx> /home/mss/simulation/weatherData/DNK_DRY_OFFICIAL_2001-2010_epw-fil_m1.smx | rmtxop -fa -c 47.4 119.9 11.6 - | rcollate -t > ~/simulation/boston/results/3PhGrid/15__micro.ill
echo "~/simulation/boston/results/3PhGrid/15__micro.ill"


- - -

mkdir -p ~/simulation/boston/results/3PhGrid
rmtxop <vmx> "~/simulation/boston/8mm MS-F 6014 Rot 90.xml" <dmx> /home/mss/simulation/weatherData/DNK_DRY_OFFICIAL_2001-2010_epw-fil_m1.smx | rmtxop -fa -c 47.4 119.9 11.6 - | rcollate -t > ~/simulation/boston/results/3PhGrid/16__micro.ill
echo "~/simulation/boston/results/3PhGrid/16__micro.ill"


- - -

mkdir -p ~/simulation/boston/results/3PhGrid
rmtxop <vmx> "~/simulation/boston/8mm MS-F 6014 Rot 90.xml" <dmx> /home/mss/simulation/weatherData/DNK_DRY_OFFICIAL_2001-2010_epw-fil_m1.smx | rmtxop -fa -c 47.4 119.9 11.6 - | rcollate -t > ~/simulation/boston/results/3PhGrid/17__micro.ill
echo "~/simulation/boston/results/3PhGrid/17__micro.ill"


- - -

mkdir -p ~/simulation/boston/results/3PhGrid
rmtxop <vmx> "~/simulation/boston/8mm MS-F 6014 Rot 90.xml" <dmx> /home/mss/simulation/weatherData/DNK_DRY_OFFICIAL_2001-2010_epw-fil_m1.smx | rmtxop -fa -c 47.4 119.9 11.6 - | rcollate -t > ~/simulation/boston/results/3PhGrid/18__micro.ill
echo "~/simulation/boston/results/3PhGrid/18__micro.ill"


- - -

mkdir -p ~/simulation/boston/results/3PhGrid
rmtxop <vmx> "~/simulation/boston/8mm MS-F 6014 Rot 90.xml" <dmx> /home/mss/simulation/weatherData/DNK_DRY_OFFICIAL_2001-2010_epw-fil_m1.smx | rmtxop -fa -c 47.4 119.9 11.6 - | rcollate -t > ~/simulation/boston/results/3PhGrid/19__micro.ill
echo "~/simulation/boston/results/3PhGrid/19__micro.ill"


- - -

mkdir -p ~/simulation/boston/results/3PhGrid
rmtxop <vmx> "~/simulation/boston/8mm MS-F 6014 Rot 90.xml" <dmx> /home/mss/simulation/weatherData/DNK_DRY_OFFICIAL_2001-2010_epw-fil_m1.smx | rmtxop -fa -c 47.4 119.9 11.6 - | rcollate -t > ~/simulation/boston/results/3PhGrid/20__micro.ill
echo "~/simulation/boston/results/3PhGrid/20__micro.ill"


- - -

mkdir -p ~/simulation/boston/results/3PhGrid
rmtxop <vmx> "~/simulation/boston/8mm MS-F 6014 Rot 90.xml" <dmx> /home/mss/simulation/weatherData/DNK_DRY_OFFICIAL_2001-2010_epw-fil_m1.smx | rmtxop -fa -c 47.4 119.9 11.6 - | rcollate -t > ~/simulation/boston/results/3PhGrid/21__micro.ill
echo "~/simulation/boston/results/3PhGrid/21__micro.ill"


- - -

mkdir -p ~/simulation/boston/results/3PhGrid
rmtxop <vmx> "~/simulation/boston/8mm MS-F 6014 Rot 90.xml" <dmx> /home/mss/simulation/weatherData/DNK_DRY_OFFICIAL_2001-2010_epw-fil_m1.smx | rmtxop -fa -c 47.4 119.9 11.6 - | rcollate -t > ~/simulation/boston/results/3PhGrid/22__micro.ill
echo "~/simulation/boston/results/3PhGrid/22__micro.ill"
""",
    fireLogs=True,
    lastRunTime=10247,
    name="rmtxop combining vmx+dmx",
    suppressWarnings=False,
    results=["~/simulation/boston/results/3PhGrid/00_00_GlassRoof_micro.ill", "~/simulation/boston/results/3PhGrid/00_00_GlassCorridorTop_micro.ill", "~/simulation/boston/results/3PhGrid/00_00_GlassCorridorBottom_micro.ill", "~/simulation/boston/results/3PhGrid/01_01_GlassRoof_micro.ill", "~/simulation/boston/results/3PhGrid/01_01_GlassCorridorTop_micro.ill", "~/simulation/boston/results/3PhGrid/01_01_GlassCorridorBottom_micro.ill"],
    commands=["""mkdir -p ~/simulation/boston/results/3PhGrid
rmtxop /home/mss/simulation/boston/mtxs/3ph_vmx_grid/01_01_GlassCorridorTop.vmx "~/simulation/boston/8mm MS-F 6014 Rot 90.xml" ~/simulation/boston/mtxs/3ph_dmx/01_GlassCorridorTop.dmx /home/mss/simulation/weatherData/DNK_DRY_OFFICIAL_2001-2010_epw-fil_m1.smx | rmtxop -fa -c 47.4 119.9 11.6 - | rcollate -t > ~/simulation/boston/results/3PhGrid/01_01_GlassCorridorTop_micro.ill
echo "~/simulation/boston/results/3PhGrid/01_01_GlassCorridorTop_micro.ill"
""", """mkdir -p ~/simulation/boston/results/3PhGrid
rmtxop /home/mss/simulation/boston/mtxs/3ph_vmx_grid/00_00_GlassCorridorBottom.vmx "~/simulation/boston/8mm MS-F 6014 Rot 90.xml" ~/simulation/boston/mtxs/3ph_dmx/00_GlassCorridorBottom.dmx /home/mss/simulation/weatherData/DNK_DRY_OFFICIAL_2001-2010_epw-fil_m1.smx | rmtxop -fa -c 47.4 119.9 11.6 - | rcollate -t > ~/simulation/boston/results/3PhGrid/00_00_GlassCorridorBottom_micro.ill
echo "~/simulation/boston/results/3PhGrid/00_00_GlassCorridorBottom_micro.ill"
""", """mkdir -p ~/simulation/boston/results/3PhGrid
rmtxop /home/mss/simulation/boston/mtxs/3ph_vmx_grid/00_00_GlassRoof.vmx "~/simulation/boston/8mm MS-F 6014 Rot 90.xml" ~/simulation/boston/mtxs/3ph_dmx/00_GlassRoof.dmx /home/mss/simulation/weatherData/DNK_DRY_OFFICIAL_2001-2010_epw-fil_m1.smx | rmtxop -fa -c 47.4 119.9 11.6 - | rcollate -t > ~/simulation/boston/results/3PhGrid/00_00_GlassRoof_micro.ill
echo "~/simulation/boston/results/3PhGrid/00_00_GlassRoof_micro.ill"
""", """mkdir -p ~/simulation/boston/results/3PhGrid
rmtxop /home/mss/simulation/boston/mtxs/3ph_vmx_grid/01_01_GlassCorridorBottom.vmx "~/simulation/boston/8mm MS-F 6014 Rot 90.xml" ~/simulation/boston/mtxs/3ph_dmx/01_GlassCorridorBottom.dmx /home/mss/simulation/weatherData/DNK_DRY_OFFICIAL_2001-2010_epw-fil_m1.smx | rmtxop -fa -c 47.4 119.9 11.6 - | rcollate -t > ~/simulation/boston/results/3PhGrid/01_01_GlassCorridorBottom_micro.ill
echo "~/simulation/boston/results/3PhGrid/01_01_GlassCorridorBottom_micro.ill"
"""])  # -> flatten(Stdout), Stderr_, Ran

panel_88 = Panel(executessh_wip_12.Stdout)
ill_file = Text(executessh_wip_12.Stdout)

list_3 = ItemSelector(
    executessh_wip_12.Stdout,
    {"~/simulation/boston/results/3PhGrid/00_00_GlassRoof_micro.ill", "~/simulation/boston/results/3PhGrid/00_00_GlassCorridorTop_micro.ill", "~/simulation/boston/results/3PhGrid/00_00_GlassCorridorBottom_micro.ill", "~/simulation/boston/results/3PhGrid/01_01_GlassRoof_micro.ill", "~/simulation/boston/results/3PhGrid/01_01_GlassCorridorTop_micro.ill", "~/simulation/boston/results/3PhGrid/01_01_GlassCorridorBottom_micro.ill"}, selected="~/simulation/boston/results/3PhGrid/00_00_GlassRoof_micro.ill")
dam_2 = DataDam(DataA=list_3, BufferDelay=10000000, BufferMode=0)
python_15 = GhPythonScript(x=executessh_wip_12.Stdout, y=list_3)  # -> out, a; inputs y: list
# ---------- python_15: Python ----------
__author__ = "mm1013"
__version__ = "2022.09.06"

import rhinoscriptsyntax as rs

a = x in y
# ---------- end python_15 ----------
unflatten_7 = UnflattenTree(Tree=executessh_wip_12.Stdout, Guide=pshift_2)
unflatten_8 = UnflattenTree(Tree=python_15.a, Guide=pshift_2)
cull_12 = CullPattern(List=unflatten_7, CullPattern=unflatten_8)
cluster_4 = Cluster_4(L=unflatten_8)
python_16 = GhPythonScript(x=cull_12, y=cluster_4)  # -> a; inputs x: list, y: Int32
# ---------- python_16: Python ----------
__author__ = "mm1013"
__version__ = "2022.09.06"

import rhinoscriptsyntax as rs

if len(x) == 0:
    a = []
elif len(x) == 1:
    a = "echo " + x[0]
else:
    rmt_files = " + ".join(x)
    
    #generating final file name
    splitted = x[0].split("/")
    p = "/".join(splitted[:-1]) + "/" + splitted[-1][:6]
    finalfile = p + "%02d" % y + "_combined.ill"
    
    
    a = 'if [ -f {0} ]; then\n    echo {0}\nelse\n    rmtxop {1} > {0};echo {0}\nfi'\
    .format(finalfile, rmt_files)
# ---------- end python_16 ----------
default_2 = DefaultMSS(data=flatten(falsestart_5), default_value_flattened=flatten(list_3))
panel_89 = Panel(python_16)
executessh_wip_13 = ExecuteSSHWIP(
    _SSHCommands_=python_16,
    Run=default_2,
    addPrefix=True,
    fireLogs=False,
    lastRunTime=10,
    suppressWarnings=False,
    results=["/home/mss/simulation/boston/results/3PhGrid/00_00_07_combined.ill", "/home/mss/simulation/boston/results/3PhGrid/01_01_05_combined.ill"],
    commands=["""if [ -f ~/simulation/boston/results/3PhGrid/01_01_05_combined.ill ]; then
    echo ~/simulation/boston/results/3PhGrid/01_01_05_combined.ill
else
    rmtxop ~/simulation/boston/results/3PhGrid/01_01_GlassRoof_micro.ill + ~/simulation/boston/results/3PhGrid/01_01_GlassCorridorBottom_micro.ill > ~/simulation/boston/results/3PhGrid/01_01_05_combined.ill;echo ~/simulation/boston/results/3PhGrid/01_01_05_combined.ill
fi""", """if [ -f ~/simulation/boston/results/3PhGrid/00_00_07_combined.ill ]; then
    echo ~/simulation/boston/results/3PhGrid/00_00_07_combined.ill
else
    rmtxop ~/simulation/boston/results/3PhGrid/00_00_GlassRoof_micro.ill + ~/simulation/boston/results/3PhGrid/00_00_GlassCorridorTop_micro.ill + ~/simulation/boston/results/3PhGrid/00_00_GlassCorridorBottom_micro.ill > ~/simulation/boston/results/3PhGrid/00_00_07_combined.ill;echo ~/simulation/boston/results/3PhGrid/00_00_07_combined.ill
fi"""])  # -> Stdout, Stderr_, Ran
convertpaths_9 = ConvertPaths(I=executessh_wip_13.Stdout)  # -> Linux, Windows

# ---- group: one room
overrides_43 = ApplyOverrides(Input_="<projfolder>")  # -> Output, Pairs
upload_3 = Upload(
    LocalFilePaths="C:\Users\mm1013\Downloads\8mm MS-F 6014 Rot 90.xml",
    SubfolderOverride=overrides_43.Output,
    Run=Toggle(True),
    stdouts="~/simulation/boston/8mm MS-F 6014 Rot 90.xml")  # -> Status, FilePaths, Ran
bsdf_venetian_2 = Text(flatten(executessh_15.Stdout))
panel_90 = Panel("""micro
venetian""")
panel_91 = Panel(upload_3.FilePaths)

# ----
# preview grid results
_17037_schedule = Integer(cluster_3)
mesh_explode = MeshExplode(m=move.Geometry)  # -> out, simplify(A); same code as mesh_explode

annualresults = AnnualResults(
    IllFile=flatten(convertpaths_9.Windows),
    Schedule=dup,
    Min="30",
    Max=0,
    Run=executessh_wip_13.Ran,
    numbers=[0.8884931507, 0.8643835616, 0.8043835616, 0.6306849315, 0.4684931507, 0.1619178082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])  # -> Headers, simplify(Results), Ran
facen_2 = FaceNormals(Mesh=mesh_explode.A)  # -> Centers, Normals

# ---- group: one room
# rmtxop (matrixmultiplication for grid based(
# mkdir -p <proj>/results/3PhGrid
# rmtxop <vmx> <bsdf> <dmx> <smx> | rmtxop -fa -c 47.4 119.9 11.6 - > <proj>/results/3PhGrid/<aperture><bsdfName>.ill
# echo "<proj>/results/3PhGrid/<aperture><bsdfName>.ill"
bsdf_micro_2 = Text(flatten(upload_3.FilePaths))
panel_92 = Panel("""mkdir -p <proj>/results/3PhGrid
rmtxop <vmx> "<bsdf>" <dmx> <smx> | rmtxop -fa -c 47.4 119.9 11.6 - | rcollate -t > <proj>/results/3PhGrid/<aperture><bsdfName>.ill
echo "<proj>/results/3PhGrid/<aperture><bsdfName>.ill"
""")
aperturename_3 = Text(glassname_3)
vmx_grid_4 = Text(vmx_grid_2)
dmx_5 = Text(dmx_2)
skymtx_4 = Text(skymtx)
falsestart_14 = LBFalseStartToggle(False)

entwine_5 = Entwine(Branch00=bsdf_micro_2, Branch01=bsdf_venetian_2, FlattenInputs=True)  # -> flatten(Result)
crossref_7 = CrossReference(ListA=dmx_5, ListB=panel_90, ListC=aperturename_3, CrossMode=1)  # -> ListA, ListB, ListC, ListD

crossref_8 = CrossReference(ListA=aperturename_3, ListB=entwine_5, ListC=dmx_5, CrossMode=1)  # -> ListA, ListB, ListC, ListD
crossref_9 = CrossReference(ListA=dmx_5, ListB=entwine_5, ListC=aperturename_3, CrossMode=1)  # -> ListA, ListB, ListC, ListD
crossref_10 = CrossReference(ListA=vmx_grid_4, ListB=entwine_5, ListC=dmx_5, CrossMode=1)  # -> ListA, ListB, ListC, ListD
overrides_44 = ApplyOverrides(
    Input_=panel_92,
    Vmx=graft(crossref_10.ListA),
    Aperture=graft(crossref_8.ListA),
    Dmx=graft(crossref_9.ListA),
    Bsdf=graft(crossref_9.ListB),
    Smx=graft(skymtx_4),
    BsdfName=graft(crossref_7.ListB))  # -> graft(Output), Pairs
panel_93 = Panel(overrides_44.Output)
executessh_18 = ExecuteSSH(
    _SSHCommands_=overrides_44.Output,
    Run=falsestart_14,
    addPrefix=True,
    description="""mkdir -p ~/simulation/boston/results/3PhGrid
rmtxop <vmx> "~/simulation/boston/8mm MS-F 6014 Rot 90.xml" <dmx> /home/mss/simulation/weatherData/DNK_DRY_OFFICIAL_2001-2010_epw-fil_m1.smx | rmtxop -fa -c 47.4 119.9 11.6 - | rcollate -t > ~/simulation/boston/results/3PhGrid/<aperture>micro.ill
echo "~/simulation/boston/results/3PhGrid/<aperture>micro.ill"


- - -

mkdir -p ~/simulation/boston/results/3PhGrid
rmtxop <vmx> "~/simulation/boston/8mm MS-F 6014 Rot 90.xml" <dmx> /home/mss/simulation/weatherData/DNK_DRY_OFFICIAL_2001-2010_epw-fil_m1.smx | rmtxop -fa -c 47.4 119.9 11.6 - | rcollate -t > ~/simulation/boston/results/3PhGrid/<aperture>venetian.ill
echo "~/simulation/boston/results/3PhGrid/<aperture>venetian.ill"
""",
    fireLogs=True,
    lastRunTime=3361,
    name="Rmtxop",
    suppressWarnings=False)  # -> flatten(Stdout), Stderr_, Ran
ill_file_2 = Text(executessh_18.Stdout)

# ----
expression = Expression(x=annualresults.Results, Expression="Format(\"{0:0}\", x*100)")

long_5 = LongestList(ListA=mesh_explode.A, ListB=expression, PaddingMode=2)  # -> ListA, ListB

gradient = Gradient(
    LowerLimit="100",
    UpperLimit="0",
    Parameter=long_5.ListB,
    stops=[0: RGB(234, 38, 0), 0.25: RGB(234, 126, 0), 0.5: RGB(254, 244, 84), 0.75: RGB(173, 203, 249), 1: RGB(75, 107, 169)])
mcol = MeshColours(Mesh=graft(long_5.ListA), Colours=graft(gradient))
mjoin = MeshJoin(Meshes=flatten(mcol))
medges = MeshEdges(Mesh=mjoin)  # -> NakedEdges, InteriorEdges, NonManifoldEdges
tag_2 = TextTag3D(
    Location=flatten(facen_2.Centers),
    Text=flatten(long_5.ListB),
    Size="0.13",
    Colour=ColourSwatch(SwatchColor=RGB(255, 255, 255)),
    Justification=5)
preview = CustomPreview(Geometry=[medges.NakedEdges, medges.InteriorEdges], Material=ColourSwatch(SwatchColor=RGB(76, 97, 125)))

# ---- group: one room
# preview grid results
ill_file_3 = Text(ill_file_2)
convertpaths_10 = ConvertPaths(I=ill_file_3)  # -> Linux, Windows
_17037_schedule_2 = Integer(cluster_3)
panel_94 = Panel("100")
falsestart_15 = LBFalseStartToggle(False)
find_file = FindOpenFileManiFolderExplorer(L=convertpaths_10.Windows, data=Button())
pt_2 = Point(flatten(pt))
mesh_explode_2 = MeshExplode(m=move.Geometry)  # -> out, simplify(A); same code as mesh_explode
pt_3 = Point(pt_2)

annualresults_2 = AnnualResults(IllFile=convertpaths_10.Windows, Schedule=_17037_schedule_2, Min=300, Max=0, Run=falsestart_15)  # -> Headers, Results, Ran

expression_2 = Expression(x=annualresults_2.Results, Expression="Format(\"{0:0}\", x*100)")
gradient_2 = Gradient(
    LowerLimit="100",
    UpperLimit="0",
    Parameter=expression_2,
    stops=[0: RGB(234, 38, 0), 0.25: RGB(234, 126, 0), 0.5: RGB(254, 244, 84), 0.75: RGB(173, 203, 249), 1: RGB(75, 107, 169)])
mcol_2 = MeshColours(Mesh=graft(mesh_explode_2.A), Colours=graft(gradient_2))
mjoin_2 = MeshJoin(Meshes=flatten(mcol_2))
preview_2 = CustomPreview(Geometry=pt_3, Material=gradient_2)
medges_2 = MeshEdges(Mesh=mjoin_2)  # -> NakedEdges, InteriorEdges, NonManifoldEdges
tag_3 = TextTag3D(Location=pt_3, Text=expression_2, Size="0.2", Colour=ColourSwatch(SwatchColor=RGB(255, 255, 255)), Justification=5)
preview_3 = CustomPreview(Geometry=[medges_2.NakedEdges, medges_2.InteriorEdges], Material=ColourSwatch(SwatchColor=RGB(0, 0, 0)))

# ==== cluster Normals
amplitude = ClusterInput()
amplitude_2 = Data(amplitude)
geo = ClusterInput()
merge = Merge(Data1=flatten(amplitude_2), Data2=flatten("1m"))
geo_2 = Geometry(geo)
item = ListItem(List=merge, Index=0, Wrap=True)
facen = FaceNormals(Mesh=geo_2)  # -> Centers, Normals
U = Units(ValueString=item)
avr = Average(Input=facen.Centers)
avr_2 = Average(Input=facen.Normals)
unflatten = UnflattenTree(Tree=avr, Guide=geo_2)
unflatten_2 = UnflattenTree(Tree=avr_2, Guide=geo_2)
amp = Amplitude(Vector=unflatten_2, Amplitude=U)
pl = PlaneNormal(Origin=unflatten, ZAxis=unflatten_2)
norm = Vector(amp)
center = Point(unflatten)
P = ClusterOutput(pl)
norm_2 = ClusterOutput(norm)
center_2 = ClusterOutput(center)

# ==== cluster Cluster
horizontaldiffrad = ClusterInput()
horizontaldiffrad_2 = Number(horizontaldiffrad)
lng = ListLength(List=horizontaldiffrad_2)
lng_2 = ListLength(List=horizontaldiffrad_2)
series = Series(Start=0, Step=0, Count=lng)
division = Division(A=lng, B=2)
series_2 = Series(Start=0, Step=1, Count=lng_2)
subtraction = Subtraction(A=division, B=1)
sort = SortList(Keys=horizontaldiffrad_2, ValuesA=series_2)  # -> reverse(Keys), reverse(ValuesA)
dom = ConstructDomain(DomainStart="0", DomainEnd=subtraction)
subset = SubList(List=sort.ValuesA, Domain=dom, Wrap=True)  # -> List, Index
replace = ReplaceItems(List=series, Item="1", Indices=subset.List, Wrap=False)
schedule_01 = ClusterOutput(replace)

# ==== cluster DefaultMSS
default_value_flattened = ClusterInput()
data = ClusterInput()
data_2 = Data(data)
merge = Merge(Data1=flatten(data_2), Data2="0")  # -> flatten(Result)
default_value_flattened_2 = Data(flatten(default_value_flattened))
lng = ListLength(List=merge)
equals = Equality(FirstNumber=lng, SecondNumber="1")  # -> Equality, Inequality
cull = CullPattern(List=data_2, CullPattern=invert(equals.Equality))
panel = Panel(equals.Equality)
cull_2 = CullPattern(List=default_value_flattened_2, CullPattern=equals.Equality)
data_3 = Data([cull, cull_2])
data_4 = ClusterOutput(data_3)

# ==== cluster MeshIt2: Meshes everything in the input. Graft the input if you want to make several meshes, otherwise returns a joined mesh.
mesh_brep = ClusterInput()
mesh_brep_2 = Geometry(simplify(mesh_brep))
tmatch = MatchText(Text=mesh_brep_2, RegEx="(mesh)", Case=False)
tmatch_2 = MatchText(Text=mesh_brep_2, RegEx="(brep)|(polysurface)|(surface)|(extrusion)", Case=False)
group = Group(Objects=mesh_brep_2)
cull = CullPattern(List=mesh_brep_2, CullPattern=tmatch_2)
mesh = MeshBrep(
    Brep=cull,
    Settings={GridMaxCount=0, GridMinCount=16, JaggedSeams=False, MaxEdgeLength=0, MinEdgeLength=0.0001, MinTolerance=0, Refine=True, RefineAngle=0, RelativeTolerance=0.65, SimplePlanes=True, Tolerance=0})  # -> simplify(Mesh)
cull_2 = CullPattern(List=mesh_brep_2, CullPattern=tmatch)  # -> simplify(List)

# ----
# Fix invalid mesh
panel = Panel("Invalid Mesh")  # disabled
mesh_2 = Mesh(mesh)  # disabled
tmatch_3 = MatchText(Text=mesh_2, RegEx=panel, Case=False)  # disabled
unweave = Unweave(List=mesh_2, UnweavePattern=tmatch_3)  # -> Data0, Data1; disabled
explode = MeshExplode(Mesh=unweave.Data1, Interpolate=False)  # -> simplify(Faces); disabled
abc_a = ABC(data=explode)  # disabled
panel_2 = Panel("0")  # disabled
num = Number(panel_2)  # disabled
area = MeshArea(Mesh=abc_a)  # -> Area, Centroid; disabled
equals = Equality(FirstNumber=area.Area, SecondNumber=num)  # -> Equality, Inequality; disabled
cull_3 = CullPattern(List=abc_a, CullPattern=equals.Inequality)  # disabled
mjoin = MeshJoin(Meshes=[cull_3, unweave.Data0])  # disabled

# ----
# Fix invalid mesh
panel_3 = Panel("Invalid Mesh")  # disabled
mesh_3 = Mesh(cull_2)  # disabled
tmatch_4 = MatchText(Text=mesh_3, RegEx=panel_3, Case=False)  # disabled
unweave_2 = Unweave(List=mesh_3, UnweavePattern=tmatch_4)  # -> Data0, Data1; disabled
explode_2 = MeshExplode(Mesh=unweave_2.Data1, Interpolate=False)  # -> simplify(Faces); disabled
abc_a_2 = ABC(data=explode_2)  # disabled
panel_4 = Panel("0")  # disabled
num_2 = Number(panel_4)  # disabled
area_2 = MeshArea(Mesh=abc_a_2)  # -> Area, Centroid; disabled
equals_2 = Equality(FirstNumber=area_2.Area, SecondNumber=num_2)  # -> Equality, Inequality; disabled
cull_4 = CullPattern(List=abc_a_2, CullPattern=equals_2.Inequality)  # disabled
mjoin_2 = MeshJoin(Meshes=[cull_4, unweave_2.Data0])  # disabled

mjoin_3 = MeshJoin(Meshes=[mesh, cull_2])
c_script = CSharpScript(mesh=mjoin_3)  # -> A; inputs mesh: Mesh
# ---------- c_script: C# ----------
    mesh.Faces.CullDegenerateFaces();
    A = mesh;
# ---------- end c_script ----------
abc_a_3 = ABC(data=mjoin)  # disabled
abc_a_4 = ABC(data=mjoin_2)  # disabled
clean = CleanTree(RemoveNulls=True, RemoveInvalid=True, RemoveEmpty=False, Tree=[abc_a_3, abc_a_4])  # disabled
mjoin_4 = MeshJoin(Meshes=clean)  # disabled
unflatten = UnflattenTree(Tree=c_script, Guide=group)
mesh_explode = MeshExplode(m=mjoin_4)  # -> out, simplify(A); disabled
# ---------- mesh_explode: VB ----------
    Component.Params.Input(0).Name = "Mesh"
    Component.Params.Input(0).Description = "Open or closed mesh"

    Component.Params.Output(1).Name = "Mesh"
    Component.Params.Output(1).Description = "If successful, a valid mesh"

    If m IsNot Nothing Then
      Dim pts As Rhino.Geometry.Collections.MeshVertexList
      Dim faces As Rhino.Geometry.Collections.MeshFaceList
      Dim clrs As Rhino.Geometry.Collections.MeshVertexColorList
      Dim i As Integer
      Dim mshs As New list(Of mesh)

      faces = m.Faces
      pts = m.Vertices
      If m.VertexColors.count() = 0 Then m.VertexColors.CreateMonotoneMesh(color.FromArgb(100, 100, 100))
      clrs = m.VertexColors

      For i = 0 To faces.count() - 1 Step 1
        Dim fc As New meshFace
        Dim face As New MeshFace
        Dim ptList As New list(Of point3d)
        Dim clrList As New list(Of color)
        Dim msh As New mesh

        face = faces(i)

        ptList.add(New point3d(pts(face.A)))
        ptList.add(New point3d(pts(face.B)))
        ptList.add(New point3d(pts(face.C)))
        If face.IsQuad Then ptList.add(New point3d(pts(face.D)))

        clrList.add(clrs(face.A))
        clrList.add(clrs(face.B))
        clrList.add(clrs(face.C))
        If face.IsQuad Then clrList.add(clrs(face.D))

        If face.IsQuad Then fc = New meshFace(0, 1, 2, 3) Else fc = New meshface(0, 1, 2)

        msh.Vertices.AddVertices(ptList.toarray())
        msh.Faces.AddFace(fc)
        msh.VertexColors.SetColors(clrList.toarray())
        mshs.add(msh)
      Next

      A = mshs
    End If
# ---------- end mesh_explode ----------
c_script_2 = CSharpScript(mesh=mjoin_4)  # -> A; inputs mesh: Mesh; disabled; same code as c_script
c_script_3 = CSharpScript(mesh=mesh_explode.A)  # -> out, A; inputs mesh: list of Mesh; disabled
# ---------- c_script_3: C# ----------
    List<bool> isValid = new List<bool>();
    for (int i = 0; i < mesh.Count; i++)
    {
      isValid.Add(mesh[i].IsValid);
    }
    
    A = isValid;
# ---------- end c_script_3 ----------
mesh_joined = Mesh(unflatten)
cullf = CullFaces(Mesh=mjoin_4, Pattern=invert(c_script_3.A))  # disabled
mesh_joined_2 = ClusterOutput(mesh_joined)

# ==== cluster LargestBREP
window_breps = ClusterInput()
window_breps_2 = Brep(window_breps)
debrep = DeconstructBrep(Brep=window_breps_2)  # -> Faces, Edges, Vertices
area = Area(Geometry=debrep.Faces)  # -> Area, Centroid
sort = SortList(Keys=area.Area, ValuesA=debrep.Faces)  # -> Keys, ValuesA
item = ListItem(List=sort.ValuesA, Index=-1, Wrap=True)
group = Group(Objects=flatten(item))
grouped = ClusterOutput(group)

# ==== cluster Cluster_2
l = ClusterInput()
python = GhPythonScript(l=l)  # -> xmin, xmax, ymin, ymax, zmin; inputs l: list
# ---------- python: Python ----------
__author__ = "mm1013"
__version__ = "2022.08.20"

import rhinoscriptsyntax as rs
li = [s for s in l[1].split(" ") if len(s) > 0]
#print(li)
xmin, xmax, ymin, ymax, zmin, zmax = [float(v) for v in li]


if zmax > 0:
    print("Err, Zmax should be < 0!")
else:
    print("Zmax is OK (< 0)")
# ---------- end python ----------
panel = Panel("""0.23
0.77""")
dom = ConstructDomain(DomainStart=python.xmin, DomainEnd=python.xmax)
dom_2 = ConstructDomain(DomainStart=python.ymin, DomainEnd=python.ymax)
zmin = ClusterOutput(python.zmin)
remap = RemapNumbers(Value=panel, Source=Domain(0, 1), Target=dom)  # -> Mapped, Clipped
remap_2 = RemapNumbers(Value=panel, Source=Domain(0, 1), Target=dom_2)  # -> Mapped, Clipped
item = ListItem(List=remap.Mapped, Index=0, Wrap=True)  # -> Item, Item1
item_2 = ListItem(List=remap_2.Mapped, Index=0, Wrap=True)  # -> Item, Item1
xend = Number(item.Item1)
ystart = Number(item_2.Item)
yend = Number(item_2.Item1)
xstart = Number(item.Item)
xend_2 = ClusterOutput(xend)
ystart_2 = ClusterOutput(ystart)
yend_2 = ClusterOutput(yend)
xstart_2 = ClusterOutput(xstart)

# ==== cluster FindOpenFileManiFolderExplorer
data = ClusterInput()
L = ClusterInput()
default = DefaultMSS(data=data, default_value_flattened=Toggle(False))
item = ListItem(List=L, Index=-1, Wrap=True)  # -> flatten(Item)
cull = CullPattern(List=item, CullPattern=default)
open_folder = PythonScript(path=cull)
# ---------- open_folder: Python ----------
try:
    _path = _path.replace("/", "\\")
    import subprocess
    subprocess.Popen(r'explorer /select,' + _path)
except AttributeError:
    pass
# ---------- end open_folder ----------

# ==== cluster Cluster_3
geo = ClusterInput()
normals = Normals(geo=geo, amplitude="600mm")  # -> center_2, norm_2, P
dc = DrawCurves(cent=flatten(normals.center_2), vect=flatten(normals.norm_2), Color=ColourSwatch(SwatchColor=RGB(0, 161, 161)))  # inputs cent: list of Point3d, vect: list of Vector3d, Color: Color
#   port cent: Curves to render {list,curve}
# ---------- dc: Python ----------
ghenv.Component.Name = "DrawCurves"
ghenv.Component.NickName = "DC"

from ghpythonlib.componentbase import executingcomponent as component
import Rhino as rc
import System
import re
import math



class MyComponent(component):
    
    def RunScript(self,cent, vect, Color):
        self.cent = cent
        if ("Color" in locals() and Color is not None):
            self.color = Color
        else:
            self.color = System.Drawing.Color.Blue
        self.vect = vect
        self.lines = []
        self.ends = []
        
        for i in range(len(cent)):
            self.ends.append(cent[i]+ vect[i])
            self.lines.append(rc.Geometry.Line(cent[i], cent[i]+ 0.8* vect[i]))

 

    def DrawViewportWires(self,arg):
        
        for i in range(len(self.lines)):
            arg.Display.DrawPatternedLine(self.lines[i], self.color, 0x001000111, 4);
            arg.Display.DrawArrowHead(self.ends[i], self.vect[i], self.color, 0.0, 0.2)
            #arg.Display.DrawArrow(self.lines[i], self.color, 0.0, 0.3)

            #arg.Display.DrawDottedLine(pl, self.color)
        #edges = srf.Edges
        
        #for edge in edges:
        #
# ---------- end dc ----------

# ==== cluster Cluster_4
L = ClusterInput()
lng = ListLength(List=L)
series = Series(Start=0, Step=1, Count=lng)
expression = Expression(x=series, Expression="2^x")
cull = CullPattern(List=expression, CullPattern=L)
ma = MassAddition(Input=cull)  # -> Result, PartialResults
R = ClusterOutput(ma.Result)

# ==== cluster ABC
data = ClusterInput()
data_2 = Data(data)
path_mapper = PathMapper(
    data_2,
    source=["{A;B;C;D;E;F;G}", "{A;B;C;D;E;F}", "{A;B;C;D;E}", "{A;B;C;D}", "{A;B;C}", "{A;B}", "{A}"],
    target=["{A}", "{A}", "{A}", "{A}", "{A}", "{A}", "{A}"])
data_3 = Data(path_mapper)
data_4 = ClusterOutput(data_3)
